# Grasshopper definition Simple Room.gh (Grasshopper 1.0.7)
# Copyright: 2021
# plug-ins: MantaRay, LadybugGrasshopper

# ----
# Read Rhino file
falsestart = LBFalseStartToggle(True)
parserhinofile = ParseRhinoFile(LayerPrefix="Daylight_Inputs::_", Grids="Grids", Run=falsestart)  # -> GlassGeometries, GlassModifiers, port, OpaqueGeometries, OpaqueModifiers, port_2, CustomGeometries, ModifierNames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
panel = Panel(parserhinofile.SkippedLayers)
opaque_modifiers = Text(parserhinofile.OpaqueModifiers)
glass_modifiers = Text(parserhinofile.GlassModifiers)
opaque_mesh = Mesh(parserhinofile.OpaqueGeometries)
all_modifiers = Text([parserhinofile.GlassModifiers, parserhinofile.OpaqueModifiers])
glass_mesh = Mesh(parserhinofile.GlassGeometries)
grids = Geometry(parserhinofile.GridGeometries)
run = Boolean(parserhinofile.Ran)

# ----
# 10klx overcast sky (RwR p357)
panel_2 = Panel("""mkdir -p skies/
echo "##Will control the gradient of the sky
" > <target>
gensky -ang 45 0 -c -B 55.866 >> <target>
echo "<glowandsource>" >> <target>
echo <target>""")
and_append_the_ground = Panel("""##The 1 will be multiplie with brightfunc
skyfunc glow sky_glow
0
0
4 1 1 1 0

##Set to 1 as it will be multiplied with the gensky result
sky_glow source sky
0
0
4 0 0 1 180

##Set to 1 as it will be multiplied with the gensky result
skyfunc glow ground_glow
0
0
4 1 1 1 0

##The ground pane
ground_glow source ground
0
0
4 0 0 -1 180""")
bool = Boolean(run)
overrides = ApplyOverrides(Input=panel_2, Target=graft("10kluxOvercast.sky"), Glowandsource=graft(and_append_the_ground))  # -> Output, DynamicOutput
executessh = ExecuteSSH(
    _SSHCommands_=overrides.DynamicOutput,
    Run=bool,
    addPrefix=True,
    description="""mkdir -p skies/
echo "##Will control the gradient of the sky
" > 10kluxOvercast.sky
gensky -ang 45 0 -c -B 55.866 >> 10kluxOvercast.sky
echo "

##The 1 will be multiplie with brightfunc
skyfunc glow sky_glow
0
0
4 1 1 1 0

##Set to 1 as it will be multiplied with the gensky result
sky_glow source sky
0
0
4 0 0 1 180

##Set to 1 as it will be multiplied with the gensky result
skyfunc glow ground_glow
0
0
4 1 1 1 0

##The ground pane
ground_glow source ground
0
0
4 0 0 -1 180" >> 10kluxOvercast.sky
echo 10kluxOvercast.sky""",
    fireLogs=False,
    lastRunTime=60.5622,
    suppressWarnings=False,
    results="10kluxOvercast.sky",
    commands="""mkdir -p skies/
echo "##Will control the gradient of the sky
" > 10kluxOvercast.sky
gensky -ang 45 0 -c -B 55.866 >> 10kluxOvercast.sky
echo "

##The 1 will be multiplie with brightfunc
skyfunc glow sky_glow
0
0
4 1 1 1 0

##Set to 1 as it will be multiplied with the gensky result
sky_glow source sky
0
0
4 0 0 1 180

##Set to 1 as it will be multiplied with the gensky result
skyfunc glow ground_glow
0
0
4 1 1 1 0

##The ground pane
ground_glow source ground
0
0
4 0 0 -1 180" >> 10kluxOvercast.sky
echo 10kluxOvercast.sky""")  # -> Stdout, Stderr_, Ran
panel_3 = Panel(executessh.Stderr_)
sky_ovc = Text(executessh.Stdout)

# ----
# Connect to SSH
# we added "cd <LinuxHome>" to
# the prefixes. This allows all of the
# components to startup in our
# LinuxHome folder
panel_4 = Panel(". /etc/profile;. ~/.profile;mkdir -p <LinuxHome>;cd <LinuxHome>")
falsestart_2 = LBFalseStartToggle(True)
connect = ConnectSSHFTP(
    User="lio",
    Ip="mm-c0d0e-028",
    ProjectName="SimpleRoom",
    Password="_prompt",
    _port="2222",
    Connect=falsestart_2,
    Prefixes=panel_4)  # -> Status, Prefixes, Run
panel_5 = Panel(connect.Status)
panel_6 = Panel(connect.Prefixes)

# ----
# Create Rad files
run_2 = Boolean(run)
de_modifier = DeconstructModifier(Modifier=glass_modifiers)  # -> GeoName, ModifierName
de_modifier_2 = DeconstructModifier(Modifier=opaque_modifiers)  # -> GeoName, ModifierName
mesh2obj = MeshToObj(
    Mesh=graft(glass_mesh),
    Name=graft(de_modifier.GeoName),
    ModifierName=graft(de_modifier.ModifierName),
    MapFileName="glass",
    TargetFolder="objFiles",
    Run=run_2,
    MapFile="glass")  # -> ObjFiles, MapFile, Run
mesh2obj_2 = MeshToObj(
    Mesh=graft(opaque_mesh),
    Name=graft(de_modifier_2.GeoName),
    ModifierName=graft(de_modifier_2.ModifierName),
    MapFileName="mapping",
    TargetFolder="objFiles",
    Run=run_2,
    MapFile="mapping")  # -> ObjFiles, MapFile, Run
obj2rad = ObjToRad(
    ObjFiles=mesh2obj.ObjFiles,
    MapFile=mesh2obj.MapFile,
    TargetFolder="radFiles",
    Run=mesh2obj.Run,
    stdouts="radFiles/Glass_70_geo.rad")  # -> Status, RadFiles, Run
obj2rad_2 = ObjToRad(
    ObjFiles=mesh2obj_2.ObjFiles,
    MapFile=mesh2obj_2.MapFile,
    TargetFolder="radFiles",
    Run=mesh2obj_2.Run,
    stdouts="radFiles/Walls_50_00_geo.rad>JOIN<radFiles/Context_20_00_geo.rad>JOIN<radFiles/Frames_70_00_geo.rad>JOIN<radFiles/Ceilings_70_00_geo.rad>JOIN<radFiles/Floors_20_00_geo.rad>JOIN<radFiles/Ground_20_00_geo.rad")  # -> Status, RadFiles, Run

# ----
# Create grids in pts file
grids_2 = Geometry(grids)
run_3 = Boolean(run)
grid = GridCreate(Geometry=graft(grids_2), GridSize_m=0.5, VerticalOffset_m=0.75, EdgeOffset_m=0.5, IsoCurves=True, GoLarge=False)  # -> Grids, Mesh, Points, Normals
points2pts = PointsToPts(
    Points=grid.Points,
    Vectors=grid.Normals,
    Run=run_3,
    stdouts="""0.5 -2.5 0.75 0 0 1
0.5 -2 0.75 0 0 1
0.5 -1.5 0.75 0 0 1
0.5 -1 0.75 0 0 1
0.5 -0.5 0.75 0 0 1
1 -2.5 0.75 0 0 1
1 -2 0.75 0 0 1
1 -1.5 0.75 0 0 1
1 -1 0.75 0 0 1
1 -0.5 0.75 0 0 1
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""")  # -> PtsString, Run

# ----
# Create mat files
panel_7 = Panel("""echo "<radFiles>" > radFiles/materials.mat
echo radFiles/materials.mat""")
all_modifiers_2 = Text(all_modifiers)
run_4 = Boolean(run)
join = TextJoin(Text=all_modifiers_2)
overrides_2 = ApplyOverrides(Input=panel_7, RadFiles=graft(join))  # -> Output, DynamicOutput
executessh_2 = ExecuteSSH(
    _SSHCommands_=overrides_2.DynamicOutput,
    Run=run_4,
    addPrefix=True,
    description="""echo "void glass Glass_70
0
0
3 0.762841984823016 0.762841984823016 0.762841984823016

void plastic Ground_20_00
0
0
5 0.2 0.2 0.2 0 0

void plastic Floors_20_00
0
0
5 0.2 0.2 0.2 0 0

void plastic Ceilings_70_00
0
0
5 0.7 0.7 0.7 0 0

void plastic Frames_70_00
0
0
5 0.7 0.7 0.7 0 0

void plastic Context_20_00
0
0
5 0.2 0.2 0.2 0 0

void plastic Walls_50_00
0
0
5 0.5 0.5 0.5 0 0" > radFiles/materials.mat
echo radFiles/materials.mat""",
    fireLogs=False,
    lastRunTime=92.4572,
    suppressWarnings=False,
    results="radFiles/materials.mat",
    commands="""echo "void glass Glass_70
0
0
3 0.762841984823016 0.762841984823016 0.762841984823016

void plastic Ground_20_00
0
0
5 0.2 0.2 0.2 0 0

void plastic Floors_20_00
0
0
5 0.2 0.2 0.2 0 0

void plastic Ceilings_70_00
0
0
5 0.7 0.7 0.7 0 0

void plastic Frames_70_00
0
0
5 0.7 0.7 0.7 0 0

void plastic Context_20_00
0
0
5 0.2 0.2 0.2 0 0

void plastic Walls_50_00
0
0
5 0.5 0.5 0.5 0 0" > radFiles/materials.mat
echo radFiles/materials.mat""")  # -> Stdout, Stderr_, Ran

# ----
# check content of sky
panel_8 = Panel("cat <target>")
overrides_3 = ApplyOverrides(Input=panel_8, Target=graft(executessh.Stdout))  # -> Output, DynamicOutput
executessh_3 = ExecuteSSH(
    _SSHCommands_=overrides_3.Output,
    Run=invert(False),
    addPrefix=True,
    fireLogs=False,
    lastRunTime=77.4618,
    suppressWarnings=False,
    results="""##Will control the gradient of the sky

# gensky -ang 45 0 -c -B 55.866
# Ground ambient level: 17.8

void brightfunc skyfunc
2 skybr skybright.cal
0
3 2 2.29e+01 3.56e+00


##The 1 will be multiplie with brightfunc
skyfunc glow sky_glow
0
0
4 1 1 1 0

##Set to 1 as it will be multiplied with the gensky result
sky_glow source sky
0
0
4 0 0 1 180

##Set to 1 as it will be multiplied with the gensky result
skyfunc glow ground_glow
0
0
4 1 1 1 0

##The ground pane
ground_glow source ground
0
0
4 0 0 -1 180""",
    commands="cat 10kluxOvercast.sky")  # -> Stdout, Stderr_, Ran
panel_9 = Panel(executessh_3.Stdout)

# ----
# Save pts file (on linux)
ptsstring = Text(points2pts.PtsString)
panel_10 = Panel("""mkdir -p ptsFiles/
echo "<pts>" > ptsFiles/<target>
echo ptsFiles/<target>""")
run_5 = Boolean(run)
overrides_4 = ApplyOverrides(Input=panel_10, Target=graft("ptsFiles.pts"), Text=graft(ptsstring))  # -> Output, DynamicOutput
executessh_4 = ExecuteSSH(
    _SSHCommands_=overrides_4.Output,
    Run=run_5,
    addPrefix=True,
    fireLogs=False,
    lastRunTime=58.2192,
    suppressWarnings=False,
    results="ptsFiles/ptsFiles.pts",
    commands="""mkdir -p ptsFiles/
echo "0.5 -2.5 0.75 0 0 1
0.5 -2 0.75 0 0 1
0.5 -1.5 0.75 0 0 1
0.5 -1 0.75 0 0 1
0.5 -0.5 0.75 0 0 1
1 -2.5 0.75 0 0 1
1 -2 0.75 0 0 1
1 -1.5 0.75 0 0 1
1 -1 0.75 0 0 1
1 -0.5 0.75 0 0 1
1.5 -2.5 0.75 0 0 1
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" > ptsFiles/ptsFiles.pts
echo ptsFiles/ptsFiles.pts""")  # -> Stdout, Stderr_, Ran
ptsfile = Text(executessh_4.Stdout)

entwine = Entwine(Branch00=executessh_2.Stdout, Branch01=obj2rad.RadFiles, Branch02=obj2rad_2.RadFiles, FlattenInputs=True)  # -> flatten(Result)
all_rad_files = Text(entwine)

# ----
# Octree - oconv
panel_11 = Panel("""mkdir -p octrees/
oconv -r 2048 -w -f <rads> > octrees/<target>
echo octrees/<target>""")
sky_ovc_2 = Text(sky_ovc)
scene_rads = Text(all_rad_files)
python = GhPythonScript(x=flatten(scene_rads))  # -> noNulls; inputs x: list
# ---------- python: Python ----------
__author__ = "mm1013"
__version__ = "2022.06.15"

import rhinoscriptsyntax as rs

noNulls = None not in x and len(x) > 0
# ---------- end python ----------
entwine_2 = Entwine(Branch01=sky_ovc_2, Branch02=scene_rads, FlattenInputs=True)  # -> flatten(Radfiles)
and = GateAnd(A=python, B=executessh_2.Ran)
join_2 = TextJoin(Text=entwine_2, Join=" ")
overrides_5 = ApplyOverrides(Input=panel_11, Rads=graft(join_2), Target=graft("Scene_Overcast10klux.oct"))  # -> Output, DynamicOutput
executessh_5 = ExecuteSSH(
    _SSHCommands=overrides_5.DynamicOutput,
    Run=and,
    addPrefix=True,
    description="""mkdir -p octrees/
oconv -r 2048 -w -f 10kluxOvercast.sky radFiles/materials.mat radFiles/Glass_70_geo.rad radFiles/Walls_50_00_geo.rad radFiles/Context_20_00_geo.rad radFiles/Frames_70_00_geo.rad radFiles/Ceilings_70_00_geo.rad radFiles/Floors_20_00_geo.rad radFiles/Ground_20_00_geo.rad > octrees/Scene_Overcast10klux.oct
echo octrees/Scene_Overcast10klux.oct""",
    fireLogs=True,
    lastRunTime=27.2322,
    name="oconv Scene_Overcast10klux.oct",
    staticDescription="""mkdir -p ~/MantaRay/Andrei/octrees/
oconv -r 2048 -w -f ~/MantaRay/Andrei/skies/overcast_sky.rad ~/MantaRay/Andrei/radFiles/Glass_70.mat /home/lio/MantaRay/Andrei/radFiles/Glass_70_geo.rad ~/MantaRay/Andrei/radFiles/opaque_materials.mat /home/lio/MantaRay/Andrei/radFiles/FloorMat_0.7_geo.rad /home/lio/MantaRay/Andrei/radFiles/Cladding_0.5_geo.rad /home/lio/MantaRay/Andrei/radFiles/ConcreteWhite_0.8_geo.rad /home/lio/MantaRay/Andrei/radFiles/ConcreteStructure_0.3_geo.rad /home/lio/MantaRay/Andrei/radFiles/ConcreteGrey_0.5_geo.rad /home/lio/MantaRay/Andrei/radFiles/IntWalls_0.9_geo.rad /home/lio/MantaRay/Andrei/radFiles/Pipes_0.03_geo.rad /home/lio/MantaRay/Andrei/radFiles/ConcreteDarker_0.1_geo.rad /home/lio/MantaRay/Andrei/radFiles/Frames_0.6_geo.rad /home/lio/MantaRay/Andrei/radFiles/Black_0.01_geo.rad /home/lio/MantaRay/Andrei/radFiles/CurvedCeiling_0.8_geo.rad /home/lio/MantaRay/Andrei/radFiles/IntWalls_0.8_geo.rad /home/lio/MantaRay/Andrei/radFiles/FloorBox_0.75_geo.rad ~/MantaRay/Andrei/radFiles/other_materials.mat > ~/MantaRay/Andrei/octrees/Scene_Overcast10klux.oct
echo ~/MantaRay/Andrei/octrees/Scene_Overcast10klux.oct""",
    suppressWarnings=False,
    results="octrees/Scene_Overcast10klux.oct",
    commands="""mkdir -p octrees/
oconv -r 2048 -w -f 10kluxOvercast.sky radFiles/materials.mat radFiles/Glass_70_geo.rad radFiles/Walls_50_00_geo.rad radFiles/Context_20_00_geo.rad radFiles/Frames_70_00_geo.rad radFiles/Ceilings_70_00_geo.rad radFiles/Floors_20_00_geo.rad radFiles/Ground_20_00_geo.rad > octrees/Scene_Overcast10klux.oct
echo octrees/Scene_Overcast10klux.oct""")  # -> Stdout, Stderr_, Ran
panel_12 = Panel(executessh_5.Stderr_)
panel_13 = Panel(overrides_5.Output)
octree_overcast = Text(executessh_5.Stdout)

# ----
# View rad files (inspect first 10 lines)
panel_14 = Panel("head <radFile>")
all_rad_files_2 = Text(all_rad_files)
falsestart_3 = LBFalseStartToggle(False)
overrides_6 = ApplyOverrides(Input=panel_14, RadFile=graft(all_rad_files_2))  # -> Output, DynamicOutput
executessh_6 = ExecuteSSH(
    _SSHCommands_=overrides_6.DynamicOutput,
    Run=falsestart_3,
    addPrefix=True,
    description="""head radFiles/materials.mat


- - -

head radFiles/Glass_70_geo.rad


- - -

head radFiles/Walls_50_00_geo.rad


- - -

head radFiles/Context_20_00_geo.rad


- - -

head radFiles/Frames_70_00_geo.rad


- - -

head radFiles/Ceilings_70_00_geo.rad


- - -

head radFiles/Floors_20_00_geo.rad


- - -

head radFiles/Ground_20_00_geo.rad""",
    fireLogs=False,
    lastRunTime=93,
    suppressWarnings=False,
    results=["""void glass Glass_70
0
0
3 0.762841984823016 0.762841984823016 0.762841984823016

void plastic Ceilings_70_00
0
0
5 0.7 0.7 0.7 0 0""", """# obj2rad -m /home/lio/MantaRay/SimpleRoom/radFiles/glass.map -f /home/lio/MantaRay/SimpleRoom/radFiles/Glass_70_geo.obj
# Written with MantaRay plugin/GH_MeshToRad

Glass_70 polygon Glass_70_geo_1.1
0
0
12
              1.198             -3.115              2.131
              3.164             -3.115              2.131
              3.164             -3.115               1.11""", """# obj2rad -m /home/lio/MantaRay/SimpleRoom/radFiles/mapping.map -f /home/lio/MantaRay/SimpleRoom/radFiles/Floors_20_00_geo.obj
# Written with MantaRay plugin/GH_MeshToRad

Floors_20_00 polygon Floors_20_00_geo_1.1
0
0
12
                4.5                  0                  0
                4.5                 -3                  0
                  0                 -3                  0""", """# obj2rad -m /home/lio/MantaRay/SimpleRoom/radFiles/mapping.map -f /home/lio/MantaRay/SimpleRoom/radFiles/Walls_50_00_geo.obj
# Written with MantaRay plugin/GH_MeshToRad

Walls_50_00 polygon Walls_50_00_geo_1.1
0
0
12
                  0                 -3                2.7
                  0                 -3                  0
              1.198                 -3               1.11""", """# obj2rad -m /home/lio/MantaRay/SimpleRoom/radFiles/mapping.map -f /home/lio/MantaRay/SimpleRoom/radFiles/Ground_20_00_geo.obj
# Written with MantaRay plugin/GH_MeshToRad

Ground_20_00 polygon Ground_20_00_geo_1.1
0
0
12
              -8.24             -8.918                  0
             11.055             -8.918                  0
             11.055               6.63                  0""", """# obj2rad -m /home/lio/MantaRay/SimpleRoom/radFiles/mapping.map -f /home/lio/MantaRay/SimpleRoom/radFiles/Frames_70_00_geo.obj
# Written with MantaRay plugin/GH_MeshToRad

Frames_70_00 polygon Frames_70_00_geo_1.1
0
0
12
              1.198                 -3               1.11
              3.164                 -3               1.11
              3.164             -3.103               1.11""", """# obj2rad -m /home/lio/MantaRay/SimpleRoom/radFiles/mapping.map -f /home/lio/MantaRay/SimpleRoom/radFiles/Context_20_00_geo.obj
# Written with MantaRay plugin/GH_MeshToRad

Context_20_00 polygon Context_20_00_geo_1.1
0
0
12
             -1.183             -7.158                  0
              0.747             -7.158                  0
              0.747             -7.158              1.983""", """# obj2rad -m /home/lio/MantaRay/SimpleRoom/radFiles/mapping.map -f /home/lio/MantaRay/SimpleRoom/radFiles/Ceilings_70_00_geo.obj
# Written with MantaRay plugin/GH_MeshToRad

Ceilings_70_00 polygon Ceilings_70_00_geo_1.1
0
0
12
                4.5                  0                2.7
                  0                  0                2.7
                  0                 -3                2.7"""],
    commands=["head radFiles/materials.mat", "head radFiles/Walls_50_00_geo.rad"])  # -> Stdout, Stderr_, Ran
panel_15 = Panel(executessh_6.Stdout)

# ----
# View rad files in 3d
all_rad_files_3 = Text(all_rad_files)
falsestart_4 = LBFalseStartToggle(False)
download = Download(
    SftpPaths=all_rad_files_3,
    Run=falsestart_4,
    stdouts="C:\Users\mm1013\MantaRay\SimpleRoom\materials.mat>JOIN<C:\Users\mm1013\MantaRay\SimpleRoom\Glass_70_geo.rad>JOIN<C:\Users\mm1013\MantaRay\SimpleRoom\Floors_20_00_geo.rad>JOIN<C:\Users\mm1013\MantaRay\SimpleRoom\Walls_50_00_geo.rad>JOIN<C:\Users\mm1013\MantaRay\SimpleRoom\Ground_20_00_geo.rad>JOIN<C:\Users\mm1013\MantaRay\SimpleRoom\Frames_70_00_geo.rad>JOIN<C:\Users\mm1013\MantaRay\SimpleRoom\Context_20_00_geo.rad>JOIN<C:\Users\mm1013\MantaRay\SimpleRoom\Ceilings_70_00_geo.rad")  # -> FilePaths, Status, Ran
cull = CullPattern(List=download.FilePaths, CullPattern=falsestart_4)
radviewer = RadViewer(
    RadFiles=flatten(cull),
    IsTwoSided=False,
    Polychromatic=True,
    ShowEdges=True,
    Transparent=True,
    ColorNames=["Glass_70", "Floors_20_00", "Walls_50_00", "Ground_20_00", "Frames_70_00", "Context_20_00", "Ceilings_70_00"],
    Colors=[RGB(138, 134, 190), RGB(132, 165, 122), RGB(132, 235, 142), RGB(185, 176, 113), RGB(140, 155, 219), RGB(120, 153, 213), RGB(180, 246, 253)])  # -> Geo, ModifierNames, Modifiers, FailedWireFrame

# ----
# Daylight Factor simulation grid based
panel_16 = Panel("""mkdir -p results/
mkdir -p ambFiles/
mkdir -p timing/
date > timing/start.md
rtrace -af ambFiles/<af> -n 50 -w -h -I+ <ambientSettings> <octree> < <pts> > results/daylightFactor.ill
echo results/daylightFactor.ill
date > timing/end.md""")
pt = Point(grid.Points)
octree_overcast_2 = Text(octree_overcast)
falsestart_5 = LBFalseStartToggle(True)
ptsfile_2 = Text(ptsfile)
panel_17 = Panel("echo results/daylightFactor.ill")
gradient = Gradient(
    LowerLimit=0,
    UpperLimit=1,
    Parameter=1,
    stops=[0: RGB(0, 0, 255), 0.1: RGB(53, 0, 202), 0.2: RGB(107, 0, 148), 0.3: RGB(160, 0, 95), 0.4: RGB(214, 0, 41), 0.5: RGB(255, 12, 0), 0.6: RGB(255, 66, 0), 0.7: RGB(255, 119, 0), 0.8: RGB(255, 173, 0), 0.9: RGB(255, 226, 0), 1: RGB(255, 255, 0)])
gridsettings = GridSettings(From="0", To="10", ASteps="11", BStepSize=-1)

python_2 = GhPythonScript(update=flatten(falsestart_5))  # -> time; inputs update: tree
# ---------- python_2: Python ----------
#if not update:
#    return self.time
"""Provides a scripting component.
    Inputs:
        x: The x script variable
        y: The y script variable
    Output:
        a: The a output variable"""
        
__author__ = "mm1013"
__version__ = "2022.08.30"
        
import rhinoscriptsyntax as rs
        
from datetime import datetime
dt = datetime.now()
        
time = "%02d_%02d_%02d_%02d%02d_%02d" % (dt.year, dt.month, dt.day, dt.hour, dt.minute, dt.second)
# ---------- end python_2 ----------

overrides_7 = ApplyOverrides(
    Input=panel_16,
    AmbientSettings=graft("-ab 5 -ad 1024 -lw 0.002"),
    Octree=graft(octree_overcast_2),
    Pts=graft(ptsfile_2),
    Af=graft(python_2))  # -> Output, DynamicOutput
executessh_7 = ExecuteSSH(
    _SSHCommands_=overrides_7.DynamicOutput,
    Run=falsestart_5,
    addPrefix=True,
    description="""mkdir -p results/
mkdir -p ambFiles/
mkdir -p timing/
date > timing/start.md
rtrace -af ambFiles/2023_04_16_1344_24 -n 50 -w -h -I+ -ab 5 -ad 1024 -lw 0.002 octrees/Scene_Overcast10klux.oct < ptsFiles/ptsFiles.pts > results/daylightFactor.ill
echo results/daylightFactor.ill
date > timing/end.md""",
    fireLogs=False,
    lastRunTime=8041.1784,
    suppressWarnings=False,
    results="results/daylightFactor.ill",
    commands="""mkdir -p results/
mkdir -p ambFiles/
mkdir -p timing/
date > timing/start.md
rtrace -af ambFiles/2023_04_16_1344_24 -n 50 -w -h -I+ -ab 5 -ad 1024 -lw 0.002 octrees/Scene_Overcast10klux.oct < ptsFiles/ptsFiles.pts > results/daylightFactor.ill
echo results/daylightFactor.ill
date > timing/end.md""")  # -> Stdout, Stderr_, Ran

overrides_8 = ApplyOverrides(Input="echo <results>", Results=graft(executessh_7.Stdout))  # -> Output, DynamicOutput

executessh_8 = ExecuteSSH(
    _SSHCommands_=overrides_8.DynamicOutput,
    Run=executessh_7.Ran,
    addPrefix=True,
    description="echo results/daylightFactor.ill",
    fireLogs=False,
    lastRunTime=23.9308,
    suppressWarnings=False,
    results="results/daylightFactor.ill",
    commands="echo results/daylightFactor.ill")  # -> Stdout, Stderr_, Ran
overrides_9 = ApplyOverrides(Input="cat <ill> | rcalc -e '$1=179*($1*.265+$2*.670+$3*.065)'", Ill=graft(executessh_8.Stdout))  # -> Output, DynamicOutput
executessh_9 = ExecuteSSH(
    _SSHCommands_=overrides_9.DynamicOutput,
    Run=executessh_8.Ran,
    addPrefix=True,
    description="cat results/daylightFactor.ill | rcalc -e '$1=179*($1*.265+$2*.670+$3*.065)'",
    fireLogs=False,
    lastRunTime=48.3379,
    suppressWarnings=False,
    results="""96.3445304
144.090489
129.270489
109.011412
92.2793688
309.753235
276.217585
195.446341
136.779914
104.728371
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""",
    commands="cat results/daylightFactor.ill | rcalc -e '$1=179*($1*.265+$2*.670+$3*.065)'")  # -> Stdout, Stderr_, Ran
split = TextSplit(Text=executessh_9.Stdout)
num = Number(expr("x/100", split))
unflatten = UnflattenTree(Tree=num, Guide=pt)
gridviewer = GridViewer(
    Grids=flatten(grid.Grids),
    Results=unflatten,
    _Gradient=gradient,
    _MinColor=RGB(169, 169, 169),
    _MaxColor=RGB(211, 211, 211),
    _SectionType=gridsettings)  # -> ColoredMesh, LayeredMesh, Curves, Planes, TempMeshes, flatten(Colors), flatten(Values)
dam = DataDam(DataA=unflatten, BufferDelay=10000000, BufferMode=0)
panel_18 = Panel(gridviewer.Values)
mesh = Mesh(gridviewer.LayeredMesh)
path_mapper = PathMapper(mesh, source="{A;B}", target="{A;B+1}")
split_2 = SplitTree(Data=path_mapper, Masks=flatten("{*;0}"))  # -> Positive, Negative
demesh = DeconstructMesh(Mesh=split_2.Positive)  # -> Vertices, Faces, Colours, Normals
mesh_2 = Mesh(split_2.Negative)
abc_a = ABC(data=mesh_2)
item = ListItem(List=demesh.Vertices, Index=0, Wrap=True)
xy = XYPlane(Origin=item)
scale_nu = ScaleNU(Geometry=abc_a, Plane=xy, ScaleX=1, ScaleY=1, ScaleZ=Slider(408.64, range=0.01..1135.1))  # -> Geometry, Transform
medges = MeshEdges(Mesh=scale_nu.Geometry)  # -> NakedEdges, InteriorEdges, NonManifoldEdges
mjoin = MeshJoin(Meshes=scale_nu.Geometry)
join_3 = JoinCurves(Curves=medges.NakedEdges, Preserve=False)
preview = CustomPreview(
    Geometry=join_3,
    Material={diffuse=RGB(221, 160, 221), emission=RGB(66, 48, 66), shine=0.5, specular=RGB(255, 255, 255), transparency=0})

# ==== cluster ABC
data = ClusterInput()
data_2 = Data(data)
path_mapper = PathMapper(
    data_2,
    source=["{A;B;C;D;E;F;G}", "{A;B;C;D;E;F}", "{A;B;C;D;E}", "{A;B;C;D}", "{A;B;C}", "{A;B}", "{A}"],
    target=["{A}", "{A}", "{A}", "{A}", "{A}", "{A}", "{A}"])
data_3 = Data(path_mapper)
data_4 = ClusterOutput(data_3)
