# Grasshopper definition TestConnection.gh (Grasshopper 1.0.7)
# Copyright: 2021
# Copyright: 2022-28-21
# Copyright: 2022-06-43
# plug-ins: GrasshopperRadianceLinuxConnector, LadybugGrasshopper, Human, HDTTreeUtils

# ----
# Setup globals
panel = Panel("5")
panel_2 = Panel("""~/simulation/test_project2
test_project2
/simulation/test_project2""")
panel_3 = Panel("""proj
projname
projfolder""")
global_overrides = GlobalOverrides(Keys=panel_3, Values=panel_2, Cpus=panel)
panel_4 = Panel(global_overrides)

# ----
# Connect
panel_5 = Panel("mss")
connect_ssh = ConnectSSH(User=panel_5, Ip="127.0.0.1", Password="_prompt", _port=22, Connect=Toggle(True))  # -> Status, Run
panel_6 = Panel(connect_ssh.Status)

od_outdated = ColourSwatch(SwatchColor=RGBA(97, 97, 97, 150))
u_updated = ColourSwatch(SwatchColor=RGBA(208, 115, 230, 112))
o_outputs = ColourSwatch(SwatchColor=RGBA(160, 218, 242, 203))
g_general = ColourSwatch(SwatchColor=RGBA(245, 243, 237, 156))
toggle = BooleanToggle(True)
s_settings = ColourSwatch(SwatchColor=RGBA(224, 145, 81, 154))
y_yellow = ColourSwatch(SwatchColor=RGBA(247, 244, 64, 188))
i_inputs = ColourSwatch(SwatchColor=RGBA(125, 217, 98, 150))
c_core = ColourSwatch(SwatchColor=RGBA(235, 227, 206, 203))
r_red = ColourSwatch(SwatchColor=RGBA(242, 63, 63, 203))

cc_core2 = ColourSwatch(SwatchColor=RGBA(230, 216, 186, 208))

# ----
# Test connection
testconnection = TestConnection()  # -> Status, Errors
panel_7 = Panel(testconnection.Status)
panel_8 = Panel(testconnection.Errors)

# ----
# Overview of all running tasks in linux
toggle_2 = BooleanToggle(True)
execute_ssh_async = ExecuteSSHAsync(
    SSHCommands="ps aux",
    Run=toggle_2,
    addPrefix=True,
    addSuffix=True,
    description="ps aux",
    fireLogs=False,
    stdouts="""USER       PID %CPU %MEM    VSZ   RSS TTY      STAT START   TIME COMMAND
root         1  0.0  0.0    896   532 ?        Sl   Jul02   0:00 /init
root         8  0.0  0.0    896    88 ?        S    Jul02   0:00 /init
root        31  0.0  0.0  12176  4252 ?        Ss   Jul02   0:00 sshd: /usr/sbin/sshd [listener] 0 of 10-100 startups
root     24682  0.3  0.0  13908  8612 ?        Ss   10:55   0:00 sshd: mss [priv]
root     24686  0.3  0.0  13908  8596 ?        Ss   10:55   0:00 sshd: mss [priv]
mss      24780  0.3  0.0  13908  5708 ?        S    10:55   0:00 sshd: mss@notty
mss      24801  0.0  0.0  13908  5304 ?        S    10:55   0:00 sshd: mss@notty
mss      24802  0.0  0.0   5888  4128 ?        Ss   10:55   0:00 /usr/lib/openssh/sftp-server
mss      24830  0.0  0.0  10616  3268 ?        R    10:55   0:00 ps aux""",
    suppressWarnings=False)  # -> Stdout, Stderr, Log, Pid, Ran
panel_9 = Panel(execute_ssh_async.Stdout)

colorgroups = CSharpScript(
    Colors=[i_inputs, s_settings, g_general, c_core, o_outputs, r_red, y_yellow, u_updated, od_outdated, cc_core2],
    Enable=toggle,
    Rename=Toggle(False),
    RunOnce=Button(),
    Debug=Toggle(False))  # -> out; inputs Colors: list of Color, Enable: Boolean, Rename: Boolean, RunOnce: Boolean, Debug: Boolean
# ---------- colorgroups: C# usings ----------
using System.Linq;
using System.Text;
using System.Reflection;
# ---------- colorgroups: C# ----------
    msg.Clear();


    this.Component.Message = "id: " + id.ToString();

    _debug = Debug; //Set to true to have all events printed in rhino log
    _rename = Rename;

    if (Enable)
    {
      msg.AppendFormat("Set up events on ID {0}\n", id);
      SetupDict(); // Create a dictionary of the input swatches
      SetEventHandlers(); // This would do the job.


    }
    else
    {
      RemoveEventHandlers();
    }
    if (RunOnce)
    {
      foreach(Grasshopper.Kernel.Special.GH_Group grp in Grasshopper.Instances.ActiveCanvas.Document.Objects.OfType<Grasshopper.Kernel.Special.GH_Group>())
      {
        ColorGroup(grp, null); // You decide if it should run once on all existing groups

      }
    }

    Print(msg.ToString());


    // Component setup
    Component.Description = "Set up event handlers to color groups based on prefixes such as 'in_' and 'out_'.\n"
      + "Please insert only swatcheds directly into the Colors input\n\n"
      + "MIT License. Copyright Mathias Sønderskov Schaltz 2022";
    Component.Params.Input[0].Description = "Please insert only swatcheds directly into the Colors input.\nRemember to rename them";
    Component.Params.Input[1].Description = "Toggle to run...";
    Component.Params.Input[2].Description = "Set to true if you want to automatically rename the groups and remove prefix. Default is false.";
    Component.Params.Input[3].Description = "Set to true to run it once and color all existing groups.";
    Component.Params.Input[Component.Params.Input.Count - 1].Description = "Set debug to true to get all the events printed in the rhino log";
# ---------- colorgroups: C# additional code ----------
  public static Random rnd = new Random();
  public int id = rnd.Next(0, 1000);
  StringBuilder msg = new StringBuilder();
  Dictionary<string, System.Drawing.Color> colorDict = new Dictionary<string, System.Drawing.Color>();

  bool _debug = false;
  bool _rename = false;

  public bool IdExists(int id)
  {
    IList<IGH_DocumentObject> objs = Grasshopper.Instances.ActiveCanvas.Document.Objects;
    return objs
      .OfType<IGH_Component>()
      .Where(ob => ob.NickName == this.Component.NickName)
      .Where(ob => ob.GetType().ToString() == "ScriptComponents.Component_CSNET_Script")
      .Where(ob => ob.Message == "id: " + id.ToString()).Any();

  }


  public void SetupDict()
  {
    colorDict.Clear();
    // Get all inputs to "Colors"
    IList<IGH_Param> colorSources = this.Component.Params.Input[0].Sources;
    if (colorSources.Count == 0)
    {
      throw new Exception("You forgot to setup the colors. Please input swatch components and rename them");
    }
    foreach(IGH_Param source in colorSources)
    {
      //if (source.Type.ToString() == "Grasshopper.Kernel.Types.GH_Colour")
      if (source is Grasshopper.Kernel.Special.GH_ColourSwatch)
      {
        string nickName = source.NickName.Split('_')[0].Trim() + "_";
        if(!colorDict.ContainsKey(nickName))
        {
          Grasshopper.Kernel.Special.GH_ColourSwatch swatch = (Grasshopper.Kernel.Special.GH_ColourSwatch) source;
          colorDict.Add(nickName, swatch.SwatchColour);
        }
        else
        {
          throw new Exception("Multiple swatches using the same name detected. Please rename");
        }
      }
      else
      {
        throw new Exception("Whacko! Why did you input a non-swatch into the Colors? " + source.Type.ToString());
      }

    }

    msg.AppendFormat("Set up the dictionaries with {0} colors\n", colorDict.Count);
    foreach(var pairs in colorDict)
    {
      msg.AppendFormat("{0} -> {1}\n", ("\"" + pairs.Key + "\"").PadRight(5 + colorDict.Keys.Select(k => k.Length).Max()), pairs.Value);
    }
  }

  public void SetEventHandlers()
  {

    // Always remove events first to avoid duplicates
    GrasshopperDocument.ObjectsAdded -= OnObjectsAdded;
    GrasshopperDocument.ObjectsDeleted -= OnObjectsRemoved;
    GrasshopperDocument.ObjectsDeleted -= OnDeleteThisComponent;

    // Attach events
    GrasshopperDocument.ObjectsAdded += OnObjectsAdded;
    GrasshopperDocument.ObjectsDeleted += OnObjectsRemoved;
    GrasshopperDocument.ObjectsDeleted += OnDeleteThisComponent;


    foreach(Grasshopper.Kernel.Special.GH_Group grp in GrasshopperDocument.Objects.OfType<Grasshopper.Kernel.Special.GH_Group>())
    {
      grp.ObjectChanged -= ColorGroup;
      grp.ObjectChanged += ColorGroup;

      //ColorGroup(grp, null); // Make sure to run it once
    }
    msg.AppendFormat("Added the eventhandlers on {0} existing groups and on future created groups\n", GrasshopperDocument.Objects.OfType<Grasshopper.Kernel.Special.GH_Group>().Count());
  }

  public void OnObjectsAdded(object sender, GH_DocObjectEventArgs e)
  {
    bool any = false;
    foreach (Grasshopper.Kernel.Special.GH_Group grp in e.Objects.OfType<Grasshopper.Kernel.Special.GH_Group>())
    {
      grp.ObjectChanged -= ColorGroup;
      grp.ObjectChanged += ColorGroup;
      any = true;
    }

    DebugWrite(any ? "Group Objects Added: Attaching Events to ObjectChanged" : "Objects Added - but no groups");
  }

  //Same but reversed
  public void OnObjectsRemoved(object sender, GH_DocObjectEventArgs e)
  {
    bool any = false;
    foreach (Grasshopper.Kernel.Special.GH_Group grp in e.Objects.OfType<Grasshopper.Kernel.Special.GH_Group>())
    {
      grp.ObjectChanged -= ColorGroup;
      any = true;
    }

    DebugWrite(any ? "Group Objects Removed, removing event" : "Objects Removed - although not a group");

  }



  public void RemoveEventHandlers()
  {
    GrasshopperDocument.ObjectsAdded -= OnObjectsAdded;
    GrasshopperDocument.ObjectsDeleted -= OnObjectsRemoved;


    foreach(Grasshopper.Kernel.Special.GH_Group grp in GrasshopperDocument.Objects.OfType<Grasshopper.Kernel.Special.GH_Group>())
    {
      grp.ObjectChanged -= ColorGroup;

    }
    msg.AppendFormat("Removed event handlers on document and on {0} groups\n", GrasshopperDocument.Objects.OfType<Grasshopper.Kernel.Special.GH_Group>().Count());

  }

  public void ColorGroup(object sender, EventArgs e)
  {
    if (!IdExists(id))
    {
      DebugWrite("Component not relevant. Disabling old id + " + id.ToString());
      RemoveEventHandlers();
      return;
    }

    Grasshopper.Kernel.Special.GH_Group grp = sender as Grasshopper.Kernel.Special.GH_Group;
    if (grp == null) return; //not type GH_Group
    //if (!grp.NickName.EndsWith("_")) return;

    string[] nameParts = grp.NickName.Split('_');
    if (nameParts.Length <= 1)
      return;
    string prefix = grp.NickName.Split('_')[0].Trim() + '_';

    string prefixes = String.Join(", ", colorDict.Keys.Select(k => "\"" + k + "\""));

    msg.Append("prefix " + prefix + "\n");
    if (colorDict.ContainsKey(prefix))
    {
      //if (grp.NickName.EndsWith("_"))
      grp.Colour = colorDict[prefix];
      if (_rename)
      {
        grp.NickName = grp.NickName.Replace(prefix, "");
      }

      DebugWrite("Colored " + grp.NickName);

    }
    else
    {
      DebugWrite("Group changed but not relevant: prefix " + prefix + " is not among " + prefixes);
    }

  }
  public void DebugWrite(string msg)
  {
    if (_debug)
    {
      Rhino.RhinoApp.WriteLine(String.Format("[ColGrps {0}]: {1}", id, msg));
    }
  }

  public void OnDeleteThisComponent(object sender, GH_DocObjectEventArgs e)
  {

    if (e.Objects.OfType<Grasshopper.Kernel.GH_Component>().Where(o => o.NickName == this.Component.NickName).Any())
    {
      DebugWrite("Removed template component. Removing all the eventhandlers");
      RemoveEventHandlers();
    }

  }
# ---------- end colorgroups ----------

fixparams = CSharpScript(FixOnce=Button(), Enable=toggle, Debug=Toggle(False))  # -> out; inputs FixOnce: Boolean, Enable: Boolean, Debug: Boolean
# ---------- fixparams: C# usings ----------
using System.Text;
using System.Linq;
using Grasshopper.Kernel.Special;
# ---------- fixparams: C# ----------
    _debug = Debug;
    _enable = Enable;
    msg.Clear();
    this.Component.Message = "id: " + id.ToString();




    if (Enable)
    {
      SetEventHandlers();
    }
    else
    {
      RemoveEventHandlers();
    }


    if (FixOnce)
    {
      FixAll();
    }

    Print(msg.ToString());

    // Component setup
    Component.Description = "Set up event handlers to change params to show nickname and not icon"
      + "\n\n"
      + "MIT License. Copyright Mathias Sønderskov Schaltz 2022";
    Component.Params.Input[0].Description = "Run me once on the document";
    Component.Params.Input[1].Description = "Toggle to enable event listener";
    Component.Params.Input[Component.Params.Input.Count - 1].Description = "Set debug to true to get all the events printed in the rhino log";
# ---------- fixparams: C# additional code ----------
  public static Random rnd = new Random();
  public int id = rnd.Next(0, 1000);
  StringBuilder msg = new StringBuilder();
  bool _debug = false;
  bool _enable = false;

  public Dictionary<IGH_ActiveObject, HashSet<GH_Group>> groupsPerObject = new Dictionary<IGH_ActiveObject, HashSet<GH_Group>>();


  public void OnObjectsAdded(object sender, GH_DocObjectEventArgs e)
  {
    if (!IdExists(id))
    {
      DebugWrite("[FixParam] Component not relevant. Disabling old id " + id.ToString());
      RemoveEventHandlers();
      return;
    }


    if(_enable)
    {
      foreach(IGH_Param par in e.Objects.OfType<IGH_Param>())
      {
        FixInputs(par);
      }
    }


  }

  public void FixAll()
  {
    //DebugWrite("Fixing all?");
    foreach(IGH_Param par in GrasshopperDocument.Objects.OfType<IGH_Param>())
    {

      FixInputs(par);
    }
  }




  public void FixInputs(IGH_ActiveObject obj)
  {



    IGH_Param par = obj as IGH_Param;
    if (par != null)
    {

      par.IconDisplayMode = GH_IconDisplayMode.name;


    }

  }


  public void SetEventHandlers()
  {

    GrasshopperDocument.ObjectsAdded -= OnObjectsAdded;
    GrasshopperDocument.ObjectsAdded += OnObjectsAdded;
    GrasshopperDocument.ObjectsDeleted -= OnDeleteThisComponent;
    GrasshopperDocument.ObjectsDeleted += OnDeleteThisComponent;
    msg.AppendFormat("Added the eventhandlers to OnObjectsAdded\n", GrasshopperDocument.Objects.OfType<Grasshopper.Kernel.Special.GH_Group>().Count());
  }

  public void RemoveEventHandlers()
  {
    GrasshopperDocument.ObjectsAdded -= OnObjectsAdded;
    GrasshopperDocument.ObjectsDeleted -= OnDeleteThisComponent;

    msg.AppendFormat("Removed wire event handlers on document\n", GrasshopperDocument.Objects.OfType<Grasshopper.Kernel.Special.GH_Group>().Count());

  }

  public void OnDeleteThisComponent(object sender, GH_DocObjectEventArgs e)
  {

    if (e.Objects.OfType<Grasshopper.Kernel.GH_Component>().Where(o => o.NickName == this.Component.NickName).Any())
    {
      DebugWrite("Removed template component. Removing all the eventhandlers");
      RemoveEventHandlers();
    }

  }

  public bool IdExists(int id)
  {
    IList<IGH_DocumentObject> objs = Grasshopper.Instances.ActiveCanvas.Document.Objects;
    return objs
      .OfType<IGH_Component>()
      .Where(ob => ob.NickName == this.Component.NickName)
      .Where(ob => ob.GetType().ToString() == "ScriptComponents.Component_CSNET_Script")
      .Where(ob => ob.Message == "id: " + id.ToString()).Any();

  }

  public void DebugWrite(string msg)
  {
    if (_debug)
    {
      Rhino.RhinoApp.WriteLine(String.Format("[FixParams {0}]: {1}", id, msg));
    }
  }
# ---------- end fixparams ----------

fixwires = CSharpScript(FixOnce=Button(), Enable=toggle, Debug=Toggle(False))  # -> out; inputs FixOnce: Boolean, Enable: Boolean, Debug: Boolean
# ---------- fixwires: C# ----------
    _debug = Debug;
    _enable = Enable;
    msg.Clear();
    this.Component.Message = "id: " + id.ToString();


    SetDictionary();

    if (Enable)
    {
      SetEventHandlers();
    }
    else
    {
      RemoveEventHandlers();
    }


    if (FixOnce)
    {
      FixAll();
    }

    Print(msg.ToString());
    
    // Component setup
    Component.Description = "Set up event handlers to change all wire types across groups to faint"
      + "\n\n"
      + "MIT License. Copyright Mathias Sønderskov Schaltz 2022";
    Component.Params.Input[0].Description = "Run me once on the document";
    Component.Params.Input[1].Description = "Toggle to enable event listener";
    Component.Params.Input[Component.Params.Input.Count - 1].Description = "Set debug to true to get all the events printed in the rhino log";
# ---------- fixwires: C# additional code ----------
  public static Random rnd = new Random();
  public int id = rnd.Next(0, 1000);
  StringBuilder msg = new StringBuilder();
  bool _debug = false;
  bool _enable = false;

  public Dictionary<IGH_ActiveObject, HashSet<GH_Group>> groupsPerObject = new Dictionary<IGH_ActiveObject, HashSet<GH_Group>>();


  public void OnSolutionExpired(object sender, GH_DocUndoEventArgs e)
  {
    if(_enable)
      FixAll();
  }

  public void FixAll()
  {
    //DebugWrite("Fixing all?");
    foreach(IGH_ActiveObject key in groupsPerObject.Keys.Where(k => groupsPerObject[k].Count() > 0))
    {

      FixInputs(key);
    }
  }



  public bool HasGroup(IGH_ActiveObject obj)
  {
    return groupsPerObject[obj].Count > 0;
  }


  public void FixInputs(IGH_ActiveObject obj)
  {

    if (!IdExists(id))
    {
      DebugWrite("Component not relevant. Disabling old id " + id.ToString());
      RemoveEventHandlers();
      return;
    }

    //List<List<IGH_ActiveObject>> parents = new List<List<IGH_ActiveObject>>();
    IGH_Param par = obj as IGH_Param;
    if (par != null && par.Sources != null)
    {


      IEnumerable<IGH_ActiveObject> p = par.Sources.Select(s => s.Attributes.GetTopLevel.DocObject as IGH_ActiveObject);
      //parents.Add(p);
      if(HasGroup(obj) && p.All(o => !HasGroupsInCommon(o, obj)) && par.WireDisplay != GH_ParamWireDisplay.faint)
      {
        DebugWrite("Fixing " + par.Attributes.GetTopLevel.DocObject.NickName);
        par.WireDisplay = GH_ParamWireDisplay.faint;
      }

    }

    IGH_Component comp = obj as IGH_Component;
    if (comp != null)
    {
      foreach(IGH_Param inp in comp.Params.Input)
      {

        IEnumerable<IGH_ActiveObject> p = inp.Sources.Select(i => i.Attributes.GetTopLevel.DocObject as IGH_ActiveObject);

        if(HasGroup(obj) && p.All(o => !HasGroupsInCommon(o, obj)) && inp.WireDisplay != GH_ParamWireDisplay.faint)
        {
          DebugWrite("Fixing " + inp.Attributes.GetTopLevel.DocObject.NickName);
          inp.WireDisplay = GH_ParamWireDisplay.faint;
        }
      }

    }



  }





  public void SetDictionary()
  {
    IList<IGH_DocumentObject> objects = Grasshopper.Instances.ActiveCanvas.Document.Objects.ToList();
    //Print(String.Join(", ", objects.Select(o => o.NickName)));

    groupsPerObject = objects
      .Where(o => o.GetType() != typeof(GH_Group))
      .OfType<IGH_ActiveObject>()
      .ToDictionary(o => o, o => new HashSet<GH_Group>());

    foreach(GH_Group grp in objects.OfType<GH_Group>())
    {

      foreach(IGH_ActiveObject obj in grp.ObjectsRecursive().OfType<IGH_ActiveObject>())
      {
        groupsPerObject[obj].Add(grp);

      }
    }



  }

  public bool HasGroupsInCommon(IGH_ActiveObject obj1, IGH_ActiveObject obj2)
  {
    HashSet<GH_Group> set1 = groupsPerObject[obj1];
    HashSet<GH_Group> set2 = groupsPerObject[obj2];

    set1.IntersectWith(set2);

    return set1.Any();
  }

  public void SetEventHandlers()
  {

    GrasshopperDocument.UndoStateChanged -= OnSolutionExpired;
    GrasshopperDocument.UndoStateChanged += OnSolutionExpired;
    GrasshopperDocument.ObjectsDeleted -= OnDeleteThisComponent;
    GrasshopperDocument.ObjectsDeleted += OnDeleteThisComponent;
    msg.AppendFormat("Added the eventhandlers to UndoStateChanged\n", GrasshopperDocument.Objects.OfType<Grasshopper.Kernel.Special.GH_Group>().Count());
  }

  public void RemoveEventHandlers()
  {
    GrasshopperDocument.UndoStateChanged -= OnSolutionExpired;
    GrasshopperDocument.ObjectsDeleted -= OnDeleteThisComponent;

    msg.AppendFormat("Removed wire event handlers on document\n", GrasshopperDocument.Objects.OfType<Grasshopper.Kernel.Special.GH_Group>().Count());

  }

  public void OnDeleteThisComponent(object sender, GH_DocObjectEventArgs e)
  {

    if (e.Objects.OfType<Grasshopper.Kernel.GH_Component>().Where(o => o.NickName == this.Component.NickName).Any())
    {
      DebugWrite("Removed template component. Removing all the eventhandlers");
      RemoveEventHandlers();
    }

  }

  public bool IdExists(int id)
  {
    IList<IGH_DocumentObject> objs = Grasshopper.Instances.ActiveCanvas.Document.Objects;
    return objs
      .OfType<IGH_Component>()
      .Where(ob => ob.NickName == this.Component.NickName)
      .Where(ob => ob.GetType().ToString() == "ScriptComponents.Component_CSNET_Script")
      .Where(ob => ob.Message == "id: " + id.ToString()).Any();

  }

  public void DebugWrite(string msg)
  {
    if (_debug)
    {
      Rhino.RhinoApp.WriteLine(String.Format("[FixWire {0}]: {1}", id, msg));
    }
  }
# ---------- end fixwires ----------

# ----
# processes to kill
panel_10 = Panel("""dctimestep
rcontrib
rtrace
oconv
rvu""")
kill = LBFalseStartToggle(False)

# ----
# Kill processes running on linux
panel_11 = Panel("pkill -f <instance>")
overrides = ApplyOverrides(Input_=panel_11, Instance=graft(panel_10))  # -> flatten(Output), Pairs
join = TextJoin(Text=overrides.Output, Join=";")
execute_ssh_async_2 = ExecuteSSHAsync(SSHCommands=join, Run=kill, addPrefix=False, addSuffix=False, fireLogs=False, suppressWarnings=False)  # -> Stdout, Stderr_, Log, Pid, Ran
panel_12 = Panel(execute_ssh_async_2.Stderr_)

# ----
# Template methods
# By Mathias Sønderskov Schaltz 2022
# Check for updates here https://github.com/Sonderwoods/GrasshopperScribbles
panel_13 = Panel(fixwires)
panel_14 = Panel(fixparams)
panel_15 = Panel(colorgroups)

panel_16 = Panel("""export PATH=$PATH.:/usr/local/radiance/bin
export RAYPATH=.:/usr/local/radiance/lib
objview <glowmat> ~/simulation/<name>.rad | meta2tga -x 1048 -y 1048 | ra_t8 -r > ~/simulation/<name>.hdr
normtiff ~/simulation/<name>.hdr ~/simulation/<name>.tif
convert ~/simulation/<name>.tif ~/simulation/<name>.png
echo "C:\Users\mm1013\simulation\<name>.png"
""")

panel_17 = Panel("""Mesh
Polysurface
Surface
Extrusion""")

panel_18 = Panel("""echo $PATH
genbox""")  # disabled
falsestart = LBFalseStartToggle(False)  # disabled
execute_ssh_async_3 = ExecuteSSHAsync(SSHCommands=panel_18, Run=falsestart, addPrefix=True, addSuffix=True, fireLogs=False, suppressWarnings=False)  # -> Stdout, Stderr, Log, Pid, Ran; disabled
panel_19 = Panel(execute_ssh_async_3.Stderr)  # disabled
panel_20 = Panel(execute_ssh_async_3.Stdout)  # disabled

# ----
# importing from rhino layers
dpipeline = DynamicGeometryPipeline(
    LayerFilter="Daylight_Inputs::*",
    TypeFilter=panel_17,
    NameFilter="*",
    GroupByLayer=False,
    GroupByType=False,
    IncludeHidden=True,
    IncludeLocked=True,
    enableFullPath=True,
    listenToAttributes=True)
dam = DataDam(DataA=dpipeline, BufferDelay=10000000, BufferMode=0)
objatts = ObjectAttributes(ObjectOrAttributes=dam)  # -> Name, LayerName, LayerFullPath, Color, MaterialName, LinetypeName, GroupIndices, PlotWeight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
cset = CreateSet(List=objatts.LayerName)  # -> Set, Map
assign_paths = AssignPaths(InputData=flatten(dam), PathsToAssign=flatten(cset.Map))
python = GhPythonScript(layer_name=graft(cset.Set))  # -> is_opaque, is_transparent, is_grid, is_HB_Room, is_HB_Window
# ---------- python: Python ----------
__author__ = "mm1013"
__version__ = "2022.01.16"

import rhinoscriptsyntax as rs

is_grid = layer_name == "Grids"

if layer_name.startswith("HB_"):
    is_opaque = is_transparent = is_grid = False
    
    is_HB_Window = layer_name.endswith("%")
    is_HB_Room = layer_name == "HB_Rooms"
    
    
else:
    if is_grid:
        is_opaque = False
        is_transparent = False
    else:
        is_transparent = layer_name.endswith("%")
        if is_transparent:
            transmittance = layer_name.split("_")[-1].replace("%","")
        is_opaque = not is_transparent
# ---------- end python ----------
layer_name = Text(cset.Set)
geo = Geometry(assign_paths)

mesh = Mesh([<mesh referenced from the Rhino model> x2])

# ----
# Log of latest(10) SSH Commands
nickname = GH_LogViewer(Number=10)
panel_21 = Panel(nickname)

facen = FaceNormals(Mesh=mesh)  # -> Centers, Normals
demesh = DeconstructMesh(Mesh=mesh)  # -> Vertices, Faces, Colours, Normals

# ----
# you can remove last characters of a value
# 
# Here adding render instead of image
panel_22 = Panel("echo <proj>/<target-8>_render.gif")
applyglobals = ApplyGlobals(Input=panel_22, AdditionalKeys="target", AdditionalValues="myFiles/myImage.hdr")  # -> Output, Pairs
panel_23 = Panel(applyglobals.Output)

# ----
# you can combine globals and locals
panel_24 = Panel("echo <proj>/<target-.>.gif")
applyglobals_2 = ApplyGlobals(Input=panel_24, AdditionalKeys="target", AdditionalValues="myFiles/myImage.hdr")  # -> Output, Pairs
panel_25 = Panel(applyglobals_2.Output)

# ----
# Applyglobals
# try <target-.>  to remove the file ending on <target>
# 
# Here we are changing from hdr to gif
panel_26 = Panel("echo <target-.>.gif")
applyglobals_3 = ApplyGlobals(Input=panel_26, AdditionalKeys="target", AdditionalValues="myFiles/myImage.hdr")  # -> Output, Pairs
panel_27 = Panel(applyglobals_3.Output)

nickname_2 = GH_LogViewer(Number=10, Filter="Octree")
panel_28 = Panel("""up_clock3
up_ccw3""")
panel_29 = Panel("""glowmat
glowmat""")
points = PointList(Points=demesh.Vertices, Size="50")
vdis = VectorDisplay(Anchor=facen.Centers, Vector=expr("x*500", facen.Normals))
panel_30 = Panel("""echo "void glow glowmat
0
0
4 12 12 12 1000" > <target>;echo <target>""")
falsestart_2 = LBFalseStartToggle(False)
panel_31 = Panel(nickname_2)
mesh2obj = MeshToObj(Mesh=graft(mesh), Name=graft(panel_28), ModifierName=graft(panel_29), Run=falsestart_2)  # -> ObjFiles, MapFile, Run
overrides_2 = ApplyOverrides(Input=panel_30, AdditionalKeys="target", AdditionalValues="~/simulation/testglow.rad")  # -> Output, Pairs
execute_ssh_async_4 = ExecuteSSHAsync(
    _SSHCommands_=overrides_2.Output,
    Run=falsestart_2,
    addPrefix=True,
    addSuffix=True,
    fireLogs=False,
    suppressWarnings=False)  # -> Stdout, Stderr_, Log, Pid, Ran
overrides_3 = ApplyOverrides(Input=panel_16, AdditionalKeys="glowmat", AdditionalValues=execute_ssh_async_4.Stdout)  # -> Output, Pairs
overrides_4 = ApplyOverrides(Input=overrides_3.Output, AdditionalKeys="name", AdditionalValues=graft(panel_28))  # -> Output, Pairs
panel_32 = Panel("echo hi")
panel_33 = Panel(overrides_4.Output)

# ----
# 5 phase bash script from andy mcneil
panel_34 = Panel("""#!/bin/bash

procs=4

### First let me download and unpacking Axel\'s files for rtcontrib lesson

printf "\nDownloading Axels rtcontrib lesson files...\n"
curl -O http://www.jaloxa.eu/resources/radiance/documentation/docs/rtcontrib_lesson.tgz
tar -xf rtcontrib_lesson.tgz
mv rtcontrib_lesson 5p_tutorial_examples

cd 5p_tutorial_examples

mkdir bsdf hourlypics hourlypics_dir hourlypics_ds hourlyresult \
	matrices octs viewpics viewpics_dir viewpics_ds
	
### Let me download the weather data file for you
printf "\nDownloading weather data...\n"
curl -O http://apps1.eere.energy.gov/buildings/energyplus/weatherdata/4_north_and_central_america_wmo_region_4/1_usa/USA_CA_Oakland.Intl.AP.724930_TMY3.zip
tar -xf USA_CA_Oakland.Intl.AP.724930_TMY3.zip
rm USA_CA_Oakland.Intl.AP.724930_TMY3.ddy 
rm USA_CA_Oakland.Intl.AP.724930_TMY3.stat
rm USA_CA_Oakland.Intl.AP.724930_TMY3.zip 
mv USA_CA_Oakland.Intl.AP.724930_TMY3.epw skies/.

# grabbing reinsrc.cal from CVS
printf "\nDownloading reinsrc.cal...\n"
curl -O http://radiance-online.org/cgi-bin/viewcvs.cgi/ray/src/cal/cal/reinsrc.cal

### Section 6.1 - Model adjustments for five-phase simulation
printf "\nMaking model adjustments...\n"
cat <<EOF > objects/testroom_Swall.rad
!genbox wall_mat wall_s_bottom 4 .3 1 |xform -t 0 -.3 0
!genbox wall_mat wall_s_top 4 .3 .5 |xform -t 0 -.3 2
!genbox wall_mat wall_s_west .5 .3 1 |xform -t 0 -.3 1
!genbox wall_mat wall_s_west .5 .3 1 |xform -t 3.5 -.3 1
EOF

cat <<EOF > objects/testroom.rad
!genbox floor_mat floor 4.6 6.6 .3 |xform -t -.3 -.3 -.3
!genbox ceiling_mat ceiling 4.6 6.6 .3 |xform -t -.3 -.3 2.5

!genbox wall_mat wall_w .3 6.6 2.5 |xform -t -.3 -.3 0
!genbox wall_mat wall_e .3 6.6 2.5 |xform -t 4 -.3 0
!genbox wall_mat wall_n 4 .3 2.5 |xform -t 0 6 0
EOF

cat <<EOF > objects/glazing.rad
void glass glazing
0
0
3 0.73 0.73 0.73

glazing polygon glass
0
0
12    0.5  -0.25   1
        0.5  -0.25   2
        3.5  -0.25   2
        3.5  -0.25   1
EOF

cat <<EOF > objects/venetianblind.rad
void plastic blindslat
0
0
5 .65 .65 .65 .01 0 

!genblinds blindslat blinds .05 3 1 25 0 +r .15 | xform -rz -90 -t 0.5 -.15 1 
EOF

cat <<EOF > objects/viewmtxsurf.rad
void glow viewsurf
0
0
4 1 1 1 0

viewsurf polygon inside
0
0
12    0.5   0   1
        0.5   0   2
        3.5   0   2
        3.5   0   1
EOF

cat <<EOF > objects/daymtxsurf.rad
void plastic daymtxsurf
0
0
5 0 0 0 0 0

daymtxsurf polygon outside
0
0
12    0.5   -0.3   1
        0.5   -0.3   2
        3.5   -0.3   2
        3.5   -0.3  1
EOF

cat <<EOF > objects/glazing_bsdf.rad
void BSDF BSDFproxy
6 0.30 bsdf/fullwindow_t45.xml 0 0 1 .
0
0

BSDFproxy polygon inside
0
0
12    0.5   0   1
        0.5   0   2
        3.5   0   2
        3.5   0   1
EOF

cat <<EOF >> materials/testroom.mat
void plastic black
0
0
5 0 0 0 0 0
EOF


### Section 6.2 - Creating BSDFs
xform -rz 180 -rx -90 -t 4 0 0 objects/glazing.rad objects/venetianblind.rad materials/testroom.mat \
	objects/testroom_Swall.rad > bsdf/fullwindow.rad

### I am going to save you the trouble of generating the High-Res BSDF
#genBSDF -n $procs +f +b -geom meter -dim 0.5 3.5 1 2 -.3 0 -t4 5 \
#	bsdf/fullwindow.rad > bsdf/fullwindow_t45.xml
printf "\nDownloading tensor tree BSDF...\n"
curl -o bsdf/fullwindow_t45.xml http://www.radiance-online.org/learning/tutorials/fivephasetutorialfiles/fullwindow_t45.xml

### I will also save you the trouble with the low-res BSDF
#bsdf2klems bsdf/fullwindow_t45.xml > bsdf/fullwindow_klems.xml
#genBSDF -n $procs +f +b -geom meter -dim 0.5 3.5 1 2 -.3 0 \
#	bsdf/fullwindow.rad > bsdf/fullwindow_klems.xml
printf "\nDownloading klems BSDF...\n"
curl -o bsdf/fullwindow.xml http://www.radiance-online.org/learning/tutorials/fivephasetutorialfiles/fullwindow.xml


### Section 6.3 - View matrix (V)
printf "\nDoing 5-phase simulation for sensor points...\n"
oconv materials/testroom.mat objects/daymtxsurf.rad objects/ground.rad objects/testroom.rad \
	objects/testroom_Swall.rad objects/viewmtxsurf.rad skies/sky_white.rad \
	objects/viewmtxsurf.rad objects/daymtxsurf.rad > octs/model_3ph.oct
printf "\nView Matrix\n"
time rcontrib < data/photocells.pts -n $procs -f klems_int.cal -b kbinS -bn Nkbins -m viewsurf \
	-I+ -ab 10 -ad 65536 -lw 1.52e-5 octs/model_3ph.oct > matrices/viewmatrix.vmx


### Section 6.4 - Direct view matrix (Vd)
printf "\nDirect View Matrix\n"
time rcontrib < data/photocells.pts -n $procs -f klems_int.cal -b kbinS -bn Nkbins -m viewsurf \
	-I+ -ab 1 -ad 65536 -lw 1.52e-5 octs/model_3ph.oct > matrices/viewmatrix_direct.vmx

### Section 6.5 - Daylight matrix (D)
printf "\nDaylight Matrix\n"
time genklemsamp -c 1000 -vd 0 -1 0 objects/daymtxsurf.rad | \
	rcontrib -n $procs -c 1000 -ab 2 -ad 1024 -e MF:1 -f reinhart.cal -b rbin -bn Nrbins \
		-m sky_glow octs/model_3ph.oct > matrices/daylightmatrix.dmx

### Section 6.6 - Direct daylight matrix (Dd)
printf "\nDirect Daylight Matrix\n"
xform -m black objects/testroom_Swall.rad objects/testroom.rad objects/ground.rad \
	objects/venetianblind.rad | oconv materials/testroom.mat - objects/viewmtxsurf.rad \
	objects/daymtxsurf.rad skies/sky_white.rad > octs/model_allblack.oct

time genklemsamp -c 1000 -vd 0 -1 0 objects/daymtxsurf.rad | \
	rcontrib -n $procs -c 1000 -ab 0 -e MF:1 -f reinhart.cal -b rbin -bn Nrbins \
		-m sky_glow octs/model_allblack.oct > matrices/daylightmatrix_direct.dmx

### Section 6.7 - Direct sun coefficient matrix (Cds)
printf "\nDirect Sun Coefficient Matrix\n"
echo void light solar 0 0 3 1e6 1e6 1e6 > skies/suns.rad
cnt 5185  |  rcalc -e MF:6 -f reinsrc.cal -e Rbin=recno \
	-o 'solar source sun 0 0 4 ${ Dx } ${ Dy } ${ Dz } 0.533' >> skies/suns.rad

xform -m black objects/testroom_Swall.rad objects/testroom.rad objects/ground.rad \
	| oconv materials/testroom.mat - objects/glazing.rad objects/venetianblind.rad \
		objects/glazing_bsdf.rad skies/suns.rad > octs/model_suns.oct

time rcontrib < data/photocells.pts -n $procs -I -ab 1 -ad 65536 -lw 1.52e-5 -dc 1 -dt 0 -dj 0 -st 1 -ss 0 -faf  \
	-e MF:6 -f reinhart.cal -b rbin -bn Nrbins -m solar \
	octs/model_suns.oct > matrices/directsun.dsmx

### Section 6.8 - Putting it all together
printf "\nCombining it all\n"
epw2wea skies/USA_CA_Oakland.Intl.AP.724930_TMY3.epw skies/OakLand.wea
gendaymtx -of skies/OakLand.wea > matrices/OakLand.smx
gendaymtx -of -d skies/OakLand.wea > matrices/OakLand_direct.smx
gendaymtx -5 -d -m 6 -of skies/OakLand.wea > matrices/OakLand_direct_m6.smx

time dctimestep -n 8760 -if matrices/viewmatrix.vmx bsdf/fullwindow.xml  \
	matrices/daylightmatrix.dmx matrices/OakLand.smx | \
	rcollate -h -oc 1 > i_3ph.txt

time dctimestep -n 8760 -if  matrices/viewmatrix_direct.vmx bsdf/fullwindow.xml  \
	matrices/daylightmatrix_direct.dmx matrices/OakLand_direct.smx | \
	rcollate -h -oc 1 > i_ds3ph.txt

time dctimestep -n 8760 -if matrices/directsun.dsmx matrices/OakLand_direct_m6.smx | \
	rcollate -h -oc 1 > i_ds5ph.txt

rlam i_3ph.txt i_ds3ph.txt i_ds5ph.txt | \
	rcalc -e 'r=$1-$4+$7;g=$2-$5+$8;b=$3-$6+$9' \
	-e '$1=179*(.265*r+.670*g+.065*b)' | \
	rcollate -h -fa1 -ic 8760 -t > illum.txt

printf "\nAll done with example 1!  look at illum.txt for the result.\n"


printf "\n\n\nDoing 5-phase simulation for rendering...\n"
### 7.1	View matrix (V)
printf "\nView Matrix...\n"
time vwrays -vf views/back.vf  -ff -x 500 -y 500 \
	| rcontrib `vwrays -vf views/back.vf  -x 500 -y 500 -d` -n $procs -ffc -fo -o viewpics/back_%03d.hdr \
		-f klems_int.cal -b kbinS -bn Nkbins -m viewsurf \
		-ab 10 -ad 65536 -lw 1.52e-5 octs/model_3ph.oct

### 7.2	Direct view matrix (Vd)	
printf "\nDirect View Matrix...\n"	
time vwrays -vf views/back.vf  -ff -x 500 -y 500 \
	| rcontrib `vwrays -vf views/back.vf  -x 500 -y 500 -d` -n $procs -ffc -fo -o viewpics_dir/back_%03d.hdr \
		-f klems_int.cal -b kbinS -bn Nkbins -m viewsurf \
		-ab 1 -ad 65536 -lw 1.52e-5 octs/model_3ph.oct

### 7.5	Direct sun coefficient matrix (Cds)
printf "\nDirect Coefficient Matrix...\n"
ulimit -n 9999
xform -m black objects/testroom_Swall.rad objects/testroom.rad objects/ground.rad | \
	oconv materials/testroom.mat - objects/venetianblind.rad > octs/model_nosuns.oct
time vwrays -c 4 -pj 1 -fa -vf views/back.vf -x 500 -y 500 | \
	rtrace -h- -opn -faa -ab 0 octs/model_nosuns.oct | \
	rcontrib `vwrays -vf views/back.vf -x 500 -y 500 -d` -n $procs -fac -fo -o viewpics_ds/back_%04d.hdr \
	-e MF:6 -f reinhart.cal -b rbin -bn Nrbins -m solar -c 4 -I -ab 1 -ad 100 -dt 0 -dc 1 -lw 1e-2 octs/model_suns.oct

oconv materials/testroom.mat objects/testroom_Swall.rad objects/testroom.rad \
	objects/ground.rad objects/glazing.rad objects/venetianblind.rad \
	objects/daymtxsurf.rad > octs/model_material.oct
time rpict -x 1000 -y 1000 -vf views/back.vf -ps 1 -pj 1 -av 0.31831 0.31831 0.31831 -aa 0 \
	octs/model_material.oct | pfilt -x /2 -y /2 -1 -e 1 > materialmap.hdr  

### 7.6	Putting it all together
printf "\nPutting it together...\n"
time dctimestep -n 8760 -if -o hourlypics/back_%04d.hdr viewpics/back_%03d.hdr \
	bsdf/fullwindow.xml matrices/daylightmatrix.dmx matrices/OakLand.smx 

time dctimestep -n 8760 -if -o hourlypics_dir/back_%04d.hdr viewpics_dir/back_%03d.hdr \
	bsdf/fullwindow.xml matrices/daylightmatrix_direct.dmx matrices/OakLand_direct.smx 

time dctimestep -n 8760 -if -o hourlypics_ds/back_%04d.hdr viewpics_ds/back_%04d.hdr \
	matrices/OakLand_direct_m6.smx

time for t in {1..8760} 
do ts=`printf %04d $t `
pcomb -e 'lo=li(1)-li(2)+li(3)*li(4)' -o hourlypics/back_${ts}.hdr -o hourlypics_dir/back_${ts}.hdr \
	-o hourlypics_ds/back_${ts}.hdr -o materialmap.hdr > hourlyresult/back_${ts}.hdr 
done
printf "\nAll Done with 5-phase Rendering sim\n"
pcond hourlyresult/back_0015.hdr | ximage &""")  # disabled

cluster = Cluster(L=execute_ssh_async_4.Stdout)
cluster_2 = Cluster(L=overrides_4.Output)
panel_35 = Panel(cluster)
execute_ssh_async_5 = ExecuteSSHAsync(SSHCommands=overrides_4.Output, addPrefix=True, addSuffix=True, fireLogs=False, suppressWarnings=False)  # -> Stdout, Stderr, Log, Pid, Ran
panel_36 = Panel(cluster_2)
cluster_3 = Cluster(L=execute_ssh_async_5.Stdout)
item = ListItem(List=flatten(execute_ssh_async_5.Stdout), Index=0, Wrap=True)  # -> Item, Item1
panel_37 = Panel(cluster_3)

vertical_offset = Panel("0.75m")
grid_size = Panel("0.5m")
docunits = ConvertToDocumentUnits(ValueString=vertical_offset)
docunits_2 = ConvertToDocumentUnits(ValueString=grid_size)

imageviewer = LBImageViewer(ImagePath_=item.Item1, _scale_=1, DisableClickable=False, SaveImgWithCoords=False, scale=1)  # -> ImagePath, Values, GIF
panel_38 = Panel(execute_ssh_async_5.Stderr)

# ----
# Setting up grid points
cull = CullPattern(List=graft(layer_name), CullPattern=graft(python.is_grid))  # -> simplify(List)
cull_2 = CullPattern(List=geo, CullPattern=python.is_grid)
grid_size_2 = Number(docunits_2)
clean = CleanTree(RemoveNulls=True, RemoveInvalid=True, RemoveEmpty=True, Tree=cull, SynchronousTree1=simplify(cull_2))  # -> Tree, SynchronousTree1
custom_mesh_settings = SettingsCustom(
    StitchSeams=True,
    SimplePlanes=False,
    Refine=True,
    MinCount=16,
    MaxCount=400,
    AspectRatio=20,
    MaxDistance=0,
    MaxAngle=20,
    MinEdge=grid_size_2,
    MaxEdge=grid_size_2)
offset = Number(docunits)
rectangle = Rectangle(Plane=PlaneXY(0, 0, 0), XSize=Domain(-1, 1), YSize=Domain(-2, 2), Radius=0)  # -> Rectangle, Length
geo_2 = Geometry(graft(clean.SynchronousTree1))
flip = Flip(Surface=geo_2, Guide=rectangle.Rectangle)  # -> Surface, Result
mesh_2 = MeshBrep(Brep=flip.Surface, Settings=custom_mesh_settings)
normals = Normals(geo=flip.Surface, amplitude=offset)  # -> center_2, norm_2, P
move = Move(Geometry=mesh_2, Motion=normals.norm_2)  # -> Geometry, Transform
facen_2 = FaceNormals(Mesh=move.Geometry)  # -> Centers, Normals

# ----
# opaque geometries
cull_3 = CullPattern(List=graft(layer_name), CullPattern=graft(python.is_opaque))  # -> simplify(List)
cull_4 = CullPattern(List=geo, CullPattern=graft(python.is_opaque))  # -> simplify(List)
panel_39 = Panel(cull_3)
python_2 = GhPythonScript(layer_name=panel_39)  # -> out, reflectance
# ---------- python_2: Python ----------
__author__ = "mm1013"
__version__ = "2022.01.16"

import rhinoscriptsyntax as rs
try:
    reflectance = layer_name.split("_")[-1]
    
except:
    reflectance = None
# ---------- end python_2 ----------
clean_2 = CleanTree(
    RemoveNulls=True,
    RemoveInvalid=True,
    RemoveEmpty=True,
    Tree=cull_3,
    SynchronousTree1=cull_4,
    SynchronousTree2=python_2.reflectance)  # -> Tree, SynchronousTree1, SynchronousTree2
geo_3 = Geometry(clean_2.SynchronousTree1)
refl = Number(clean_2.SynchronousTree2)
panel_40 = Panel(refl)
name = Text(clean_2.Tree)
concat = Concatenate(FragmentA=name, FragmentB="_mat")

imageviewer_2 = LBImageViewer(ImagePath_=item.Item, _scale_=1, DisableClickable=False, SaveImgWithCoords=False, scale=1)  # -> ImagePath, Values, GIF

# ----
# Glass geometries
cull_5 = CullPattern(List=graft(layer_name), CullPattern=graft(python.is_transparent))  # -> simplify(List)
cull_6 = CullPattern(List=geo, CullPattern=python.is_transparent)
python_3 = GhPythonScript(layer_name=cull_5)  # -> out, transmittance, name
# ---------- python_3: Python ----------
__author__ = "mm1013"
__version__ = "2022.01.16"

import rhinoscriptsyntax as rs

try:
    transmittance = layer_name.split("_")[-1].replace("%","")
    name = layer_name.replace("%","")
except:
    transmittance = None
    name = None
# ---------- end python_3 ----------
clean_3 = CleanTree(
    RemoveNulls=True,
    RemoveInvalid=True,
    RemoveEmpty=True,
    Tree=simplify(cull_6),
    SynchronousTree1=simplify(python_3.name),
    SynchronousTree2=simplify(python_3.transmittance))  # -> Tree, SynchronousTree1, SynchronousTree2
mesh_3 = MeshBrep(
    Brep=clean_3.Tree,
    Settings={GridMaxCount=0, GridMinCount=16, JaggedSeams=False, MaxEdgeLength=0, MinEdgeLength=0.0001, MinTolerance=0, Refine=True, RefineAngle=0, RelativeTolerance=0.65, SimplePlanes=True, Tolerance=0})
transmittance = Number(expr("x/100", clean_3.SynchronousTree2))
name_2 = Text(clean_3.SynchronousTree1)
geo_4 = Geometry(mesh_3)
panel_41 = Panel(name_2)
mesh_4 = Mesh(geo_4)
concat_2 = Concatenate(FragmentA=panel_41, FragmentB="_mat")

# ----
# export PATH=$PATH.:/usr/local/radiance/bin
# export RAYPATH=.:/usr/local/radiance/lib
# obj2rad -m /home/mss/simulation/mapping.map -f /home/mss/simulation/twoMeshes4.obj 2>&1 1>/home/mss/simulation/x.rad
# head /home/mss/simulation/x.rad
panel_42 = Panel("""export PATH=$PATH.:/usr/local/radiance/bin
export RAYPATH=.:/usr/local/radiance/lib
objline ~/simulation/twoMeshes5.rad | meta2tga -x 1048 -y 1048 | ra_t8 -r > ~/simulation/test.hdr
normtiff ~/simulation/test.hdr ~/simulation/test.tif
convert ~/simulation/test.tif ~/simulation/test.png
echo "C:\Users\mm1013\simulation\test.png"
""")  # disabled

start_raytracing_2ph_dds = LBFalseStartToggle(True)
prep_octrees = LBFalseStartToggle(True)
raytrace_2ph = Boolean(start_raytracing_2ph_dds)

# ----
# Create working folder
panel_43 = Panel("mkdir -p <proj>;echo <proj>")
applyglobals_4 = ApplyGlobals(Input=panel_43)  # -> Output, Pairs
execute_ssh_async_6 = ExecuteSSHAsync(
    _SSHCommands_=applyglobals_4.Output,
    Run=prep_octrees,
    addPrefix=True,
    addSuffix=True,
    description="mkdir -p ~/simulation/test_project2;echo ~/simulation/test_project2",
    fireLogs=False,
    name="Create folders",
    stdouts="/home/mss/simulation/test_project2",
    suppressWarnings=False)  # -> Stdout, Stderr_, Log, Pid, Ran

falsestart_3 = LBFalseStartToggle(False)  # disabled
execute_ssh_async_7 = ExecuteSSHAsync(SSHCommands=panel_42, Run=falsestart_3, addPrefix=True, addSuffix=True, fireLogs=False, suppressWarnings=False)  # -> Stdout, Stderr, Log, Pid, Ran; disabled

overrides_5 = ApplyOverrides(Input="<projfolder>/radFiles")  # -> Output, Pairs
overrides_6 = ApplyOverrides(Input="<projfolder>")  # -> Output, Pairs

# ---- group: floor geometries
floor = Geometry(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)

# ----
imageviewer_3 = LBImageViewer(ImagePath_=execute_ssh_async_7.Stdout, _scale_=1, DisableClickable=False, SaveImgWithCoords=False, scale=1)  # -> ImagePath, Values, GIF; disabled

# ----
# Grid
# grid points
geo_5 = Geometry(floor)
pt = Point(facen_2.Centers)
vec = Vector(facen_2.Normals)
area = Area(Geometry=geo_5)  # -> Area, Centroid
scale = Scale(Geometry=geo_5, Center=area.Centroid, Factor="1.3")  # -> Geometry, Transform
sdivide = DivideSurface(Surface=scale.Geometry, UCount=10, VCount=20)  # -> Points, Normals, Parameters
overrides_7 = ApplyOverrides(Input="<projfolder>")  # -> Output, Pairs
panel_44 = Panel(sdivide.Parameters)
lng = ListLength(List=flatten(pt))
points2pts = PointsToPts(
    Points=flatten(pt),
    Vectors=flatten(vec),
    Name="points",
    SubfolderOverride=overrides_7.Output,
    Run=execute_ssh_async_6.Ran)  # -> PtsFile, Run
ptscount = Integer(lng)
points_2 = Text(points2pts.PtsFile)

# ----
# Opaque geometry
names = Text(name)
mesh2obj_2 = MeshToObj(
    Mesh=geo_3,
    Name=graft(names),
    MapFileName="mapping_opaque",
    ModifierName=graft(concat),
    SubfolderOverride=overrides_6.Output,
    Run=execute_ssh_async_6.Ran)  # -> ObjFiles, MapFile, Run
obj2rad = ObjToRad(
    ObjFiles=mesh2obj_2.ObjFiles,
    MapFile=mesh2obj_2.MapFile,
    SubfolderOverride=overrides_5.Output,
    Run=mesh2obj_2.Run,
    stdouts="~/simulation/test_project2/radFiles/Ceiling_70.rad>JOIN<~/simulation/test_project2/radFiles/Floor_20.rad>JOIN<~/simulation/test_project2/radFiles/Context_25.rad>JOIN<~/simulation/test_project2/radFiles/Wall_50.rad>JOIN<~/simulation/test_project2/radFiles/Frames_70.rad>JOIN<~/simulation/test_project2/radFiles/Terrain_20.rad")  # -> Status, RadFiles, Run
opaque_rad = Text(obj2rad.RadFiles)

panel_45 = Panel(execute_ssh_async_7.Stderr)  # disabled

# ----
# rad files
# Window geometry
panel_46 = Panel("mapping_windows")
mesh2obj_3 = MeshToObj(
    Mesh=mesh_4,
    Name=graft(panel_41),
    MapFileName=panel_46,
    ModifierName=graft(concat_2),
    SubfolderOverride=overrides_6.Output,
    Run=execute_ssh_async_6.Ran)  # -> ObjFiles, MapFile, Run
obj2rad_2 = ObjToRad(
    ObjFiles=mesh2obj_3.ObjFiles,
    MapFile=mesh2obj_3.MapFile,
    SubfolderOverride=overrides_5.Output,
    Run=mesh2obj_3.Run,
    stdouts="~/simulation/test_project2/radFiles/Glass_50.rad")  # -> Status, RadFiles, Run
window_rad = Text(obj2rad_2.RadFiles)

# ----
# sun primitive
panel_47 = Panel("""echo "void light solar 0 0 3 1e6 1e6 1e6" > <target>
echo "<target>"
""")
overrides_8 = ApplyOverrides(Input_=panel_47, Target="<LinuxHome>/suns.rad")  # -> Output, Pairs
execute_ssh_async_8 = ExecuteSSHAsync(
    _SSHCommands_=overrides_8.Output,
    Run=execute_ssh_async_6.Ran,
    addPrefix=True,
    addSuffix=True,
    description="echo \"void light solar 0 0 3 1e6 1e6 1e6\" > ~/simulation/suns.rad;echo \"~/simulation/suns.rad\"",
    fireLogs=False,
    name="Sun primitive",
    stdouts="~/simulation/suns.rad",
    suppressWarnings=False)  # -> Stdout, Stderr_, Log, Pid, Ran

# ----
# opaque materials
panel_48 = Panel("echo \"<mats>\" > <proj>/radFiles/<target>;echo \"<proj>/radFiles/<target>\"")
opaquegreymat = OpaqueGreyMat(Name=concat, Reflectance_0_1=refl, Specularity=0, Roughness=0)  # -> flatten(RadMaterials), RadMaterialList
join_2 = TextJoin(Text=opaquegreymat.RadMaterials)
overrides_9 = ApplyOverrides(Input_=panel_48, Mats=join_2, Target="opaque_materials.mat")  # -> Output, Pairs
execute_ssh_async_9 = ExecuteSSHAsync(
    SSHCommands_=overrides_9.Output,
    Run=obj2rad.Run,
    addPrefix=False,
    addSuffix=True,
    description="""echo "void plastic Terrain_20_mat
0
0
5 0.200 0.200 0.200 0.000 0.000
void plastic Frames_70_mat
0
0
5 0.700 0.700 0.700 0.000 0.000
void plastic Wall_50_mat
0
0
5 0.500 0.500 0.500 0.000 0.000
void plastic Context_25_mat
0
0
5 0.250 0.250 0.250 0.000 0.000
void plastic Floor_20_mat
0
0
5 0.200 0.200 0.200 0.000 0.000
void plastic Ceiling_70_mat
0
0
5 0.700 0.700 0.700 0.000 0.000" > ~/simulation/test_project2/radFiles/opaque_materials.mat;echo "~/simulation/test_project2/radFiles/opaque_materials.mat"
""",
    fireLogs=False,
    name="Opaque Materials",
    stdouts="~/simulation/test_project2/radFiles/opaque_materials.mat",
    suppressWarnings=False)  # -> Stdout, Stderr_, Log, Pid, Ran
opaque_mat = Text(execute_ssh_async_9.Stdout)

# ----
# blackmaterials
panel_49 = Panel("blackMaterial")
panel_50 = Panel("echo \"<mats>\" > <proj>/radFiles/<target>;echo \"<proj>/radFiles/<target>\"")
blackmatname = Text(panel_49)
opaquegreymat_2 = OpaqueGreyMat(Name=flatten(blackmatname), Reflectance_0_1="0.0", Specularity=0, Roughness=0)  # -> RadMaterials, RadMaterialList
overrides_10 = ApplyOverrides(Input_=panel_50, Mats=opaquegreymat_2.RadMaterials, Target="black_material.mat")  # -> Output, Pairs
execute_ssh_async_10 = ExecuteSSHAsync(
    _SSHCommands_=overrides_10.Output,
    Run=execute_ssh_async_6.Ran,
    addPrefix=True,
    addSuffix=True,
    description="""echo "void plastic blackMaterial
0
0
5 0.000 0.000 0.000 0.000 0.000" > ~/simulation/test_project2/radFiles/black_material.mat;echo "~/simulation/test_project2/radFiles/black_material.mat"
""",
    fireLogs=False,
    name="Black Materials",
    staticDescription="""echo "void plastic blackMaterial
0
0
5 0.000 0.000 0.000 0.000 0.000" > ~/simulation/test_project2/radFiles/black_material.mat;echo "~/simulation/testfefe_project2/radFiles/black_material.mat"
""",
    stdouts="~/simulation/test_project2/radFiles/black_material.mat",
    suppressWarnings=False)  # -> Stdout, Stderr_, Log, Pid, Ran
black_mat = Text(execute_ssh_async_10.Stdout)

names_2 = Text(names)
panel_51 = Panel("xform -m <blackmat> <proj>/radFiles/<name>.rad > <proj>/radFiles/<name>_black.rad;echo \"<proj>/radFiles/<name>_black.rad\"")
overrides_11 = ApplyOverrides(Input_=panel_51, Name=names_2, Blackmat=blackmatname)  # -> Output, Pairs
execute_ssh_async_11 = ExecuteSSHAsync(
    _SSHCommands_=overrides_11.Output,
    Run=execute_ssh_async_6.Ran,
    addPrefix=True,
    addSuffix=True,
    description="""xform -m blackMaterial ~/simulation/test_project2/radFiles/Terrain_20.rad > ~/simulation/test_project2/radFiles/Terrain_20_black.rad;echo "~/simulation/test_project2/radFiles/Terrain_20_black.rad"
xform -m blackMaterial ~/simulation/test_project2/radFiles/Frames_70.rad > ~/simulation/test_project2/radFiles/Frames_70_black.rad;echo "~/simulation/test_project2/radFiles/Frames_70_black.rad"
xform -m blackMaterial ~/simulation/test_project2/radFiles/Wall_50.rad > ~/simulation/test_project2/radFiles/Wall_50_black.rad;echo "~/simulation/test_project2/radFiles/Wall_50_black.rad"
xform -m blackMaterial ~/simulation/test_project2/radFiles/Context_25.rad > ~/simulation/test_project2/radFiles/Context_25_black.rad;echo "~/simulation/test_project2/radFiles/Context_25_black.rad"
xform -m blackMaterial ~/simulation/test_project2/radFiles/Floor_20.rad > ~/simulation/test_project2/radFiles/Floor_20_black.rad;echo "~/simulation/test_project2/radFiles/Floor_20_black.rad"
xform -m blackMaterial ~/simulation/test_project2/radFiles/Ceiling_70.rad > ~/simulation/test_project2/radFiles/Ceiling_70_black.rad;echo "~/simulation/test_project2/radFiles/Ceiling_70_black.rad"
""",
    fireLogs=False,
    name="Black Materials",
    staticDescription="""echo "void plastic blackMaterial
0
0
5 0.000 0.000 0.000 0.000 0.000" > ~/simulation/test_project2/radFiles/black_material.mat;echo "~/simulation/testfefe_project2/radFiles/black_material.mat"
""",
    stdouts="~/simulation/test_project2/radFiles/Terrain_20_black.rad>JOIN<~/simulation/test_project2/radFiles/Frames_70_black.rad>JOIN<~/simulation/test_project2/radFiles/Wall_50_black.rad>JOIN<~/simulation/test_project2/radFiles/Context_25_black.rad>JOIN<~/simulation/test_project2/radFiles/Floor_20_black.rad>JOIN<~/simulation/test_project2/radFiles/Ceiling_70_black.rad",
    suppressWarnings=False)  # -> Stdout, Stderr_, Log, Pid, Ran
black_rad_files = Text(execute_ssh_async_11.Stdout)

# ----
# Setup glass materials
glassmat = GlassMat(Name=concat_2, Transmittance_0_1=transmittance)  # -> RadMaterials, RadMaterialList
# materials
panel_52 = Panel("echo \"<mats>\" > <proj>/radFiles/<target>;echo \"<proj>/radFiles/<target>\"")
overrides_12 = ApplyOverrides(Input_=panel_52, Mats=glassmat.RadMaterials, Target="glass_materials.mat")  # -> Output, Pairs
execute_ssh_async_12 = ExecuteSSHAsync(
    _SSHCommands_=overrides_12.Output,
    Run=obj2rad.Run,
    addPrefix=True,
    addSuffix=True,
    description="""echo "void glass Glass_50_mat
0
0
3 0.545 0.545 0.545" > ~/simulation/test_project2/radFiles/glass_materials.mat;echo "~/simulation/test_project2/radFiles/glass_materials.mat"
""",
    fireLogs=False,
    name="Glass Materials",
    stdouts="~/simulation/test_project2/radFiles/glass_materials.mat",
    suppressWarnings=False)  # -> Stdout, Stderr_, Log, Pid, Ran
window_mat = Text(execute_ssh_async_12.Stdout)

# ----
# Sun
panel_53 = Panel("""cnt 5165 | rcalc -e MF:6 -f reinsrc.cal -e Rbin=recno -o 'solar source sun 0 0 4 ${Dx} ${Dy} ${Dz} 0.553' >> <target>
echo <target>""")

# ----
# solar discs and modifiers for 5165 suns (=MF:6)
overrides_13 = ApplyOverrides(Input_=panel_53, Target=execute_ssh_async_8.Stdout)  # -> Output, Pairs
execute_ssh_async_13 = ExecuteSSHAsync(
    _SSHCommands_=overrides_13.Output,
    Run=execute_ssh_async_8.Ran,
    addPrefix=True,
    addSuffix=True,
    description="cnt 5165 | rcalc -e MF:6 -f reinsrc.cal -e Rbin=recno -o 'solar source sun 0 0 4 ${Dx} ${Dy} ${Dz} 0.553' >> ~/simulation/suns.rad;echo ~/simulation/suns.rad",
    fireLogs=False,
    name="Solar Dics",
    stdouts="/home/mss/simulation/suns.rad",
    suppressWarnings=False)  # -> Stdout, Stderr_, Log, Pid, Ran

# ----
# -f is frozen (all links embedded)
panel_54 = Panel("""mkdir -p <proj>/octrees
oconv -f <rads> > <proj>/octrees/<target>.oct;echo <proj>/octrees/<target>.oct""")

# ----
# create black octree
black_rad_files_2 = Text(black_rad_files)
window_mat_2 = Text(window_mat)
window_rad_2 = Text(window_rad)
black_mat_2 = Text(black_mat)
and = GateAnd(A=execute_ssh_async_12.Ran, B=execute_ssh_async_10.Ran)
panel_55 = Panel("""mkdir -p <proj>/octrees
oconv -f <rads> > <proj>/octrees/my_geometry_black.oct;echo <proj>/octrees/my_geometry_black.oct""")
entwine = Entwine(Branch02=black_mat_2, Branch03=black_rad_files_2, FlattenInputs=True)  # -> flatten(Result)
join_3 = TextJoin(Text=flatten(entwine), Join=" ")
overrides_14 = ApplyOverrides(Input=panel_55, Rads=join_3)  # -> Output, Pairs
execute_ssh_async_14 = ExecuteSSHAsync(
    _SSHCommands_=overrides_14.Output,
    Run=and,
    addPrefix=True,
    addSuffix=True,
    description="""mkdir -p ~/simulation/test_project2/octrees
oconv -f ~/simulation/test_project2/radFiles/black_material.mat ~/simulation/test_project2/radFiles/Terrain_20_black.rad ~/simulation/test_project2/radFiles/Frames_70_black.rad ~/simulation/test_project2/radFiles/Wall_50_black.rad ~/simulation/test_project2/radFiles/Context_25_black.rad ~/simulation/test_project2/radFiles/Floor_20_black.rad ~/simulation/test_project2/radFiles/Ceiling_70_black.rad > ~/simulation/test_project2/octrees/my_geometry_black.oct;echo ~/simulation/test_project2/octrees/my_geometry_black.oct""",
    fireLogs=False,
    name="Black Octree",
    stdouts="/home/mss/simulation/test_project2/octrees/my_geometry_black.oct",
    suppressWarnings=False)  # -> Stdout, Stderr_, Log, Pid, Ran
panel_56 = Panel(execute_ssh_async_14.Stdout)
octree_black = Text(execute_ssh_async_14.Stdout)

# ----
# Create skyglow.rad
panel_57 = Panel("""#@rfluxmtx u=+Y h=u
void glow groundglow
0
0
4 1 1 1 0

groundglow source ground
0
0
4 0 0 -1 180

#@rfluxmtx u=+Y h=r1
void glow skyglow
0
0
4 1 1 1 0

skyglow source skydome
0
0
4 0 0 1 180""")
panel_58 = Panel("""mkdir -p <proj>/radFiles
echo "<skyglow>" > <proj>/radFiles/<target>; echo <proj>/radFiles/<target>""")
overrides_15 = ApplyOverrides(Input=panel_58, Skyglow=panel_57, Target="skyglow.rad")  # -> Output, Pairs
execute_ssh_async_15 = ExecuteSSHAsync(
    _SSHCommands_=overrides_15.Output,
    Run=execute_ssh_async_6.Ran,
    addPrefix=True,
    addSuffix=True,
    description="""mkdir -p ~/simulation/test_project2/radFiles
echo "#@rfluxmtx u=+Y h=u
void glow groundglow
0
0
4 1 1 1 0

groundglow source ground
0
0
4 0 0 -1 180

#@rfluxmtx u=+Y h=r1
void glow skyglow
0
0
4 1 1 1 0

skyglow source skydome
0
0
4 0 0 1 180" > ~/simulation/test_project2/radFiles/skyglow.rad; echo ~/simulation/test_project2/radFiles/skyglow.rad""",
    fireLogs=False,
    stdouts="/home/mss/simulation/test_project2/radFiles/skyglow.rad",
    suppressWarnings=False)  # -> Stdout, Stderr_, Log, Pid, Ran
overrides_16 = ApplyOverrides(Input="head <proj>/radFiles/<target>", Target="skyglow.rad")  # -> Output, Pairs
execute_ssh_async_16 = ExecuteSSHAsync(
    _SSHCommands_=overrides_16.Output,
    Run=execute_ssh_async_15.Ran,
    addPrefix=True,
    addSuffix=True,
    description="head ~/simulation/test_project2/radFiles/skyglow.rad",
    fireLogs=False,
    stdouts="""#@rfluxmtx u=+Y h=u
void glow groundglow
0
0
4 1 1 1 0

groundglow source ground
0
0
4 0 0 -1 180""",
    suppressWarnings=False)  # -> Stdout, Stderr_, Log, Pid, Ran
panel_59 = Panel(execute_ssh_async_15.Stdout)
panel_60 = Panel(execute_ssh_async_16.Stdout)
skyglow = Text(execute_ssh_async_15.Stdout)

# ----
# preview pts files
# opt1 - cat directly from linux
panel_61 = Panel("cat <pts>")
points_3 = Text(points_2)
overrides_17 = ApplyOverrides(Input_=panel_61, Pts=points_3)  # -> Output, Pairs
execute_ssh_async_17 = ExecuteSSHAsync(
    _SSHCommands_=overrides_17.Output,
    Run=Toggle(True),
    addPrefix=True,
    addSuffix=True,
    description="cat /home/mss/simulation/test_project2/points.pts",
    fireLogs=False,
    stdouts="""-10408 -15348 3750 0 0 1
-10853 -15684 3750 0 0 1
-11299 -16020 3750 0 0 1
-11744 -16356 3750 0 0 1
-12190 -16691 3750 0 0 1
-10742 -14904 3750 0 0 1
-11188 -15240 3750 0 0 1
-11633 -15576 3750 0 0 1
-12079 -15911 3750 0 0 1
-12524 -16247 3750 0 0 1
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""",
    suppressWarnings=False)  # -> Stdout, Stderr_, Log, Pid, Ran
ptsview = PtsViewer(PtsString=execute_ssh_async_17.Stdout)  # disabled

# ----
# opt2 - read local windows pts file
points_4 = Text(points_2)
convertpaths = ConvertPaths(I=points_4)  # -> Linux, Windows
ptsview_2 = PtsViewer(PtsString=convertpaths.Windows)

button = Button()
view = CreateView(Viewport="Perspective", Update=button)  # -> ViewfileContent, ImageRatio
panel_62 = Panel(view.ViewfileContent)

panel_63 = Panel("""C:\Users\mm1013\simulation\NRH_J_Para_LT06_Lysning07_WWR055_Facades03\daylight_factor\model\scene\envelope.mat
C:\Users\mm1013\simulation\NRH_J_Para_LT06_Lysning07_WWR055_Facades03\daylight_factor\model\scene\envelope.rad""")  # disabled

view_2 = CreateView(Viewport="MyCamera")  # -> ViewfileContent, ImageRatio
panel_64 = Panel(view_2.ViewfileContent)

radviewer = RadViewer(RadFiles=panel_63, IsTwoSided=True, ShowEdges=True, Transparent=True)  # -> Meshes, Names, ModifierNames, Modifiers, FailedWireFrame; disabled
falsestart_4 = LBFalseStartToggle(False)
crv = Curve(radviewer.FailedWireFrame)  # disabled
panel_65 = Panel(radviewer.Modifiers)
points_5 = Text(points_2)
analysisperiod = LBAnalysisPeriod(start_month=1, start_day=1, start_hour="8", end_hour="18")  # -> period, hoys, dates; plug-in component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
pt_2 = Point(flatten(pt))
Z = UnitZ(Factor=1)
long = LongestList(ListA=pt_2, ListB=Z, PaddingMode=2)  # -> ListA, ListB
honeybee = Honeybee_Honeybee()  # -> Vviiiiiiiiiizzz; plug-in component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
toggle_3 = BooleanToggle(False)
pt_3 = Point(pt_2)
falsestart_5 = LBFalseStartToggle(False)
applyglobals_5 = ApplyGlobals(Input="[ -f <file> ] && echo \"1\" || echo \"0\"", AdditionalKeys="file", AdditionalValues="~/simulation/points.pts2")  # -> Output, Pairs
execute_ssh_async_18 = ExecuteSSHAsync(
    _SSHCommands_=applyglobals_5.Output,
    Run=falsestart_5,
    addPrefix=True,
    addSuffix=True,
    fireLogs=False,
    suppressWarnings=False)  # -> Stdout, Stderr_, Log, Pid, Ran
panel_66 = Panel(execute_ssh_async_18.Stdout)

panel_67 = Panel("cat ~/.bashrc")  # disabled
panel_68 = Panel("dwd | tee ~/simulation/log.txt")  # disabled
falsestart_6 = LBFalseStartToggle(False)  # disabled

execute_ssh_async_19 = ExecuteSSHAsync(
    SSHCommands=[panel_67, panel_68],
    Run=falsestart_6,
    addPrefix=True,
    addSuffix=True,
    fireLogs=False,
    suppressWarnings=False)  # -> Stdout, Stderr, Log, Pid, Ran; disabled

panel_69 = Panel(execute_ssh_async_19.Stdout)  # disabled
panel_70 = Panel(execute_ssh_async_19.Log)  # disabled
panel_71 = Panel(execute_ssh_async_19.Stderr)  # disabled

# ----
# Check if ximage and other x-commands work.
# Must have Xlaunch running on windows with disabled access control
# Otherwise it will crash!
panel_72 = Panel("""export "DISPLAY=$(ip route list default | awk '{print $3}'):0"
export "LIBGL_ALWAYS_INDIRECT=1"
xclock""")
falsestart_7 = LBFalseStartToggle(False)

execute_ssh_async_20 = ExecuteSSHAsync(_SSHCommands_=panel_72, Run=falsestart_7, addPrefix=True, addSuffix=True, fireLogs=False, suppressWarnings=False)  # -> Stdout, Stderr_, Log, Pid, Ran
panel_73 = Panel(execute_ssh_async_20.Log)

panel_74 = Panel(execute_ssh_async_20.Stderr_)

# ----
# WEA file
# create WEA file
panel_75 = Panel("<LinuxHome>/weatherData")
path = FilePath("C:\ladybug\NOR_OS_Alna.014870_TMYx.2004-2018\NOR_OS_Alna.014870_TMYx.2004-2018.epw")
overrides_18 = ApplyOverrides(Input_=panel_75)  # -> Output, Pairs

python_4 = GhPythonScript(x=overrides_18.Output)  # -> a
# ---------- python_4: Python ----------
__author__ = "mm1013"
__version__ = "2022.07.02"

import rhinoscriptsyntax as rs

a = x[1:]
# ---------- end python_4 ----------

upload = Upload(
    LocalFilePaths=path,
    SubfolderOverride=python_4,
    Run=execute_ssh_async_6.Ran,
    stdouts="~/simulation/weatherData/NOR_OS_Alna.014870_TMYx.2004-2018.epw")  # -> Status, FilePaths, Run
overrides_19 = ApplyOverrides(Input_="epw2wea <epw> <epw-.>.wea 1>&2;echo <epw-.>.wea", Epw=upload.FilePaths)  # -> Output, Pairs
execute_ssh_async_21 = ExecuteSSHAsync(
    _SSHCommands_=overrides_19.Output,
    Run=upload.Run,
    addPrefix=True,
    addSuffix=True,
    description="epw2wea ~/simulation/weatherData/NOR_OS_Alna.014870_TMYx.2004-2018.epw ~/simulation/weatherData/NOR_OS_Alna.014870_TMYx.2004-2018.wea 1>&2;echo ~/simulation/weatherData/NOR_OS_Alna.014870_TMYx.2004-2018.wea",
    fireLogs=False,
    stdouts="/home/mss/simulation/weatherData/NOR_OS_Alna.014870_TMYx.2004-2018.wea",
    suppressWarnings=True)  # -> Stdout, Stderr, Log, Pid, Ran
panel_76 = Panel(execute_ssh_async_21.Stdout)
panel_77 = Panel(execute_ssh_async_21.Stderr)
wea_file = Text(execute_ssh_async_21.Stdout)

file_exists = Panel("[ -f <out> ] && echo \"1\" || echo \"0\"")  # disabled
panel_78 = Panel("out")  # disabled
applyglobals_6 = ApplyGlobals(Input=file_exists, AdditionalKeys=panel_78, AdditionalValues=execute_ssh_async_21.Stdout)  # -> Output, Pairs; disabled
execute_ssh_async_22 = ExecuteSSHAsync(
    SSHCommands=applyglobals_6.Output,
    Run=upload.Run,
    addPrefix=True,
    addSuffix=True,
    fireLogs=False,
    stdouts="1",
    suppressWarnings=False)  # -> Stdout, Stderr, Log, Pid, Ran; disabled

# ----
# Skies and Skymatrices
# Annual sky-matrix 145 patches
panel_79 = Panel("gendaymtx -m 1 \"<wea>\" > <wea-.>.smx;echo \"<wea-.>.smx\"")
wea_file_2 = Text(wea_file)
overrides_20 = ApplyOverrides(Input=panel_79, Wea=wea_file_2)  # -> Output, Pairs
execute_ssh_async_23 = ExecuteSSHAsync(
    _SSHCommands_=overrides_20.Output,
    Run=execute_ssh_async_21.Ran,
    addPrefix=True,
    addSuffix=True,
    description="gendaymtx -m 1 \"/home/mss/simulation/weatherData/NOR_OS_Alna.014870_TMYx.2004-2018.wea\" > /home/mss/simulation/weatherData/NOR_OS_Alna.014870_TMYx.2004-2018.smx;echo \"/home/mss/simulation/weatherData/NOR_OS_Alna.014870_TMYx.2004-2018.smx\"",
    fireLogs=False,
    name="Sky 145 patch",
    stdouts="/home/mss/simulation/weatherData/NOR_OS_Alna.014870_TMYx.2004-2018.smx",
    suppressWarnings=False)  # -> Stdout, Stderr_, Log, Pid, Ran
panel_80 = Panel(execute_ssh_async_23.Stdout)

# ----
# Annual direct only daylight matrix with 145 patches
panel_81 = Panel("gendaymtx -m 1 -d \"<wea>\" > <wea-.>.smx;echo \"<wea-.>.smx\"")
wea_file_3 = Text(wea_file)
overrides_21 = ApplyOverrides(Input=panel_81, Wea=wea_file_3)  # -> Output, Pairs
execute_ssh_async_24 = ExecuteSSHAsync(
    _SSHCommands_=overrides_21.Output,
    Run=execute_ssh_async_21.Ran,
    addPrefix=True,
    addSuffix=True,
    description="gendaymtx -m 1 -d \"/home/mss/simulation/weatherData/NOR_OS_Alna.014870_TMYx.2004-2018.wea\" > /home/mss/simulation/weatherData/NOR_OS_Alna.014870_TMYx.2004-2018.smx;echo \"/home/mss/simulation/weatherData/NOR_OS_Alna.014870_TMYx.2004-2018.smx\"",
    fireLogs=False,
    name="Sky 145 patch direct only",
    stdouts="/home/mss/simulation/weatherData/NOR_OS_Alna.014870_TMYx.2004-2018.smx",
    suppressWarnings=False)  # -> Stdout, Stderr_, Log, Pid, Ran
panel_82 = Panel(execute_ssh_async_24.Stdout)

# ----
# Sun matrix with 5165 suns
panel_83 = Panel("gendaymtx -5 0.533 -d -m 6 \"<wea>\" > <wea-.>.smx;echo \"<wea-.>.smx\"")
wea_file_4 = Text(wea_file)
overrides_22 = ApplyOverrides(Input=panel_83, Wea=wea_file_4)  # -> Output, Pairs
execute_ssh_async_25 = ExecuteSSHAsync(
    _SSHCommands_=overrides_22.Output,
    Run=execute_ssh_async_21.Ran,
    addPrefix=True,
    addSuffix=True,
    description="gendaymtx -5 0.533 -d -m 6 \"/home/mss/simulation/weatherData/NOR_OS_Alna.014870_TMYx.2004-2018.wea\" > /home/mss/simulation/weatherData/NOR_OS_Alna.014870_TMYx.2004-2018.smx;echo \"/home/mss/simulation/weatherData/NOR_OS_Alna.014870_TMYx.2004-2018.smx\"",
    fireLogs=False,
    name="Sky 5165",
    stdouts="/home/mss/simulation/weatherData/NOR_OS_Alna.014870_TMYx.2004-2018.smx",
    suppressWarnings=False)  # -> Stdout, Stderr_, Log, Pid, Ran
panel_84 = Panel(execute_ssh_async_25.Stdout)

# ----
# Getting results (dctimestep)
m6_sky_mtx = Text(panel_84)

# ----
# Octrees
# STANDARD octree
window_mat_3 = Text(window_mat)
opaque_mat_2 = Text(opaque_mat)
opaque_rad_2 = Text(opaque_rad)
window_rad_3 = Text(window_rad)
and_2 = GateAnd(A=execute_ssh_async_12.Ran, B=execute_ssh_async_9.Ran)
entwine_2 = Entwine(Branch00=window_mat_3, Branch01=window_rad_3, Branch02=opaque_mat_2, Branch03=opaque_rad_2, FlattenInputs=True)  # -> flatten(Result)
join_4 = TextJoin(Text=flatten(entwine_2), Join=" ")
overrides_23 = ApplyOverrides(Input_=panel_54, Rads=join_4, Target="my_geometry")  # -> Output, Pairs

execute_ssh_async_26 = ExecuteSSHAsync(
    _SSHCommands_=overrides_23.Output,
    Run=and_2,
    addPrefix=True,
    addSuffix=True,
    description="""mkdir -p ~/simulation/test_project2/octrees
oconv -f ~/simulation/test_project2/radFiles/glass_materials.mat ~/simulation/test_project2/radFiles/Glass_50.rad ~/simulation/test_project2/radFiles/opaque_materials.mat ~/simulation/test_project2/radFiles/Ceiling_70.rad ~/simulation/test_project2/radFiles/Floor_20.rad ~/simulation/test_project2/radFiles/Context_25.rad ~/simulation/test_project2/radFiles/Wall_50.rad ~/simulation/test_project2/radFiles/Frames_70.rad ~/simulation/test_project2/radFiles/Terrain_20.rad > ~/simulation/test_project2/octrees/my_geometry.oct;echo ~/simulation/test_project2/octrees/my_geometry.oct""",
    fireLogs=False,
    name="Standard Octree",
    stdouts="/home/mss/simulation/test_project2/octrees/my_geometry.oct",
    suppressWarnings=False)  # -> Stdout, Stderr_, Log, Pid, Ran
panel_85 = Panel(execute_ssh_async_26.Stdout)
octree = Text(execute_ssh_async_26.Stdout)

panel_86 = Panel(overrides_23.Output)

# ----
# preview rad files
convertpaths_2 = ConvertPaths(I=entwine_2)  # -> Linux, Windows
radviewer_2 = RadViewer(RadFiles=convertpaths_2.Windows, IsTwoSided=True, ShowEdges=False, Transparent=True)  # -> Meshes, Names, ModifierNames, Modifiers, FailedWireFrame

# ----
# 2phase DDS simulation
# NO GOOD METHOD (YET) OF MAKING SURE
# THESE 3 DONT RUN AT THE SAME TIME.
# 
# Unless we chain them (doing that as a temp fix)
# Raytracing (rfluxmtx)
# Generate daylight coefficients
# export PATH=$PATH.:/usr/local/radiance/bin
# export RAYPATH=.:/usr/local/radiance/lib
panel_87 = Panel("""mkdir -p <proj>/mtxs/
rfluxmtx -I+ -y <ptcount> -lw 0.0001 -ab 5 -ad 5000 -n <cpus> - <skyglow> -i <octree> < <points> > <proj>/mtxs/<target>;echo <proj>/mtxs/<target>""")
raytrace_2ph_2 = Boolean(raytrace_2ph)
ptscount_2 = Integer(ptscount)
and_3 = GateAnd(
    octree_ok=execute_ssh_async_26.Ran,
    skyglow_ok=execute_ssh_async_15.Ran,
    points_ok=points2pts.Run,
    raytrace=raytrace_2ph_2)
skyglow_2 = Text(skyglow)
octree_2 = Text(octree)
points_6 = Text(points_2)
overrides_24 = ApplyOverrides(Input_=panel_87, Ptcount=ptscount_2, Skyglow=skyglow_2, Octree=octree_2, Points=points_6, Target="dc_illum.mtx")  # -> Output, Pairs
execute_ssh_async_27 = ExecuteSSHAsync(
    _SSHCommands_=overrides_24.Output,
    Run=and_3,
    addPrefix=True,
    addSuffix=True,
    description="mkdir -p ~/simulation/test_project2/mtxs/;rfluxmtx -I+ -y 198 -lw 0.0001 -ab 5 -ad 5000 -n 5 - /home/mss/simulation/test_project2/radFiles/skyglow.rad -i /home/mss/simulation/test_project2/octrees/my_geometry.oct < /home/mss/simulation/test_project2/points.pts > ~/simulation/test_project2/mtxs/dc_illum.mtx;echo ~/simulation/test_project2/mtxs/dc_illum.mtx",
    fireLogs=False,
    stdouts="/home/mss/simulation/test_project2/mtxs/dc_illum.mtx",
    suppressWarnings=False)  # -> Stdout, Stderr_, Log, Pid, Ran
panel_88 = Panel(overrides_24.Output)
panel_89 = Panel(execute_ssh_async_27.Stdout)

# ----
# Generate daylight coefficients black (direct only)
panel_90 = Panel("dcd_illum.mtx")
panel_91 = Panel("""mkdir -p <proj>/mtxs/
rfluxmtx -I+ -y <ptcount> -lw 0.0002 -ab 1 -ad 5000 -n <cpus> - <skyglow> -i <octree> < <points> > <proj>/mtxs/<target>;echo <proj>/mtxs/<target>""")
octree_black_2 = Text(octree_black)
ptscount_3 = Integer(ptscount)
skyglow_3 = Text(skyglow)
points_7 = Text(points_2)
and_4 = GateAnd(
    octree_ok=execute_ssh_async_14.Ran,
    skyglow_ok=execute_ssh_async_14.Ran,
    points_ok=points2pts.Run,
    ran_above=execute_ssh_async_27.Ran)
overrides_25 = ApplyOverrides(Input=panel_91, Ptcount=ptscount_3, Skyglow=skyglow_3, Octree=octree_black_2, Points=points_7, Target=panel_90)  # -> Output, Pairs
execute_ssh_async_28 = ExecuteSSHAsync(
    _SSHCommands_=overrides_25.Output,
    Run=and_4,
    addPrefix=True,
    addSuffix=True,
    description="mkdir -p ~/simulation/test_project2/mtxs/;rfluxmtx -I+ -y 198 -lw 0.0002 -ab 1 -ad 5000 -n 5 - /home/mss/simulation/test_project2/radFiles/skyglow.rad -i /home/mss/simulation/test_project2/octrees/my_geometry_black.oct < /home/mss/simulation/test_project2/points.pts > ~/simulation/test_project2/mtxs/dcd_illum.mtx;echo ~/simulation/test_project2/mtxs/dcd_illum.mtx",
    fireLogs=False,
    stdouts="/home/mss/simulation/test_project2/mtxs/dcd_illum.mtx",
    suppressWarnings=False)  # -> Stdout, Stderr_, Log, Pid, Ran
panel_92 = Panel(overrides_25.Output)
panel_93 = Panel(execute_ssh_async_28.Stdout)

# ----
# Results of daylight coefficients
panel_94 = Panel("""mkdir -p <proj>/results/
dctimestep <dcillum> <skymtx> | rmtxop -fa -t -c 47.4 119.9 11.6 - > <proj>/results/<target>;echo <proj>/results/<target>""")
overrides_26 = ApplyOverrides(Input=panel_94, Dcillum=execute_ssh_async_27.Stdout, Skymtx=execute_ssh_async_23.Stdout, Target="annualR_DC.ill")  # -> Output, Pairs
and_5 = GateAnd(A=execute_ssh_async_27.Ran, B=execute_ssh_async_23.Ran)
execute_ssh_async_29 = ExecuteSSHAsync(
    _SSHCommands_=overrides_26.Output,
    Run=and_5,
    addPrefix=True,
    addSuffix=True,
    description="mkdir -p ~/simulation/test_project2/results/;dctimestep /home/mss/simulation/test_project2/mtxs/dc_illum.mtx /home/mss/simulation/weatherData/NOR_OS_Alna.014870_TMYx.2004-2018.smx | rmtxop -fa -t -c 47.4 119.9 11.6 - > ~/simulation/test_project2/results/annualR_DC.ill;echo ~/simulation/test_project2/results/annualR_DC.ill",
    fireLogs=False,
    stdouts="/home/mss/simulation/test_project2/results/annualR_DC.ill",
    suppressWarnings=False)  # -> Stdout, Stderr_, Log, Pid, Ran
panel_95 = Panel(execute_ssh_async_29.Stderr_)

# ----
# - Results of daylight coefficients (direct from 145 sample sky)
panel_96 = Panel("""export PATH=$PATH.:/usr/local/radiance/bin
export RAYPATH=.:/usr/local/radiance/lib
mkdir -p <proj>/results/
dctimestep <dcillum> <skymtx> | rmtxop -fa -t -c 47.4 119.9 11.6 - > <proj>/results/<target>;echo <proj>/results/<target>""")
overrides_27 = ApplyOverrides(Input=panel_96, Dcillum=execute_ssh_async_28.Stdout, Skymtx=execute_ssh_async_24.Stdout, Target="annualR_DCD.ill")  # -> Output, Pairs
and_6 = GateAnd(A=execute_ssh_async_24.Ran, B=execute_ssh_async_28.Ran)
execute_ssh_async_30 = ExecuteSSHAsync(
    _SSHCommands_=overrides_27.Output,
    Run=and_6,
    addPrefix=True,
    addSuffix=True,
    description="export PATH=$PATH.:/usr/local/radiance/bin;export RAYPATH=.:/usr/local/radiance/lib;mkdir -p ~/simulation/test_project2/results/;dctimestep /home/mss/simulation/test_project2/mtxs/dcd_illum.mtx /home/mss/simulation/weatherData/NOR_OS_Alna.014870_TMYx.2004-2018.smx | rmtxop -fa -t -c 47.4 119.9 11.6 - > ~/simulation/test_project2/results/annualR_DCD.ill;echo ~/simulation/test_project2/results/annualR_DCD.ill",
    fireLogs=False,
    stdouts="/home/mss/simulation/test_project2/results/annualR_DCD.ill",
    suppressWarnings=False)  # -> Stdout, Stderr_, Log, Pid, Ran
panel_97 = Panel(overrides_27.Output)
panel_98 = Panel(execute_ssh_async_30.Stdout)

panel_99 = Panel("head <ill> -n 13;echo \" \";echo \"Number of lines\";wc -l <ill>")
applyglobals_7 = ApplyGlobals(Input=panel_99, AdditionalKeys="ill", AdditionalValues=execute_ssh_async_29.Stdout)  # -> Output, Pairs
execute_ssh_async_31 = ExecuteSSHAsync(
    _SSHCommands_=applyglobals_7.Output,
    Run=execute_ssh_async_29.Ran,
    addPrefix=True,
    addSuffix=True,
    fireLogs=False,
    stdouts="""#?RADIANCE
rmtxop -fa -t -c 47.4 119.9 11.6 -
dctimestep /home/mss/simulation/dc_illum.mtx /home/mss/simulation/weatherData/NOR_OS_Alna.014870_TMYx.2004-2018.smx
CAPDATE= 2022:06:09 16:55:47
GMT= 2022:06:09 14:55:47
Applied 1x3 matrix transform
Transposed rows and columns
NROWS=8760
NCOLS=108
NCOMP=1
FORMAT=ascii

 0.000000000000000e+00	 0.000000000000000e+00	 0.000000000000000e+00	 0.000000000000000e+00	 0.000000000000000e+00	 0.000000000000000e+00	 0.000000000000000e+00	 0.000000000000000e+00	 0.000000000000000e+00	 0.000000000000000e+00	 0.000000000000000e+00	 0.000000000000000e+00	 0.000000000000000e+00	 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
 
Number of lines
8772 /home/mss/simulation/test_project/results/annualR_DC.ill""",
    suppressWarnings=False)  # -> Stdout, Stderr_, Log, Pid, Ran
panel_100 = Panel(execute_ssh_async_31.Stdout)

panel_101 = Panel("head <ill> -n 13;echo \" \";echo \"Number of lines\";wc -l <ill>")
overrides_28 = ApplyOverrides(Input=panel_101, Ill=execute_ssh_async_30.Stdout)  # -> Output, Pairs
execute_ssh_async_32 = ExecuteSSHAsync(
    _SSHCommands_=overrides_28.Output,
    Run=execute_ssh_async_30.Ran,
    addPrefix=True,
    addSuffix=True,
    fireLogs=False,
    stdouts="""#?RADIANCE
rmtxop -fa -t -c 47.4 119.9 11.6 -
dctimestep /home/mss/simulation/dcd_illum.mtx /home/mss/simulation/weatherData/NOR_OS_Alna.014870_TMYx.2004-2018d.smx
CAPDATE= 2022:06:09 16:56:15
GMT= 2022:06:09 14:56:15
Applied 1x3 matrix transform
Transposed rows and columns
NROWS=8760
NCOLS=108
NCOMP=1
FORMAT=ascii

 0.000000000000000e+00	 0.000000000000000e+00	 0.000000000000000e+00	 0.000000000000000e+00	 0.000000000000000e+00	 0.000000000000000e+00	 0.000000000000000e+00	 0.000000000000000e+00	 0.000000000000000e+00	 0.000000000000000e+00	 0.000000000000000e+00	 0.000000000000000e+00	 0.000000000000000e+00	 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
 
Number of lines
8772 /home/mss/simulation/test_project/results/annualR_DCD.ill""",
    suppressWarnings=False)  # -> Stdout, Stderr_, Log, Pid, Ran
panel_102 = Panel(execute_ssh_async_32.Stdout)

# ----
# create black octreeDDS
suns_material = Text(execute_ssh_async_8.Stdout)
black_rad_files_3 = Text(black_rad_files)
window_mat_4 = Text(window_mat)
window_rad_4 = Text(window_rad)
black_mat_3 = Text(black_mat)
mf6_suns = Text(execute_ssh_async_13.Stdout)
entwine_3 = Entwine(
    Branch00=window_mat_4,
    Branch01=window_rad_4,
    Branch02=black_mat_3,
    Branch03=black_rad_files_3,
    Branch04=suns_material,
    Branch05=mf6_suns,
    FlattenInputs=True)  # -> flatten(Result)
panel_103 = Panel("""mkdir -p <proj>/octrees
oconv -f <rads> > <proj>/octrees/<target>;echo <proj>/octrees/<target>""")
join_5 = TextJoin(Text=flatten(entwine_3), Join=" ")
overrides_29 = ApplyOverrides(Input=panel_103, Rads=join_5, Target="my_geometry_black_sunCoeffecientsDDS.oct")  # -> Output, Pairs

execute_ssh_async_33 = ExecuteSSHAsync(
    _SSHCommands_=overrides_29.Output,
    Run=execute_ssh_async_13.Ran,
    addPrefix=True,
    addSuffix=True,
    description="""mkdir -p ~/simulation/test_project2/octrees
oconv -f ~/simulation/test_project2/radFiles/glass_materials.mat ~/simulation/test_project2/radFiles/Glass_50.rad ~/simulation/test_project2/radFiles/black_material.mat ~/simulation/test_project2/radFiles/Terrain_20_black.rad ~/simulation/test_project2/radFiles/Frames_70_black.rad ~/simulation/test_project2/radFiles/Wall_50_black.rad ~/simulation/test_project2/radFiles/Context_25_black.rad ~/simulation/test_project2/radFiles/Floor_20_black.rad ~/simulation/test_project2/radFiles/Ceiling_70_black.rad ~/simulation/suns.rad /home/mss/simulation/suns.rad > ~/simulation/test_project2/octrees/my_geometry_black_sunCoeffecientsDDS.oct;echo ~/simulation/test_project2/octrees/my_geometry_black_sunCoeffecientsDDS.oct""",
    fireLogs=False,
    name="Black Octree DDS",
    stdouts="/home/mss/simulation/test_project2/octrees/my_geometry_black_sunCoeffecientsDDS.oct",
    suppressWarnings=False)  # -> Stdout, Stderr_, Log, Pid, Ran

panel_104 = Panel(execute_ssh_async_33.Stdout)
octree_blackdds = Text(panel_104)

# ----
# Calculate illuminance sun coefficients for illuminance calculations
panel_105 = Panel("cdsDDS_illum.mtx")
# Raytracing suns (rcontrib)
panel_106 = Panel("""mkdir -p <proj>/mtxs/
rcontrib -I+ -ab 1 -y <ptcount> -n <cpus> -ad 256 -lw 1.0e-3 -dc 1 -dt 0 -dj 0 -faf -e MF:6 -f reinhart.cal -b rbin -bn Nrbins -m solar <octree> < <points> > <proj>/mtxs/<target>
echo <proj>/mtxs/<target>""")
octree_blackdds_2 = Text(octree_blackdds)
ptscount_4 = Integer(ptscount)
points_8 = Text(points_2)
and_7 = GateAnd(octree_ok=execute_ssh_async_33.Ran, points_ok=points2pts.Run, ran_above=execute_ssh_async_28.Ran)
overrides_30 = ApplyOverrides(Input=panel_106, Ptcount=ptscount_4, Octree=octree_blackdds_2, Points=points_8, Target=panel_105)  # -> Output, Pairs
execute_ssh_async_34 = ExecuteSSHAsync(
    _SSHCommands_=overrides_30.Output,
    Run=and_7,
    addPrefix=True,
    addSuffix=True,
    description="mkdir -p ~/simulation/test_project2/mtxs/;rcontrib -I+ -ab 1 -y 198 -n 5 -ad 256 -lw 1.0e-3 -dc 1 -dt 0 -dj 0 -faf -e MF:6 -f reinhart.cal -b rbin -bn Nrbins -m solar /home/mss/simulation/test_project2/octrees/my_geometry_black_sunCoeffecientsDDS.oct < /home/mss/simulation/test_project2/points.pts > ~/simulation/test_project2/mtxs/cdsDDS_illum.mtx;echo ~/simulation/test_project2/mtxs/cdsDDS_illum.mtx",
    fireLogs=False,
    stdouts="/home/mss/simulation/test_project2/mtxs/cdsDDS_illum.mtx",
    suppressWarnings=False)  # -> Stdout, Stderr_, Log, Pid, Ran
panel_107 = Panel(execute_ssh_async_34.Stdout)

# ----
# + Results of direct sun coefficients (5165 sample sky)
panel_108 = Panel("annualR_CDS.ill")
panel_109 = Panel("""export PATH=$PATH.:/usr/local/radiance/bin
export RAYPATH=.:/usr/local/radiance/lib
mkdir -p <proj>/results/
dctimestep <dcillum> <skymtx> | rmtxop -fa -t -c 47.4 119.9 11.6 - > <proj>/results/<target>;echo <proj>/results/<target>""")
overrides_31 = ApplyOverrides(Input=panel_109, Dcillum=panel_107, Skymtx=m6_sky_mtx, Target=panel_108)  # -> Output, Pairs
and_8 = GateAnd(A=execute_ssh_async_34.Ran, B=execute_ssh_async_25.Ran)
execute_ssh_async_35 = ExecuteSSHAsync(
    _SSHCommands_=overrides_31.Output,
    Run=and_8,
    addPrefix=True,
    addSuffix=True,
    description="export PATH=$PATH.:/usr/local/radiance/bin;export RAYPATH=.:/usr/local/radiance/lib;mkdir -p ~/simulation/test_project2/results/;dctimestep /home/mss/simulation/test_project2/mtxs/cdsDDS_illum.mtx /home/mss/simulation/weatherData/NOR_OS_Alna.014870_TMYx.2004-2018.smx | rmtxop -fa -t -c 47.4 119.9 11.6 - > ~/simulation/test_project2/results/annualR_CDS.ill;echo ~/simulation/test_project2/results/annualR_CDS.ill",
    fireLogs=False,
    stdouts="/home/mss/simulation/test_project2/results/annualR_CDS.ill",
    suppressWarnings=False)  # -> Stdout, Stderr_, Log, Pid, Ran
panel_110 = Panel(overrides_31.Output)
panel_111 = Panel(execute_ssh_async_35.Stdout)

panel_112 = Panel("head <ill> -n 13;echo \" \";echo \"Number of lines\";wc -l <ill>")
overrides_32 = ApplyOverrides(Input=panel_112, Ill=execute_ssh_async_35.Stdout)  # -> Output, Pairs
execute_ssh_async_36 = ExecuteSSHAsync(
    _SSHCommands_=overrides_32.Output,
    Run=execute_ssh_async_35.Ran,
    addPrefix=True,
    addSuffix=True,
    description="head /home/mss/simulation/test_project2/results/annualR_CDS.ill -n 13;echo \" \";echo \"Number of lines\";wc -l /home/mss/simulation/test_project2/results/annualR_CDS.ill",
    fireLogs=False,
    stdouts="""#?RADIANCE
rmtxop -fa -t -c 47.4 119.9 11.6 -
dctimestep /home/mss/simulation/test_project2/mtxs/cdsDDS_illum.mtx /home/mss/simulation/weatherData/NOR_OS_Alna.014870_TMYx.2004-2018.smx
CAPDATE= 2022:07:03 11:08:45
GMT= 2022:07:03 09:08:45
Applied 1x3 matrix transform
Transposed rows and columns
NROWS=8760
NCOLS=198
NCOMP=1
FORMAT=ascii

 0.000000000000000e+00	 0.000000000000000e+00	 0.000000000000000e+00	 0.000000000000000e+00	 0.000000000000000e+00	 0.000000000000000e+00	 0.000000000000000e+00	 0.000000000000000e+00	 0.000000000000000e+00	 0.000000000000000e+00	 0.000000000000000e+00	 0.000000000000000e+00	 0.000000000000000e+00	 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
 
Number of lines
8772 /home/mss/simulation/test_project2/results/annualR_CDS.ill""",
    suppressWarnings=False)  # -> Stdout, Stderr_, Log, Pid, Ran
panel_113 = Panel(execute_ssh_async_36.Stdout)

# ----
# final step: Combine results
panel_114 = Panel("""export PATH=$PATH.:/usr/local/radiance/bin
export RAYPATH=.:/usr/local/radiance/lib
rmtxop <DCannualR> + -s -1 <DCDannualR> + <CDSannualR> > <proj>/results/<target>;echo <proj>/results/<target>""")
panel_115 = Panel("""DCannualR
DCDannualR
CDSannualR
target""")
falsestart_8 = LBFalseStartToggle(False)
and_9 = GateAnd(A=execute_ssh_async_29.Ran, B=execute_ssh_async_30.Ran, C=execute_ssh_async_35.Ran)
entwine_4 = Entwine(
    Branch00=execute_ssh_async_29.Stdout,
    Branch01=execute_ssh_async_30.Stdout,
    Branch02=execute_ssh_async_35.Stdout,
    Branch03="DDS_Total.ill",
    FlattenInputs=True)  # -> flatten(Result)
or = GateOr(A=and_9, B=falsestart_8)
applyglobals_8 = ApplyGlobals(Input=panel_114, AdditionalKeys=panel_115, AdditionalValues=entwine_4)  # -> Output, Pairs
execute_ssh_async_37 = ExecuteSSHAsync(
    _SSHCommands_=applyglobals_8.Output,
    Run=or,
    addPrefix=True,
    addSuffix=True,
    fireLogs=False,
    stdouts="/home/mss/simulation/test_project/results/DDS_Total.ill",
    suppressWarnings=False)  # -> Stdout, Stderr_, Log, Pid, Ran
panel_116 = Panel(applyglobals_8.Output)
int = Integer("1")

overrides_33 = ApplyOverrides(Input="<proj>/results/<dds>", AdditionalKeys="dds", AdditionalValues="DDS_Total.ill")  # -> Output, Pairs
replace = ReplaceItems(List=entwine_4, Item=overrides_33.Output, Indices=-1, Wrap=True)
panel_117 = Panel(execute_ssh_async_37.Stdout)

panel_118 = Panel("C:\Users\mm1013\simulation\radTutorialFiles\room\points.txt")
panel_119 = Panel("C:\Users\mm1013\simulation\radTutorialFiles\room\results\dcDDS\annualR.ill")
file = ReadFile(File=panel_118, PerLineParse=True)
c_script = CSharpScript(x=file)  # -> out, A; inputs x: list of String
# ---------- c_script: C# ----------
    List<Point3d> pts = new List<Point3d>(x.Count);

    for (int i = 0; i < x.Count; i++)
    {
      string[] split = x[i].Split(' ');
      pts.Add(new Point3d(double.Parse(split[0]),
        double.Parse(split[1]),
        double.Parse(split[2]))
        );
    }

    A = pts;
# ---------- end c_script ----------
falsestart_9 = LBFalseStartToggle(False)
dup = DuplicateData(Data=int, Number="40", Order=True)
annualresults = AnnualResults(IllFile=panel_119, Schedule=dup, Min="300", Max="300000000", Run=falsestart_9)  # -> Headers, Results, Ran
gradient = Gradient(
    LowerLimit="1",
    UpperLimit="0",
    Parameter=annualresults.Results,
    stops=[0: RGB(234, 38, 0), 0.25: RGB(234, 126, 0), 0.5: RGB(254, 244, 84), 0.75: RGB(173, 203, 249), 1: RGB(75, 107, 169)])
preview = CustomPreview(Geometry=c_script.A, Material=gradient)

or_2 = GateOr(A=execute_ssh_async_37.Ran, B=falsestart_4)
list = ItemSelector(
    replace,
    {"/home/mss/simulation/test_project2/results/annualR_DC.ill", "/home/mss/simulation/test_project2/results/annualR_CDS.ill", "~/simulation/test_project2/results/DDS_Total.ill"}, selected="/home/mss/simulation/test_project2/results/annualR_DC.ill")
download = Download(LinuxFilePaths=list, Run=or_2)  # -> Status, FilePaths, Run
panel_120 = Panel(download.FilePaths)
dup_2 = DuplicateData(Data=int, Number="8760", Order=True)
annualresults_2 = AnnualResults(IllFile=download.FilePaths, Schedule=dup_2, Min=300, Max=0, Run=download.Run)  # -> Headers, Results, Ran
bnd = Bounds(Numbers=annualresults_2.Results)
readannualresultsi = Honeybee_ReadAnnualResultI(
    illFilesAddress=panel_120,
    testPoints=simplify(long.ListA),
    ptsVectors=long.ListB,
    DLAIllumThresholds=300,
    runIt=download.Run)  # -> DLA, UDLI_Less_100, UDLI_100_2000, UDLI_More_2000, CDA, sDA, annualProfiles, htmReport; plug-in component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
panel_121 = Panel(bnd)
reload_analysisgrid = GhPythonScript(pts_file="C:\Users\mm1013\simulation\points.pts", ill_file=panel_120, hoys=analysisperiod.hoys, run=or_2)  # -> out, analysisGrid; inputs hoys: list
# ---------- reload_analysisgrid: Python ----------
"""
    Args:
        _pts_file: Path to a points (*.pts) file
        _ill_file: Path to an illuminance (*.ill) file
        _hoys: A list of hours of the year. This should be the same list as the
            one used to run the simulation earlier.
            
            If you ran an Annual Simulation (using the Annual Daylight, Annual
            Radiation, DC-Grid Based, 3P or 5P recipe), you should provide a
            list of integers from 0 to 8759. If you used smaller timesteps in
            your simulation (e.g. using 'hoys_' input in HoneybeePlus_SkyMatrix
            component), make sure you provide a list with appropriate matching
            timesteps.
            
            If you ran a Solar Access simulation, you could use the hoys output
            from LadybugPlus_SunPath component i.e. the same you provided for the
            Solar Access Recipe.
            
            If you ran a simulation using HoneybeePlus Grid Based Recipe, you
            should enter the same hoy as was used to create the sky.
            
            You can get this _hoys list from:
            (1) LadybugPlus_SunPath component
            (2) LadybugPlus_Analysis Period component
            (3) LadybugPlus_Calculate HOY component
            (4) Standard grasshopper components
        _gridMode_: 0 > load the values. (Default)
            1 > load values as binary. Any non-zero value will be 1. Useful for studies such as Solar Access a.k.a. Sunlight Hours.
            2 > load the values divided by mode number. Use this mode for daylight factor or radiation analysis
        _run: Set to True to load the AnalysisGrid
    Returns:
        analysisGrid: Outputs a analysis grid loaded with results. Connect this
             grid to standard honeybee[+] copmonents to get the values
"""

import rhinoscriptsyntax as rs
from honeybee_plus.radiance.analysisgrid import AnalysisGrid

if _run == True:


    if _gridMode_ == None:
        gmode = 0
    else:
        gmode = int(_gridMode_)

# first let's create an analysis grid from pts file
    analysisGrid = AnalysisGrid.from_file(_pts_file)

# now let's load the results
    analysisGrid.set_values_from_file(_ill_file, hoys=_hoys, mode=gmode)
# ---------- end reload_analysisgrid ----------
readannualresultsiii = ReadAnnualResultsIII(resultFilesAddress=panel_120, minThreshold=300, maxThreshold=0)  # -> out, lessThanRange, inTheRange, moreThanRange, CDA; inputs resultFilesAddress: list of String, minThreshold: Double, maxThreshold: Double
# ---------- readannualresultsiii: C# usings ----------
using System.IO;
using System.Linq;
using System.Data;
using System.Drawing;
using System.Reflection;
using System.Windows.Forms;
using System.Xml;
using System.Xml.Linq;
using System.Runtime.InteropServices;

using Rhino.DocObjects;
using Rhino.Collections;
using GH_IO;
using GH_IO.Serialization;
# ---------- readannualresultsiii: C# ----------
    List < string > lines = new List<string>{};
    int ptsNumbers = 0;
    double min = minThreshold;
    double max = maxThreshold;

    var underT = new List<int>{};
    var withinT = new List<int>{};
    var aboveT = new List<int>{};

    var underTPercent = new List<double>{};
    var withinTPercent = new List<double>{};
    var aboveTPercent = new List<double>{};
    var cda = new List<double>{};

    double oneHrToPercent = 1 / 36.50;


    double infinity = 1.0 / 0.0;
    if(max == 0)max = infinity;



    for(int f = 0; f < resultFilesAddress.Count; f++){
      lines = File.ReadAllLines(resultFilesAddress[f], System.Text.Encoding.GetEncoding(1252)).ToList();

      int catecount = lines[0].Split(' ').Length - 4;


      for(int i = 0; i < catecount; i++){
        //underT.Add(0);
        //withinT.Add(0);
        //aboveT.Add(0);
        underTPercent.Add(0);
        withinTPercent.Add(0);
        aboveTPercent.Add(0);
        cda.Add(0);
      }

      for(int i = 0; i < 8760; i++){
        string [] items = lines[i].Split(' ');
        //A = items;
        var hr = Convert.ToDouble(items[2]);

        if(hr >= 8 && hr < 18){

          for(int l = 0; l < catecount; l++){
            int item = Convert.ToInt32(items[l + 4]);
            int ptsIndex = l + ptsNumbers;

            if(item < min){
              //underT[ptsIndex] += 1;
              underTPercent[ptsIndex] += oneHrToPercent;
              double factor = item / min;
              cda[ptsIndex] += oneHrToPercent * factor;
            }else if(item > max){
              //aboveT[ptsIndex] += 1;
              aboveTPercent[ptsIndex] += oneHrToPercent;
            }else{
              //withinT[ptsIndex] += 1;
              withinTPercent[ptsIndex] += oneHrToPercent;
              cda[ptsIndex] += oneHrToPercent;
            }
          }

        }
      }

      ptsNumbers += catecount;


    }



    lessThanRange = underTPercent;
    inTheRange = withinTPercent;
    moreThanRange = aboveTPercent;
    CDA = cda;
# ---------- end readannualresultsiii ----------
readannualresultsiii_2 = ReadAnnualResultsIII(resultFilesAddress=panel_120, workingHours=[8, 9, 10, 11, 12, 13, 14, 15, 16, 17], minThreshold=300, maxThreshold=0)  # -> out, lessThanRange, inTheRange, moreThanRange, CDA; inputs resultFilesAddress: list of String, workingHours: list of Int32, minThreshold: Double, maxThreshold: Double
# ---------- readannualresultsiii_2: C# ----------
    Component.Message = "VER 0.0.61\nJUL_06_2017";
    List < string > lines = new List<string>{};
    //int ptsNumbers = 0;
    min = minThreshold;
    max = maxThreshold;
    hours = workingHours;
    oneHrToPercent = 1 / (3.65*hours.Count);

    var AllProcessedData = new List<List<List<double>>>();

    var underTPercent = new List<double>{};
    var withinTPercent = new List<double>{};
    var aboveTPercent = new List<double>{};
    var cda = new List<double>{};


    double infinity = 1.0 / 0.0;
    if(max == 0)max = infinity;

    var illResults = resultFilesAddress.AsParallel().AsOrdered().Select(file => readIllFile(file));
    foreach (var illResult in illResults)
    {
      underTPercent.AddRange(illResult[0]);
      withinTPercent.AddRange(illResult[1]);
      aboveTPercent.AddRange(illResult[2]);
      cda.AddRange(illResult[3]);
    }

    lessThanRange = underTPercent;
    inTheRange = withinTPercent;
    moreThanRange = aboveTPercent;
    CDA = cda;
# ---------- readannualresultsiii_2: C# additional code ----------
  static double min = 300;
  static double max = 0;
  static double oneHrToPercent= 1 / 36.50;
  static List<int> hours;

  static List < List < double >> readIllFile (object file)
  {

    var underTPercent = new List<double>(){};
    var withinTPercent = new List<double>(){};
    var aboveTPercent = new List<double>(){};
    var cda = new List<double>{};
    var lines = File.ReadAllLines((String) file, System.Text.Encoding.GetEncoding(1252)).ToList();

    int ptsCount = lines[0].Split(' ').Length - 4;

    for(int i = 0; i < ptsCount; i++){

      underTPercent.Add(0);
      withinTPercent.Add(0);
      aboveTPercent.Add(0);
      cda.Add(0);
    }

    for(int i = 0; i < 8760; i++){
      string [] items = lines[i].Split(' ');
      //A = items;
      var hr = (int) Convert.ToDouble(items[2]);
      
      //var hrs = new List<int>(){8,9,10};
      int pos = hours.IndexOf(hr);

      if(pos >= 0){

        for(int l = 0; l < ptsCount; l++){
          int item = Convert.ToInt32(items[l + 4]);
          int ptsIndex = l;

          //underTPercent
          if(item < min){
            underTPercent[ptsIndex] += oneHrToPercent;
            cda[ptsIndex] += oneHrToPercent * item / min;
          }
            //aboveTPercent
          else if(item > max)
          {
            aboveTPercent[ptsIndex] += oneHrToPercent;
          }
            //withinTPercent
          else
          {
            withinTPercent[ptsIndex] += oneHrToPercent;
            cda[ptsIndex] += oneHrToPercent;
          }
        }

      }else{
        //underTPercent[hr] = pos;
      }
    }

    //processedData for one ill file
    List < List < double >> processedData = new List<List<double>>(){};

    processedData.Add(underTPercent);
    processedData.Add(withinTPercent);
    processedData.Add(aboveTPercent);
    processedData.Add(cda);

    return processedData;


  }
# ---------- end readannualresultsiii_2 ----------
reload_analysisgrid_2 = GhPythonScript(pts_file="C:\Users\mm1013\simulation\points.pts", ill_file=panel_120, run=Toggle(True))  # -> out, analysisGrid; inputs hoys: list
# ---------- reload_analysisgrid_2: Python ----------
"""
    Args:
        _pts_file: Path to a points (*.pts) file
        _ill_file: Path to an illuminance (*.ill) file
        _hoys: A list of hours of the year. This should be the same list as the
            one used to run the simulation earlier.
            
            If you ran an Annual Simulation (using the Annual Daylight, Annual
            Radiation, DC-Grid Based, 3P or 5P recipe), you should provide a
            list of integers from 0 to 8759. If you used smaller timesteps in
            your simulation (e.g. using 'hoys_' input in HoneybeePlus_SkyMatrix
            component), make sure you provide a list with appropriate matching
            timesteps.
            
            If you ran a Solar Access simulation, you could use the hoys output
            from LadybugPlus_SunPath component i.e. the same you provided for the
            Solar Access Recipe.
            
            If you ran a simulation using HoneybeePlus Grid Based Recipe, you
            should enter the same hoy as was used to create the sky.
            
            You can get this _hoys list from:
            (1) LadybugPlus_SunPath component
            (2) LadybugPlus_Analysis Period component
            (3) LadybugPlus_Calculate HOY component
            (4) Standard grasshopper components
        _gridMode_: 0 > load the values. (Default)
            1 > load values as binary. Any non-zero value will be 1. Useful for studies such as Solar Access a.k.a. Sunlight Hours.
            2 > load the values divided by mode number. Use this mode for daylight factor or radiation analysis
        _run: Set to True to load the AnalysisGrid
    Returns:
        analysisGrid: Outputs a analysis grid loaded with results. Connect this
             grid to standard honeybee[+] copmonents to get the values
"""

import rhinoscriptsyntax as rs
from honeybee_radiance.sensorgrid import SensorGrid
#from honeybee.radiance.analysisgrid import AnalysisGrid

if _run == True:


    if _gridMode_ == None:
        gmode = 0
    else:
        gmode = int(_gridMode_)

# first let's create an analysis grid from pts file
    analysisGrid = SensorGrid.from_file(_pts_file)
    

# now let's load the results
    #analysisGrid.set_values_from_file(_ill_file, hoys=_hoys, mode=gmode)
# ---------- end reload_analysisgrid_2 ----------
readannualresultsii = Honeybee_ReadAnnualResultII(resultFilesAddress=panel_120, testPts=long.ListA, timeStep=1, runIt=download.Run)  # -> readMe, lessThanRange, inTheRange, moreThanRange; plug-in component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
python_5 = GhPythonScript(x=reload_analysisgrid_2.analysisGrid)  # -> out, a
# ---------- python_5: Python ----------
__author__ = "mm1013"
__version__ = "2022.05.02"

import rhinoscriptsyntax as rs

a = x.sensors
# ---------- end python_5 ----------
gradient_2 = Gradient(
    LowerLimit="1",
    UpperLimit="0",
    Parameter=annualresults_2.Results,
    stops=[0: RGB(234, 38, 0), 0.25: RGB(234, 126, 0), 0.5: RGB(254, 244, 84), 0.75: RGB(173, 203, 249), 1: RGB(75, 107, 169)])
bnd_2 = Bounds(Numbers=readannualresultsii.inTheRange)
preview_2 = CustomPreview(Geometry=pt_3, Material=gradient_2)

# ----
# RENDER TESTS
# # start of sky definition for daylighting studies
# # location name: COPENHAGEN_DNK LAT: 55.63
# !gensky 5 14 14.0 -c -a 55.63 -o -12.67 -m -15.0 | xform -rz 0.0
# skyfunc glow sky_mat
# 0
# 0
# 4
# 1 1 1 0
# sky_mat source sky
# 0
# 0
# 4
# 0 0 1 180
# skyfunc glow ground_glow
# 0
# 0
# 4
# 1 .8 .5 0
# ground_glow source ground
# 0
# 0
# 4
# 0 0 -1 180
# # end of sky definition for daylighting studies
panel_122 = Panel("""mkdir -p <proj>/radFiles/
gensky -ang 45 0 -c -B 55.866 > <proj>/radFiles/<target>; echo <proj>/radFiles/<target>""")
_10000lux_overcast = Panel("gensky -ang 45 0 -c -B 55.866")
and_append_the_ground = Panel("""##The 1 will be multiplie with brightfunc
skyfunc glow sky_glow
0
0
4 1 1 1 0

##Set to 1 as it will be multiplied with the gensky result
sky_glow source sky
0
0
4 0 0 1 180

##Set to 1 as it will be multiplied with the gensky result
skyfunc glow ground_glow
0
0
4 1 1 1 0

##The ground pane
ground_glow source ground
0
0
4 0 0 -1 180""")
ladybug = Ladybug_Ladybug()  # -> Vviiiiiiiiiizzz; disabled; plug-in component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
geo_6 = Geometry(<brep referenced from the Rhino model>)  # disabled
path_2 = FilePath("C:\Users\mm1013\Documents\Rhino setup\DNK_Copenhagen.061800_IWEC.epw")  # disabled
panel_123 = Panel("5")  # disabled
panel_124 = Panel("14")  # disabled
panel_125 = Panel("14")  # disabled
debrep = DeconstructBrep(Brep=geo_6)  # -> Faces, Edges, Vertices; disabled
panel_126 = Panel("4")  # disabled
genstandardciesky = Honeybee_GenerateStandardCIESky(weatherFile=path_2, month=panel_123, day=panel_124, hour=panel_125, skyType=panel_126)  # -> skyFilePath; disabled; plug-in component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
createhbsrfs = Honeybee_createHBSrfs(geometry=debrep.Faces)  # -> readMe, simplify(HBSurface); disabled; plug-in component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
panel_127 = Panel("Perspective")  # disabled
panel_128 = Panel("700")  # disabled
panel_129 = Panel("152")  # disabled
imagebasedsimulation = Honeybee_ImageBasedSimulation(
    skyFile=genstandardciesky,
    rhinoViewsName=panel_127,
    simulationType=2,
    imageWidth=panel_129,
    imageHeight=panel_128,
    backupImages=0)  # -> analysisRecipe; disabled; plug-in component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
toggle_4 = BooleanToggle(True)  # disabled
rundaylightanalysis = Honeybee_RunDaylightSimulation(
    HBObjects=flatten(createhbsrfs.HBSurface),
    analysisRecipe=imagebasedsimulation,
    writeRad=toggle_4,
    runRad=toggle_4,
    overwriteResults=True)  # -> readMe, analysisType, resultsUnit, results, testPts, luminance_files, radGeoFile, studyFolder, done; disabled; plug-in component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
hdr_gif = Honeybee_ConvertHDRToGIF(HDRFilePath=rundaylightanalysis.luminance_files, adjustExposure=False)  # -> GIFFilePath; disabled; plug-in component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
imageviewer_4 = LBImageViewer(ImagePath_=hdr_gif, _scale_=1, DisableClickable=False, SaveImgWithCoords=False, scale=1)  # -> ImagePath, Values, GIF; disabled

# ----
# Create a dummy gensky for renders
# mkdir -p <proj>/radFiles/
# gensky 12 4 +12:00 -c -B 55.866 > <proj>/radFiles/<target>; echo <proj>/radFiles/<target>
panel_130 = Panel("sky_10klx.mat")
overrides_34 = ApplyOverrides(Input=panel_122, Target=panel_130)  # -> Output, Pairs
execute_ssh_async_38 = ExecuteSSHAsync(
    _SSHCommands_=overrides_34.Output,
    Run=execute_ssh_async_6.Ran,
    addPrefix=True,
    addSuffix=True,
    description="""mkdir -p ~/simulation/test_project2/radFiles/
gensky -ang 45 0 -c -B 55.866 > ~/simulation/test_project2/radFiles/sky_10klx.mat; echo ~/simulation/test_project2/radFiles/sky_10klx.mat""",
    fireLogs=False,
    stdouts="/home/mss/simulation/test_project2/radFiles/sky_10klx.mat",
    suppressWarnings=False)  # -> Stdout, Stderr_, Log, Pid, Ran
overrides_35 = ApplyOverrides(Input="head <proj>/radFiles/<target>", Target=panel_130)  # -> Output, Pairs
execute_ssh_async_39 = ExecuteSSHAsync(
    _SSHCommands_=overrides_35.Output,
    Run=execute_ssh_async_38.Ran,
    addPrefix=True,
    addSuffix=True,
    description="head ~/simulation/test_project2/radFiles/sky_10klx.mat",
    fireLogs=False,
    stdouts="""# gensky -ang 45 0 -c -B 55.866
# Ground ambient level: 17.8

void brightfunc skyfunc
2 skybr skybright.cal
0
3 2 2.29e+01 3.56e+00""",
    suppressWarnings=False)  # -> Stdout, Stderr_, Log, Pid, Ran
panel_131 = Panel(execute_ssh_async_38.Stdout)
panel_132 = Panel(execute_ssh_async_39.Stdout)
sky10klx = Text(execute_ssh_async_38.Stdout)

# ----
# Preview a RAD file with objpict
# can also use ra_tiff/normtiff/pfilt
# gamma will vary
# 
# check axel jacobs radiance tutorial p26
panel_133 = Panel("""mkdir -p <proj>/images/
objpict <rad> > <proj>/images/<target-.>.hdr
normtiff <proj>/images/<target-.>.hdr <proj>/images/<target-.>.tif
convert <proj>/images/<target-.>.tif <proj>/images/<target>
echo <proj>/images/<target>""")  # disabled
radfile = Text(execute_ssh_async_38.Stdout)  # disabled
panel_134 = Panel("quickRender.png")  # disabled
panel_135 = Panel("""rad
target""")  # disabled
applyglobals_9 = ApplyGlobals(Input=panel_133, AdditionalKeys=panel_135, AdditionalValues=[radfile, panel_134])  # -> Output, Pairs; disabled
execute_ssh_async_40 = ExecuteSSHAsync(
    SSHCommands=applyglobals_9.Output,
    Run=execute_ssh_async_39.Ran,
    addPrefix=True,
    addSuffix=True,
    fireLogs=False,
    stdouts="/home/mss/simulation/test_project/images/quickRender.png",
    suppressWarnings=False)  # -> Stdout, Stderr, Log, Pid, Ran; disabled
convertpaths_3 = ConvertPaths(I=execute_ssh_async_40.Stdout)  # -> Linux, Windows; disabled
imageviewer_5 = LBImageViewer(ImagePath_=convertpaths_3.Windows, _scale_=1, DisableClickable=False, SaveImgWithCoords=False, scale=1)  # -> ImagePath, Values, GIF; disabled

txt = Text(sky10klx)

# ----
# 10klx overcast sky (RwR p357)
bool = Boolean(execute_ssh_async_39.Ran)
execute_ssh_async_41 = ExecuteSSHAsync(
    _SSHCommands_="gensky -ang 45 0 -c -B 55.866",
    Run=bool,
    addPrefix=True,
    addSuffix=True,
    description="gensky -ang 45 0 -c -B 55.866",
    fireLogs=False,
    stdouts="""# gensky -ang 45 0 -c -B 55.866
# Ground ambient level: 17.8

void brightfunc skyfunc
2 skybr skybright.cal
0
3 2 2.29e+01 3.56e+00""",
    suppressWarnings=False)  # -> Stdout, Stderr_, Log, Pid, Ran
panel_136 = Panel("""mkdir -p <proj>/skies/
echo "<sky>" > <proj>/skies/<target>
echo "<proj>/skies/<target>"
""")

concat_3 = Concatenate(
    FragmentC="##Will control the gradient of the sky",
    FragmentA=execute_ssh_async_41.Stdout,
    FragmentB=and_append_the_ground)

panel_137 = Panel(concat_3)
overrides_36 = ApplyOverrides(Input=panel_136, Sky=panel_137, Target="overcast_sky.rad")  # -> Output, Pairs
execute_ssh_async_42 = ExecuteSSHAsync(
    _SSHCommands_=overrides_36.Output,
    Run=execute_ssh_async_41.Ran,
    addPrefix=True,
    addSuffix=True,
    description="""mkdir -p ~/simulation/test_project2/skies/;echo "##Will control the gradient of the sky
# gensky -ang 45 0 -c -B 55.866
# Ground ambient level: 17.8

void brightfunc skyfunc
2 skybr skybright.cal
0
3 2 2.29e+01 3.56e+00

##The 1 will be multiplie with brightfunc
skyfunc glow sky_glow
0
0
4 1 1 1 0

##Set to 1 as it will be multiplied with the gensky result
sky_glow source sky
0
0
4 0 0 1 180

##Set to 1 as it will be multiplied with the gensky result
skyfunc glow ground_glow
0
0
4 1 1 1 0

##The ground pane
ground_glow source ground
0
0
4 0 0 -1 180" > ~/simulation/test_project2/skies/overcast_sky.rad;echo "~/simulation/test_project2/skies/overcast_sky.rad"
""",
    fireLogs=False,
    stdouts="~/simulation/test_project2/skies/overcast_sky.rad",
    suppressWarnings=False)  # -> Stdout, Stderr_, Log, Pid, Ran
panel_138 = Panel(execute_ssh_async_42.Stdout)

overrides_37 = ApplyOverrides(Input="cat <target>", Target=execute_ssh_async_42.Stdout)  # -> Output, Pairs
execute_ssh_async_43 = ExecuteSSHAsync(
    _SSHCommands_=overrides_37.Output,
    Run=execute_ssh_async_42.Ran,
    addPrefix=True,
    addSuffix=True,
    description="cat ~/simulation/test_project2/skies/overcast_sky.rad",
    fireLogs=False,
    stdouts="""##Will control the gradient of the sky
# gensky -ang 45 0 -c -B 55.866
# Ground ambient level: 17.8

void brightfunc skyfunc
2 skybr skybright.cal
0
3 2 2.29e+01 3.56e+00

##The 1 will be multiplie with brightfunc
skyfunc glow sky_glow
0
0
4 1 1 1 0

##Set to 1 as it will be multiplied with the gensky result
sky_glow source sky
0
0
4 0 0 1 180

##Set to 1 as it will be multiplied with the gensky result
skyfunc glow ground_glow
0
0
4 1 1 1 0

##The ground pane
ground_glow source ground
0
0
4 0 0 -1 180""",
    suppressWarnings=False)  # -> Stdout, Stderr_, Log, Pid, Ran
panel_139 = Panel(execute_ssh_async_43.Stdout)

# ----
# OCTREE
panel_140 = Panel("my_test_scene.oct")
scene_rads = Text(entwine_2)
sky_ovc = Text(execute_ssh_async_42.Stdout)
python_6 = GhPythonScript(x=flatten(scene_rads))  # -> a; inputs x: list
# ---------- python_6: Python ----------
__author__ = "mm1013"
__version__ = "2022.06.15"

import rhinoscriptsyntax as rs

a = None not in x
# ---------- end python_6 ----------
entwine_5 = Entwine(Branch01=sky_ovc, Branch02=scene_rads, FlattenInputs=True)  # -> flatten(Radfiles)
panel_141 = Panel("""mkdir -p <proj>/octrees/
oconv -r 2048 -f <rads> > <proj>/octrees/<target>
echo <proj>/octrees/<target>""")
and_10 = GateAnd(A=python_6, B=execute_ssh_async_42.Ran)
panel_142 = Panel(" ")
join_6 = TextJoin(Text=entwine_5, Join=" ")
overrides_38 = ApplyOverrides(Input=panel_141, Rads=join_6, Target=panel_140)  # -> Output, Pairs
execute_ssh_async_44 = ExecuteSSHAsync(
    _SSHCommands_=overrides_38.Output,
    Run=and_10,
    addPrefix=True,
    addSuffix=True,
    description="""mkdir -p ~/simulation/test_project2/octrees/
oconv -r 2048 -f ~/simulation/test_project2/skies/overcast_sky.rad ~/simulation/test_project2/radFiles/glass_materials.mat ~/simulation/test_project2/radFiles/Glass_50.rad ~/simulation/test_project2/radFiles/opaque_materials.mat ~/simulation/test_project2/radFiles/Ceiling_70.rad ~/simulation/test_project2/radFiles/Floor_20.rad ~/simulation/test_project2/radFiles/Context_25.rad ~/simulation/test_project2/radFiles/Wall_50.rad ~/simulation/test_project2/radFiles/Frames_70.rad ~/simulation/test_project2/radFiles/Terrain_20.rad > ~/simulation/test_project2/octrees/my_test_scene.oct
echo ~/simulation/test_project2/octrees/my_test_scene.oct""",
    fireLogs=False,
    stdouts="/home/mss/simulation/test_project2/octrees/my_test_scene.oct",
    suppressWarnings=False)  # -> Stdout, Stderr_, Log, Pid, Ran
convertpaths_4 = ConvertPaths(I=execute_ssh_async_44.Stdout)  # -> Linux, Windows
panel_143 = Panel(execute_ssh_async_44.Stdout)
panel_144 = Panel(convertpaths_4.Windows)

or_3 = GateOr(A=execute_ssh_async_44.Ran, B=Toggle(True))

# ----
# VIEW
panel_145 = Panel("""mkdir -p <proj>/views/
echo "<vf>" > <proj>/views/<target>
echo <proj>/views/<target>""")
panel_146 = Panel("""vf
target""")
vf = Text(view.ViewfileContent)
overrides_39 = ApplyOverrides(Input=panel_145, Vf=vf, Target="view.vf")  # -> Output, Pairs
file_exists_2 = Panel("[ -f <out> ] && echo \"1\" || echo \"0\"")
execute_ssh_async_45 = ExecuteSSHAsync(
    _SSHCommands_=overrides_39.Output,
    Run=button,
    addPrefix=True,
    addSuffix=True,
    fireLogs=False,
    stdouts="/home/mss/simulation/test_project2/views/view.vf",
    suppressWarnings=False)  # -> Stdout, Stderr_, Log, Pid, Ran
panel_147 = Panel(execute_ssh_async_45.Stdout)
overrides_40 = ApplyOverrides(Input=file_exists_2, Out=execute_ssh_async_45.Stdout)  # -> Output, Pairs
execute_ssh_async_46 = ExecuteSSHAsync(
    SSHCommands=overrides_40.Output,
    Run=or_3,
    addPrefix=True,
    addSuffix=True,
    description="[ -f /home/mss/simulation/test_project2/views/view.vf ] && echo \"1\" || echo \"0\"",
    fireLogs=False,
    stdouts="1",
    suppressWarnings=False)  # -> Stdout, Stderr, Log, Pid, Ran

# ----
# rpict RENDER
# single core render, using normtiff to set
# exposure and convert to png
# -ps 8 -pt 0.15 -pj 0.6 -dj 0 -ds 0.5 -dt 0.5 -dc 0.25 -dr 0 -dp 64 -st 0.85 -ab 2 -ad 512 -as 128 -ar 16 -aa 0.250 -lr 4 -lw 0.050 -av 0 0 0
panel_148 = Panel("""mkdir -p <proj>/images/
rpict -t 10 -vf <vf> -x <x> -y <y> <radPar> <octree> > <proj>/images/<target-.>.hdr
normtiff <proj>/images/<target-.>.hdr <proj>/images/<target-.>.tif
convert <proj>/images/<target-.>.tif <proj>/images/<target>
echo <proj>/images/<target>""")
octree_3 = Text(execute_ssh_async_44.Stdout)
and_11 = GateAnd(A=execute_ssh_async_44.Ran, B=execute_ssh_async_46.Stdout)
overrides_41 = ApplyOverrides(
    Input=panel_148,
    Vf=execute_ssh_async_45.Stdout,
    X="600",
    Y="500",
    RadPar="-ab 1 -ad 512",
    Octree=octree_3,
    Target="rpict_render.png")  # -> Output, Pairs
execute_ssh_async_47 = ExecuteSSHAsync(
    _SSHCommands_=overrides_41.Output,
    Run=and_11,
    addPrefix=True,
    addSuffix=True,
    description="""mkdir -p ~/simulation/test_project2/images/
rpict -t 10 -vf /home/mss/simulation/test_project2/views/view.vf -x 600 -y 500 -ab 1 -ad 512 /home/mss/simulation/test_project2/octrees/my_test_scene.oct > ~/simulation/test_project2/images/rpict_render.hdr
normtiff ~/simulation/test_project2/images/rpict_render.hdr ~/simulation/test_project2/images/rpict_render.tif
convert ~/simulation/test_project2/images/rpict_render.tif ~/simulation/test_project2/images/rpict_render.png
echo ~/simulation/test_project2/images/rpict_render.png""",
    fireLogs=False,
    stdouts="/home/mss/simulation/test_project2/images/rpict_render.png",
    suppressWarnings=False)  # -> Stdout, Stderr_, Log, Pid, Ran
convertpaths_5 = ConvertPaths(I=execute_ssh_async_47.Stdout)  # -> Linux, Windows
imageviewer_6 = LBImageViewer(ImagePath_=convertpaths_5.Windows, _scale_=1, DisableClickable=False, SaveImgWithCoords=False, scale=1)  # -> ImagePath, Values, GIF

# ----
# Parallel RTRACE render (illuminance)
# this hdr is over exposed,
# I wonder what we can do with that..
panel_149 = Panel("""mkdir -p <proj>/images/
vwrays -ff -x <x> -y <y> -vf <vf> -pa 1 | rtrace <radOptions> -n <cpus> `vwrays -d -ff -x <x> -y <y> -vf <vf> -pa 1` -ffc <oct> > <proj>/images/<target-.>.hdr
echo <proj>/images/<target-.>.hdr""")
octree_4 = Text(execute_ssh_async_44.Stdout)
run = LBFalseStartToggle(False)
viewfile = Text(execute_ssh_async_45.Stdout)
panel_150 = Panel("echo \"rvu -vtv -vp 0.5 4.5 1.6 -vd 0.830824 -1.13002 -0.181063 -vu 0 0 1 -vh 98.2132 -vv 79.2785 -vo 0 -va 0 -vs 0 -vl 0\" > <proj>/views/myview.vf;echo <proj>/views/myview.vf")
overrides_42 = ApplyOverrides(
    Input=panel_149,
    RadOptions="-i -ab 1 -ad 512",
    X="600",
    Y="500",
    Vf=viewfile,
    Oct=octree_4,
    Target="rtrace_rendering_illum.png")  # -> Output, Pairs
execute_ssh_async_48 = ExecuteSSHAsync(
    SSHCommands=panel_150,
    Run=run,
    addPrefix=True,
    addSuffix=True,
    fireLogs=False,
    stdouts="/home/mss/simulation/test_project2/views/myview.vf",
    suppressWarnings=False)  # -> Stdout, Stderr, Log, Pid, Ran; disabled
execute_ssh_async_49 = ExecuteSSHAsync(
    _SSHCommands=overrides_42.Output,
    Run=run,
    addPrefix=True,
    addSuffix=False,
    fireLogs=False,
    stdouts="/home/mss/simulation/test_project2/images/rtrace_rendering_illum.hdr",
    suppressWarnings=False)  # -> Stdout, Stderr_, Log, Pid, Ran
panel_151 = Panel(execute_ssh_async_49.Stdout)
convertpaths_6 = ConvertPaths(I=execute_ssh_async_49.Stdout)  # -> Linux, Windows
imageviewer_7 = LBImageViewer(ImagePath_=convertpaths_6.Windows, _scale_=1, DisableClickable=False, SaveImgWithCoords=False, scale=1)  # -> ImagePath, Values, GIF

# ----
# Parallel RTRACE render
# this hdr is over exposed,
# I wonder what we can do with that..
octree_5 = Text(execute_ssh_async_44.Stdout)
run_2 = LBFalseStartToggle(False)
viewfile_2 = Text(execute_ssh_async_45.Stdout)
panel_152 = Panel("""mkdir -p <proj>/images/
vwrays -ff -x <x> -y <y> -vf <vf> -pa 1 | rtrace <radOptions> -n <cpus> `vwrays -d -ff -x <x> -y <y> -vf <vf> -pa 1` -ffc <oct> > <proj>/images/<target-.>.hdr
echo <proj>/images/<target-.>.hdr""")
panel_153 = Panel("echo \"rvu -vtv -vp 0.5 4.5 1.6 -vd 0.830824 -1.13002 -0.181063 -vu 0 0 1 -vh 98.2132 -vv 79.2785 -vo 0 -va 0 -vs 0 -vl 0\" > <proj>/views/myview.vf;echo <proj>/views/myview.vf")
overrides_43 = ApplyOverrides(
    Input=panel_152,
    RadOptions="-ab 1 -ad 512",
    X="600",
    Y="500",
    Vf=viewfile_2,
    Oct=octree_5,
    Target="rtrace_rendering.png")  # -> Output, Pairs
execute_ssh_async_50 = ExecuteSSHAsync(
    SSHCommands=panel_153,
    Run=run_2,
    addPrefix=True,
    addSuffix=True,
    fireLogs=False,
    stdouts="/home/mss/simulation/test_project2/views/myview.vf",
    suppressWarnings=False)  # -> Stdout, Stderr, Log, Pid, Ran; disabled
execute_ssh_async_51 = ExecuteSSHAsync(
    _SSHCommands=overrides_43.Output,
    Run=run_2,
    addPrefix=True,
    addSuffix=False,
    description="Hi",
    fireLogs=False,
    name="Test",
    stdouts="/home/mss/simulation/test_project2/images/rtrace_rendering.hdr",
    suppressWarnings=False)  # -> Stdout, Stderr_, Log, Pid, Ran
panel_154 = Panel(execute_ssh_async_51.Stdout)
convertpaths_7 = ConvertPaths(I=execute_ssh_async_51.Stdout)  # -> Linux, Windows
imageviewer_8 = LBImageViewer(ImagePath_=convertpaths_7.Windows, _scale_=1, DisableClickable=False, SaveImgWithCoords=False, scale=1)  # -> ImagePath, Values, GIF

# ----
# RENDER PARALLEL (RPIECE)
# rpiece render multithreaded
# 
# https://discourse.radiance-online.org/t/another-rpiece-question/308/5
opt1 = Panel("""NCPU=<cpus>
COLS=<cpus>
ROWS=8
echo "-vf views/view.vf" > viewpoint
echo "-w -i -bv -ab 4 -ar 128 -ad 1024 -as 512 -aa 0.15 -av 0.0 0.0 0.0 -aw 0 -lr -10 -lw 0.004 -x 2048 -y 2048 -af ambfile -ps 1 -ds .1 -dj .6 -t 120" > options
echo "-o <proj>/<unf> <proj>/<octree>" > arguments
echo $COLS $ROWS > syncfile
rm -f pp
while [ "$NCPU" -gt 0 ]
do
	echo "running proc $NCPU"
	rpiece -v -PP pp -F syncfile @viewpoint @options @arguments &
	NCPU=`expr $NCPU - 1`
	sleep 2
done
wait""")
panel_155 = Panel("""echo "" > <proj>/run2.sh

tee -a <proj>/run2.sh > /dev/null <<EOF
<shell>
EOF""")
ex = Ex(T=opt1)
overrides_44 = ApplyOverrides(Input=panel_155, Shell=ex)  # -> Output, Pairs
octree_6 = Text(execute_ssh_async_44.Stdout)
falsestart_10 = LBFalseStartToggle(False)
overrides_45 = ApplyOverrides(Input=overrides_44.Output, Unf="collectedRender.unf", Octree=octree_6)  # -> Output, Pairs
panel_156 = Panel("pcompos -a <cpus> <unf> > <targethdr>")
execute_ssh_async_52 = ExecuteSSHAsync(
    SSHCommands_=overrides_45.Output,
    Run=falsestart_10,
    addPrefix=False,
    addSuffix=True,
    fireLogs=False,
    suppressWarnings=False)  # -> Stdout, Stderr_, Log, Pid, Ran
panel_157 = Panel(overrides_45.Output)
panel_158 = Panel(execute_ssh_async_52.Stderr_)

# ----
# Using PCOND to set automatic exposure
# and convert to PNG
panel_159 = Panel("""pcond -h <hdr> <hdr-.>_exposed.hdr
ra_tiff <hdr-.>_exposed.hdr <hdr-.>_exposed.tif
convert <hdr-.>_exposed.tif <hdr-.>_exposed.png
echo <hdr-.>_exposed.png""")
overrides_46 = ApplyOverrides(Input_=panel_159, Hdr=execute_ssh_async_49.Stdout)  # -> Output, Pairs
execute_ssh_async_53 = ExecuteSSHAsync(
    _SSHCommands_=overrides_46.Output,
    Run=execute_ssh_async_49.Ran,
    addPrefix=True,
    addSuffix=True,
    fireLogs=False,
    stdouts="/home/mss/simulation/test_project2/images/rtrace_rendering_illum_exposed.png",
    suppressWarnings=False)  # -> Stdout, Stderr_, Log, Pid, Ran
convertpaths_8 = ConvertPaths(I=execute_ssh_async_53.Stdout)  # -> Linux, Windows
imageviewer_9 = LBImageViewer(ImagePath_=convertpaths_8.Windows, _scale_="1.5", DisableClickable=False, SaveImgWithCoords=False, scale=1.5)  # -> ImagePath, Values, GIF

# ----
# Using PCOND to set automatic exposure
# and convert to PNG
panel_160 = Panel("""pcond -h <hdr> <hdr-.>_exposed.hdr
ra_tiff <hdr-.>_exposed.hdr <hdr-.>_exposed.tif
convert <hdr-.>_exposed.tif <hdr-.>_exposed.png
echo <hdr-.>_exposed.png""")
overrides_47 = ApplyOverrides(Input_=panel_160, Hdr=execute_ssh_async_51.Stdout)  # -> Output, Pairs
execute_ssh_async_54 = ExecuteSSHAsync(
    _SSHCommands_=overrides_47.Output,
    Run=execute_ssh_async_51.Ran,
    addPrefix=True,
    addSuffix=True,
    fireLogs=False,
    stdouts="/home/mss/simulation/test_project2/images/rtrace_rendering_exposed.png",
    suppressWarnings=False)  # -> Stdout, Stderr_, Log, Pid, Ran
convertpaths_9 = ConvertPaths(I=execute_ssh_async_54.Stdout)  # -> Linux, Windows
imageviewer_10 = LBImageViewer(ImagePath_=convertpaths_9.Windows, _scale_="1.5", DisableClickable=False, SaveImgWithCoords=False, scale=1.5)  # -> ImagePath, Values, GIF

# ----
# False color with illuminance curves
# on top of luminance picture
panel_161 = Panel("falsecolor -s 9000 -l lux -p <rad-.>_exposed.hdr -i <irrad> -cl -log 2 > <rad-.>_fc.hdr;echo <rad-.>_fc.hdr")
and_12 = GateAnd(A=execute_ssh_async_54.Ran, B=execute_ssh_async_49.Ran)
overrides_48 = ApplyOverrides(Input_=panel_161, Rad=execute_ssh_async_51.Stdout, Irrad=execute_ssh_async_49.Stdout)  # -> Output, Pairs
execute_ssh_async_55 = ExecuteSSHAsync(
    _SSHCommands_=overrides_48.Output,
    Run=and_12,
    addPrefix=True,
    addSuffix=True,
    fireLogs=False,
    stdouts="/home/mss/simulation/test_project2/images/rtrace_rendering_fc.hdr",
    suppressWarnings=False)  # -> Stdout, Stderr_, Log, Pid, Ran
convertpaths_10 = ConvertPaths(I=execute_ssh_async_55.Stdout)  # -> Linux, Windows
imageviewer_11 = LBImageViewer(ImagePath_=convertpaths_10.Windows, _scale_="1.5", DisableClickable=False, SaveImgWithCoords=False, scale=1.5)  # -> ImagePath, Values, GIF

# ==== cluster Cluster
L = ClusterInput()
item = ListItem(List=flatten(L), Index=0, Wrap=True)
rec = DataRecorder(item, DataLimit=-10, RecordData=True)
lng = ListLength(List=rec)
L_2 = ClusterOutput(lng)

# ==== cluster Normals
amplitude = ClusterInput()
amplitude_2 = Data(amplitude)
geo = ClusterInput()
merge = Merge(Data1=flatten(amplitude_2), Data2=flatten("1m"))
geo_2 = Geometry(geo)
item = ListItem(List=merge, Index=0, Wrap=True)
facen = FaceNormals(Mesh=geo_2)  # -> Centers, Normals
U = Units(ValueString=item)
avr = Average(Input=facen.Centers)
avr_2 = Average(Input=facen.Normals)
unflatten = UnflattenTree(Tree=avr, Guide=geo_2)
unflatten_2 = UnflattenTree(Tree=avr_2, Guide=geo_2)
amp = Amplitude(Vector=unflatten_2, Amplitude=U)
pl = PlaneNormal(Origin=unflatten, ZAxis=unflatten_2)
norm = Vector(amp)
center = Point(unflatten)
P = ClusterOutput(pl)
norm_2 = ClusterOutput(norm)
center_2 = ClusterOutput(center)

# ==== cluster Ex
T = ClusterInput()
rep = ReplaceText(Text=T, Find="\", Replace="\\", RecursiveReplace=False)
rep_2 = ReplaceText(Text=rep, Find="$", Replace="\$", RecursiveReplace=False)
rep_3 = ReplaceText(Text=rep_2, Find="`", Replace="\`", RecursiveReplace=False)
R = ClusterOutput(rep_3)
