# Grasshopper definition TestRenders.gh (Grasshopper 1.0.7)
# Copyright: 2021
# Copyright: 2022-29-14
# Copyright: 2022-22-28
# plug-ins: MantaRay, LadybugGrasshopper, Human, Telepathy

# ----
# Setup globals
panel = Panel("""<LinuxHome>
simulation""")
panel_2 = Panel("""proj
projname""")
global_overrides = GlobalOverrides(Keys=panel_2, Values=panel)
panel_3 = Panel(global_overrides)

panel_4 = Panel("C:\MantaRayLinux")

# ----
# Local Connect
python = GhPythonScript()  # -> username; disabled
# ---------- python: Python ----------
__author__ = "mm1013"
__version__ = "2022.09.25"

import rhinoscriptsyntax as rs

import System

username = System.Environment.UserName

if username == "mm1013":
    username = "mss"
# ---------- end python ----------
toggle = BooleanToggle(True)  # disabled
panel_5 = Panel("127.0.0.1")  # disabled
panel_6 = Panel(python)  # disabled
connect = ConnectSSHFTP(User=panel_6, Ip="127.0.0.1", Password="_prompt", _port=22, Connect=toggle)  # -> Status, Prefixes, Run; disabled
panel_7 = Panel(connect.Status)  # disabled

od_outdated = ColourSwatch(SwatchColor=RGBA(97, 97, 97, 150))
u_updated = ColourSwatch(SwatchColor=RGBA(208, 115, 230, 112))
toggle_2 = BooleanToggle(False)
g_general = ColourSwatch(SwatchColor=RGBA(245, 243, 237, 156))
o_outputs = ColourSwatch(SwatchColor=RGBA(160, 218, 242, 203))
s_settings = ColourSwatch(SwatchColor=RGBA(224, 145, 81, 154))
cc_core2 = ColourSwatch(SwatchColor=RGBA(230, 216, 186, 208))
y_yellow = ColourSwatch(SwatchColor=RGBA(247, 244, 64, 188))
i_inputs = ColourSwatch(SwatchColor=RGBA(125, 217, 98, 150))
c_core = ColourSwatch(SwatchColor=RGBA(235, 227, 206, 203))
r_red = ColourSwatch(SwatchColor=RGBA(242, 63, 63, 203))

# ----
# Test connection
testconnection = TestConnection()  # -> Status, Errors
panel_8 = Panel(testconnection.Status)
panel_9 = Panel(testconnection.Errors)

# ----
# double click to update
parserhinofile = ParseRhinoFile(LayerPrefix="Daylight_Inputs::_", Grids="_Grids")  # -> GlassGeometries, GlassModifiers, port, OpaqueGeometries, OpaqueModifiers, port_2, CustomGeometries, ModifierNames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

# ----
# Log of latest(10) SSH Commands
logviewer = LogViewer(Number=10)  # -> CurrentTasks, Logs
panel_10 = Panel(logviewer.CurrentTasks)
panel_11 = Panel(logviewer.Logs)

colorgroups = CSharpScript(
    Colors=[i_inputs, s_settings, g_general, c_core, o_outputs, r_red, y_yellow, u_updated, od_outdated, cc_core2],
    Enable=toggle_2,
    Rename=Toggle(False),
    RunOnce=Button(),
    Debug=Toggle(False))  # -> out; inputs Colors: list of Color, Enable: Boolean, Rename: Boolean, RunOnce: Boolean, Debug: Boolean
# ---------- colorgroups: C# usings ----------
using System.Linq;
using System.Text;
using System.Reflection;
# ---------- colorgroups: C# ----------
    msg.Clear();


    this.Component.Message = "id: " + id.ToString();

    _debug = Debug; //Set to true to have all events printed in rhino log
    _rename = Rename;

    if (Enable)
    {
      msg.AppendFormat("Set up events on ID {0}\n", id);
      SetupDict(); // Create a dictionary of the input swatches
      SetEventHandlers(); // This would do the job.


    }
    else
    {
      RemoveEventHandlers();
    }
    if (RunOnce)
    {
      foreach(Grasshopper.Kernel.Special.GH_Group grp in Grasshopper.Instances.ActiveCanvas.Document.Objects.OfType<Grasshopper.Kernel.Special.GH_Group>())
      {
        ColorGroup(grp, null); // You decide if it should run once on all existing groups

      }
    }

    Print(msg.ToString());


    // Component setup
    Component.Description = "Set up event handlers to color groups based on prefixes such as 'in_' and 'out_'.\n"
      + "Please insert only swatcheds directly into the Colors input\n\n"
      + "MIT License. Copyright Mathias Sønderskov Schaltz 2022";
    Component.Params.Input[0].Description = "Please insert only swatcheds directly into the Colors input.\nRemember to rename them";
    Component.Params.Input[1].Description = "Toggle to run...";
    Component.Params.Input[2].Description = "Set to true if you want to automatically rename the groups and remove prefix. Default is false.";
    Component.Params.Input[3].Description = "Set to true to run it once and color all existing groups.";
    Component.Params.Input[Component.Params.Input.Count - 1].Description = "Set debug to true to get all the events printed in the rhino log";
# ---------- colorgroups: C# additional code ----------
  public static Random rnd = new Random();
  public int id = rnd.Next(0, 1000);
  StringBuilder msg = new StringBuilder();
  Dictionary<string, System.Drawing.Color> colorDict = new Dictionary<string, System.Drawing.Color>();

  bool _debug = false;
  bool _rename = false;

  public bool IdExists(int id)
  {
    IList<IGH_DocumentObject> objs = Grasshopper.Instances.ActiveCanvas.Document.Objects;
    return objs
      .OfType<IGH_Component>()
      .Where(ob => ob.NickName == this.Component.NickName)
      .Where(ob => ob.GetType().ToString() == "ScriptComponents.Component_CSNET_Script")
      .Where(ob => ob.Message == "id: " + id.ToString()).Any();

  }


  public void SetupDict()
  {
    colorDict.Clear();
    // Get all inputs to "Colors"
    IList<IGH_Param> colorSources = this.Component.Params.Input[0].Sources;
    if (colorSources.Count == 0)
    {
      throw new Exception("You forgot to setup the colors. Please input swatch components and rename them");
    }
    foreach(IGH_Param source in colorSources)
    {
      //if (source.Type.ToString() == "Grasshopper.Kernel.Types.GH_Colour")
      if (source is Grasshopper.Kernel.Special.GH_ColourSwatch)
      {
        string nickName = source.NickName.Split('_')[0].Trim() + "_";
        if(!colorDict.ContainsKey(nickName))
        {
          Grasshopper.Kernel.Special.GH_ColourSwatch swatch = (Grasshopper.Kernel.Special.GH_ColourSwatch) source;
          colorDict.Add(nickName, swatch.SwatchColour);
        }
        else
        {
          throw new Exception("Multiple swatches using the same name detected. Please rename");
        }
      }
      else
      {
        throw new Exception("Whacko! Why did you input a non-swatch into the Colors? " + source.Type.ToString());
      }

    }

    msg.AppendFormat("Set up the dictionaries with {0} colors\n", colorDict.Count);
    foreach(var pairs in colorDict)
    {
      msg.AppendFormat("{0} -> {1}\n", ("\"" + pairs.Key + "\"").PadRight(5 + colorDict.Keys.Select(k => k.Length).Max()), pairs.Value);
    }
  }

  public void SetEventHandlers()
  {

    // Always remove events first to avoid duplicates
    GrasshopperDocument.ObjectsAdded -= OnObjectsAdded;
    GrasshopperDocument.ObjectsDeleted -= OnObjectsRemoved;
    GrasshopperDocument.ObjectsDeleted -= OnDeleteThisComponent;

    // Attach events
    GrasshopperDocument.ObjectsAdded += OnObjectsAdded;
    GrasshopperDocument.ObjectsDeleted += OnObjectsRemoved;
    GrasshopperDocument.ObjectsDeleted += OnDeleteThisComponent;


    foreach(Grasshopper.Kernel.Special.GH_Group grp in GrasshopperDocument.Objects.OfType<Grasshopper.Kernel.Special.GH_Group>())
    {
      grp.ObjectChanged -= ColorGroup;
      grp.ObjectChanged += ColorGroup;

      //ColorGroup(grp, null); // Make sure to run it once
    }
    msg.AppendFormat("Added the eventhandlers on {0} existing groups and on future created groups\n", GrasshopperDocument.Objects.OfType<Grasshopper.Kernel.Special.GH_Group>().Count());
  }

  public void OnObjectsAdded(object sender, GH_DocObjectEventArgs e)
  {
    bool any = false;
    foreach (Grasshopper.Kernel.Special.GH_Group grp in e.Objects.OfType<Grasshopper.Kernel.Special.GH_Group>())
    {
      grp.ObjectChanged -= ColorGroup;
      grp.ObjectChanged += ColorGroup;
      any = true;
    }

    DebugWrite(any ? "Group Objects Added: Attaching Events to ObjectChanged" : "Objects Added - but no groups");
  }

  //Same but reversed
  public void OnObjectsRemoved(object sender, GH_DocObjectEventArgs e)
  {
    bool any = false;
    foreach (Grasshopper.Kernel.Special.GH_Group grp in e.Objects.OfType<Grasshopper.Kernel.Special.GH_Group>())
    {
      grp.ObjectChanged -= ColorGroup;
      any = true;
    }

    DebugWrite(any ? "Group Objects Removed, removing event" : "Objects Removed - although not a group");

  }



  public void RemoveEventHandlers()
  {
    GrasshopperDocument.ObjectsAdded -= OnObjectsAdded;
    GrasshopperDocument.ObjectsDeleted -= OnObjectsRemoved;


    foreach(Grasshopper.Kernel.Special.GH_Group grp in GrasshopperDocument.Objects.OfType<Grasshopper.Kernel.Special.GH_Group>())
    {
      grp.ObjectChanged -= ColorGroup;

    }
    msg.AppendFormat("Removed event handlers on document and on {0} groups\n", GrasshopperDocument.Objects.OfType<Grasshopper.Kernel.Special.GH_Group>().Count());

  }

  public void ColorGroup(object sender, EventArgs e)
  {
    if (!IdExists(id))
    {
      DebugWrite("Component not relevant. Disabling old id + " + id.ToString());
      RemoveEventHandlers();
      return;
    }

    Grasshopper.Kernel.Special.GH_Group grp = sender as Grasshopper.Kernel.Special.GH_Group;
    if (grp == null) return; //not type GH_Group
    //if (!grp.NickName.EndsWith("_")) return;

    string[] nameParts = grp.NickName.Split('_');
    if (nameParts.Length <= 1)
      return;
    string prefix = grp.NickName.Split('_')[0].Trim() + '_';

    string prefixes = String.Join(", ", colorDict.Keys.Select(k => "\"" + k + "\""));

    msg.Append("prefix " + prefix + "\n");
    if (colorDict.ContainsKey(prefix))
    {
      //if (grp.NickName.EndsWith("_"))
      grp.Colour = colorDict[prefix];
      if (_rename)
      {
        grp.NickName = grp.NickName.Replace(prefix, "");
      }

      DebugWrite("Colored " + grp.NickName);

    }
    else
    {
      DebugWrite("Group changed but not relevant: prefix " + prefix + " is not among " + prefixes);
    }

  }
  public void DebugWrite(string msg)
  {
    if (_debug)
    {
      Rhino.RhinoApp.WriteLine(String.Format("[ColGrps {0}]: {1}", id, msg));
    }
  }

  public void OnDeleteThisComponent(object sender, GH_DocObjectEventArgs e)
  {

    if (e.Objects.OfType<Grasshopper.Kernel.GH_Component>().Where(o => o.NickName == this.Component.NickName).Any())
    {
      DebugWrite("Removed template component. Removing all the eventhandlers");
      RemoveEventHandlers();
    }

  }
# ---------- end colorgroups ----------

fixparams = CSharpScript(FixOnce=Button(), Enable=toggle_2, Debug=Toggle(False))  # -> out; inputs FixOnce: Boolean, Enable: Boolean, Debug: Boolean
# ---------- fixparams: C# usings ----------
using System.Text;
using System.Linq;
using Grasshopper.Kernel.Special;
# ---------- fixparams: C# ----------
    _debug = Debug;
    _enable = Enable;
    msg.Clear();
    this.Component.Message = "id: " + id.ToString();




    if (Enable)
    {
      SetEventHandlers();
    }
    else
    {
      RemoveEventHandlers();
    }


    if (FixOnce)
    {
      FixAll();
    }

    Print(msg.ToString());

    // Component setup
    Component.Description = "Set up event handlers to change params to show nickname and not icon"
      + "\n\n"
      + "MIT License. Copyright Mathias Sønderskov Schaltz 2022";
    Component.Params.Input[0].Description = "Run me once on the document";
    Component.Params.Input[1].Description = "Toggle to enable event listener";
    Component.Params.Input[Component.Params.Input.Count - 1].Description = "Set debug to true to get all the events printed in the rhino log";
# ---------- fixparams: C# additional code ----------
  public static Random rnd = new Random();
  public int id = rnd.Next(0, 1000);
  StringBuilder msg = new StringBuilder();
  bool _debug = false;
  bool _enable = false;

  public Dictionary<IGH_ActiveObject, HashSet<GH_Group>> groupsPerObject = new Dictionary<IGH_ActiveObject, HashSet<GH_Group>>();


  public void OnObjectsAdded(object sender, GH_DocObjectEventArgs e)
  {
    if (!IdExists(id))
    {
      DebugWrite("[FixParam] Component not relevant. Disabling old id " + id.ToString());
      RemoveEventHandlers();
      return;
    }


    if(_enable)
    {
      foreach(IGH_Param par in e.Objects.OfType<IGH_Param>())
      {
        FixInputs(par);
      }
    }


  }

  public void FixAll()
  {
    //DebugWrite("Fixing all?");
    foreach(IGH_Param par in GrasshopperDocument.Objects.OfType<IGH_Param>())
    {

      FixInputs(par);
    }
  }




  public void FixInputs(IGH_ActiveObject obj)
  {



    IGH_Param par = obj as IGH_Param;
    if (par != null)
    {

      par.IconDisplayMode = GH_IconDisplayMode.name;


    }

  }


  public void SetEventHandlers()
  {

    GrasshopperDocument.ObjectsAdded -= OnObjectsAdded;
    GrasshopperDocument.ObjectsAdded += OnObjectsAdded;
    GrasshopperDocument.ObjectsDeleted -= OnDeleteThisComponent;
    GrasshopperDocument.ObjectsDeleted += OnDeleteThisComponent;
    msg.AppendFormat("Added the eventhandlers to OnObjectsAdded\n", GrasshopperDocument.Objects.OfType<Grasshopper.Kernel.Special.GH_Group>().Count());
  }

  public void RemoveEventHandlers()
  {
    GrasshopperDocument.ObjectsAdded -= OnObjectsAdded;
    GrasshopperDocument.ObjectsDeleted -= OnDeleteThisComponent;

    msg.AppendFormat("Removed wire event handlers on document\n", GrasshopperDocument.Objects.OfType<Grasshopper.Kernel.Special.GH_Group>().Count());

  }

  public void OnDeleteThisComponent(object sender, GH_DocObjectEventArgs e)
  {

    if (e.Objects.OfType<Grasshopper.Kernel.GH_Component>().Where(o => o.NickName == this.Component.NickName).Any())
    {
      DebugWrite("Removed template component. Removing all the eventhandlers");
      RemoveEventHandlers();
    }

  }

  public bool IdExists(int id)
  {
    IList<IGH_DocumentObject> objs = Grasshopper.Instances.ActiveCanvas.Document.Objects;
    return objs
      .OfType<IGH_Component>()
      .Where(ob => ob.NickName == this.Component.NickName)
      .Where(ob => ob.GetType().ToString() == "ScriptComponents.Component_CSNET_Script")
      .Where(ob => ob.Message == "id: " + id.ToString()).Any();

  }

  public void DebugWrite(string msg)
  {
    if (_debug)
    {
      Rhino.RhinoApp.WriteLine(String.Format("[FixParams {0}]: {1}", id, msg));
    }
  }
# ---------- end fixparams ----------

fixwires = CSharpScript(FixOnce=Button(), Enable=toggle_2, Debug=Toggle(False))  # -> out; inputs FixOnce: Boolean, Enable: Boolean, Debug: Boolean
# ---------- fixwires: C# ----------
    _debug = Debug;
    _enable = Enable;
    msg.Clear();
    this.Component.Message = "id: " + id.ToString();


    SetDictionary();

    if (Enable)
    {
      SetEventHandlers();
    }
    else
    {
      RemoveEventHandlers();
    }


    if (FixOnce)
    {
      FixAll();
    }

    Print(msg.ToString());
    
    // Component setup
    Component.Description = "Set up event handlers to change all wire types across groups to faint"
      + "\n\n"
      + "MIT License. Copyright Mathias Sønderskov Schaltz 2022";
    Component.Params.Input[0].Description = "Run me once on the document";
    Component.Params.Input[1].Description = "Toggle to enable event listener";
    Component.Params.Input[Component.Params.Input.Count - 1].Description = "Set debug to true to get all the events printed in the rhino log";
# ---------- fixwires: C# additional code ----------
  public static Random rnd = new Random();
  public int id = rnd.Next(0, 1000);
  StringBuilder msg = new StringBuilder();
  bool _debug = false;
  bool _enable = false;

  public Dictionary<IGH_ActiveObject, HashSet<GH_Group>> groupsPerObject = new Dictionary<IGH_ActiveObject, HashSet<GH_Group>>();


  public void OnSolutionExpired(object sender, GH_DocUndoEventArgs e)
  {
    if(_enable)
      FixAll();
  }

  public void FixAll()
  {
    //DebugWrite("Fixing all?");
    foreach(IGH_ActiveObject key in groupsPerObject.Keys.Where(k => groupsPerObject[k].Count() > 0))
    {

      FixInputs(key);
    }
  }



  public bool HasGroup(IGH_ActiveObject obj)
  {
    return groupsPerObject[obj].Count > 0;
  }


  public void FixInputs(IGH_ActiveObject obj)
  {

    if (!IdExists(id))
    {
      DebugWrite("Component not relevant. Disabling old id " + id.ToString());
      RemoveEventHandlers();
      return;
    }

    //List<List<IGH_ActiveObject>> parents = new List<List<IGH_ActiveObject>>();
    IGH_Param par = obj as IGH_Param;
    if (par != null && par.Sources != null)
    {


      IEnumerable<IGH_ActiveObject> p = par.Sources.Select(s => s.Attributes.GetTopLevel.DocObject as IGH_ActiveObject);
      //parents.Add(p);
      if(HasGroup(obj) && p.All(o => !HasGroupsInCommon(o, obj)) && par.WireDisplay != GH_ParamWireDisplay.faint)
      {
        DebugWrite("Fixing " + par.Attributes.GetTopLevel.DocObject.NickName);
        par.WireDisplay = GH_ParamWireDisplay.faint;
      }

    }

    IGH_Component comp = obj as IGH_Component;
    if (comp != null)
    {
      foreach(IGH_Param inp in comp.Params.Input)
      {

        IEnumerable<IGH_ActiveObject> p = inp.Sources.Select(i => i.Attributes.GetTopLevel.DocObject as IGH_ActiveObject);

        if(HasGroup(obj) && p.All(o => !HasGroupsInCommon(o, obj)) && inp.WireDisplay != GH_ParamWireDisplay.faint)
        {
          DebugWrite("Fixing " + inp.Attributes.GetTopLevel.DocObject.NickName);
          inp.WireDisplay = GH_ParamWireDisplay.faint;
        }
      }

    }



  }





  public void SetDictionary()
  {
    IList<IGH_DocumentObject> objects = Grasshopper.Instances.ActiveCanvas.Document.Objects.ToList();
    //Print(String.Join(", ", objects.Select(o => o.NickName)));

    groupsPerObject = objects
      .Where(o => o.GetType() != typeof(GH_Group))
      .OfType<IGH_ActiveObject>()
      .ToDictionary(o => o, o => new HashSet<GH_Group>());

    foreach(GH_Group grp in objects.OfType<GH_Group>())
    {

      foreach(IGH_ActiveObject obj in grp.ObjectsRecursive().OfType<IGH_ActiveObject>())
      {
        groupsPerObject[obj].Add(grp);

      }
    }



  }

  public bool HasGroupsInCommon(IGH_ActiveObject obj1, IGH_ActiveObject obj2)
  {
    HashSet<GH_Group> set1 = groupsPerObject[obj1];
    HashSet<GH_Group> set2 = groupsPerObject[obj2];

    set1.IntersectWith(set2);

    return set1.Any();
  }

  public void SetEventHandlers()
  {

    GrasshopperDocument.UndoStateChanged -= OnSolutionExpired;
    GrasshopperDocument.UndoStateChanged += OnSolutionExpired;
    GrasshopperDocument.ObjectsDeleted -= OnDeleteThisComponent;
    GrasshopperDocument.ObjectsDeleted += OnDeleteThisComponent;
    msg.AppendFormat("Added the eventhandlers to UndoStateChanged\n", GrasshopperDocument.Objects.OfType<Grasshopper.Kernel.Special.GH_Group>().Count());
  }

  public void RemoveEventHandlers()
  {
    GrasshopperDocument.UndoStateChanged -= OnSolutionExpired;
    GrasshopperDocument.ObjectsDeleted -= OnDeleteThisComponent;

    msg.AppendFormat("Removed wire event handlers on document\n", GrasshopperDocument.Objects.OfType<Grasshopper.Kernel.Special.GH_Group>().Count());

  }

  public void OnDeleteThisComponent(object sender, GH_DocObjectEventArgs e)
  {

    if (e.Objects.OfType<Grasshopper.Kernel.GH_Component>().Where(o => o.NickName == this.Component.NickName).Any())
    {
      DebugWrite("Removed template component. Removing all the eventhandlers");
      RemoveEventHandlers();
    }

  }

  public bool IdExists(int id)
  {
    IList<IGH_DocumentObject> objs = Grasshopper.Instances.ActiveCanvas.Document.Objects;
    return objs
      .OfType<IGH_Component>()
      .Where(ob => ob.NickName == this.Component.NickName)
      .Where(ob => ob.GetType().ToString() == "ScriptComponents.Component_CSNET_Script")
      .Where(ob => ob.Message == "id: " + id.ToString()).Any();

  }

  public void DebugWrite(string msg)
  {
    if (_debug)
    {
      Rhino.RhinoApp.WriteLine(String.Format("[FixWire {0}]: {1}", id, msg));
    }
  }
# ---------- end fixwires ----------

# ----
# Read rhino file and prepare simple geometry
falsestart = LBFalseStartToggle(True)
panel_12 = Panel(parserhinofile.SkippedLayers)

# ----
# Create working folder
panel_13 = Panel("""mkdir -p <LinuxHome>
mkdir -p <LinuxHome>/radFiles
mkdir -p <LinuxHome>/objFiles
echo <LinuxHome>""")
overrides = ApplyOverrides(Input=panel_13)  # -> Output, DynamicOutput
executessh = ExecuteSSH(
    _SSHCommands_=overrides.DynamicOutput,
    Run=falsestart,
    addPrefix=True,
    description="""mkdir -p ~/MantaRay/TestFolder
mkdir -p ~/MantaRay/TestFolder/radFiles
mkdir -p ~/MantaRay/TestFolder/objFiles
echo ~/MantaRay/TestFolder""",
    fireLogs=False,
    lastRunTime=65.1296,
    name="Create working dir",
    suppressWarnings=False,
    results="/home/lio/MantaRay/TestFolder",
    commands="""mkdir -p ~/MantaRay/TestFolder
mkdir -p ~/MantaRay/TestFolder/radFiles
mkdir -p ~/MantaRay/TestFolder/objFiles
echo ~/MantaRay/TestFolder""")  # -> Stdout, Stderr_, Ran

# ----
# processes to kill
panel_14 = Panel("""dctimestep
rcontrib
rtrace
oconv
rvu
rmtxop""")
kill = LBFalseStartToggle(False)

# ----
# Kill processes running on linux
panel_15 = Panel("pkill -f <instance>")
overrides_2 = ApplyOverrides(Input=panel_15, Instance=graft(panel_14))  # -> Output, DynamicOutput
join = TextJoin(Text=flatten(overrides_2.Output), Join=";")
executessh_2 = ExecuteSSH(_SSHCommands_=join, Run=kill, addPrefix=True, fireLogs=False, lastRunTime=0, suppressWarnings=False)  # -> Stdout, Stderr_, Ran
panel_16 = Panel(executessh_2.Stderr_)

# ----
# Keep biggest srf
# Colored skies! Why not?
# from https://discourse.radiance-online.org/t/new-tool-for-generating-colored-sky/5891
largest_brep = LargestBREP(window_breps=[<geometry referenced from the Rhino model> x224])

# ----
# Template methods
# By Mathias Sønderskov Schaltz 2022
# Check for updates here https://github.com/Sonderwoods/GrasshopperScribbles
panel_17 = Panel(colorgroups)
panel_18 = Panel(fixwires)
panel_19 = Panel(fixparams)

bool = Boolean(executessh.Ran)
cluster = Cluster(mod=parserhinofile.GlassModifiers)  # -> name_geo, name_mod
geo = Geometry(parserhinofile.GlassGeometries)
overrides_3 = ApplyOverrides(Input="<Project>\objFiles")  # -> Output, DynamicOutput
mesh2obj = MeshToObj(
    Mesh=graft(geo),
    Name=graft(cluster.name_geo),
    MapFileName="mapping_glass",
    ModifierName=graft(cluster.name_mod),
    TargetFolder=overrides_3.Output,
    Run=bool)  # -> ObjFiles, MapFile, Run
entwine = Entwine(Branch00=mesh2obj.ObjFiles, Branch01=mesh2obj.MapFile, FlattenInputs=True)
overrides_4 = ApplyOverrides(Input="<SftpHome>/objFiles")
upload = Upload(
    LocalFilePaths=flatten(entwine),
    TargetFolder=overrides_4,
    Run=mesh2obj.Run,
    stdouts="/home/lio/MantaRay/TestFolder/objFiles/Glass_70_geo.obj>JOIN</home/lio/MantaRay/TestFolder/objFiles/mapping_glass.map")  # -> Status, FilePaths, Ran
panel_20 = Panel("""obj2rad -m <mapfile> -f <objFile> > <LinuxHome>/radFiles/<name>.rad
echo <LinuxHome>/radFiles/<name>.rad""")
python_2 = GhPythonScript(f=upload.FilePaths)  # -> m, o; inputs f: list
# ---------- python_2: Python ----------
__author__ = "mm1013"
__version__ = "2023.03.11"

import rhinoscriptsyntax as rs

try:
    m = f[-1]
    o = f[:-1]
except:
    pass
# ---------- end python_2 ----------
overrides_5 = ApplyOverrides(Input=panel_20, Mapfile=graft(python_2.m), ObjFile=graft(python_2.o), Name=graft(cluster.name_geo))  # -> Output, flatten(DynamicOutput)
executessh_3 = ExecuteSSH(
    _SSHCommands_=graft(overrides_5.DynamicOutput),
    Run=upload.Ran,
    addPrefix=True,
    description="""obj2rad -m /home/lio/MantaRay/TestFolder/objFiles/mapping_glass.map -f /home/lio/MantaRay/TestFolder/objFiles/Glass_70_geo.obj > ~/MantaRay/TestFolder/radFiles/Glass_70_geo.rad
echo ~/MantaRay/TestFolder/radFiles/Glass_70_geo.rad""",
    fireLogs=True,
    lastRunTime=67.1108,
    name="obj2map - glass",
    suppressWarnings=False,
    results="/home/lio/MantaRay/TestFolder/radFiles/Glass_70_geo.rad",
    commands="""obj2rad -m /home/lio/MantaRay/TestFolder/objFiles/mapping_glass.map -f /home/lio/MantaRay/TestFolder/objFiles/Glass_70_geo.obj > ~/MantaRay/TestFolder/radFiles/Glass_70_geo.rad
echo ~/MantaRay/TestFolder/radFiles/Glass_70_geo.rad""")  # -> flatten(Stdout), Stderr_, Ran
window_rad = Text(executessh_3.Stdout)

bool_2 = Boolean(executessh.Ran)
cluster_2 = Cluster(mod=parserhinofile.OpaqueModifiers)  # -> name_geo, name_mod
geo_2 = Geometry(parserhinofile.OpaqueGeometries)
overrides_6 = ApplyOverrides(Input="<Project>\objFiles")  # -> Output, DynamicOutput
mesh2obj_2 = MeshToObj(
    Mesh=graft(geo_2),
    Name=graft(cluster_2.name_geo),
    MapFileName="mapping_opaque",
    ModifierName=graft(cluster_2.name_mod),
    TargetFolder=overrides_6.Output,
    Run=bool_2)  # -> ObjFiles, MapFile, Run
entwine_2 = Entwine(Branch00=mesh2obj_2.ObjFiles, Branch01=mesh2obj_2.MapFile, FlattenInputs=True)
overrides_7 = ApplyOverrides(Input="<SftpHome>/objFiles")
upload_2 = Upload(
    LocalFilePaths=flatten(entwine_2),
    TargetFolder=overrides_7,
    Run=mesh2obj_2.Run,
    stdouts="/home/lio/MantaRay/TestFolder/objFiles/FloorMat_0.7_geo.obj>JOIN</home/lio/MantaRay/TestFolder/objFiles/Cladding_0.5_geo.obj>JOIN</home/lio/MantaRay/TestFolder/objFiles/ConcreteWhite_0.8_geo.obj>JOIN</home/lio/MantaRay/TestFolder/objFiles/ConcreteStructure_0.3_geo.obj>JOIN</home/lio/MantaRay/TestFolder/objFiles/ConcreteGrey_0.5_geo.obj>JOIN</home/lio/MantaRay/TestFolder/objFiles/IntWalls_0.9_geo.obj>JOIN</home/lio/MantaRay/TestFolder/objFiles/Pipes_0.03_geo.obj>JOIN</home/lio/MantaRay/TestFolder/objFiles/ConcreteDarker_0.1_geo.obj>JOIN</home/lio/MantaRay/TestFolder/objFiles/Frames_0.6_geo.obj>JOIN</home/lio/MantaRay/TestFolder/objFiles/Black_0.01_geo.obj>JOIN</home/lio/MantaRay/TestFolder/objFiles/CurvedCeiling_0.8_geo.obj>JOIN</home/lio/MantaRay/TestFolder/objFiles/IntWalls_0.8_geo.obj>JOIN</home/lio/MantaRay/TestFolder/objFiles/FloorBox_0.75_geo.obj>JOIN</home/lio/MantaRay/TestFolder/objFiles/mapping_opaque.map")  # -> Status, FilePaths, Ran
panel_21 = Panel("""obj2rad -m <mapfile> -f <objFile> > <LinuxHome>/radFiles/<name>.rad
echo <LinuxHome>/radFiles/<name>.rad""")
python_3 = GhPythonScript(f=upload_2.FilePaths)  # -> m, o; inputs f: list; same code as python_2
overrides_8 = ApplyOverrides(Input=panel_21, Mapfile=graft(python_3.m), ObjFile=graft(python_3.o), Name=graft(cluster_2.name_geo))  # -> Output, flatten(DynamicOutput)
executessh_4 = ExecuteSSH(
    _SSHCommands_=graft(overrides_8.DynamicOutput),
    Run=upload_2.Ran,
    addPrefix=True,
    description="""obj2rad -m /home/lio/MantaRay/TestFolder/objFiles/mapping_opaque.map -f /home/lio/MantaRay/TestFolder/objFiles/FloorMat_0.7_geo.obj > ~/MantaRay/TestFolder/radFiles/FloorMat_0.7_geo.rad
echo ~/MantaRay/TestFolder/radFiles/FloorMat_0.7_geo.rad


- - -

obj2rad -m /home/lio/MantaRay/TestFolder/objFiles/mapping_opaque.map -f /home/lio/MantaRay/TestFolder/objFiles/Cladding_0.5_geo.obj > ~/MantaRay/TestFolder/radFiles/Cladding_0.5_geo.rad
echo ~/MantaRay/TestFolder/radFiles/Cladding_0.5_geo.rad


- - -

obj2rad -m /home/lio/MantaRay/TestFolder/objFiles/mapping_opaque.map -f /home/lio/MantaRay/TestFolder/objFiles/ConcreteWhite_0.8_geo.obj > ~/MantaRay/TestFolder/radFiles/ConcreteWhite_0.8_geo.rad
echo ~/MantaRay/TestFolder/radFiles/ConcreteWhite_0.8_geo.rad


- - -

obj2rad -m /home/lio/MantaRay/TestFolder/objFiles/mapping_opaque.map -f /home/lio/MantaRay/TestFolder/objFiles/ConcreteStructure_0.3_geo.obj > ~/MantaRay/TestFolder/radFiles/ConcreteStructure_0.3_geo.rad
echo ~/MantaRay/TestFolder/radFiles/ConcreteStructure_0.3_geo.rad


- - -

obj2rad -m /home/lio/MantaRay/TestFolder/objFiles/mapping_opaque.map -f /home/lio/MantaRay/TestFolder/objFiles/ConcreteGrey_0.5_geo.obj > ~/MantaRay/TestFolder/radFiles/ConcreteGrey_0.5_geo.rad
echo ~/MantaRay/TestFolder/radFiles/ConcreteGrey_0.5_geo.rad


- - -

obj2rad -m /home/lio/MantaRay/TestFolder/objFiles/mapping_opaque.map -f /home/lio/MantaRay/TestFolder/objFiles/IntWalls_0.9_geo.obj > ~/MantaRay/TestFolder/radFiles/IntWalls_0.9_geo.rad
echo ~/MantaRay/TestFolder/radFiles/IntWalls_0.9_geo.rad


- - -

obj2rad -m /home/lio/MantaRay/TestFolder/objFiles/mapping_opaque.map -f /home/lio/MantaRay/TestFolder/objFiles/Pipes_0.03_geo.obj > ~/MantaRay/TestFolder/radFiles/Pipes_0.03_geo.rad
echo ~/MantaRay/TestFolder/radFiles/Pipes_0.03_geo.rad


- - -

obj2rad -m /home/lio/MantaRay/TestFolder/objFiles/mapping_opaque.map -f /home/lio/MantaRay/TestFolder/objFiles/ConcreteDarker_0.1_geo.obj > ~/MantaRay/TestFolder/radFiles/ConcreteDarker_0.1_geo.rad
echo ~/MantaRay/TestFolder/radFiles/ConcreteDarker_0.1_geo.rad


- - -

obj2rad -m /home/lio/MantaRay/TestFolder/objFiles/mapping_opaque.map -f /home/lio/MantaRay/TestFolder/objFiles/Frames_0.6_geo.obj > ~/MantaRay/TestFolder/radFiles/Frames_0.6_geo.rad
echo ~/MantaRay/TestFolder/radFiles/Frames_0.6_geo.rad


- - -

obj2rad -m /home/lio/MantaRay/TestFolder/objFiles/mapping_opaque.map -f /home/lio/MantaRay/TestFolder/objFiles/Black_0.01_geo.obj > ~/MantaRay/TestFolder/radFiles/Black_0.01_geo.rad
echo ~/MantaRay/TestFolder/radFiles/Black_0.01_geo.rad


- - -

obj2rad -m /home/lio/MantaRay/TestFolder/objFiles/mapping_opaque.map -f /home/lio/MantaRay/TestFolder/objFiles/CurvedCeiling_0.8_geo.obj > ~/MantaRay/TestFolder/radFiles/CurvedCeiling_0.8_geo.rad
echo ~/MantaRay/TestFolder/radFiles/CurvedCeiling_0.8_geo.rad


- - -

obj2rad -m /home/lio/MantaRay/TestFolder/objFiles/mapping_opaque.map -f /home/lio/MantaRay/TestFolder/objFiles/IntWalls_0.8_geo.obj > ~/MantaRay/TestFolder/radFiles/IntWalls_0.8_geo.rad
echo ~/MantaRay/TestFolder/radFiles/IntWalls_0.8_geo.rad


- - -

obj2rad -m /home/lio/MantaRay/TestFolder/objFiles/mapping_opaque.map -f /home/lio/MantaRay/TestFolder/objFiles/FloorBox_0.75_geo.obj > ~/MantaRay/TestFolder/radFiles/FloorBox_0.75_geo.rad
echo ~/MantaRay/TestFolder/radFiles/FloorBox_0.75_geo.rad""",
    fireLogs=True,
    lastRunTime=246.5555,
    name="obj2map - opaque",
    suppressWarnings=False,
    results=["/home/lio/MantaRay/TestFolder/radFiles/FloorMat_0.7_geo.rad", "/home/lio/MantaRay/TestFolder/radFiles/Cladding_0.5_geo.rad", "/home/lio/MantaRay/TestFolder/radFiles/ConcreteWhite_0.8_geo.rad", "/home/lio/MantaRay/TestFolder/radFiles/ConcreteStructure_0.3_geo.rad", "/home/lio/MantaRay/TestFolder/radFiles/ConcreteGrey_0.5_geo.rad", "/home/lio/MantaRay/TestFolder/radFiles/IntWalls_0.9_geo.rad", "/home/lio/MantaRay/TestFolder/radFiles/Pipes_0.03_geo.rad", "/home/lio/MantaRay/TestFolder/radFiles/ConcreteDarker_0.1_geo.rad", "/home/lio/MantaRay/TestFolder/radFiles/Frames_0.6_geo.rad", "/home/lio/MantaRay/TestFolder/radFiles/Black_0.01_geo.rad", "/home/lio/MantaRay/TestFolder/radFiles/CurvedCeiling_0.8_geo.rad", "/home/lio/MantaRay/TestFolder/radFiles/IntWalls_0.8_geo.rad", "/home/lio/MantaRay/TestFolder/radFiles/FloorBox_0.75_geo.rad"],
    commands=["""obj2rad -m /home/lio/MantaRay/TestFolder/objFiles/mapping_opaque.map -f /home/lio/MantaRay/TestFolder/objFiles/FloorMat_0.7_geo.obj > ~/MantaRay/TestFolder/radFiles/FloorMat_0.7_geo.rad
echo ~/MantaRay/TestFolder/radFiles/FloorMat_0.7_geo.rad""", """obj2rad -m /home/lio/MantaRay/TestFolder/objFiles/mapping_opaque.map -f /home/lio/MantaRay/TestFolder/objFiles/Cladding_0.5_geo.obj > ~/MantaRay/TestFolder/radFiles/Cladding_0.5_geo.rad
echo ~/MantaRay/TestFolder/radFiles/Cladding_0.5_geo.rad""", """obj2rad -m /home/lio/MantaRay/TestFolder/objFiles/mapping_opaque.map -f /home/lio/MantaRay/TestFolder/objFiles/ConcreteWhite_0.8_geo.obj > ~/MantaRay/TestFolder/radFiles/ConcreteWhite_0.8_geo.rad
echo ~/MantaRay/TestFolder/radFiles/ConcreteWhite_0.8_geo.rad""", """obj2rad -m /home/lio/MantaRay/TestFolder/objFiles/mapping_opaque.map -f /home/lio/MantaRay/TestFolder/objFiles/ConcreteGrey_0.5_geo.obj > ~/MantaRay/TestFolder/radFiles/ConcreteGrey_0.5_geo.rad
echo ~/MantaRay/TestFolder/radFiles/ConcreteGrey_0.5_geo.rad""", """obj2rad -m /home/lio/MantaRay/TestFolder/objFiles/mapping_opaque.map -f /home/lio/MantaRay/TestFolder/objFiles/ConcreteStructure_0.3_geo.obj > ~/MantaRay/TestFolder/radFiles/ConcreteStructure_0.3_geo.rad
echo ~/MantaRay/TestFolder/radFiles/ConcreteStructure_0.3_geo.rad""", """obj2rad -m /home/lio/MantaRay/TestFolder/objFiles/mapping_opaque.map -f /home/lio/MantaRay/TestFolder/objFiles/IntWalls_0.9_geo.obj > ~/MantaRay/TestFolder/radFiles/IntWalls_0.9_geo.rad
echo ~/MantaRay/TestFolder/radFiles/IntWalls_0.9_geo.rad"""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])  # -> flatten(Stdout), Stderr_, Ran
opaque_rad = Text(executessh_4.Stdout)

bool_3 = Boolean(executessh.Ran)
geo_3 = Geometry(parserhinofile.CustomGeometries)
cluster_3 = Cluster_3(L=geo_3)
n = N(mod=parserhinofile.ModifierNames)  # -> name_geo, name_mod
and = GateAnd(A=bool_3, B=cluster_3)
overrides_9 = ApplyOverrides(Input="<Project>\objFiles")  # -> Output, DynamicOutput
mesh2obj_3 = MeshToObj(
    Mesh=graft(geo_3),
    Name=graft(n.name_geo),
    MapFileName="mapping_other",
    ModifierName=graft(n.name_mod),
    TargetFolder=overrides_9.Output,
    Run=and)  # -> ObjFiles, MapFile, Run
entwine_3 = Entwine(Branch00=mesh2obj_3.ObjFiles, Branch01=mesh2obj_3.MapFile, FlattenInputs=True)
overrides_10 = ApplyOverrides(Input="<SftpHome>/objFiles")
upload_3 = Upload(LocalFilePaths=flatten(entwine_3), TargetFolder=overrides_10, Run=mesh2obj_3.Run)  # -> Status, FilePaths, Ran
panel_22 = Panel("""obj2rad -m <mapfile> -f <objFile> > <LinuxHome>/radFiles/<name>.rad
echo <LinuxHome>/radFiles/<name>.rad""")
python_4 = GhPythonScript(f=upload_3.FilePaths)  # -> m, o; inputs f: list; same code as python_2
cull = CullPattern(List=panel_22, CullPattern=and)
overrides_11 = ApplyOverrides(Input=cull, Mapfile=graft(python_4.m), ObjFile=graft(python_4.o), Name=graft(n.name_geo))  # -> Output, flatten(DynamicOutput)
executessh_5 = ExecuteSSH(
    _SSHCommands_=graft(overrides_11.DynamicOutput),
    Run=upload_3.Ran,
    addPrefix=True,
    fireLogs=True,
    lastRunTime=186.0257,
    name="obj2map - other",
    suppressWarnings=False,
    stderr="""bash: -c: line 0: syntax error near unexpected token `>'
bash: -c: line 0: `. /etc/profile;. ~/.profile;obj2rad -m <mapfile> -f <objFile> > ~/MantaRay/Andrei/radFiles/<name>.rad'""",
    commands="""obj2rad -m <mapfile> -f <objFile> > ~/MantaRay/Andrei/radFiles/<name>.rad
echo ~/MantaRay/Andrei/radFiles/<name>.rad""")  # -> flatten(Stdout), Stderr_, Ran
cull_2 = CullPattern(List=executessh_5.Stdout, CullPattern=and)
other_rad = Text(cull_2)

# ----
# Other users, linux
panel_23 = Panel("w")
falsestart_2 = LBFalseStartToggle(False)
falsestart_3 = LBFalseStartToggle(False)
executessh_6 = ExecuteSSH(
    _SSHCommands_="last -10 --ip",
    Run=falsestart_3,
    addPrefix=True,
    fireLogs=False,
    lastRunTime=20,
    name="Last Users",
    suppressWarnings=False,
    results="""lio      pts/1        172.19.128.1     Mon Mar 13 08:12 - 14:42  (06:29)
lio      pts/1        172.19.128.1     Sun Mar 12 21:37 - 21:45  (00:07)
lio      pts/0        172.19.128.1     Mon Mar  6 14:14   still logged in
lio      pts/0        172.19.128.1     Fri Mar  3 14:04 - 14:14  (00:09)
lio      pts/0        172.19.128.1     Fri Mar  3 09:07 - 11:42  (02:35)
reboot   system boot  0.0.0.0          Fri Mar  3 08:55   still running
lio      pts/0        192.168.112.1    Thu Mar  2 15:13 - 15:13  (00:00)
reboot   system boot  0.0.0.0          Thu Mar  2 15:11   still running
lio      pts/0        172.19.64.1      Thu Mar  2 15:04 - 15:09  (00:05)
lio      pts/0        172.19.64.1      Thu Mar  2 14:12 - 14:12  (00:00)

wtmp begins Fri Oct 14 13:16:38 2022""",
    commands="last -10 --ip")  # -> Stdout, Stderr_, Ran
executessh_7 = ExecuteSSH(
    _SSHCommands_=panel_23,
    Run=falsestart_2,
    addPrefix=True,
    fireLogs=False,
    lastRunTime=17,
    name="Who is logged in",
    suppressWarnings=False,
    results=""" 08:43:49 up 10 days, 23:47,  1 user,  load average: 0.00, 0.00, 0.00
USER     TTY      FROM             LOGIN@   IDLE   JCPU   PCPU WHAT
lio      pts/0    172.19.128.1     06Mar23  7days  0.03s  0.03s -bash""",
    commands="w")  # -> Stdout, Stderr_, Ran
panel_24 = Panel(executessh_7.Stdout)
panel_25 = Panel(executessh_6.Stdout)

# ----
# Vertex order (and normal)
# 
# source : https://www.radiance-online.org/learning/tutorials/Tutorial-ThreePhaseMethod.pdf
image = ImageSampler(Filter="Colour", Interpolate=True, Umax=1, Umin=0, Vmax=1, Vmin=0, Wrap=1)  # disabled

# ----
# Check radiance
# Radiacnce versino
# check ssh login
panel_26 = Panel("head /usr/local/radiance/bin/rtpict -n 2")
# Read more
# 
# 
# Ambient cache
# https://discourse.radiance-online.org/t/what-data-does-ambfile-store/4785/2
toggle_3 = BooleanToggle(True)
executessh_8 = ExecuteSSH(
    _SSHCommands_="genbox",
    Run=Toggle(True),
    addPrefix=True,
    fireLogs=False,
    lastRunTime=96.177,
    suppressWarnings=False,
    stderr="Usage: genbox material name xsize ysize zsize [-i] [-b bevel | -r round [-n nsegs][-s]] [-o]",
    commands="genbox")  # -> Stdout, Stderr_, Ran
# FILE NAMES: *.vmx - view matrix (data)
# *.hdr - view matrix (renderings)
# *.dmx - daylight matrix
# *.skv - sky vector
# *.smx – sky matrix
# *.xml - transmission matrix (the file is xml format)
# 
# *.rad - radiance scene data
# *.oct - octree file
# *.vf - view file
# *.dat - data
# 
# source : https://www.radiance-online.org/learning/tutorials/Tutorial-ThreePhaseMethod.pdf
executessh_9 = ExecuteSSH(
    _SSHCommands_="whoami",
    Run=toggle_3,
    addPrefix=True,
    fireLogs=False,
    lastRunTime=97.1574,
    suppressWarnings=False,
    results="lio",
    commands="whoami")  # -> Stdout, Stderr_, Ran
executessh_10 = ExecuteSSH(
    _SSHCommands_=panel_26,
    Run=Toggle(True),
    addPrefix=True,
    fireLogs=False,
    lastRunTime=96.0811,
    suppressWarnings=False,
    results="""#!/usr/bin/perl -w
# RCSid $Id: rtpict.pl,v 2.25 2022/04/12 00:30:58 greg Exp $""",
    commands="head /usr/local/radiance/bin/rtpict -n 2")  # -> Stdout, Stderr_, Ran
panel_27 = Panel(executessh_8.Stdout)
panel_28 = Panel(executessh_8.Stderr_)
panel_29 = Panel(executessh_9.Stdout)
panel_30 = Panel(executessh_10.Stdout)

# ----
# Dummy
swatch = ColourSwatch(SwatchColor=RGB(188, 118, 194))
nickname = GH_TestComponentColor(Color=swatch, SelColor=ColourSwatch(SwatchColor=RGB(191, 128, 128)))

panel_31 = Panel("""void trans polycarbon35diff55ref0spec
0
0
7 0.968 0.968 0.968 0.070 0.010 0.389 0.000""")

# ----
# materials
run = Boolean(executessh.Ran)

# ----
# other materials (trans etc, NOT BSDF)
opaque_mats = Data(panel_31)
panel_32 = Panel("echo \"<mats>\" > <LinuxHome>/radFiles/<target>;echo \"<LinuxHome>/radFiles/<target>\"")
join_2 = TextJoin(Text=opaque_mats)
overrides_12 = ApplyOverrides(Input=panel_32, Mats=graft(join_2), Target=graft("other_materials.mat"))  # -> Output, DynamicOutput
executessh_11 = ExecuteSSH(
    _SSHCommands_=overrides_12.DynamicOutput,
    Run=run,
    addPrefix=True,
    description="""echo "void trans polycarbon35diff55ref0spec
0
0
7 0.968 0.968 0.968 0.070 0.010 0.389 0.000" > ~/MantaRay/TestFolder/radFiles/other_materials.mat;echo "~/MantaRay/TestFolder/radFiles/other_materials.mat"
""",
    fireLogs=False,
    lastRunTime=92.012,
    name="otherMats",
    suppressWarnings=False,
    results="~/MantaRay/TestFolder/radFiles/other_materials.mat",
    commands="""echo "void trans polycarbon35diff55ref0spec
0
0
7 0.968 0.968 0.968 0.070 0.010 0.389 0.000" > ~/MantaRay/TestFolder/radFiles/other_materials.mat;echo "~/MantaRay/TestFolder/radFiles/other_materials.mat"
""")  # -> Stdout, Stderr_, Ran
other_mat = Text(executessh_11.Stdout)

# ----
# opaque materials
opaque_mats_2 = Data(parserhinofile.OpaqueModifiers)
panel_33 = Panel("echo \"<mats>\" > <LinuxHome>/radFiles/<target>;echo \"<LinuxHome>/radFiles/<target>\"")
join_3 = TextJoin(Text=opaque_mats_2)
overrides_13 = ApplyOverrides(Input=panel_33, Mats=graft(join_3), Target=graft("opaque_materials.mat"))  # -> Output, DynamicOutput
executessh_12 = ExecuteSSH(
    _SSHCommands_=overrides_13.DynamicOutput,
    Run=run,
    addPrefix=True,
    description="""echo "void plastic FloorMat_0.7
0
0
5 70.000 70.000 70.000 0.000 0.000
void plastic Cladding_0.5
0
0
5 50.000 50.000 50.000 0.000 0.000
void plastic ConcreteWhite_0.8
0
0
5 80.000 80.000 80.000 0.000 0.000
void plastic ConcreteStructure_0.3
0
0
5 30.000 30.000 30.000 0.000 0.000
void plastic ConcreteGrey_0.5
0
0
5 50.000 50.000 50.000 0.000 0.000
void plastic IntWalls_0.9
0
0
5 90.000 90.000 90.000 0.000 0.000
void plastic Pipes_0.03
0
0
5 3.000 3.000 3.000 0.000 0.000
void plastic ConcreteDarker_0.1
0
0
5 10.000 10.000 10.000 0.000 0.000
void plastic Frames_0.6
0
0
5 60.000 60.000 60.000 0.000 0.000
void plastic Black_0.01
0
0
5 1.000 1.000 1.000 0.000 0.000
void plastic CurvedCeiling_0.8
0
0
5 80.000 80.000 80.000 0.000 0.000
void plastic IntWalls_0.8
0
0
5 80.000 80.000 80.000 0.000 0.000
void plastic FloorBox_0.75
0
0
5 75.000 75.000 75.000 0.000 0.000" > ~/MantaRay/TestFolder/radFiles/opaque_materials.mat;echo "~/MantaRay/TestFolder/radFiles/opaque_materials.mat"
""",
    fireLogs=False,
    lastRunTime=117.3542,
    name="opaqueMats",
    suppressWarnings=False,
    results="~/MantaRay/TestFolder/radFiles/opaque_materials.mat",
    commands="""echo "void plastic FloorMat_0.7
0
0
5 70.000 70.000 70.000 0.000 0.000
void plastic Cladding_0.5
0
0
5 50.000 50.000 50.000 0.000 0.000
void plastic ConcreteWhite_0.8
0
0
5 80.000 80.000 80.000 0.000 0.000
void plastic ConcreteStructure_0.3
0
0
5 30.000 30.000 30.000 0.000 0.000
void plastic ConcreteGrey_0.5
0
0
5 50.000 50.000 50.000 0.000 0.000
void plastic IntWalls_0.9
0
0
5 90.000 90.000 90.000 0.000 0.000
void plastic Pipes_0.03
0
0
5 3.000 3.000 3.000 0.000 0.000
void plastic ConcreteDarker_0.1
0
0
5 10.000 10.000 10.000 0.000 0.000
void plastic Frames_0.6
0
0
5 60.000 60.000 60.000 0.000 0.000
void plastic Black_0.01
0
0
5 1.000 1.000 1.000 0.000 0.000
void plastic CurvedCeiling_0.8
0
0
5 80.000 80.000 80.000 0.000 0.000
void plastic IntWalls_0.8
0
0
5 80.000 80.000 80.000 0.000 0.000
void plastic FloorBox_0.75
0
0
5 75.000 75.000 75.000 0.000 0.000" > ~/MantaRay/TestFolder/radFiles/opaque_materials.mat;echo "~/MantaRay/TestFolder/radFiles/opaque_materials.mat"
""")  # -> Stdout, Stderr_, Ran
opaque_mat = Text(executessh_12.Stdout)

# ----
# Setup glass materials
glass_mat = Data(parserhinofile.GlassModifiers)
panel_34 = Panel("echo \"<mats>\" > <LinuxHome>/radFiles/<target>;echo \"<LinuxHome>/radFiles/<target>\"")
overrides_14 = ApplyOverrides(Input="<mat>.mat", Mat=graft(cluster.name_mod))
overrides_15 = ApplyOverrides(Input=panel_34, Mats=graft(glass_mat), Target=graft(overrides_14))  # -> Output, DynamicOutput
cluster_4 = Cluster_2(L=glass_mat)
executessh_13 = ExecuteSSH(
    _SSHCommands_=overrides_15.DynamicOutput,
    Run=run,
    addPrefix=True,
    description="""echo "void glass Glass_70
0
0
3 0.763 0.763 0.763" > ~/MantaRay/TestFolder/radFiles/Glass_70.mat;echo "~/MantaRay/TestFolder/radFiles/Glass_70.mat"
""",
    fireLogs=False,
    lastRunTime=96.0797,
    name="glassMats",
    suppressWarnings=False,
    results="~/MantaRay/TestFolder/radFiles/Glass_70.mat",
    commands="""echo "void glass Glass_70
0
0
3 0.763 0.763 0.763" > ~/MantaRay/TestFolder/radFiles/Glass_70.mat;echo "~/MantaRay/TestFolder/radFiles/Glass_70.mat"
""")  # -> Stdout, Stderr_, Ran
cull_3 = CullPattern(List=executessh_13.Stdout, CullPattern=cluster_4)
window_mat = Text(flatten(cull_3))

# ----
# Octrees
# STANDARD octree
window_mat_2 = Text(window_mat)
window_rad_2 = Text(window_rad)
opaque_mat_2 = Text(opaque_mat)
other_mat_2 = Text(other_mat)
opaque_rad_2 = Text(opaque_rad)
other_rad_2 = Text(other_rad)
entwine_4 = Entwine(
    Branch00=window_mat_2,
    Branch01=window_rad_2,
    Branch02=opaque_mat_2,
    Branch03=opaque_rad_2,
    Branch04=other_mat_2,
    Branch05=other_rad_2,
    FlattenInputs=True)  # -> flatten(Result)

# ----
# Download and preview rad files
# (might take 1 min)
entwine_5 = Entwine(Branch00=window_mat_2, Branch01=window_rad_2, FlattenInputs=True)
entwine_6 = Entwine(Branch00=opaque_mat_2, Branch01=opaque_rad_2, FlattenInputs=True)
entwine_7 = Entwine(Branch00=other_mat_2, Branch01=other_rad_2, FlattenInputs=True)
falsestart_4 = LBFalseStartToggle(False)
falsestart_5 = LBFalseStartToggle(False)
overrides_16 = ApplyOverrides(Input="<WinHome>\Downloads")
falsestart_6 = LBFalseStartToggle(False)
download = Download(
    LinuxFilePaths=flatten(entwine_5),
    TargetLocalFolder=overrides_16,
    Run=falsestart_6,
    stdouts="C:\Users\mm1013\MantaRay\TestingRemote\Downloads\Glass_70_mat.mat>JOIN<C:\Users\mm1013\MantaRay\TestingRemote\Downloads\Glass_70.rad")  # -> FilePaths, Status, Ran
download_2 = Download(
    LinuxFilePaths=entwine_7,
    TargetLocalFolder=overrides_16,
    Run=falsestart_4,
    stdouts="C:\Users\mm1013\MantaRay\Andrei\Downloads\polycarbon35diff55ref0spec_geo.rad")  # -> FilePaths, Status, Ran
download_3 = Download(
    LinuxFilePaths=entwine_6,
    TargetLocalFolder=overrides_16,
    Run=falsestart_5,
    stdouts="C:\Users\mm1013\MantaRay\Andrei\Downloads\RoofMullions_70_geo.rad>JOIN<C:\Users\mm1013\MantaRay\Andrei\Downloads\ContextMat_30_geo.rad>JOIN<C:\Users\mm1013\MantaRay\Andrei\Downloads\Ground_20_geo.rad>JOIN<C:\Users\mm1013\MantaRay\Andrei\Downloads\Floors_20_geo.rad>JOIN<C:\Users\mm1013\MantaRay\Andrei\Downloads\Ceilings_70_geo.rad>JOIN<C:\Users\mm1013\MantaRay\Andrei\Downloads\Roofs_20_geo.rad>JOIN<C:\Users\mm1013\MantaRay\Andrei\Downloads\RevitJintInnerWalls_50_geo.rad>JOIN<C:\Users\mm1013\MantaRay\Andrei\Downloads\RevitJintInnerDoors_50_geo.rad>JOIN<C:\Users\mm1013\MantaRay\Andrei\Downloads\RevitJfacadeFacadesWall_50_geo.rad>JOIN<C:\Users\mm1013\MantaRay\Andrei\Downloads\RevitJfacadeFacadesFrames_70_geo.rad>JOIN<C:\Users\mm1013\MantaRay\Andrei\Downloads\RevitJfacadeFacadeWHITE_70_geo.rad>JOIN<C:\Users\mm1013\MantaRay\Andrei\Downloads\RevitJfacadeWindowsFrames_70_geo.rad>JOIN<C:\Users\mm1013\MantaRay\Andrei\Downloads\RevitJfacadeDoors_55_geo.rad>JOIN<C:\Users\mm1013\MantaRay\Andrei\Downloads\RevitJfacadeDoorsMISC_55_geo.rad")  # -> FilePaths, Status, Ran
cull_4 = CullPattern(List=download.FilePaths, CullPattern=falsestart_6)
cull_5 = CullPattern(List=download_2.FilePaths, CullPattern=falsestart_4)
cull_6 = CullPattern(List=download_3.FilePaths, CullPattern=falsestart_5)
radviewer = RadViewer(
    RadFiles=flatten(cull_5),
    IsTwoSided=False,
    Polychromatic=True,
    ShowEdges=True,
    Transparent=True,
    ColorNames=["GlassTak_70_mat", "GlassInt_74_mat", "GlassFacade_74_mat", "GlassBSDF_70_mat", "SkylightWall_70_mat", "SlabCeiling_80_mat", "SlabFloor_30_mat", "SlabWall_50_mat", "SlabJ_50_mat", "WallExterior_50_mat"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],
    Colors=[RGB(177, 203, 218), RGB(149, 243, 118), RGB(218, 247, 105), RGB(165, 199, 252), RGB(100, 251, 165), RGB(203, 230, 172)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])  # -> Geo, ModifierNames, Modifiers, FailedWireFrame
radviewer_2 = RadViewer(
    RadFiles=flatten(cull_4),
    IsTwoSided=False,
    Polychromatic=True,
    ShowEdges=True,
    Transparent=True,
    ColorNames=["GlassTak_70_mat", "GlassInt_74_mat", "GlassFacade_74_mat", "GlassBSDF_70_mat", "SkylightWall_70_mat", "SlabCeiling_80_mat", "SlabFloor_30_mat", "SlabWall_50_mat", "SlabJ_50_mat", "WallExterior_50_mat", "Roofs_50_mat", "Doors_50_mat", "FramesCW_50_mat", "FacadeBright_70_mat", "ContextBright_70_mat", "WallInterior_70_mat", "FacadeDark_30_mat", "Frames_50_mat", "Terrain_20_mat", "Buildings_50_mat", "Glass_70_mat"],
    Colors=[RGB(177, 203, 218), RGB(149, 243, 118), RGB(218, 247, 105), RGB(165, 199, 252), RGB(100, 251, 165), RGB(203, 230, 172), RGB(169, 243, 224), RGB(238, 176, 232), RGB(242, 222, 239), RGB(146, 222, 239), RGB(144, 119, 233), RGB(174, 245, 124), RGB(120, 214, 159), RGB(156, 153, 225), RGB(117, 221, 150), RGB(184, 150, 138), RGB(158, 205, 172), RGB(189, 132, 143), RGB(106, 135, 236), RGB(102, 168, 232), RGB(245, 194, 251)])  # -> Geo, ModifierNames, Modifiers, FailedWireFrame
radviewer_3 = RadViewer(
    RadFiles=flatten(cull_6),
    IsTwoSided=False,
    Polychromatic=True,
    ShowEdges=True,
    Transparent=True,
    ColorNames=["GlassTak_70_mat", "GlassInt_74_mat", "GlassFacade_74_mat", "GlassBSDF_70_mat", "SkylightWall_70_mat", "SlabCeiling_80_mat", "SlabFloor_30_mat", "SlabWall_50_mat", "SlabJ_50_mat", "WallExterior_50_mat"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],
    Colors=[RGB(177, 203, 218), RGB(149, 243, 118), RGB(218, 247, 105), RGB(165, 199, 252), RGB(100, 251, 165), RGB(203, 230, 172)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])  # -> Geo, ModifierNames, Modifiers, FailedWireFrame
panel_35 = Panel(entwine_6)

# ----
# Preview a RAD file with objpict
# can also use ra_tiff/normtiff/pfilt
# gamma will vary
# 
# check axel jacobs radiance tutorial p26
panel_36 = Panel("""mkdir -p <proj>/images/
objpict <rad> > <proj>/images/<target-.>.hdr
normtiff <proj>/images/<target-.>.hdr <proj>/images/<target-.>.tif
convert <proj>/images/<target-.>.tif <proj>/images/<target>
echo <proj>/images/<target>""")
falsestart_7 = LBFalseStartToggle(False)
radfile = Text(flatten(entwine_4))
list = ItemSelector(
    radfile,
    {"~/MantaRay/TestFolder/radFiles/Glass_70.mat", "/home/lio/MantaRay/TestFolder/radFiles/Glass_70_geo.rad", "~/MantaRay/TestFolder/radFiles/opaque_materials.mat", "/home/lio/MantaRay/TestFolder/radFiles/FloorMat_0.7_geo.rad", "/home/lio/MantaRay/TestFolder/radFiles/Cladding_0.5_geo.rad", "/home/lio/MantaRay/TestFolder/radFiles/ConcreteWhite_0.8_geo.rad", "/home/lio/MantaRay/TestFolder/radFiles/ConcreteStructure_0.3_geo.rad", "/home/lio/MantaRay/TestFolder/radFiles/ConcreteGrey_0.5_geo.rad", "/home/lio/MantaRay/TestFolder/radFiles/IntWalls_0.9_geo.rad", "/home/lio/MantaRay/TestFolder/radFiles/Pipes_0.03_geo.rad", "/home/lio/MantaRay/TestFolder/radFiles/ConcreteDarker_0.1_geo.rad", "/home/lio/MantaRay/TestFolder/radFiles/Frames_0.6_geo.rad", "/home/lio/MantaRay/TestFolder/radFiles/Black_0.01_geo.rad", "/home/lio/MantaRay/TestFolder/radFiles/CurvedCeiling_0.8_geo.rad", "/home/lio/MantaRay/TestFolder/radFiles/IntWalls_0.8_geo.rad", "/home/lio/MantaRay/TestFolder/radFiles/FloorBox_0.75_geo.rad", "~/MantaRay/TestFolder/radFiles/other_materials.mat"}, selected="~/MantaRay/TestFolder/radFiles/Glass_70.mat")
panel_37 = Panel("""rad
target""")
entwine_8 = Entwine(Branch00=window_mat_2, Branch01=opaque_mat_2, Branch02=list, FlattenInputs=True)  # -> flatten(Result)
join_4 = TextJoin(Text=entwine_8, Join=" ")
overrides_17 = ApplyOverrides(Input=panel_36, Rad=graft(join_4), Target=graft("quickRender.png"))  # -> Output, DynamicOutput
executessh_14 = ExecuteSSH(
    _SSHCommands_=overrides_17.DynamicOutput,
    Run=falsestart_7,
    addPrefix=True,
    description="""mkdir -p ~/simulation/boston/images/
objpict ~/MantaRay/TestFolder/radFiles/Glass_70.mat ~/MantaRay/TestFolder/radFiles/opaque_materials.mat ~/MantaRay/TestFolder/radFiles/Glass_70.mat > ~/simulation/boston/images/quickRender.hdr
normtiff ~/simulation/boston/images/quickRender.hdr ~/simulation/boston/images/quickRender.tif
convert ~/simulation/boston/images/quickRender.tif ~/simulation/boston/images/quickRender.png
echo ~/simulation/boston/images/quickRender.png""",
    fireLogs=False,
    lastRunTime=537,
    suppressWarnings=False,
    results="""_JOIN_
_JOIN_
_JOIN_
_JOIN_
/home/lio/MantaRay/Andrei/images/quickRender.png""",
    stderr="""oconv: fatal - (standard input): undefined modifier "polycarbon35diff55ref0spec"
rpict: fatal - (/tmp/NP9HjfGHxP/op.oct): truncated octree
rpict: 0 rays, 0.00% after 0.000u 0.000s 0.000r hours on mm-c0d0e-028 (PID 93494)
rpict: fatal - (/tmp/NP9HjfGHxP/op.oct): truncated octree
rpict: 0 rays, 0.00% after 0.000u 0.000s 0.000r hours on mm-c0d0e-028 (PID 93496)
rpict: fatal - (/tmp/NP9HjfGHxP/op.oct): truncated octree
rpict: 0 rays, 0.00% after 0.000u 0.000s 0.000r hours on mm-c0d0e-028 (PID 93498)
rpict: fatal - (/tmp/NP9HjfGHxP/op.oct): truncated octree
rpict: 0 rays, 0.00% after 0.000u 0.000s 0.000r hours on mm-c0d0e-028 (PID 93500)
/tmp/NP9HjfGHxP/down.hdr: bad picture size
pfilt: bad picture size
/home/lio/MantaRay/Andrei/images/quickRender.hdr: Not a TIFF or MDI file, bad magic number 16163 (0x3f23).
normtiff: cannot open or interpret file "/home/lio/MantaRay/Andrei/images/quickRender.hdr"
""",
    commands="""mkdir -p ~/MantaRay/Andrei/images/
_JOIN_
objpict ~/MantaRay/Andrei/radFiles/Skylights_55.mat ~/MantaRay/Andrei/radFiles/RevitJintInnerDoors_80.mat ~/MantaRay/Andrei/radFiles/RevitJfacadeFacadesCWglass_74.mat ~/MantaRay/Andrei/radFiles/RevitJfacadeWindowGlass_74.mat ~/MantaRay/Andrei/radFiles/RevitJfacadeDoorPanel_70.mat ~/MantaRay/Andrei/radFiles/opaque_materials.mat /home/lio/MantaRay/Andrei/radFiles/polycarbon35diff55ref0spec_geo.rad > ~/MantaRay/Andrei/images/quickRender.hdr
_JOIN_
normtiff ~/MantaRay/Andrei/images/quickRender.hdr ~/MantaRay/Andrei/images/quickRender.tif
_JOIN_
convert ~/MantaRay/Andrei/images/quickRender.tif ~/MantaRay/Andrei/images/quickRender.png
_JOIN_
echo ~/MantaRay/Andrei/images/quickRender.png""")  # -> Stdout, Stderr_, Ran
download_4 = Download(SftpPaths=executessh_14.Stdout, Run=executessh_14.Ran, stdouts="C:\Users\mm1013\MantaRay\Andrei\quickRender.png")  # -> FilePaths, Status, Ran
imageviewer = LBImageViewer(ImagePath_=download_4.FilePaths, _scale_=1, DisableClickable=False, SaveImgWithCoords=False, scale=1)  # -> ImagePath, Values, GIF

# ----
# 10klx overcast sky (RwR p357)
# # start of sky definition for daylighting studies
# # location name: COPENHAGEN_DNK LAT: 55.63
# !gensky 5 14 14.0 -c -a 55.63 -o -12.67 -m -15.0 | xform -rz 0.0
# skyfunc glow sky_mat
# 0
# 0
# 4
# 1 1 1 0
# sky_mat source sky
# 0
# 0
# 4
# 0 0 1 180
# skyfunc glow ground_glow
# 0
# 0
# 4
# 1 .8 .5 0
# ground_glow source ground
# 0
# 0
# 4
# 0 0 -1 180
# # end of sky definition for daylighting studies
falsestart_8 = LBFalseStartToggle(True)
and_append_the_ground = Panel("""##The 1 will be multiplie with brightfunc
skyfunc glow sky_glow
0
0
4 1 1 1 0

##Set to 1 as it will be multiplied with the gensky result
sky_glow source sky
0
0
4 0 0 1 180

##Set to 1 as it will be multiplied with the gensky result
skyfunc glow ground_glow
0
0
4 1 1 1 0

##The ground pane
ground_glow source ground
0
0
4 0 0 -1 180""")
# Skies
bool_4 = Boolean(falsestart_8)
executessh_15 = ExecuteSSH(
    _SSHCommands_="gensky -ang 45 0 -c -B 55.866",
    Run=bool_4,
    addPrefix=True,
    fireLogs=False,
    lastRunTime=78.7027,
    suppressWarnings=False,
    results="""# gensky -ang 45 0 -c -B 55.866
# Ground ambient level: 17.8

void brightfunc skyfunc
2 skybr skybright.cal
0
3 2 2.29e+01 3.56e+00""",
    commands="gensky -ang 45 0 -c -B 55.866")  # -> Stdout, Stderr_, Ran
concat = Concatenate(FragmentC="##Will control the gradient of the sky", FragmentA=executessh_15.Stdout, FragmentB=and_append_the_ground)
panel_38 = Panel(concat)
panel_39 = Panel("""mkdir -p <proj>/skies/
echo "<sky>" > <proj>/skies/<target>
echo "<proj>/skies/<target>"
""")
overrides_18 = ApplyOverrides(Input=panel_39, Sky=graft(panel_38), Target=graft("overcast_sky.rad"))  # -> Output, DynamicOutput
executessh_16 = ExecuteSSH(
    _SSHCommands_=overrides_18.DynamicOutput,
    Run=executessh_15.Ran,
    addPrefix=True,
    description="""mkdir -p ~/simulation/boston/skies/
echo "##Will control the gradient of the sky
# gensky -ang 45 0 -c -B 55.866
# Ground ambient level: 17.8

void brightfunc skyfunc
2 skybr skybright.cal
0
3 2 2.29e+01 3.56e+00

##The 1 will be multiplie with brightfunc
skyfunc glow sky_glow
0
0
4 1 1 1 0

##Set to 1 as it will be multiplied with the gensky result
sky_glow source sky
0
0
4 0 0 1 180

##Set to 1 as it will be multiplied with the gensky result
skyfunc glow ground_glow
0
0
4 1 1 1 0

##The ground pane
ground_glow source ground
0
0
4 0 0 -1 180" > ~/simulation/boston/skies/overcast_sky.rad
echo "~/simulation/boston/skies/overcast_sky.rad"
""",
    fireLogs=False,
    lastRunTime=72.6436,
    suppressWarnings=False,
    results="""_JOIN_
_JOIN_
~/simulation/boston/skies/overcast_sky.rad""",
    commands="""mkdir -p ~/simulation/boston/skies/
_JOIN_
echo "##Will control the gradient of the sky
# gensky -ang 45 0 -c -B 55.866
# Ground ambient level: 17.8

void brightfunc skyfunc
2 skybr skybright.cal
0
3 2 2.29e+01 3.56e+00

##The 1 will be multiplie with brightfunc
skyfunc glow sky_glow
0
0
4 1 1 1 0

##Set to 1 as it will be multiplied with the gensky result
sky_glow source sky
0
0
4 0 0 1 180

##Set to 1 as it will be multiplied with the gensky result
skyfunc glow ground_glow
0
0
4 1 1 1 0

##The ground pane
ground_glow source ground
0
0
4 0 0 -1 180" > ~/simulation/boston/skies/overcast_sky.rad
_JOIN_
echo "~/simulation/boston/skies/overcast_sky.rad"
""")  # -> Stdout, Stderr_, Ran
panel_40 = Panel(overrides_18.DynamicOutput)
panel_41 = Panel(executessh_16.Stderr_)
sky_ovc = Text(executessh_16.Stdout)

# ----
# 10 sunny skies (SET LAT AND LON)
panel_42 = Panel("gensky 7 4 <h>:00CEST +s -a <lat> -o <lon>")
falsestart_9 = LBFalseStartToggle(False)
series = Series(Start=8, Step=1, Count=10)
overrides_19 = ApplyOverrides(Input=panel_42, H=graft(series), Lat=graft("59.9"), Lon=graft("10.7"))  # -> Output, DynamicOutput
and_append_the_ground_2 = Panel("""##The 1 will be multiplie with brightfunc
skyfunc glow sky_glow
0
0
4 1 1 1 0

##Set to 1 as it will be multiplied with the gensky result
sky_glow source sky
0
0
4 0 0 1 180

##Set to 1 as it will be multiplied with the gensky result
skyfunc glow ground_glow
0
0
4 1 1 1 0

##The ground pane
ground_glow source ground
0
0
4 0 0 -1 180""")
bool_5 = Boolean(falsestart_9)
executessh_17 = ExecuteSSH(
    _SSHCommands_=overrides_19.DynamicOutput,
    Run=bool_5,
    addPrefix=True,
    description="""gensky 7 4 8:00CEST +s -a 59.9 -o 10.7


- - -

gensky 7 4 9:00CEST +s -a 59.9 -o 10.7


- - -

gensky 7 4 10:00CEST +s -a 59.9 -o 10.7


- - -

gensky 7 4 11:00CEST +s -a 59.9 -o 10.7


- - -

gensky 7 4 12:00CEST +s -a 59.9 -o 10.7


- - -

gensky 7 4 13:00CEST +s -a 59.9 -o 10.7


- - -

gensky 7 4 14:00CEST +s -a 59.9 -o 10.7


- - -

gensky 7 4 15:00CEST +s -a 59.9 -o 10.7


- - -

gensky 7 4 16:00CEST +s -a 59.9 -o 10.7


- - -

gensky 7 4 17:00CEST +s -a 59.9 -o 10.7""",
    fireLogs=False,
    lastRunTime=39,
    suppressWarnings=False,
    results=["""# gensky 7 4 8:00CEST +s -a 59.9 -o 10.7
# Local solar time: 5.22
# Solar altitude and azimuth: 14.1 -111.6
# Ground ambient level: 8.8

void light solar
0
0
3 3.92e+06 3.92e+06 3.92e+06

solar source sun
0
0
4 0.901641 0.357186 0.243849 0.5

void brightfunc skyfunc
2 skybr skybright.cal
0
7 1 3.81e+00 5.41e+00 3.08e-01 0.901641 0.357186 0.243849""", """# gensky 7 4 9:00CEST +s -a 59.9 -o 10.7
# Local solar time: 6.22
# Solar altitude and azimuth: 21.4 -99.3
# Ground ambient level: 10.8

void light solar
0
0
3 5.36e+06 5.36e+06 5.36e+06

solar source sun
0
0
4 0.919246 0.149788 0.364073 0.5

void brightfunc skyfunc
2 skybr skybright.cal
0
7 1 4.88e+00 9.62e+00 3.41e-01 0.919246 0.149788 0.364073""", """# gensky 7 4 10:00CEST +s -a 59.9 -o 10.7
# Local solar time: 7.22
# Solar altitude and azimuth: 28.8 -86.4
# Ground ambient level: 12.6

void light solar
0
0
3 6.07e+06 6.07e+06 6.07e+06

solar source sun
0
0
4 0.874207 -0.054485 0.482486 0.5

void brightfunc skyfunc
2 skybr skybright.cal
0
7 1 6.11e+00 1.37e+01 3.90e-01 0.874207 -0.054485 0.482486""", """# gensky 7 4 11:00CEST +s -a 59.9 -o 10.7
# Local solar time: 8.22
# Solar altitude and azimuth: 36.2 -72.6
# Ground ambient level: 13.8

void light solar
0
0
3 6.48e+06 6.48e+06 6.48e+06

solar source sun
0
0
4 0.769592 -0.241712 0.591018 0.5

void brightfunc skyfunc
2 skybr skybright.cal
0
7 1 7.51e+00 1.74e+01 4.56e-01 0.769592 -0.241712 0.591018""", """# gensky 7 4 12:00CEST +s -a 59.9 -o 10.7
# Local solar time: 9.22
# Solar altitude and azimuth: 43.0 -56.9
# Ground ambient level: 14.6

void light solar
0
0
3 6.72e+06 6.72e+06 6.72e+06

solar source sun
0
0
4 0.612531 -0.399135 0.682273 0.5

void brightfunc skyfunc
2 skybr skybright.cal
0
7 1 9.05e+00 2.04e+01 5.41e-01 0.612531 -0.399135 0.682273""", """# gensky 7 4 13:00CEST +s -a 59.9 -o 10.7
# Local solar time: 10.22
# Solar altitude and azimuth: 48.6 -38.7
# Ground ambient level: 15.0

void light solar
0
0
3 6.86e+06 6.86e+06 6.86e+06

solar source sun
0
0
4 0.413727 -0.516025 0.750032 0.5

void brightfunc skyfunc
2 skybr skybright.cal
0
7 1 1.06e+01 2.26e+01 6.32e-01 0.413727 -0.516025 0.750032"""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],
    commands=["gensky 7 4 12:00CEST +s -a 59.9 -o 10.7", "gensky 7 4 8:00CEST +s -a 59.9 -o 10.7", "gensky 7 4 9:00CEST +s -a 59.9 -o 10.7", "gensky 7 4 13:00CEST +s -a 59.9 -o 10.7", "gensky 7 4 15:00CEST +s -a 59.9 -o 10.7", "gensky 7 4 16:00CEST +s -a 59.9 -o 10.7", "gensky 7 4 17:00CEST +s -a 59.9 -o 10.7"])  # -> Stdout, Stderr_, Ran
panel_43 = Panel(executessh_17.Stdout)
concat_2 = Concatenate(FragmentC="##Will control the gradient of the sky", FragmentA=executessh_17.Stdout, FragmentB=and_append_the_ground_2)
panel_44 = Panel("""mkdir -p <proj>/skies/
echo "<sky>" > <proj>/skies/<target>
echo "<proj>/skies/<target>"
""")
overrides_20 = ApplyOverrides(Input=panel_44, Sky=graft(concat_2), Target=graft("sunny_sky_<h>.rad"), H=graft(series))  # -> Output, DynamicOutput
executessh_18 = ExecuteSSH(
    _SSHCommands_=overrides_20.DynamicOutput,
    Run=executessh_17.Ran,
    addPrefix=True,
    description="""mkdir -p ~/MantaRay/TestFolder/skies/
echo "##Will control the gradient of the sky
# gensky 7 4 8:00CEST +s -a 59.9 -o 10.7
# Local solar time: 5.22
# Solar altitude and azimuth: 14.1 -111.6
# Ground ambient level: 8.8

void light solar
0
0
3 3.92e+06 3.92e+06 3.92e+06

solar source sun
0
0
4 0.901641 0.357186 0.243849 0.5

void brightfunc skyfunc
2 skybr skybright.cal
0
7 1 3.81e+00 5.41e+00 3.08e-01 0.901641 0.357186 0.243849

##The 1 will be multiplie with brightfunc
skyfunc glow sky_glow
0
0
4 1 1 1 0

##Set to 1 as it will be multiplied with the gensky result
sky_glow source sky
0
0
4 0 0 1 180

##Set to 1 as it will be multiplied with the gensky result
skyfunc glow ground_glow
0
0
4 1 1 1 0

##The ground pane
ground_glow source ground
0
0
4 0 0 -1 180" > ~/MantaRay/TestFolder/skies/sunny_sky_8.rad
echo "~/MantaRay/TestFolder/skies/sunny_sky_8.rad"


- - -

mkdir -p ~/MantaRay/TestFolder/skies/
echo "##Will control the gradient of the sky
# gensky 7 4 9:00CEST +s -a 59.9 -o 10.7
# Local solar time: 6.22
# Solar altitude and azimuth: 21.4 -99.3
# Ground ambient level: 10.8

void light solar
0
0
3 5.36e+06 5.36e+06 5.36e+06

solar source sun
0
0
4 0.919246 0.149788 0.364073 0.5

void brightfunc skyfunc
2 skybr skybright.cal
0
7 1 4.88e+00 9.62e+00 3.41e-01 0.919246 0.149788 0.364073

##The 1 will be multiplie with brightfunc
skyfunc glow sky_glow
0
0
4 1 1 1 0

##Set to 1 as it will be multiplied with the gensky result
sky_glow source sky
0
0
4 0 0 1 180

##Set to 1 as it will be multiplied with the gensky result
skyfunc glow ground_glow
0
0
4 1 1 1 0

##The ground pane
ground_glow source ground
0
0
4 0 0 -1 180" > ~/MantaRay/TestFolder/skies/sunny_sky_9.rad
echo "~/MantaRay/TestFolder/skies/sunny_sky_9.rad"


- - -

mkdir -p ~/MantaRay/TestFolder/skies/
echo "##Will control the gradient of the sky
# gensky 7 4 10:00CEST +s -a 59.9 -o 10.7
# Local solar time: 7.22
# Solar altitude and azimuth: 28.8 -86.4
# Ground ambient level: 12.6

void light solar
0
0
3 6.07e+06 6.07e+06 6.07e+06

solar source sun
0
0
4 0.874207 -0.054485 0.482486 0.5

void brightfunc skyfunc
2 skybr skybright.cal
0
7 1 6.11e+00 1.37e+01 3.90e-01 0.874207 -0.054485 0.482486

##The 1 will be multiplie with brightfunc
skyfunc glow sky_glow
0
0
4 1 1 1 0

##Set to 1 as it will be multiplied with the gensky result
sky_glow source sky
0
0
4 0 0 1 180

##Set to 1 as it will be multiplied with the gensky result
skyfunc glow ground_glow
0
0
4 1 1 1 0

##The ground pane
ground_glow source ground
0
0
4 0 0 -1 180" > ~/MantaRay/TestFolder/skies/sunny_sky_10.rad
echo "~/MantaRay/TestFolder/skies/sunny_sky_10.rad"


- - -

mkdir -p ~/MantaRay/TestFolder/skies/
echo "##Will control the gradient of the sky
# gensky 7 4 11:00CEST +s -a 59.9 -o 10.7
# Local solar time: 8.22
# Solar altitude and azimuth: 36.2 -72.6
# Ground ambient level: 13.8

void light solar
0
0
3 6.48e+06 6.48e+06 6.48e+06

solar source sun
0
0
4 0.769592 -0.241712 0.591018 0.5

void brightfunc skyfunc
2 skybr skybright.cal
0
7 1 7.51e+00 1.74e+01 4.56e-01 0.769592 -0.241712 0.591018

##The 1 will be multiplie with brightfunc
skyfunc glow sky_glow
0
0
4 1 1 1 0

##Set to 1 as it will be multiplied with the gensky result
sky_glow source sky
0
0
4 0 0 1 180

##Set to 1 as it will be multiplied with the gensky result
skyfunc glow ground_glow
0
0
4 1 1 1 0

##The ground pane
ground_glow source ground
0
0
4 0 0 -1 180" > ~/MantaRay/TestFolder/skies/sunny_sky_11.rad
echo "~/MantaRay/TestFolder/skies/sunny_sky_11.rad"


- - -

mkdir -p ~/MantaRay/TestFolder/skies/
echo "##Will control the gradient of the sky
# gensky 7 4 12:00CEST +s -a 59.9 -o 10.7
# Local solar time: 9.22
# Solar altitude and azimuth: 43.0 -56.9
# Ground ambient level: 14.6

void light solar
0
0
3 6.72e+06 6.72e+06 6.72e+06

solar source sun
0
0
4 0.612531 -0.399135 0.682273 0.5

void brightfunc skyfunc
2 skybr skybright.cal
0
7 1 9.05e+00 2.04e+01 5.41e-01 0.612531 -0.399135 0.682273

##The 1 will be multiplie with brightfunc
skyfunc glow sky_glow
0
0
4 1 1 1 0

##Set to 1 as it will be multiplied with the gensky result
sky_glow source sky
0
0
4 0 0 1 180

##Set to 1 as it will be multiplied with the gensky result
skyfunc glow ground_glow
0
0
4 1 1 1 0

##The ground pane
ground_glow source ground
0
0
4 0 0 -1 180" > ~/MantaRay/TestFolder/skies/sunny_sky_12.rad
echo "~/MantaRay/TestFolder/skies/sunny_sky_12.rad"


- - -

mkdir -p ~/MantaRay/TestFolder/skies/
echo "##Will control the gradient of the sky
# gensky 7 4 13:00CEST +s -a 59.9 -o 10.7
# Local solar time: 10.22
# Solar altitude and azimuth: 48.6 -38.7
# Ground ambient level: 15.0

void light solar
0
0
3 6.86e+06 6.86e+06 6.86e+06

solar source sun
0
0
4 0.413727 -0.516025 0.750032 0.5

void brightfunc skyfunc
2 skybr skybright.cal
0
7 1 1.06e+01 2.26e+01 6.32e-01 0.413727 -0.516025 0.750032

##The 1 will be multiplie with brightfunc
skyfunc glow sky_glow
0
0
4 1 1 1 0

##Set to 1 as it will be multiplied with the gensky result
sky_glow source sky
0
0
4 0 0 1 180

##Set to 1 as it will be multiplied with the gensky result
skyfunc glow ground_glow
0
0
4 1 1 1 0

##The ground pane
ground_glow source ground
0
0
4 0 0 -1 180" > ~/MantaRay/TestFolder/skies/sunny_sky_13.rad
echo "~/MantaRay/TestFolder/skies/sunny_sky_13.rad"


- - -

mkdir -p ~/MantaRay/TestFolder/skies/
echo "##Will control the gradient of the sky
# gensky 7 4 14:00CEST +s -a 59.9 -o 10.7
# Local solar time: 11.22
# Solar altitude and azimuth: 52.2 -17.7
# Ground ambient level: 15.1

void light solar
0
0
3 6.93e+06 6.93e+06 6.93e+06

solar source sun
0
0
4 0.186727 -0.584417 0.789677 0.5

void brightfunc skyfunc
2 skybr skybright.cal
0
7 1 1.18e+01 2.39e+01 7.04e-01 0.186727 -0.584417 0.789677

##The 1 will be multiplie with brightfunc
skyfunc glow sky_glow
0
0
4 1 1 1 0

##Set to 1 as it will be multiplied with the gensky result
sky_glow source sky
0
0
4 0 0 1 180

##Set to 1 as it will be multiplied with the gensky result
skyfunc glow ground_glow
0
0
4 1 1 1 0

##The ground pane
ground_glow source ground
0
0
4 0 0 -1 180" > ~/MantaRay/TestFolder/skies/sunny_sky_14.rad
echo "~/MantaRay/TestFolder/skies/sunny_sky_14.rad"


- - -

mkdir -p ~/MantaRay/TestFolder/skies/
echo "##Will control the gradient of the sky
# gensky 7 4 15:00CEST +s -a 59.9 -o 10.7
# Local solar time: 12.22
# Solar altitude and azimuth: 53.0 5.1
# Ground ambient level: 15.2

void light solar
0
0
3 6.94e+06 6.94e+06 6.94e+06

solar source sun
0
0
4 -0.052997 -0.599649 0.798507 0.5

void brightfunc skyfunc
2 skybr skybright.cal
0
7 1 1.21e+01 2.42e+01 7.23e-01 -0.052997 -0.599649 0.798507

##The 1 will be multiplie with brightfunc
skyfunc glow sky_glow
0
0
4 1 1 1 0

##Set to 1 as it will be multiplied with the gensky result
sky_glow source sky
0
0
4 0 0 1 180

##Set to 1 as it will be multiplied with the gensky result
skyfunc glow ground_glow
0
0
4 1 1 1 0

##The ground pane
ground_glow source ground
0
0
4 0 0 -1 180" > ~/MantaRay/TestFolder/skies/sunny_sky_15.rad
echo "~/MantaRay/TestFolder/skies/sunny_sky_15.rad"


- - -

mkdir -p ~/MantaRay/TestFolder/skies/
echo "##Will control the gradient of the sky
# gensky 7 4 16:00CEST +s -a 59.9 -o 10.7
# Local solar time: 13.22
# Solar altitude and azimuth: 50.9 27.3
# Ground ambient level: 15.1

void light solar
0
0
3 6.91e+06 6.91e+06 6.91e+06

solar source sun
0
0
4 -0.289110 -0.560683 0.775919 0.5

void brightfunc skyfunc
2 skybr skybright.cal
0
7 1 1.13e+01 2.35e+01 6.77e-01 -0.289110 -0.560683 0.775919

##The 1 will be multiplie with brightfunc
skyfunc glow sky_glow
0
0
4 1 1 1 0

##Set to 1 as it will be multiplied with the gensky result
sky_glow source sky
0
0
4 0 0 1 180

##Set to 1 as it will be multiplied with the gensky result
skyfunc glow ground_glow
0
0
4 1 1 1 0

##The ground pane
ground_glow source ground
0
0
4 0 0 -1 180" > ~/MantaRay/TestFolder/skies/sunny_sky_16.rad
echo "~/MantaRay/TestFolder/skies/sunny_sky_16.rad"


- - -

mkdir -p ~/MantaRay/TestFolder/skies/
echo "##Will control the gradient of the sky
# gensky 7 4 17:00CEST +s -a 59.9 -o 10.7
# Local solar time: 14.22
# Solar altitude and azimuth: 46.3 47.1
# Ground ambient level: 14.8

void light solar
0
0
3 6.81e+06 6.81e+06 6.81e+06

solar source sun
0
0
4 -0.505520 -0.470175 0.723454 0.5

void brightfunc skyfunc
2 skybr skybright.cal
0
7 1 9.93e+00 2.18e+01 5.92e-01 -0.505520 -0.470175 0.723454

##The 1 will be multiplie with brightfunc
skyfunc glow sky_glow
0
0
4 1 1 1 0

##Set to 1 as it will be multiplied with the gensky result
sky_glow source sky
0
0
4 0 0 1 180

##Set to 1 as it will be multiplied with the gensky result
skyfunc glow ground_glow
0
0
4 1 1 1 0

##The ground pane
ground_glow source ground
0
0
4 0 0 -1 180" > ~/MantaRay/TestFolder/skies/sunny_sky_17.rad
echo "~/MantaRay/TestFolder/skies/sunny_sky_17.rad"
""",
    fireLogs=False,
    lastRunTime=45,
    suppressWarnings=False,
    results=["""_JOIN_
_JOIN_
~/MantaRay/TestingRemote/skies/sunny_sky_8.rad""", """_JOIN_
_JOIN_
~/MantaRay/TestingRemote/skies/sunny_sky_9.rad""", """_JOIN_
_JOIN_
~/MantaRay/TestingRemote/skies/sunny_sky_10.rad""", """_JOIN_
_JOIN_
~/MantaRay/TestingRemote/skies/sunny_sky_11.rad""", """_JOIN_
_JOIN_
~/MantaRay/TestingRemote/skies/sunny_sky_12.rad""", """_JOIN_
_JOIN_
~/MantaRay/TestingRemote/skies/sunny_sky_13.rad""", """_JOIN_
_JOIN_
~/MantaRay/TestingRemote/skies/sunny_sky_14.rad""", """_JOIN_
_JOIN_
~/MantaRay/TestingRemote/skies/sunny_sky_15.rad""", """_JOIN_
_JOIN_
~/MantaRay/TestingRemote/skies/sunny_sky_16.rad""", """_JOIN_
_JOIN_
~/MantaRay/TestingRemote/skies/sunny_sky_17.rad"""],
    commands=["""mkdir -p ~/MantaRay/TestingRemote/skies/
_JOIN_
echo "##Will control the gradient of the sky
# gensky 7 4 10:00CEST +s -a 59.9 -o 10.7
# Local solar time: 7.22
# Solar altitude and azimuth: 28.8 -86.4
# Ground ambient level: 12.6

void light solar
0
0
3 6.07e+06 6.07e+06 6.07e+06

solar source sun
0
0
4 0.874207 -0.054485 0.482486 0.5

void brightfunc skyfunc
2 skybr skybright.cal
0
7 1 6.11e+00 1.37e+01 3.90e-01 0.874207 -0.054485 0.482486

##The 1 will be multiplie with brightfunc
skyfunc glow sky_glow
0
0
4 1 1 1 0

##Set to 1 as it will be multiplied with the gensky result
sky_glow source sky
0
0
4 0 0 1 180

##Set to 1 as it will be multiplied with the gensky result
skyfunc glow ground_glow
0
0
4 1 1 1 0

##The ground pane
ground_glow source ground
0
0
4 0 0 -1 180" > ~/MantaRay/TestingRemote/skies/sunny_sky_10.rad
_JOIN_
echo "~/MantaRay/TestingRemote/skies/sunny_sky_10.rad"
""", """mkdir -p ~/MantaRay/TestingRemote/skies/
_JOIN_
echo "##Will control the gradient of the sky
# gensky 7 4 9:00CEST +s -a 59.9 -o 10.7
# Local solar time: 6.22
# Solar altitude and azimuth: 21.4 -99.3
# Ground ambient level: 10.8

void light solar
0
0
3 5.36e+06 5.36e+06 5.36e+06

solar source sun
0
0
4 0.919246 0.149788 0.364073 0.5

void brightfunc skyfunc
2 skybr skybright.cal
0
7 1 4.88e+00 9.62e+00 3.41e-01 0.919246 0.149788 0.364073

##The 1 will be multiplie with brightfunc
skyfunc glow sky_glow
0
0
4 1 1 1 0

##Set to 1 as it will be multiplied with the gensky result
sky_glow source sky
0
0
4 0 0 1 180

##Set to 1 as it will be multiplied with the gensky result
skyfunc glow ground_glow
0
0
4 1 1 1 0

##The ground pane
ground_glow source ground
0
0
4 0 0 -1 180" > ~/MantaRay/TestingRemote/skies/sunny_sky_9.rad
_JOIN_
echo "~/MantaRay/TestingRemote/skies/sunny_sky_9.rad"
""", """mkdir -p ~/MantaRay/TestingRemote/skies/
_JOIN_
echo "##Will control the gradient of the sky
# gensky 7 4 14:00CEST +s -a 59.9 -o 10.7
# Local solar time: 11.22
# Solar altitude and azimuth: 52.2 -17.7
# Ground ambient level: 15.1

void light solar
0
0
3 6.93e+06 6.93e+06 6.93e+06

solar source sun
0
0
4 0.186727 -0.584417 0.789677 0.5

void brightfunc skyfunc
2 skybr skybright.cal
0
7 1 1.18e+01 2.39e+01 7.04e-01 0.186727 -0.584417 0.789677

##The 1 will be multiplie with brightfunc
skyfunc glow sky_glow
0
0
4 1 1 1 0

##Set to 1 as it will be multiplied with the gensky result
sky_glow source sky
0
0
4 0 0 1 180

##Set to 1 as it will be multiplied with the gensky result
skyfunc glow ground_glow
0
0
4 1 1 1 0

##The ground pane
ground_glow source ground
0
0
4 0 0 -1 180" > ~/MantaRay/TestingRemote/skies/sunny_sky_14.rad
_JOIN_
echo "~/MantaRay/TestingRemote/skies/sunny_sky_14.rad"
""", """mkdir -p ~/MantaRay/TestingRemote/skies/
_JOIN_
echo "##Will control the gradient of the sky
# gensky 7 4 12:00CEST +s -a 59.9 -o 10.7
# Local solar time: 9.22
# Solar altitude and azimuth: 43.0 -56.9
# Ground ambient level: 14.6

void light solar
0
0
3 6.72e+06 6.72e+06 6.72e+06

solar source sun
0
0
4 0.612531 -0.399135 0.682273 0.5

void brightfunc skyfunc
2 skybr skybright.cal
0
7 1 9.05e+00 2.04e+01 5.41e-01 0.612531 -0.399135 0.682273

##The 1 will be multiplie with brightfunc
skyfunc glow sky_glow
0
0
4 1 1 1 0

##Set to 1 as it will be multiplied with the gensky result
sky_glow source sky
0
0
4 0 0 1 180

##Set to 1 as it will be multiplied with the gensky result
skyfunc glow ground_glow
0
0
4 1 1 1 0

##The ground pane
ground_glow source ground
0
0
4 0 0 -1 180" > ~/MantaRay/TestingRemote/skies/sunny_sky_12.rad
_JOIN_
echo "~/MantaRay/TestingRemote/skies/sunny_sky_12.rad"
""", """mkdir -p ~/MantaRay/TestingRemote/skies/
_JOIN_
echo "##Will control the gradient of the sky
# gensky 7 4 8:00CEST +s -a 59.9 -o 10.7
# Local solar time: 5.22
# Solar altitude and azimuth: 14.1 -111.6
# Ground ambient level: 8.8

void light solar
0
0
3 3.92e+06 3.92e+06 3.92e+06

solar source sun
0
0
4 0.901641 0.357186 0.243849 0.5

void brightfunc skyfunc
2 skybr skybright.cal
0
7 1 3.81e+00 5.41e+00 3.08e-01 0.901641 0.357186 0.243849

##The 1 will be multiplie with brightfunc
skyfunc glow sky_glow
0
0
4 1 1 1 0

##Set to 1 as it will be multiplied with the gensky result
sky_glow source sky
0
0
4 0 0 1 180

##Set to 1 as it will be multiplied with the gensky result
skyfunc glow ground_glow
0
0
4 1 1 1 0

##The ground pane
ground_glow source ground
0
0
4 0 0 -1 180" > ~/MantaRay/TestingRemote/skies/sunny_sky_8.rad
_JOIN_
echo "~/MantaRay/TestingRemote/skies/sunny_sky_8.rad"
""", """mkdir -p ~/MantaRay/TestingRemote/skies/
_JOIN_
echo "##Will control the gradient of the sky
# gensky 7 4 16:00CEST +s -a 59.9 -o 10.7
# Local solar time: 13.22
# Solar altitude and azimuth: 50.9 27.3
# Ground ambient level: 15.1

void light solar
0
0
3 6.91e+06 6.91e+06 6.91e+06

solar source sun
0
0
4 -0.289110 -0.560683 0.775919 0.5

void brightfunc skyfunc
2 skybr skybright.cal
0
7 1 1.13e+01 2.35e+01 6.77e-01 -0.289110 -0.560683 0.775919

##The 1 will be multiplie with brightfunc
skyfunc glow sky_glow
0
0
4 1 1 1 0

##Set to 1 as it will be multiplied with the gensky result
sky_glow source sky
0
0
4 0 0 1 180

##Set to 1 as it will be multiplied with the gensky result
skyfunc glow ground_glow
0
0
4 1 1 1 0

##The ground pane
ground_glow source ground
0
0
4 0 0 -1 180" > ~/MantaRay/TestingRemote/skies/sunny_sky_16.rad
_JOIN_
echo "~/MantaRay/TestingRemote/skies/sunny_sky_16.rad"
"""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])  # -> Stdout, Stderr_, Ran
item = ListItem(List=executessh_18.Stdout, Index=0, Wrap=True)  # -> Item1, Item
python_5 = GhPythonScript(x=series)  # -> a; inputs x: Int32
# ---------- python_5: Python ----------
__author__ = "mm1013"
__version__ = "2022.08.30"

import rhinoscriptsyntax as rs

a = "%02d00" % x
# ---------- end python_5 ----------
hours = Number(python_5)
# Check if ximage and other x-commands work.
# Must have Xlaunch running on windows with disabled access control
# Otherwise it will crash!
hours_2 = Text(python_5)

overrides_21 = ApplyOverrides(Input="cat <target>", Target=graft(executessh_16.Stdout))  # -> Output, DynamicOutput
executessh_19 = ExecuteSSH(
    _SSHCommands_=overrides_21.Output,
    Run=False,
    addPrefix=True,
    fireLogs=False,
    lastRunTime=0,
    suppressWarnings=False,
    results="""##Will control the gradient of the sky
# gensky -ang 45 0 -c -B 55.866
# Ground ambient level: 17.8

void brightfunc skyfunc
2 skybr skybright.cal
0
3 2 2.29e+01 3.56e+00

##The 1 will be multiplie with brightfunc
skyfunc glow sky_glow
0
0
4 1 1 1 0

##Set to 1 as it will be multiplied with the gensky result
sky_glow source sky
0
0
4 0 0 1 180

##Set to 1 as it will be multiplied with the gensky result
skyfunc glow ground_glow
0
0
4 1 1 1 0

##The ground pane
ground_glow source ground
0
0
4 0 0 -1 180""",
    commands="cat ~/MantaRay/UnnamedProject/skies/overcast_sky.rad")  # -> Stdout, Stderr_, Ran
panel_45 = Panel(executessh_19.Stdout)

overrides_22 = ApplyOverrides(Input="head <target>", Target=graft(item.Item1))  # -> Output, DynamicOutput
executessh_20 = ExecuteSSH(
    _SSHCommands_=overrides_22.DynamicOutput,
    Run=executessh_18.Ran,
    addPrefix=True,
    description="""head ~/MantaRay/TestingRemote/skies/sunny_sky_8.rad


- - -

head ~/MantaRay/TestingRemote/skies/sunny_sky_9.rad


- - -

head ~/MantaRay/TestingRemote/skies/sunny_sky_10.rad


- - -

head ~/MantaRay/TestingRemote/skies/sunny_sky_11.rad


- - -

head ~/MantaRay/TestingRemote/skies/sunny_sky_12.rad


- - -

head ~/MantaRay/TestingRemote/skies/sunny_sky_13.rad


- - -

head ~/MantaRay/TestingRemote/skies/sunny_sky_14.rad


- - -

head ~/MantaRay/TestingRemote/skies/sunny_sky_15.rad


- - -

head ~/MantaRay/TestingRemote/skies/sunny_sky_16.rad


- - -

head ~/MantaRay/TestingRemote/skies/sunny_sky_17.rad""",
    fireLogs=False,
    lastRunTime=40,
    suppressWarnings=False,
    results=["""##Will control the gradient of the sky
# gensky 7 4 8:00CEST +s -a 59.9 -o 10.7
# Local solar time: 5.22
# Solar altitude and azimuth: 14.1 -111.6
# Ground ambient level: 8.8

void light solar
0
0
3 3.92e+06 3.92e+06 3.92e+06""", """##Will control the gradient of the sky
# gensky 7 4 9:00CEST +s -a 59.9 -o 10.7
# Local solar time: 6.22
# Solar altitude and azimuth: 21.4 -99.3
# Ground ambient level: 10.8

void light solar
0
0
3 5.36e+06 5.36e+06 5.36e+06""", """##Will control the gradient of the sky
# gensky 7 4 10:00CEST +s -a 59.9 -o 10.7
# Local solar time: 7.22
# Solar altitude and azimuth: 28.8 -86.4
# Ground ambient level: 12.6

void light solar
0
0
3 6.07e+06 6.07e+06 6.07e+06""", """##Will control the gradient of the sky
# gensky 7 4 11:00CEST +s -a 59.9 -o 10.7
# Local solar time: 8.22
# Solar altitude and azimuth: 36.2 -72.6
# Ground ambient level: 13.8

void light solar
0
0
3 6.48e+06 6.48e+06 6.48e+06""", """##Will control the gradient of the sky
# gensky 7 4 12:00CEST +s -a 59.9 -o 10.7
# Local solar time: 9.22
# Solar altitude and azimuth: 43.0 -56.9
# Ground ambient level: 14.6

void light solar
0
0
3 6.72e+06 6.72e+06 6.72e+06""", """##Will control the gradient of the sky
# gensky 7 4 13:00CEST +s -a 59.9 -o 10.7
# Local solar time: 10.22
# Solar altitude and azimuth: 48.6 -38.7
# Ground ambient level: 15.0

void light solar
0
0
3 6.86e+06 6.86e+06 6.86e+06""", """##Will control the gradient of the sky
# gensky 7 4 14:00CEST +s -a 59.9 -o 10.7
# Local solar time: 11.22
# Solar altitude and azimuth: 52.2 -17.7
# Ground ambient level: 15.1

void light solar
0
0
3 6.93e+06 6.93e+06 6.93e+06""", """##Will control the gradient of the sky
# gensky 7 4 15:00CEST +s -a 59.9 -o 10.7
# Local solar time: 12.22
# Solar altitude and azimuth: 53.0 5.1
# Ground ambient level: 15.2

void light solar
0
0
3 6.94e+06 6.94e+06 6.94e+06""", """##Will control the gradient of the sky
# gensky 7 4 16:00CEST +s -a 59.9 -o 10.7
# Local solar time: 13.22
# Solar altitude and azimuth: 50.9 27.3
# Ground ambient level: 15.1

void light solar
0
0
3 6.91e+06 6.91e+06 6.91e+06""", """##Will control the gradient of the sky
# gensky 7 4 17:00CEST +s -a 59.9 -o 10.7
# Local solar time: 14.22
# Solar altitude and azimuth: 46.3 47.1
# Ground ambient level: 14.8

void light solar
0
0
3 6.81e+06 6.81e+06 6.81e+06"""],
    commands=["head ~/MantaRay/TestingRemote/skies/sunny_sky_8.rad", "head ~/MantaRay/TestingRemote/skies/sunny_sky_9.rad", "head ~/MantaRay/TestingRemote/skies/sunny_sky_11.rad", "head ~/MantaRay/TestingRemote/skies/sunny_sky_10.rad", "head ~/MantaRay/TestingRemote/skies/sunny_sky_12.rad", "head ~/MantaRay/TestingRemote/skies/sunny_sky_13.rad", "head ~/MantaRay/TestingRemote/skies/sunny_sky_15.rad", "head ~/MantaRay/TestingRemote/skies/sunny_sky_14.rad", "head ~/MantaRay/TestingRemote/skies/sunny_sky_17.rad"])  # -> Stdout, Stderr_, Ran
panel_46 = Panel(executessh_20.Stdout)

falsestart_10 = LBFalseStartToggle(True)

falsestart_11 = LBFalseStartToggle(True)

# ----
# OCTREE (overcast)
scene_rads = Text(entwine_4)
sky_ovc_2 = Text(sky_ovc)
python_6 = GhPythonScript(x=flatten(scene_rads))  # -> noNulls; inputs x: list
# ---------- python_6: Python ----------
__author__ = "mm1013"
__version__ = "2022.06.15"

import rhinoscriptsyntax as rs

noNulls = None not in x and len(x) > 0
# ---------- end python_6 ----------
entwine_9 = Entwine(Branch01=sky_ovc_2, Branch02=scene_rads, FlattenInputs=True)  # -> flatten(Radfiles)
panel_47 = Panel("""mkdir -p <proj>/octrees/
oconv -r 2048 -w -f <rads> > <proj>/octrees/<target>
echo <proj>/octrees/<target>""")
and_2 = GateAnd(A=python_6, B=falsestart_10)
join_5 = TextJoin(Text=entwine_9, Join=" ")
overrides_23 = ApplyOverrides(Input=panel_47, Rads=graft(join_5), Target=graft("Scene_Overcast10klux.oct"))  # -> Output, DynamicOutput
executessh_21 = ExecuteSSH(
    _SSHCommands=overrides_23.DynamicOutput,
    Run=and_2,
    addPrefix=True,
    description="""mkdir -p ~/simulation/boston/octrees/
oconv -r 2048 -w -f ~/simulation/boston/skies/overcast_sky.rad ~/MantaRay/TestFolder/radFiles/Glass_70.mat /home/lio/MantaRay/TestFolder/radFiles/Glass_70_geo.rad ~/MantaRay/TestFolder/radFiles/opaque_materials.mat /home/lio/MantaRay/TestFolder/radFiles/FloorMat_0.7_geo.rad /home/lio/MantaRay/TestFolder/radFiles/Cladding_0.5_geo.rad /home/lio/MantaRay/TestFolder/radFiles/ConcreteWhite_0.8_geo.rad /home/lio/MantaRay/TestFolder/radFiles/ConcreteStructure_0.3_geo.rad /home/lio/MantaRay/TestFolder/radFiles/ConcreteGrey_0.5_geo.rad /home/lio/MantaRay/TestFolder/radFiles/IntWalls_0.9_geo.rad /home/lio/MantaRay/TestFolder/radFiles/Pipes_0.03_geo.rad /home/lio/MantaRay/TestFolder/radFiles/ConcreteDarker_0.1_geo.rad /home/lio/MantaRay/TestFolder/radFiles/Frames_0.6_geo.rad /home/lio/MantaRay/TestFolder/radFiles/Black_0.01_geo.rad /home/lio/MantaRay/TestFolder/radFiles/CurvedCeiling_0.8_geo.rad /home/lio/MantaRay/TestFolder/radFiles/IntWalls_0.8_geo.rad /home/lio/MantaRay/TestFolder/radFiles/FloorBox_0.75_geo.rad ~/MantaRay/TestFolder/radFiles/other_materials.mat > ~/simulation/boston/octrees/Scene_Overcast10klux.oct
echo ~/simulation/boston/octrees/Scene_Overcast10klux.oct""",
    fireLogs=True,
    lastRunTime=3246.8392,
    name="oconv Scene_Overcast10klux.oct",
    staticDescription="""mkdir -p ~/MantaRay/Andrei/octrees/
oconv -r 2048 -w -f ~/MantaRay/Andrei/skies/overcast_sky.rad ~/MantaRay/Andrei/radFiles/Glass_70.mat /home/lio/MantaRay/Andrei/radFiles/Glass_70_geo.rad ~/MantaRay/Andrei/radFiles/opaque_materials.mat /home/lio/MantaRay/Andrei/radFiles/FloorMat_0.7_geo.rad /home/lio/MantaRay/Andrei/radFiles/Cladding_0.5_geo.rad /home/lio/MantaRay/Andrei/radFiles/ConcreteWhite_0.8_geo.rad /home/lio/MantaRay/Andrei/radFiles/ConcreteStructure_0.3_geo.rad /home/lio/MantaRay/Andrei/radFiles/ConcreteGrey_0.5_geo.rad /home/lio/MantaRay/Andrei/radFiles/IntWalls_0.9_geo.rad /home/lio/MantaRay/Andrei/radFiles/Pipes_0.03_geo.rad /home/lio/MantaRay/Andrei/radFiles/ConcreteDarker_0.1_geo.rad /home/lio/MantaRay/Andrei/radFiles/Frames_0.6_geo.rad /home/lio/MantaRay/Andrei/radFiles/Black_0.01_geo.rad /home/lio/MantaRay/Andrei/radFiles/CurvedCeiling_0.8_geo.rad /home/lio/MantaRay/Andrei/radFiles/IntWalls_0.8_geo.rad /home/lio/MantaRay/Andrei/radFiles/FloorBox_0.75_geo.rad ~/MantaRay/Andrei/radFiles/other_materials.mat > ~/MantaRay/Andrei/octrees/Scene_Overcast10klux.oct
echo ~/MantaRay/Andrei/octrees/Scene_Overcast10klux.oct""",
    suppressWarnings=False,
    results="/home/lio/simulation/boston/octrees/Scene_Overcast10klux.oct",
    commands="""mkdir -p ~/simulation/boston/octrees/
oconv -r 2048 -w -f ~/simulation/boston/skies/overcast_sky.rad ~/MantaRay/TestFolder/radFiles/Glass_70.mat /home/lio/MantaRay/TestFolder/radFiles/Glass_70_geo.rad ~/MantaRay/TestFolder/radFiles/opaque_materials.mat /home/lio/MantaRay/TestFolder/radFiles/FloorMat_0.7_geo.rad /home/lio/MantaRay/TestFolder/radFiles/Cladding_0.5_geo.rad /home/lio/MantaRay/TestFolder/radFiles/ConcreteWhite_0.8_geo.rad /home/lio/MantaRay/TestFolder/radFiles/ConcreteStructure_0.3_geo.rad /home/lio/MantaRay/TestFolder/radFiles/ConcreteGrey_0.5_geo.rad /home/lio/MantaRay/TestFolder/radFiles/IntWalls_0.9_geo.rad /home/lio/MantaRay/TestFolder/radFiles/Pipes_0.03_geo.rad /home/lio/MantaRay/TestFolder/radFiles/ConcreteDarker_0.1_geo.rad /home/lio/MantaRay/TestFolder/radFiles/Frames_0.6_geo.rad /home/lio/MantaRay/TestFolder/radFiles/Black_0.01_geo.rad /home/lio/MantaRay/TestFolder/radFiles/CurvedCeiling_0.8_geo.rad /home/lio/MantaRay/TestFolder/radFiles/IntWalls_0.8_geo.rad /home/lio/MantaRay/TestFolder/radFiles/FloorBox_0.75_geo.rad ~/MantaRay/TestFolder/radFiles/other_materials.mat > ~/simulation/boston/octrees/Scene_Overcast10klux.oct
echo ~/simulation/boston/octrees/Scene_Overcast10klux.oct""")  # -> Stdout, Stderr_, Ran
panel_48 = Panel(overrides_23.Output)
panel_49 = Panel(executessh_21.Stderr_)
octree_overcast = Text(executessh_21.Stdout)

# ----
# OCTREE (Sunny - 10 hourly skies!)
scene_rads_2 = Text(entwine_4)
# 5 phase bash script from andy mcneil
falsestart_12 = LBFalseStartToggle(False)
python_7 = GhPythonScript(x=flatten(scene_rads_2))  # -> a; inputs x: list
# ---------- python_7: Python ----------
__author__ = "mm1013"
__version__ = "2022.06.15"

import rhinoscriptsyntax as rs

a = None not in x
# ---------- end python_7 ----------
entwine_10 = Entwine(Branch02=scene_rads_2, FlattenInputs=True)  # -> flatten(Radfiles)
panel_50 = Panel("""mkdir -p <proj>/octrees/
oconv -r 2048 -f -w <rads> > <proj>/octrees/<target>
echo <proj>/octrees/<target>""")
join_6 = TextJoin(Text=entwine_10, Join=" ")
overrides_24 = ApplyOverrides(Input=panel_50, Rads=graft(join_6), Target=graft("my_test_scene_NOSKY.oct"))  # -> Output, DynamicOutput
panel_51 = Panel("oconv -r 2048 -i <oldOct> -f <newRads> > <proj>/octrees/<target>_<h>.oct;echo <proj>/octrees/<target>_<h>.oct")
executessh_22 = ExecuteSSH(
    _SSHCommands_=overrides_24.DynamicOutput,
    Run=[python_7, falsestart_12],
    addPrefix=True,
    description="""mkdir -p ~/simulation/boston/octrees/
oconv -r 2048 -f -w ~/MantaRay/TestFolder/radFiles/Glass_70.mat /home/lio/MantaRay/TestFolder/radFiles/Glass_70_geo.rad ~/MantaRay/TestFolder/radFiles/opaque_materials.mat /home/lio/MantaRay/TestFolder/radFiles/FloorMat_0.7_geo.rad /home/lio/MantaRay/TestFolder/radFiles/Cladding_0.5_geo.rad /home/lio/MantaRay/TestFolder/radFiles/ConcreteWhite_0.8_geo.rad /home/lio/MantaRay/TestFolder/radFiles/ConcreteStructure_0.3_geo.rad /home/lio/MantaRay/TestFolder/radFiles/ConcreteGrey_0.5_geo.rad /home/lio/MantaRay/TestFolder/radFiles/IntWalls_0.9_geo.rad /home/lio/MantaRay/TestFolder/radFiles/Pipes_0.03_geo.rad /home/lio/MantaRay/TestFolder/radFiles/ConcreteDarker_0.1_geo.rad /home/lio/MantaRay/TestFolder/radFiles/Frames_0.6_geo.rad /home/lio/MantaRay/TestFolder/radFiles/Black_0.01_geo.rad /home/lio/MantaRay/TestFolder/radFiles/CurvedCeiling_0.8_geo.rad /home/lio/MantaRay/TestFolder/radFiles/IntWalls_0.8_geo.rad /home/lio/MantaRay/TestFolder/radFiles/FloorBox_0.75_geo.rad ~/MantaRay/TestFolder/radFiles/other_materials.mat > ~/simulation/boston/octrees/my_test_scene_NOSKY.oct
echo ~/simulation/boston/octrees/my_test_scene_NOSKY.oct""",
    fireLogs=False,
    lastRunTime=1124,
    suppressWarnings=False,
    results="/home/lio/MantaRay/Andrei/octrees/my_test_scene_NOSKY.oct",
    commands="""mkdir -p ~/MantaRay/Andrei/octrees/
oconv -r 2048 -f -w ~/MantaRay/Andrei/radFiles/Glass_70.mat /home/lio/MantaRay/Andrei/radFiles/Glass_70_geo.rad ~/MantaRay/Andrei/radFiles/opaque_materials.mat /home/lio/MantaRay/Andrei/radFiles/FloorMat_0.7_geo.rad /home/lio/MantaRay/Andrei/radFiles/Cladding_0.5_geo.rad /home/lio/MantaRay/Andrei/radFiles/ConcreteWhite_0.8_geo.rad /home/lio/MantaRay/Andrei/radFiles/ConcreteStructure_0.3_geo.rad /home/lio/MantaRay/Andrei/radFiles/ConcreteGrey_0.5_geo.rad /home/lio/MantaRay/Andrei/radFiles/IntWalls_0.9_geo.rad /home/lio/MantaRay/Andrei/radFiles/Pipes_0.03_geo.rad /home/lio/MantaRay/Andrei/radFiles/ConcreteDarker_0.1_geo.rad /home/lio/MantaRay/Andrei/radFiles/Frames_0.6_geo.rad /home/lio/MantaRay/Andrei/radFiles/Black_0.01_geo.rad /home/lio/MantaRay/Andrei/radFiles/CurvedCeiling_0.8_geo.rad /home/lio/MantaRay/Andrei/radFiles/IntWalls_0.8_geo.rad /home/lio/MantaRay/Andrei/radFiles/FloorBox_0.75_geo.rad > ~/MantaRay/Andrei/octrees/my_test_scene_NOSKY.oct
echo ~/MantaRay/Andrei/octrees/my_test_scene_NOSKY.oct""")  # -> Stdout, Stderr_, Ran
hours_3 = Text(hours_2)
sky_sunny = Text(graft(item.Item1))
panel_52 = Panel(executessh_22.Stdout)
overrides_25 = ApplyOverrides(
    Input=panel_51,
    OldOct=graft(executessh_22.Stdout),
    NewRads=graft(sky_sunny),
    Target=graft("my_test_scene"),
    H=graft(hours_3))  # -> Output, DynamicOutput
executessh_23 = ExecuteSSH(
    _SSHCommands_=overrides_25.DynamicOutput,
    Run=executessh_22.Ran,
    addPrefix=True,
    description="""oconv -r 2048 -i /home/lio/MantaRay/Andrei/octrees/my_test_scene_NOSKY.oct -f ~/MantaRay/TestingRemote/skies/sunny_sky_8.rad > ~/simulation/boston/octrees/my_test_scene_0800.oct;echo ~/simulation/boston/octrees/my_test_scene_0800.oct


- - -

oconv -r 2048 -i /home/lio/MantaRay/Andrei/octrees/my_test_scene_NOSKY.oct -f ~/MantaRay/TestingRemote/skies/sunny_sky_9.rad > ~/simulation/boston/octrees/my_test_scene_0900.oct;echo ~/simulation/boston/octrees/my_test_scene_0900.oct


- - -

oconv -r 2048 -i /home/lio/MantaRay/Andrei/octrees/my_test_scene_NOSKY.oct -f ~/MantaRay/TestingRemote/skies/sunny_sky_10.rad > ~/simulation/boston/octrees/my_test_scene_1000.oct;echo ~/simulation/boston/octrees/my_test_scene_1000.oct


- - -

oconv -r 2048 -i /home/lio/MantaRay/Andrei/octrees/my_test_scene_NOSKY.oct -f ~/MantaRay/TestingRemote/skies/sunny_sky_11.rad > ~/simulation/boston/octrees/my_test_scene_1100.oct;echo ~/simulation/boston/octrees/my_test_scene_1100.oct


- - -

oconv -r 2048 -i /home/lio/MantaRay/Andrei/octrees/my_test_scene_NOSKY.oct -f ~/MantaRay/TestingRemote/skies/sunny_sky_12.rad > ~/simulation/boston/octrees/my_test_scene_1200.oct;echo ~/simulation/boston/octrees/my_test_scene_1200.oct


- - -

oconv -r 2048 -i /home/lio/MantaRay/Andrei/octrees/my_test_scene_NOSKY.oct -f ~/MantaRay/TestingRemote/skies/sunny_sky_13.rad > ~/simulation/boston/octrees/my_test_scene_1300.oct;echo ~/simulation/boston/octrees/my_test_scene_1300.oct


- - -

oconv -r 2048 -i /home/lio/MantaRay/Andrei/octrees/my_test_scene_NOSKY.oct -f ~/MantaRay/TestingRemote/skies/sunny_sky_14.rad > ~/simulation/boston/octrees/my_test_scene_1400.oct;echo ~/simulation/boston/octrees/my_test_scene_1400.oct


- - -

oconv -r 2048 -i /home/lio/MantaRay/Andrei/octrees/my_test_scene_NOSKY.oct -f ~/MantaRay/TestingRemote/skies/sunny_sky_15.rad > ~/simulation/boston/octrees/my_test_scene_1500.oct;echo ~/simulation/boston/octrees/my_test_scene_1500.oct


- - -

oconv -r 2048 -i /home/lio/MantaRay/Andrei/octrees/my_test_scene_NOSKY.oct -f ~/MantaRay/TestingRemote/skies/sunny_sky_16.rad > ~/simulation/boston/octrees/my_test_scene_1600.oct;echo ~/simulation/boston/octrees/my_test_scene_1600.oct


- - -

oconv -r 2048 -i /home/lio/MantaRay/Andrei/octrees/my_test_scene_NOSKY.oct -f ~/MantaRay/TestingRemote/skies/sunny_sky_17.rad > ~/simulation/boston/octrees/my_test_scene_1700.oct;echo ~/simulation/boston/octrees/my_test_scene_1700.oct""",
    fireLogs=False,
    lastRunTime=126,
    suppressWarnings=False,
    results=["/home/lio/MantaRay/Andrei/octrees/my_test_scene_0800.oct", "/home/lio/MantaRay/Andrei/octrees/my_test_scene_0900.oct", "/home/lio/MantaRay/Andrei/octrees/my_test_scene_1000.oct", "/home/lio/MantaRay/Andrei/octrees/my_test_scene_1100.oct", "/home/lio/MantaRay/Andrei/octrees/my_test_scene_1200.oct", "/home/lio/MantaRay/Andrei/octrees/my_test_scene_1300.oct", "/home/lio/MantaRay/Andrei/octrees/my_test_scene_1400.oct", "/home/lio/MantaRay/Andrei/octrees/my_test_scene_1500.oct", "/home/lio/MantaRay/Andrei/octrees/my_test_scene_1600.oct", "/home/lio/MantaRay/Andrei/octrees/my_test_scene_1700.oct"],
    commands=["oconv -r 2048 -i /home/lio/MantaRay/Andrei/octrees/my_test_scene_NOSKY.oct -f ~/MantaRay/TestingRemote/skies/sunny_sky_8.rad > ~/MantaRay/Andrei/octrees/my_test_scene_0800.oct;echo ~/MantaRay/Andrei/octrees/my_test_scene_0800.oct", "oconv -r 2048 -i /home/lio/MantaRay/Andrei/octrees/my_test_scene_NOSKY.oct -f ~/MantaRay/TestingRemote/skies/sunny_sky_10.rad > ~/MantaRay/Andrei/octrees/my_test_scene_1000.oct;echo ~/MantaRay/Andrei/octrees/my_test_scene_1000.oct", "oconv -r 2048 -i /home/lio/MantaRay/Andrei/octrees/my_test_scene_NOSKY.oct -f ~/MantaRay/TestingRemote/skies/sunny_sky_11.rad > ~/MantaRay/Andrei/octrees/my_test_scene_1100.oct;echo ~/MantaRay/Andrei/octrees/my_test_scene_1100.oct", "oconv -r 2048 -i /home/lio/MantaRay/Andrei/octrees/my_test_scene_NOSKY.oct -f ~/MantaRay/TestingRemote/skies/sunny_sky_9.rad > ~/MantaRay/Andrei/octrees/my_test_scene_0900.oct;echo ~/MantaRay/Andrei/octrees/my_test_scene_0900.oct", "oconv -r 2048 -i /home/lio/MantaRay/Andrei/octrees/my_test_scene_NOSKY.oct -f ~/MantaRay/TestingRemote/skies/sunny_sky_13.rad > ~/MantaRay/Andrei/octrees/my_test_scene_1300.oct;echo ~/MantaRay/Andrei/octrees/my_test_scene_1300.oct", "oconv -r 2048 -i /home/lio/MantaRay/Andrei/octrees/my_test_scene_NOSKY.oct -f ~/MantaRay/TestingRemote/skies/sunny_sky_15.rad > ~/MantaRay/Andrei/octrees/my_test_scene_1500.oct;echo ~/MantaRay/Andrei/octrees/my_test_scene_1500.oct", "oconv -r 2048 -i /home/lio/MantaRay/Andrei/octrees/my_test_scene_NOSKY.oct -f ~/MantaRay/TestingRemote/skies/sunny_sky_17.rad > ~/MantaRay/Andrei/octrees/my_test_scene_1700.oct;echo ~/MantaRay/Andrei/octrees/my_test_scene_1700.oct"])  # -> Stdout, Stderr_, Ran

# ----
# OCTREE (ONLY a 10klux sky, no geo)
panel_53 = Panel("PureSky_Overcast10klux.oct")
panel_54 = Panel("""mkdir -p <proj>/octrees/
oconv -r 2048 -w -f <rads> > <proj>/octrees/<target>
echo <proj>/octrees/<target>""")
sky_ovc_3 = Text(sky_ovc)
overrides_26 = ApplyOverrides(Input=panel_54, Rads=graft(sky_ovc_3), Target=graft(panel_53))  # -> Output, DynamicOutput
executessh_24 = ExecuteSSH(
    _SSHCommands=overrides_26.DynamicOutput,
    Run=falsestart_11,
    addPrefix=True,
    description="""mkdir -p ~/simulation/boston/octrees/
oconv -r 2048 -w -f ~/simulation/boston/skies/overcast_sky.rad > ~/simulation/boston/octrees/PureSky_Overcast10klux.oct
echo ~/simulation/boston/octrees/PureSky_Overcast10klux.oct""",
    fireLogs=True,
    lastRunTime=91.1043,
    name="oconv PureSky_Overcast10klux.oct",
    staticDescription="""mkdir -p ~/MantaRay/Andrei/octrees/
oconv -r 2048 -w -f ~/MantaRay/Andrei/skies/overcast_sky.rad ~/MantaRay/Andrei/radFiles/Glass_70.mat /home/lio/MantaRay/Andrei/radFiles/Glass_70_geo.rad ~/MantaRay/Andrei/radFiles/opaque_materials.mat /home/lio/MantaRay/Andrei/radFiles/FloorMat_0.7_geo.rad /home/lio/MantaRay/Andrei/radFiles/Cladding_0.5_geo.rad /home/lio/MantaRay/Andrei/radFiles/ConcreteWhite_0.8_geo.rad /home/lio/MantaRay/Andrei/radFiles/ConcreteStructure_0.3_geo.rad /home/lio/MantaRay/Andrei/radFiles/ConcreteGrey_0.5_geo.rad /home/lio/MantaRay/Andrei/radFiles/IntWalls_0.9_geo.rad /home/lio/MantaRay/Andrei/radFiles/Pipes_0.03_geo.rad /home/lio/MantaRay/Andrei/radFiles/ConcreteDarker_0.1_geo.rad /home/lio/MantaRay/Andrei/radFiles/Frames_0.6_geo.rad /home/lio/MantaRay/Andrei/radFiles/Black_0.01_geo.rad /home/lio/MantaRay/Andrei/radFiles/CurvedCeiling_0.8_geo.rad /home/lio/MantaRay/Andrei/radFiles/IntWalls_0.8_geo.rad /home/lio/MantaRay/Andrei/radFiles/FloorBox_0.75_geo.rad ~/MantaRay/Andrei/radFiles/other_materials.mat > ~/MantaRay/Andrei/octrees/Scene_Overcast10klux.oct
echo ~/MantaRay/Andrei/octrees/Scene_Overcast10klux.oct""",
    suppressWarnings=False,
    results="/home/lio/simulation/boston/octrees/PureSky_Overcast10klux.oct",
    commands="""mkdir -p ~/simulation/boston/octrees/
oconv -r 2048 -w -f ~/simulation/boston/skies/overcast_sky.rad > ~/simulation/boston/octrees/PureSky_Overcast10klux.oct
echo ~/simulation/boston/octrees/PureSky_Overcast10klux.oct""")  # -> Stdout, Stderr_, Ran

# ----
# # CIE overcast sky (Bz = 1)
# 
# !gensky -ang 45 0 -c -B 55.866
# 
# skyfunc glow sky_glow
# 0
# 0
# 4 1 1 1 0
# sky_glow source sky
# 0
# 0
# 4 0 0 1 180
overrides_27 = ApplyOverrides()  # -> Output, DynamicOutput
panel_55 = Panel("gensky -ang 45 0 -c -B 55.866")
panel_56 = Panel("<sky> > ")
panel_57 = Panel("echo \"0 0 0 0 0 1\" | rtrace -h -w -I+ -w -ab 1 -ad 10000 <oct> | rcalc -e '$1=($1*0.265+$2*0.670+$3*0.065)*179'")
panel_58 = Panel("""rpict -vf <vf> -x 1512 -y 1512 <oct> > <LinuxHome>/images/<target-.>.hdr
echo <LinuxHome>/images/<target-.>.hdr""")
falsestart_13 = LBFalseStartToggle(True)
panel_59 = Panel("""ra_tiff <hdr-.>_exposed.hdr <hdr-.>_exposed.tif
convert <hdr-.>_exposed.tif <hdr-.>_exposed.png
echo <hdr-.>_exposed.png""")
download_5 = Download(
    SftpPaths=executessh_24.Stdout,
    Run=falsestart_13,
    stdouts="C:\Users\mm1013\MantaRay\TestFolder\PureSky_Overcast10klux.oct")  # -> FilePaths, Status, Ran
overrides_28 = ApplyOverrides(Input=panel_57, Oct=graft(executessh_24.Stdout))  # -> Output, DynamicOutput
executessh_25 = ExecuteSSH(
    _SSHCommands_=overrides_28.DynamicOutput,
    Run=executessh_24.Ran,
    addPrefix=True,
    description="echo \"0 0 0 0 0 1\" | rtrace -h -w -I+ -w -ab 1 -ad 10000 /home/lio/simulation/boston/octrees/PureSky_Overcast10klux.oct | rcalc -e '$1=($1*0.265+$2*0.670+$3*0.065)*179'",
    fireLogs=False,
    lastRunTime=94.8471,
    suppressWarnings=False,
    results="10004.6322",
    commands="echo \"0 0 0 0 0 1\" | rtrace -h -w -I+ -w -ab 1 -ad 10000 /home/lio/simulation/boston/octrees/PureSky_Overcast10klux.oct | rcalc -e '$1=($1*0.265+$2*0.670+$3*0.065)*179'")  # -> Stdout, Stderr_, Ran
panel_60 = Panel(download_5.FilePaths)
panel_61 = Panel(executessh_25.Stdout)

view = CreateView(Viewport="Perspective")  # -> ViewfileContent, ImageRatio
panel_62 = Panel("""mkdir -p <proj>/views/
echo "<vf>" > <proj>/views/<target>.vf
echo <proj>/views/<target>.vf""")
concat_3 = Concatenate(FragmentA="Perspective", FragmentB="3")
vf = Text(view.ViewfileContent)
panel_63 = Panel(view.ViewfileContent)
overrides_29 = ApplyOverrides(Input=panel_62, Vf=graft(vf), Target=graft(concat_3))  # -> Output, DynamicOutput
executessh_26 = ExecuteSSH(
    _SSHCommands_=overrides_29.DynamicOutput,
    Run=Toggle(True),
    addPrefix=True,
    description="""mkdir -p ~/MantaRay/TestFolder/views/
echo "rvu -vtv -vp 76.210958985352 16.4300937305602 1.83584927923156 -vd -0.349680913647465 0.927360836447747 0.133135786524922 -vu 0.0469732080515546 -0.124573895254805 0.991097806649975 -vh 63.227 -vv 50.000" > ~/MantaRay/TestFolder/views/Perspective3.vf
echo ~/MantaRay/TestFolder/views/Perspective3.vf""",
    fireLogs=False,
    lastRunTime=79.6111,
    suppressWarnings=False,
    results="/home/lio/MantaRay/TestFolder/views/Perspective3.vf",
    commands="""mkdir -p ~/MantaRay/TestFolder/views/
echo "rvu -vtv -vp 76.210958985352 16.4300937305602 1.83584927923156 -vd -0.349680913647465 0.927360836447747 0.133135786524922 -vu 0.0469732080515546 -0.124573895254805 0.991097806649975 -vh 63.227 -vv 50.000" > ~/MantaRay/TestFolder/views/Perspective3.vf
echo ~/MantaRay/TestFolder/views/Perspective3.vf""")  # -> Stdout, Stderr_, Ran
viewname = Text(concat_3)

# ----
# img size
target_res = ValueList({"750x330": 750, "1500x750": 1500, "3000x1500": 3000, "5000x2500": 5000, "7000x3500": 7000, "8000x4000": 8000}, selected="750x330")
division = Division(A=target_res, B=2)
x = RemoteSender(target_res)
y = RemoteSender(division)

view_2 = CreateView(Viewport="Perspective")  # -> ViewfileContent, ImageRatio
panel_64 = Panel("""mkdir -p <proj>/views/
echo "<vf>" > <proj>/views/<target>.vf
echo <proj>/views/<target>.vf""")
concat_4 = Concatenate(FragmentA="Perspective", FragmentB="2")
vf_2 = Text(view_2.ViewfileContent)
panel_65 = Panel(view_2.ViewfileContent)
overrides_30 = ApplyOverrides(Input=panel_64, Vf=graft(vf_2), Target=graft(concat_4))  # -> Output, DynamicOutput
executessh_27 = ExecuteSSH(
    _SSHCommands_=overrides_30.DynamicOutput,
    Run=Toggle(True),
    addPrefix=True,
    description="""mkdir -p ~/MantaRay/TestFolder/views/
echo "rvu -vtv -vp 105.772317148807 9.23475143745903 4.45065721872267 -vd -0.913008145687204 0.407261279627677 -0.023545191119206 -vu -0.0215029124594609 0.00959170373816365 0.999722773560331 -vh 63.227 -vv 50.000" > ~/MantaRay/TestFolder/views/Perspective2.vf
echo ~/MantaRay/TestFolder/views/Perspective2.vf""",
    fireLogs=False,
    lastRunTime=77.2753,
    suppressWarnings=False,
    results="/home/lio/MantaRay/TestFolder/views/Perspective2.vf",
    commands="""mkdir -p ~/MantaRay/TestFolder/views/
echo "rvu -vtv -vp 105.772317148807 9.23475143745903 4.45065721872267 -vd -0.913008145687204 0.407261279627677 -0.023545191119206 -vu -0.0215029124594609 0.00959170373816365 0.999722773560331 -vh 63.227 -vv 50.000" > ~/MantaRay/TestFolder/views/Perspective2.vf
echo ~/MantaRay/TestFolder/views/Perspective2.vf""")  # -> Stdout, Stderr_, Ran
viewname_2 = Text(concat_4)

overrides_31 = ApplyOverrides(Input=panel_58, vf=graft(executessh_27.Stdout), oct=graft(octree_overcast), target=graft("test.hdr"))  # -> Output, DynamicOutput
executessh_28 = ExecuteSSH(
    _SSHCommands_=overrides_31.DynamicOutput,
    Run=executessh_21.Ran,
    addPrefix=True,
    description="""rpict -vf /home/lio/MantaRay/TestFolder/views/Perspective2.vf -x 1512 -y 1512 /home/lio/simulation/boston/octrees/Scene_Overcast10klux.oct > ~/MantaRay/TestFolder/images/test.hdr
echo ~/MantaRay/TestFolder/images/test.hdr""",
    fireLogs=False,
    lastRunTime=624.3494,
    suppressWarnings=False,
    results="/home/lio/MantaRay/TestFolder/images/test.hdr",
    stderr="rpict: warning - no light sources found",
    commands="""rpict -vf /home/lio/MantaRay/TestFolder/views/Perspective2.vf -x 1512 -y 1512 /home/lio/simulation/boston/octrees/Scene_Overcast10klux.oct > ~/MantaRay/TestFolder/images/test.hdr
echo ~/MantaRay/TestFolder/images/test.hdr""")  # -> Stdout, Stderr_, Ran
overrides_32 = ApplyOverrides(Input=panel_59, Hdr=graft(executessh_28.Stdout))  # -> Output, DynamicOutput
panel_66 = Panel(overrides_31.Output)
executessh_29 = ExecuteSSH(
    _SSHCommands_=overrides_32.DynamicOutput,
    Run=executessh_28.Ran,
    addPrefix=True,
    description="""ra_tiff /home/lio/MantaRay/TestFolder/images/test_exposed.hdr /home/lio/MantaRay/TestFolder/images/test_exposed.tif
convert /home/lio/MantaRay/TestFolder/images/test_exposed.tif /home/lio/MantaRay/TestFolder/images/test_exposed.png
echo /home/lio/MantaRay/TestFolder/images/test_exposed.png""",
    fireLogs=False,
    lastRunTime=95.5481,
    suppressWarnings=False,
    results="/home/lio/MantaRay/TestFolder/images/test_exposed.png",
    commands="""ra_tiff /home/lio/MantaRay/TestFolder/images/test_exposed.hdr /home/lio/MantaRay/TestFolder/images/test_exposed.tif
convert /home/lio/MantaRay/TestFolder/images/test_exposed.tif /home/lio/MantaRay/TestFolder/images/test_exposed.png
echo /home/lio/MantaRay/TestFolder/images/test_exposed.png""")  # -> Stdout, Stderr_, Ran
download_6 = Download(SftpPaths=executessh_29.Stdout, Run=executessh_29.Ran, stdouts="C:\Users\mm1013\MantaRay\TestFolder\test_exposed.png")  # -> FilePaths, Status, Ran

# ----
# attempt to do overcast discretized sky (rtcontrib tutorial p20)
panel_67 = Panel("gensky 3 21 10 -c -a 51 -o 0 -m 0 -b 22.86")
falsestart_14 = LBFalseStartToggle(False)
panel_68 = Panel("""gensky 3 21 10 -c -a 51 -o 0 -m 0 -b 22.86 \
|rcalc -i '3 2 <zenithbr> <groundbr>' \
-e '$1=<groundbr>'""")
executessh_30 = ExecuteSSH(
    _SSHCommands_=panel_67,
    Run=falsestart_14,
    addPrefix=True,
    fireLogs=False,
    lastRunTime=5,
    suppressWarnings=False,
    results="""# gensky 3 21 10 -c -a 51 -o 0 -m 0 -b 22.86
# Local solar time: 9.88
# Solar altitude and azimuth: 31.9 -38.5
# Ground ambient level: 17.8

void brightfunc skyfunc
2 skybr skybright.cal
0
3 2 2.29e+01 3.56e+00""",
    commands="gensky 3 21 10 -c -a 51 -o 0 -m 0 -b 22.86")  # -> Stdout, Stderr_, Ran
python_8 = GhPythonScript(x=executessh_30.Stdout)  # -> a
# ---------- python_8: Python ----------
__author__ = "mm1013"
__version__ = "2022.09.27"

import rhinoscriptsyntax as rs

a = float(x.split("\n")[3].split(" ")[-1])
# ---------- end python_8 ----------
python_9 = GhPythonScript(x=executessh_30.Stdout)  # -> a
# ---------- python_9: Python ----------
__author__ = "mm1013"
__version__ = "2022.09.27"

import rhinoscriptsyntax as rs

a = float(x.split(" ")[-2])
# ---------- end python_9 ----------
panel_69 = Panel(executessh_30.Stdout)
overrides_33 = ApplyOverrides(Input=panel_68, Zenithbr=graft(python_9), Groundbr=graft(python_8))  # -> Output, DynamicOutput
executessh_31 = ExecuteSSH(
    _SSHCommands_=overrides_33.Output,
    Run=executessh_30.Ran,
    addPrefix=True,
    fireLogs=False,
    lastRunTime=6,
    suppressWarnings=False,
    stderr="3 2 22.9 17.8: cannot open",
    commands="""gensky 3 21 10 -c -a 51 -o 0 -m 0 -b 22.86 \
|rcalc -i '3 2 22.9 17.8' \
-e '$1=17.8'""")  # -> Stdout, Stderr_, Ran
panel_70 = Panel(executessh_31.Stderr_)

# ----
# Set focus zone to RAD
# to calculate parameters
type = ValueList({"Interior": "I", "Exterior": "E"}, selected="Exterior")
zone = Box({Plane=PlaneXY(67.34687306, 14.8177948, 0), X=Domain(0, 14.49025655), Y=Domain(0, 18.20965901), Z=Domain(0, 13.53214381)})
zone_2 = GhPythonScript(zoneBox=zone, type=type)  # -> out, zone; inputs zoneBox: Box
# ---------- zone_2: Python ----------
__author__ = "mm1013"
__version__ = "2022.10.06"

import rhinoscriptsyntax as rs
import Rhino.Geometry as rg

import Grasshopper.Kernel as gh

#e = gh.GH_RuntimeMessageLevel.Error
w = gh.GH_RuntimeMessageLevel.Warning

zone =""

testPlane = rg.Plane(rg.Point3d(0,0,0), zoneBox.Plane.XAxis, zoneBox.Plane.YAxis)
if testPlane != rg.Plane.WorldXY:
    ghenv.Component.AddRuntimeMessage(w, "Bounding box must have XY as base plane")
else:
    zone = "ZONE={type} {Xmin:.2f} {Xmax:.2f} {Ymin:.2f} {Ymax:.2f} {Zmin:.2f} {Zmax:.2f}\n".format( \
    type=type, Xmin = zoneBox.X.Min, Xmax = zoneBox.X.Max, Ymin = zoneBox.Y.Min, Ymax = zoneBox.Y.Max, Zmin = zoneBox.Z.Min, Zmax = zoneBox.Z.Max)
# ---------- end zone_2 ----------

panel_71 = Panel("~/MantaRay/Andrei/images/2023_03_12_2232_rtpict_rendering_aa0_5000_sunny_ad32_0/radiance.hdr")

# ----
# Parallel RTRACE render
# with ambient cache - with error log
run_2 = LBFalseStartToggle(False)
octree = Text(executessh_21.Stdout)
viewfile = Text(executessh_27.Stdout)
# Produces weird results with ab > 1 ! https://discourse.radiance-online.org/t/rtrace-render-self-reflections/6215
panel_72 = Panel("""mkdir -p <LinuxHome>/images/
mkdir -p <LinuxHome>/ambientFiles/
vwrays -ff -x <x> -y <y> -vf <vf> -pa 1 | rtrace <radOptions> -af <LinuxHome>/ambientFiles/<af> -w -n <cpus> `vwrays -d -ff -x <x> -y <y> -vf <vf> -pa 1` -ffc -e <LinuxHome>/ambientFiles/<target-.>.err <oct> > <LinuxHome>/images/<target-.>.hdr
echo <LinuxHome>/images/<target-.>.hdr""")
python_10 = GhPythonScript(x=viewfile)  # -> a
# ---------- python_10: Python ----------
__author__ = "mm1013"
__version__ = "2022.09.13"

import rhinoscriptsyntax as rs

a = x.split("/")[-1].split(".")[0]
# ---------- end python_10 ----------
panel_73 = Panel("<time>_<view>_render.hdr")
panel_74 = Panel("-as 128 -ab 2 -aa 0.5 -ad 128")
x_2 = RemoteReceiver(x)
y_2 = RemoteReceiver(y)
overrides_34 = ApplyOverrides(
    Input=panel_72,
    X=graft(x_2),
    Y=graft(y_2),
    Vf=graft("<vf>"),
    RadOptions=graft(panel_74),
    Oct=graft(octree),
    Target=graft(panel_73),
    Af=graft("<af>"),
    Time=graft("<time>"),
    View=graft("<view>"))  # -> Output, DynamicOutput
python_11 = GhPythonScript(update=overrides_34.Output)  # -> time; inputs update: tree
# ---------- python_11: Python ----------
#if not update:
#    return self.time
"""Provides a scripting component.
    Inputs:
        x: The x script variable
        y: The y script variable
    Output:
        a: The a output variable"""
        
__author__ = "mm1013"
__version__ = "2022.08.30"
        
import rhinoscriptsyntax as rs
        
from datetime import datetime
dt = datetime.now()
        
time = "%02d_%02d_%02d_%02d%02d_%02d" % (dt.year, dt.month, dt.day, dt.hour, dt.minute, dt.second)
# ---------- end python_11 ----------
overrides_35 = ApplyOverrides(
    Input=overrides_34.DynamicOutput,
    Time=graft(python_11),
    View=graft(viewname_2),
    Vf=graft(executessh_27.Stdout),
    Af=graft("ambfile2_<time>.af"))  # -> Output, DynamicOutput
falsestart_15 = LBFalseStartToggle(False)
executessh_32 = ExecuteSSH(
    _SSHCommands_=overrides_35.Output,
    Run=run_2,
    addPrefix=True,
    fireLogs=False,
    lastRunTime=149839.2195,
    suppressWarnings=False,
    results="/home/lio/MantaRay/TestFolder/images/2023_03_30_2254_05_Perspective2_render.hdr",
    stderr="""rtrace: warning - zero area for polygon "Pipes_0.03_geo_1.43"
rtrace: warning - zero area for polygon "Pipes_0.03_geo_1.75"
rtrace: warning - zero area for polygon "Pipes_0.03_geo_1.540"
rtrace: warning - zero area for polygon "Pipes_0.03_geo_1.572"
rtrace: warning - zero area for polygon "Pipes_0.03_geo_1.638"
rtrace: warning - zero area for polygon "Pipes_0.03_geo_1.670"
rtrace: warning - zero area for polygon "Pipes_0.03_geo_1.1252"
rtrace: warning - zero area for polygon "Pipes_0.03_geo_1.1286"
rtrace: warning - zero area for polygon "Pipes_0.03_geo_1.1356"
rtrace: warning - zero area for polygon "Pipes_0.03_geo_1.1390"
rtrace: warning - zero area for polygon "Pipes_0.03_geo_1.2184"
rtrace: warning - zero area for polygon "Pipes_0.03_geo_1.2200"
rtrace: warning - zero area for polygon "Pipes_0.03_geo_1.2216"
rtrace: warning - zero area for polygon "Pipes_0.03_geo_1.2232"
rtrace: warning - zero area for polygon "Pipes_0.03_geo_1.2402"
rtrace: warning - zero area for polygon "Pipes_0.03_geo_1.2409"
rtrace: warning - zero area for polygon "Pipes_0.03_geo_1.2434"
rtrace: warning - zero area for polygon "Pipes_0.03_geo_1.2441"
rtrace: warning - zero area for polygon "Pipes_0.03_geo_1.2492"
rtrace: warning - zero area for polygon "Pipes_0.03_geo_1.2497"
rtrace: warning - zero area for polygon "Pipes_0.03_geo_1.2510"
rtrace: warning - zero area for polygon "Pipes_0.03_geo_1.2515"
rtrace: warning - zero area for polygon "Pipes_0.03_geo_1.2528"
rtrace: warning - zero area for polygon "Pipes_0.03_geo_1.2533"
rtrace: warning - zero area for polygon "Pipes_0.03_geo_1.2546"
rtrace: warning - zero area for polygon "Pipes_0.03_geo_1.2551"
rtrace: warning - zero area for polygon "Pipes_0.03_geo_1.2723"
rtrace: warning - zero area for polygon "Pipes_0.03_geo_1.2749"
rtrace: warning - zero area for polygon "Pipes_0.03_geo_1.2763"
rtrace: warning - zero area for polygon "Pipes_0.03_geo_1.2789"
rtrace: warning - zero area for polygon "Pipes_0.03_geo_1.2856"
rtrace: warning - zero area for polygon "Pipes_0.03_geo_1.2861"
rtrace: warning - zero area for polygon "Pipes_0.03_geo_1.2891"
rtrace: warning - zero area for polygon "Pipes_0.03_geo_1.2896"
rtrace: warning - zero area for polygon "Pipes_0.03_geo_1.3076"
rtrace: warning - zero area for polygon "Pipes_0.03_geo_1.3111"
rtrace: warning - zero area for polygon "Pipes_0.03_geo_1.3168"
rtrace: warning - zero area for polygon "Pipes_0.03_geo_1.3196"
rtrace: warning - zero area for polygon "Pipes_0.03_geo_1.3207"
rtrace: warning - zero area for polygon "Pipes_0.03_geo_1.3235"
rtrace: warning - zero area for polygon "Pipes_0.03_geo_1.3699"
rtrace: warning - zero area for polygon "Pipes_0.03_geo_1.3741"
rtrace: warning - zero area for polygon "Pipes_0.03_geo_1.3804"
rtrace: warning - zero area for polygon "Pipes_0.03_geo_1.3843"
rtrace: warning - zero area for polygon "Pipes_0.03_geo_1.4287"
rtrace: warning - zero area for polygon "Pipes_0.03_geo_1.4327"
rtrace: warning - zero area for polygon "Pipes_0.03_geo_1.4402"
rtrace: warning - zero area for polygon "Pipes_0.03_geo_1.4405"
rtrace: warning - zero area for polygon "Pipes_0.03_geo_1.4406"
rtrace: warning - zero area for polygon "Pipes_0.03_geo_1.4440"
rtrace: warning - zero area for polygon "Pipes_0.03_geo_1.4443"
rtrace: warning - zero area for polygon "Pipes_0.03_geo_1.4444"
rtrace: warning - zero area for polygon "Pipes_0.03_geo_1.4499"
rtrace: warning - zero area for polygon "Pipes_0.03_geo_1.4512"
rtrace: warning - zero area for polygon "Pipes_0.03_geo_1.4535"
rtrace: warning - zero area for polygon "Pipes_0.03_geo_1.4548"
rtrace: warning - zero area for polygon "Pipes_0.03_geo_1.4619"
rtrace: warning - zero area for polygon "Pipes_0.03_geo_1.4651"
rtrace: warning - zero area for polygon "Pipes_0.03_geo_1.4798"
rtrace: warning - zero area for polygon "Pipes_0.03_geo_1.4830"
rtrace: warning - zero area for polygon "Pipes_0.03_geo_1.4933"
rtrace: warning - zero area for polygon "Pipes_0.03_geo_1.4972"
rtrace: warning - zero area for polygon "Pipes_0.03_geo_1.5052"
rtrace: warning - zero area for polygon "Pipes_0.03_geo_1.5091"
rtrace: warning - zero area for polygon "Pipes_0.03_geo_1.5171"
rtrace: warning - zero area for polygon "Pipes_0.03_geo_1.5210"
rtrace: warning - zero area for polygon "Pipes_0.03_geo_1.5283"
rtrace: warning - zero area for polygon "Pipes_0.03_geo_1.5290"
rtrace: warning - zero area for polygon "Pipes_0.03_geo_1.5322"
rtrace: warning - zero area for polygon "Pipes_0.03_geo_1.5329"
rtrace: warning - zero area for polygon "Pipes_0.03_geo_1.5409"
rtrace: warning - zero area for polygon "Pipes_0.03_geo_1.5448"
rtrace: warning - zero area for polygon "Pipes_0.03_geo_1.5528"
rtrace: warning - zero area for polygon "Pipes_0.03_geo_1.5567"
rtrace: warning - zero area for polygon "Pipes_0.03_geo_1.5647"
rtrace: warning - zero area for polygon "Pipes_0.03_geo_1.5686"
rtrace: warning - zero area for polygon "Pipes_0.03_geo_1.5766"
rtrace: warning - zero area for polygon "Pipes_0.03_geo_1.5805"
rtrace: warning - zero area for polygon "Pipes_0.03_geo_1.5885"
rtrace: warning - zero area for polygon "Pipes_0.03_geo_1.5924"
rtrace: warning - zero area for polygon "Pipes_0.03_geo_1.6004"
rtrace: warning - zero area for polygon "Pipes_0.03_geo_1.6043"
rtrace: warning - zero area for polygon "Pipes_0.03_geo_1.6123"
rtrace: warning - zero area for polygon "Pipes_0.03_geo_1.6162"
rtrace: warning - zero area for polygon "Pipes_0.03_geo_1.6242"
rtrace: warning - zero area for polygon "Pipes_0.03_geo_1.6281"
rtrace: warning - zero area for polygon "Pipes_0.03_geo_1.6354"
rtrace: warning - zero area for polygon "Pipes_0.03_geo_1.6393"
rtrace: warning - zero area for polygon "Pipes_0.03_geo_1.6473"
rtrace: warning - zero area for polygon "Pipes_0.03_geo_1.6512"
rtrace: warning - zero area for polygon "Pipes_0.03_geo_1.6711"
rtrace: warning - zero area for polygon "Pipes_0.03_geo_1.6718"
rtrace: warning - zero area for polygon "Pipes_0.03_geo_1.6750"
rtrace: warning - zero area for polygon "Pipes_0.03_geo_1.6757"
rtrace: warning - zero area for polygon "Pipes_0.03_geo_1.6837"
rtrace: warning - zero area for polygon "Pipes_0.03_geo_1.6876"
rtrace: warning - zero area for polygon "Pipes_0.03_geo_1.6956"
rtrace: warning - zero area for polygon "Pipes_0.03_geo_1.6995"
rtrace: warning - zero area for polygon "Pipes_0.03_geo_1.7075"
rtrace: warning - zero area for polygon "Pipes_0.03_geo_1.7114"
rtrace: warning - zero area for polygon "Pipes_0.03_geo_1.7194"
rtrace: warning - zero area for polygon "Pipes_0.03_geo_1.7233"
rtrace: warning - zero area for polygon "Pipes_0.03_geo_1.7313"
rtrace: warning - zero area for polygon "Pipes_0.03_geo_1.7352"
rtrace: warning - zero area for polygon "Pipes_0.03_geo_1.7425"
rtrace: warning - zero area for polygon "Pipes_0.03_geo_1.7464"
rtrace: warning - zero area for polygon "Pipes_0.03_geo_1.7544"
rtrace: warning - zero area for polygon "Pipes_0.03_geo_1.7583"
rtrace: warning - non-planar vertex for polygon "Black_0.01_geo_1.7"
rtrace: warning - non-planar vertex for polygon "Black_0.01_geo_1.13"
rtrace: warning - zero area for polygon "Black_0.01_geo_1.81"
rtrace: warning - zero area for polygon "Black_0.01_geo_1.112"
rtrace: warning - zero area for polygon "Black_0.01_geo_1.148"
rtrace: warning - zero area for polygon "Black_0.01_geo_1.156"
rtrace: warning - zero area for polygon "Black_0.01_geo_1.176"
rtrace: warning - zero area for polygon "Black_0.01_geo_1.179"
rtrace: warning - zero area for polygon "Black_0.01_geo_1.187"
rtrace: warning - zero area for polygon "Black_0.01_geo_1.207"
rtrace: warning - zero area for polygon "Black_0.01_geo_1.243"
rtrace: warning - zero area for polygon "Black_0.01_geo_1.274"
""",
    commands="""mkdir -p ~/MantaRay/TestFolder/images/
mkdir -p ~/MantaRay/TestFolder/ambientFiles/
vwrays -ff -x 750 -y 375 -vf /home/lio/MantaRay/TestFolder/views/Perspective2.vf -pa 1 | rtrace -ab 2 -n 63 `vwrays -d -ff -x 750 -y 375 -vf /home/lio/MantaRay/TestFolder/views/Perspective2.vf -pa 1` -ffc /home/lio/simulation/boston/octrees/Scene_Overcast10klux.oct > ~/MantaRay/TestFolder/images/2023_03_30_2254_05_Perspective2_render.hdr
echo ~/MantaRay/TestFolder/images/2023_03_30_2254_05_Perspective2_render.hdr""")  # -> Stdout, Stderr_, Ran
or = GateOr(A=falsestart_15, B=executessh_32.Ran)

# ----
# Parallel RTRACE render (illuminance)
# with ambient cache (reusing file from above!)
# -ab 2 -aa 0.2 -ad 512
panel_75 = Panel("""mkdir -p <proj>/images/
vwrays -ff -x <x> -y <y> -vf <vf> -pa 1 | rtrace -i <radOptions> -af <af> -w -n 11 `vwrays -d -ff -x <x> -y <y> -vf <vf> -pa 1` -ffc <oct> > <proj>/images/<target-.>.hdr
echo <proj>/images/<target-.>.hdr""")
octree_2 = Text(executessh_21.Stdout)
viewfile_2 = Text(executessh_27.Stdout)
run_3 = LBFalseStartToggle(False)
python_12 = GhPythonScript(x=viewfile_2)  # -> a; same code as python_10
x_3 = RemoteReceiver(x)
y_3 = RemoteReceiver(y)
overrides_36 = ApplyOverrides(
    Input=panel_75,
    X=graft(x_3),
    Y=graft(y_3),
    Vf=graft(viewfile_2),
    RadOptions=graft(panel_74),
    Oct=graft(octree_2),
    Target=graft("<time>_<view>_render_illum.hdr"),
    Af=graft("<af>"),
    View=graft(python_12),
    Time=graft("<time>"))  # -> Output, DynamicOutput
overrides_37 = ApplyOverrides(
    Input=overrides_36.DynamicOutput,
    Time=graft(python_11),
    View=graft(viewname_2),
    Vf=graft(executessh_27.Stdout),
    Af=graft("ambfile2_<time>.af"))  # -> Output, DynamicOutput
executessh_33 = ExecuteSSH(
    _SSHCommands_=overrides_37.DynamicOutput,
    Run=run_3,
    addPrefix=True,
    description="""mkdir -p ~/simulation/boston/images/
vwrays -ff -x 750 -y 375 -vf /home/lio/MantaRay/TestFolder/views/Perspective2.vf -pa 1 | rtrace -i -ab 2 -af ambfile2_2023_03_30_2254_05.af -w -n 11 `vwrays -d -ff -x 750 -y 375 -vf /home/lio/MantaRay/TestFolder/views/Perspective2.vf -pa 1` -ffc /home/lio/simulation/boston/octrees/Scene_Overcast10klux.oct > ~/simulation/boston/images/2023_03_30_2254_05_Perspective2_render_illum.hdr
echo ~/simulation/boston/images/2023_03_30_2254_05_Perspective2_render_illum.hdr""",
    fireLogs=False,
    lastRunTime=45839.9269,
    suppressWarnings=False,
    results="/home/lio/simulation/boston/images/2023_03_30_2250_36_Perspective2_render_illum.hdr",
    stderr="""rtrace: signal - Terminate
rtracertracertrace: signal - : Terminatertrace
signal - rtrace: rtraceTerminate: signal - : rtracesignal - Terminatesignal - rtrace
rtraceTerminate: Terminate
: rtracertrace: 

signal - signal - : : signal - signal - TerminateTerminateTerminate

signal - Terminate
Terminate

: signal - Terminate""",
    commands="""mkdir -p ~/simulation/boston/images/
vwrays -ff -x 750 -y 375 -vf /home/lio/MantaRay/TestFolder/views/Perspective2.vf -pa 1 | rtrace -i -ab 2 -af ambfile2_2023_03_30_2250_36.af -w -n 11 `vwrays -d -ff -x 750 -y 375 -vf /home/lio/MantaRay/TestFolder/views/Perspective2.vf -pa 1` -ffc /home/lio/simulation/boston/octrees/Scene_Overcast10klux.oct > ~/simulation/boston/images/2023_03_30_2250_36_Perspective2_render_illum.hdr
echo ~/simulation/boston/images/2023_03_30_2250_36_Perspective2_render_illum.hdr""")  # -> Stdout, Stderr_, Ran

resolution = ValueList({"750x330": 750, "1500x750": 1500, "3000x1500": 3000, "5000x2500": 5000, "7000x3500": 7000, "8000x4000": 8000, "16000x8000": 16000, "20000x12000": 20000}, selected="750x330")
x_4 = Number(resolution)

falsestart_16 = LBFalseStartToggle(False)
download_7 = Download(SftpPaths=panel_71, Run=falsestart_16, stdouts="C:\Users\mm1013\MantaRay\Andrei\radiance.hdr")  # -> FilePaths, Status, Ran
supersampling = Panel("4")
y_4 = RemoteReceiver(y)
x_5 = RemoteReceiver(x)
multiplication = Multiplication(A=x_5, B=supersampling)
multiplication_2 = Multiplication(A=y_4, B=supersampling)
panel_76 = Panel(python_11)
falsestart_17 = LBFalseStartToggle(False)

panel_77 = Panel("""pkill rtpict
pkill rtrace
pkill rpict""")
executessh_34 = ExecuteSSH(
    _SSHCommands_=panel_77,
    Run=Button(),
    addPrefix=True,
    fireLogs=False,
    lastRunTime=54.2441,
    suppressWarnings=False,
    commands="""pkill rtpict
pkill rtrace
pkill rpict""")  # -> Stdout, Stderr_, Ran

no_auto_exposure = Panel("""pfilt -1 -e -9 <hdr> > <hdr-.>_exposed2.hdr
ra_tiff <hdr-.>_exposed2.hdr <hdr-.>_exposed2.tif
convert <hdr-.>_exposed2.tif <hdr-.>_exposed2.png
echo <hdr-.>_exposed2.png""")

# ----
# Using PCOND to set automatic exposure
# and convert to PNG
panel_78 = Panel("""pcond -h <hdr> <hdr-.>_exposed.hdr
ra_tiff <hdr-.>_exposed.hdr <hdr-.>_exposed.tif
convert <hdr-.>_exposed.tif <hdr-.>_exposed.png
echo <hdr-.>_exposed.png""")
overrides_38 = ApplyOverrides(Input=[no_auto_exposure, panel_78], Hdr=graft(executessh_32.Stdout))  # -> Output, DynamicOutput
executessh_35 = ExecuteSSH(
    _SSHCommands_=overrides_38.DynamicOutput,
    Run=or,
    addPrefix=True,
    description="""pfilt -1 -e -9 /home/lio/MantaRay/TestFolder/images/2023_03_30_2254_05_Perspective2_render.hdr > /home/lio/MantaRay/TestFolder/images/2023_03_30_2254_05_Perspective2_render_exposed2.hdr
ra_tiff /home/lio/MantaRay/TestFolder/images/2023_03_30_2254_05_Perspective2_render_exposed2.hdr /home/lio/MantaRay/TestFolder/images/2023_03_30_2254_05_Perspective2_render_exposed2.tif
convert /home/lio/MantaRay/TestFolder/images/2023_03_30_2254_05_Perspective2_render_exposed2.tif /home/lio/MantaRay/TestFolder/images/2023_03_30_2254_05_Perspective2_render_exposed2.png
echo /home/lio/MantaRay/TestFolder/images/2023_03_30_2254_05_Perspective2_render_exposed2.png
pcond -h /home/lio/MantaRay/TestFolder/images/2023_03_30_2254_05_Perspective2_render.hdr /home/lio/MantaRay/TestFolder/images/2023_03_30_2254_05_Perspective2_render_exposed.hdr
ra_tiff /home/lio/MantaRay/TestFolder/images/2023_03_30_2254_05_Perspective2_render_exposed.hdr /home/lio/MantaRay/TestFolder/images/2023_03_30_2254_05_Perspective2_render_exposed.tif
convert /home/lio/MantaRay/TestFolder/images/2023_03_30_2254_05_Perspective2_render_exposed.tif /home/lio/MantaRay/TestFolder/images/2023_03_30_2254_05_Perspective2_render_exposed.png
echo /home/lio/MantaRay/TestFolder/images/2023_03_30_2254_05_Perspective2_render_exposed.png""",
    fireLogs=False,
    lastRunTime=81.7153,
    suppressWarnings=False,
    results="""/home/lio/MantaRay/TestFolder/images/2023_03_30_2254_05_Perspective2_render_exposed2.png
_JOIN_
/home/lio/MantaRay/TestFolder/images/2023_03_30_2254_05_Perspective2_render_exposed.png""",
    commands="""pfilt -1 -e -9 /home/lio/MantaRay/TestFolder/images/2023_03_30_2254_05_Perspective2_render.hdr > /home/lio/MantaRay/TestFolder/images/2023_03_30_2254_05_Perspective2_render_exposed2.hdr
ra_tiff /home/lio/MantaRay/TestFolder/images/2023_03_30_2254_05_Perspective2_render_exposed2.hdr /home/lio/MantaRay/TestFolder/images/2023_03_30_2254_05_Perspective2_render_exposed2.tif
convert /home/lio/MantaRay/TestFolder/images/2023_03_30_2254_05_Perspective2_render_exposed2.tif /home/lio/MantaRay/TestFolder/images/2023_03_30_2254_05_Perspective2_render_exposed2.png
echo /home/lio/MantaRay/TestFolder/images/2023_03_30_2254_05_Perspective2_render_exposed2.png
_JOIN_
pcond -h /home/lio/MantaRay/TestFolder/images/2023_03_30_2254_05_Perspective2_render.hdr /home/lio/MantaRay/TestFolder/images/2023_03_30_2254_05_Perspective2_render_exposed.hdr
ra_tiff /home/lio/MantaRay/TestFolder/images/2023_03_30_2254_05_Perspective2_render_exposed.hdr /home/lio/MantaRay/TestFolder/images/2023_03_30_2254_05_Perspective2_render_exposed.tif
convert /home/lio/MantaRay/TestFolder/images/2023_03_30_2254_05_Perspective2_render_exposed.tif /home/lio/MantaRay/TestFolder/images/2023_03_30_2254_05_Perspective2_render_exposed.png
echo /home/lio/MantaRay/TestFolder/images/2023_03_30_2254_05_Perspective2_render_exposed.png""")  # -> Stdout, Stderr_, Ran
download_8 = Download(
    LinuxFilePaths=executessh_35.Stdout,
    Run=executessh_35.Ran,
    stdouts="C:\Users\mm1013\MantaRay\TestFolder\2023_03_30_2254_05_Perspective2_render_exposed2.png>JOIN<C:\Users\mm1013\MantaRay\TestFolder\2023_03_30_2254_05_Perspective2_render_exposed.png")  # -> FilePaths, Status, Ran
denoiser = DenoiseImage(InputImage=download_8.FilePaths, PathToDenoisr="C:\Denoiser_v1.6\Denoiser.exe")  # disabled
imageviewer_2 = LBImageViewer(ImagePath_=download_8.FilePaths, _scale_="1", DisableClickable=False, SaveImgWithCoords=False, scale=1)  # -> ImagePath, Values, GIF

imageviewer_3 = LBImageViewer(ImagePath_=download_6.FilePaths, _scale_="1", DisableClickable=False, SaveImgWithCoords=False, scale=1)  # -> ImagePath, Values, GIF

# ----
# killl the task
panel_79 = Panel("cat <LinuxHome>/ambientFiles/<target-.>.err")
overrides_39 = ApplyOverrides(Input=panel_79, Target=graft(panel_73), Time=graft(python_11), View=graft(viewname_2))  # -> Output, DynamicOutput
executessh_36 = ExecuteSSH(
    _SSHCommands_=overrides_39.DynamicOutput,
    Run=executessh_32.Ran,
    addPrefix=True,
    description="cat ~/MantaRay/TestFolder/ambientFiles/2023_03_30_2254_05_Perspective2_render.err",
    fireLogs=False,
    lastRunTime=140.8024,
    suppressWarnings=False,
    stderr="cat: /home/lio/MantaRay/TestFolder/ambientFiles/2023_03_30_2254_05_Perspective2_render.err: No such file or directory",
    commands="cat ~/MantaRay/TestFolder/ambientFiles/2023_03_30_2254_05_Perspective2_render.err")  # -> Stdout, Stderr_, Ran
panel_80 = Panel(executessh_36.Stdout)
python_13 = GhPythonScript(errIn=executessh_36.Stdout)  # -> pid, run
# ---------- python_13: Python ----------
__author__ = "mm1013"
__version__ = "2022.10.06"

import rhinoscriptsyntax as rs

start = errIn.split(":")[0].split(" ")[-1]
print(start)
try:
    pid = int(start)
    run = True
except:
    run = False
# ---------- end python_13 ----------
falsestart_18 = LBFalseStartToggle(False)
overrides_40 = ApplyOverrides(Input="kill <pid>", Pid=graft(python_13.pid))  # -> Output, DynamicOutput
executessh_37 = ExecuteSSH(
    _SSHCommands_=overrides_40.Output,
    Run=flatten([python_13.run, falsestart_18]),
    addPrefix=True,
    fireLogs=False,
    lastRunTime=0,
    suppressWarnings=False)  # -> Stdout, Stderr_, Ran

# ----
# Using PCOND to set automatic exposure
# and convert to PNG
panel_81 = Panel("""pcond -h <hdr> <hdr-.>_exposed.hdr
ra_tiff <hdr-.>_exposed.hdr <hdr-.>_exposed.tif
convert <hdr-.>_exposed.tif <hdr-.>_exposed.png
echo <hdr-.>_exposed.png""")
overrides_41 = ApplyOverrides(Input=panel_81, Hdr=graft(executessh_33.Stdout))  # -> Output, DynamicOutput
executessh_38 = ExecuteSSH(
    _SSHCommands_=overrides_41.DynamicOutput,
    Run=executessh_33.Ran,
    addPrefix=True,
    description="""pcond -h /home/lio/simulation/boston/images/2023_03_30_2250_36_Perspective2_render_illum.hdr /home/lio/simulation/boston/images/2023_03_30_2250_36_Perspective2_render_illum_exposed.hdr
ra_tiff /home/lio/simulation/boston/images/2023_03_30_2250_36_Perspective2_render_illum_exposed.hdr /home/lio/simulation/boston/images/2023_03_30_2250_36_Perspective2_render_illum_exposed.tif
convert /home/lio/simulation/boston/images/2023_03_30_2250_36_Perspective2_render_illum_exposed.tif /home/lio/simulation/boston/images/2023_03_30_2250_36_Perspective2_render_illum_exposed.png
echo /home/lio/simulation/boston/images/2023_03_30_2250_36_Perspective2_render_illum_exposed.png""",
    fireLogs=False,
    lastRunTime=550.5555,
    suppressWarnings=False,
    results="/home/lio/simulation/boston/images/2023_03_30_2249_33_Perspective2_render_illum_exposed.png",
    commands="""pcond -h /home/lio/simulation/boston/images/2023_03_30_2249_33_Perspective2_render_illum.hdr /home/lio/simulation/boston/images/2023_03_30_2249_33_Perspective2_render_illum_exposed.hdr
ra_tiff /home/lio/simulation/boston/images/2023_03_30_2249_33_Perspective2_render_illum_exposed.hdr /home/lio/simulation/boston/images/2023_03_30_2249_33_Perspective2_render_illum_exposed.tif
convert /home/lio/simulation/boston/images/2023_03_30_2249_33_Perspective2_render_illum_exposed.tif /home/lio/simulation/boston/images/2023_03_30_2249_33_Perspective2_render_illum_exposed.png
echo /home/lio/simulation/boston/images/2023_03_30_2249_33_Perspective2_render_illum_exposed.png""")  # -> Stdout, Stderr_, Ran
download_9 = Download(
    LinuxFilePaths=executessh_38.Stdout,
    Run=executessh_38.Ran,
    stdouts="C:\Users\mm1013\MantaRay\TestFolder\2023_03_30_2249_33_Perspective2_render_illum_exposed.png")  # -> FilePaths, Status, Ran
imageviewer_4 = LBImageViewer(ImagePath_=download_9.FilePaths, _scale_="1", DisableClickable=False, SaveImgWithCoords=False, scale=1)  # -> ImagePath, Values, GIF

# ----
# False color with illuminance curves
# on top of luminance picture
panel_82 = Panel("""pcond -h <irrad> <irrad-.>_exposed.hdr
falsecolor -s 9000 -d 0 -l lux -p <irrad-.>_exposed.hdr -i <irrad> -cl -log 2 > <rad-.>_fc.hdr;echo <rad-.>_fc.hdr""")
bool_6 = Boolean([or, executessh_33.Ran])
rad = Text(executessh_32.Stdout)
irrad = Text(executessh_33.Stdout)
overrides_42 = ApplyOverrides(Input=panel_82, Rad=graft(rad), Irrad=graft(irrad))  # -> Output, DynamicOutput
executessh_39 = ExecuteSSH(
    _SSHCommands_=overrides_42.DynamicOutput,
    Run=bool_6,
    addPrefix=True,
    description="""pcond -h /home/lio/simulation/boston/images/2023_03_30_2250_36_Perspective2_render_illum.hdr /home/lio/simulation/boston/images/2023_03_30_2250_36_Perspective2_render_illum_exposed.hdr
falsecolor -s 9000 -d 0 -l lux -p /home/lio/simulation/boston/images/2023_03_30_2250_36_Perspective2_render_illum_exposed.hdr -i /home/lio/simulation/boston/images/2023_03_30_2250_36_Perspective2_render_illum.hdr -cl -log 2 > /home/lio/MantaRay/TestFolder/images/2023_03_30_2254_05_Perspective2_render_fc.hdr;echo /home/lio/MantaRay/TestFolder/images/2023_03_30_2254_05_Perspective2_render_fc.hdr""",
    fireLogs=False,
    lastRunTime=76.8603,
    suppressWarnings=False,
    results="/home/lio/MantaRay/TestFolder/images/2023_03_30_2249_33_Perspective2_render_fc.hdr",
    commands="""pcond -h /home/lio/simulation/boston/images/2023_03_30_2249_33_Perspective2_render_illum.hdr /home/lio/simulation/boston/images/2023_03_30_2249_33_Perspective2_render_illum_exposed.hdr
falsecolor -s 9000 -d 0 -l lux -p /home/lio/simulation/boston/images/2023_03_30_2249_33_Perspective2_render_illum_exposed.hdr -i /home/lio/simulation/boston/images/2023_03_30_2249_33_Perspective2_render_illum.hdr -cl -log 2 > /home/lio/MantaRay/TestFolder/images/2023_03_30_2249_33_Perspective2_render_fc.hdr;echo /home/lio/MantaRay/TestFolder/images/2023_03_30_2249_33_Perspective2_render_fc.hdr""")  # -> Stdout, Stderr_, Ran
download_10 = Download(
    LinuxFilePaths=executessh_39.Stdout,
    Run=executessh_39.Ran,
    stdouts="C:\Users\mm1013\MantaRay\TestFolder\2023_03_30_2249_33_Perspective2_render_fc.hdr")  # -> FilePaths, Status, Ran
imageviewer_5 = LBImageViewer(ImagePath_=download_10.FilePaths, _scale_="1", DisableClickable=False, SaveImgWithCoords=False, scale=1)  # -> ImagePath, Values, GIF

and_3 = GateAnd(A=executessh_32.Ran, B=executessh_33.Ran)

# ----
# False color with illuminance curves
# on top of luminance picture
panel_83 = Panel("falsecolor -s 50 -n 10 -m 1.79 -l DF -p <rad-.>_exposed.hdr -i <irrad> -cp > <rad-.>_fc4.hdr;echo <rad-.>_fc4.hdr")
overrides_43 = ApplyOverrides(Input=panel_83, Rad=graft(executessh_32.Stdout), Irrad=graft(executessh_33.Stdout))  # -> Output, DynamicOutput
executessh_40 = ExecuteSSH(
    _SSHCommands_=overrides_43.DynamicOutput,
    Run=and_3,
    addPrefix=True,
    description="falsecolor -s 50 -n 10 -m 1.79 -l DF -p /home/lio/MantaRay/TestFolder/images/2023_03_30_2254_05_Perspective2_render_exposed.hdr -i /home/lio/simulation/boston/images/2023_03_30_2250_36_Perspective2_render_illum.hdr -cp > /home/lio/MantaRay/TestFolder/images/2023_03_30_2254_05_Perspective2_render_fc4.hdr;echo /home/lio/MantaRay/TestFolder/images/2023_03_30_2254_05_Perspective2_render_fc4.hdr",
    fireLogs=False,
    lastRunTime=598.3093,
    suppressWarnings=False,
    results="/home/lio/MantaRay/TestFolder/images/2023_03_30_2249_33_Perspective2_render_fc4.hdr",
    commands="falsecolor -s 50 -n 10 -m 1.79 -l DF -p /home/lio/MantaRay/TestFolder/images/2023_03_30_2249_33_Perspective2_render_exposed.hdr -i /home/lio/simulation/boston/images/2023_03_30_2249_33_Perspective2_render_illum.hdr -cp > /home/lio/MantaRay/TestFolder/images/2023_03_30_2249_33_Perspective2_render_fc4.hdr;echo /home/lio/MantaRay/TestFolder/images/2023_03_30_2249_33_Perspective2_render_fc4.hdr")  # -> Stdout, Stderr_, Ran
download_11 = Download(
    LinuxFilePaths=executessh_40.Stdout,
    Run=executessh_40.Ran,
    stdouts="C:\Users\mm1013\MantaRay\TestFolder\2023_03_30_2249_33_Perspective2_render_fc4.hdr")  # -> FilePaths, Status, Ran
imageviewer_6 = LBImageViewer(ImagePath_=download_11.FilePaths, _scale_="1", DisableClickable=False, SaveImgWithCoords=False, scale=1)  # -> ImagePath, Values, GIF

x_6 = RemoteReceiver(x)
set_exposure_manually_e_3 = Panel("""pfilt -1 -e -3 <hdr> > <hdr-.>_filt.hdr
ra_tiff <hdr-.>_filt.hdr <hdr-.>_filt.tif
convert <hdr-.>_filt.tif <hdr-.>_filt.png
rm <hdr-.>_filt.tif
rm <hdr-.>_filt.hdr
echo <hdr-.>_filt.png""")

# ---- group: Extracted Coordinates
pt = Point([Point(811, 630, 0), Point(812, 668, 0), Point(814, 715, 0), Point(816, 753, 0), Point(816, 798, 0), Point(1312, 468, 0), Point(1308, 506, 0), Point(1305, 547, 0), Point(1305, 574, 0), Point(1299, 606, 0), Point(1627, 410, 0), Point(1619, 440, 0), Point(1614, 468, 0), Point(1608, 500, 0), Point(132, 21, 0)])

# ----
# attempt to probe values from pixels
panel_84 = Panel("pcomb -o <hdr> | pcompos -x 2 -y 2 - -<x> -<y> | pvalue -h -H -df | total -if3 -m | sed -r 's/[\t]+/1/g'")
pdecon = Deconstruct(Point=pt)  # -> XComponent, YComponent, ZComponent
subtraction = Subtraction(A=y_2, B=pdecon.YComponent)
overrides_44 = ApplyOverrides(Input=panel_84, Hdr=graft(executessh_33.Stdout), X=graft(pdecon.XComponent), Y=graft(subtraction))  # -> Output, DynamicOutput
item_2 = ListItem(List=flatten(overrides_44.Output), Index=0, Wrap=True)
panel_85 = Panel(item_2)
executessh_41 = ExecuteSSH(
    _SSHCommands_=overrides_44.DynamicOutput,
    Run=executessh_33.Ran,
    addPrefix=True,
    description="""pcomb -o /home/lio/simulation/boston/images/2023_03_30_2250_36_Perspective2_render_illum.hdr | pcompos -x 2 -y 2 - -811 --255 | pvalue -h -H -df | total -if3 -m | sed -r 's/[\t]+/1/g'


- - -

pcomb -o /home/lio/simulation/boston/images/2023_03_30_2250_36_Perspective2_render_illum.hdr | pcompos -x 2 -y 2 - -812 --293 | pvalue -h -H -df | total -if3 -m | sed -r 's/[\t]+/1/g'


- - -

pcomb -o /home/lio/simulation/boston/images/2023_03_30_2250_36_Perspective2_render_illum.hdr | pcompos -x 2 -y 2 - -814 --340 | pvalue -h -H -df | total -if3 -m | sed -r 's/[\t]+/1/g'


- - -

pcomb -o /home/lio/simulation/boston/images/2023_03_30_2250_36_Perspective2_render_illum.hdr | pcompos -x 2 -y 2 - -816 --378 | pvalue -h -H -df | total -if3 -m | sed -r 's/[\t]+/1/g'


- - -

pcomb -o /home/lio/simulation/boston/images/2023_03_30_2250_36_Perspective2_render_illum.hdr | pcompos -x 2 -y 2 - -816 --423 | pvalue -h -H -df | total -if3 -m | sed -r 's/[\t]+/1/g'


- - -

pcomb -o /home/lio/simulation/boston/images/2023_03_30_2250_36_Perspective2_render_illum.hdr | pcompos -x 2 -y 2 - -1312 --93 | pvalue -h -H -df | total -if3 -m | sed -r 's/[\t]+/1/g'


- - -

pcomb -o /home/lio/simulation/boston/images/2023_03_30_2250_36_Perspective2_render_illum.hdr | pcompos -x 2 -y 2 - -1308 --131 | pvalue -h -H -df | total -if3 -m | sed -r 's/[\t]+/1/g'


- - -

pcomb -o /home/lio/simulation/boston/images/2023_03_30_2250_36_Perspective2_render_illum.hdr | pcompos -x 2 -y 2 - -1305 --172 | pvalue -h -H -df | total -if3 -m | sed -r 's/[\t]+/1/g'


- - -

pcomb -o /home/lio/simulation/boston/images/2023_03_30_2250_36_Perspective2_render_illum.hdr | pcompos -x 2 -y 2 - -1305 --199 | pvalue -h -H -df | total -if3 -m | sed -r 's/[\t]+/1/g'


- - -

pcomb -o /home/lio/simulation/boston/images/2023_03_30_2250_36_Perspective2_render_illum.hdr | pcompos -x 2 -y 2 - -1299 --231 | pvalue -h -H -df | total -if3 -m | sed -r 's/[\t]+/1/g'


- - -

pcomb -o /home/lio/simulation/boston/images/2023_03_30_2250_36_Perspective2_render_illum.hdr | pcompos -x 2 -y 2 - -1627 --35 | pvalue -h -H -df | total -if3 -m | sed -r 's/[\t]+/1/g'


- - -

pcomb -o /home/lio/simulation/boston/images/2023_03_30_2250_36_Perspective2_render_illum.hdr | pcompos -x 2 -y 2 - -1619 --65 | pvalue -h -H -df | total -if3 -m | sed -r 's/[\t]+/1/g'


- - -

pcomb -o /home/lio/simulation/boston/images/2023_03_30_2250_36_Perspective2_render_illum.hdr | pcompos -x 2 -y 2 - -1614 --93 | pvalue -h -H -df | total -if3 -m | sed -r 's/[\t]+/1/g'


- - -

pcomb -o /home/lio/simulation/boston/images/2023_03_30_2250_36_Perspective2_render_illum.hdr | pcompos -x 2 -y 2 - -1608 --125 | pvalue -h -H -df | total -if3 -m | sed -r 's/[\t]+/1/g'


- - -

pcomb -o /home/lio/simulation/boston/images/2023_03_30_2250_36_Perspective2_render_illum.hdr | pcompos -x 2 -y 2 - -132 -354 | pvalue -h -H -df | total -if3 -m | sed -r 's/[\t]+/1/g'""",
    fireLogs=False,
    lastRunTime=554.1131,
    suppressWarnings=False,
    results=["01010", "01010", "01010", "01010", "01010", "01010", "01010", "01010", "01010", "01010", "01010", "01010", "01010", "01010", "267.51267.51267.5"],
    commands=["pcomb -o /home/lio/simulation/boston/images/2023_03_30_2249_33_Perspective2_render_illum.hdr | pcompos -x 2 -y 2 - -814 --340 | pvalue -h -H -df | total -if3 -m | sed -r 's/[\t]+/1/g'", "pcomb -o /home/lio/simulation/boston/images/2023_03_30_2249_33_Perspective2_render_illum.hdr | pcompos -x 2 -y 2 - -812 --293 | pvalue -h -H -df | total -if3 -m | sed -r 's/[\t]+/1/g'", "pcomb -o /home/lio/simulation/boston/images/2023_03_30_2249_33_Perspective2_render_illum.hdr | pcompos -x 2 -y 2 - -816 --423 | pvalue -h -H -df | total -if3 -m | sed -r 's/[\t]+/1/g'", "pcomb -o /home/lio/simulation/boston/images/2023_03_30_2249_33_Perspective2_render_illum.hdr | pcompos -x 2 -y 2 - -1312 --93 | pvalue -h -H -df | total -if3 -m | sed -r 's/[\t]+/1/g'", "pcomb -o /home/lio/simulation/boston/images/2023_03_30_2249_33_Perspective2_render_illum.hdr | pcompos -x 2 -y 2 - -1308 --131 | pvalue -h -H -df | total -if3 -m | sed -r 's/[\t]+/1/g'", "pcomb -o /home/lio/simulation/boston/images/2023_03_30_2249_33_Perspective2_render_illum.hdr | pcompos -x 2 -y 2 - -1305 --172 | pvalue -h -H -df | total -if3 -m | sed -r 's/[\t]+/1/g'", "pcomb -o /home/lio/simulation/boston/images/2023_03_30_2249_33_Perspective2_render_illum.hdr | pcompos -x 2 -y 2 - -1305 --199 | pvalue -h -H -df | total -if3 -m | sed -r 's/[\t]+/1/g'", "pcomb -o /home/lio/simulation/boston/images/2023_03_30_2249_33_Perspective2_render_illum.hdr | pcompos -x 2 -y 2 - -1299 --231 | pvalue -h -H -df | total -if3 -m | sed -r 's/[\t]+/1/g'", "pcomb -o /home/lio/simulation/boston/images/2023_03_30_2249_33_Perspective2_render_illum.hdr | pcompos -x 2 -y 2 - -1627 --35 | pvalue -h -H -df | total -if3 -m | sed -r 's/[\t]+/1/g'", "pcomb -o /home/lio/simulation/boston/images/2023_03_30_2249_33_Perspective2_render_illum.hdr | pcompos -x 2 -y 2 - -1619 --65 | pvalue -h -H -df | total -if3 -m | sed -r 's/[\t]+/1/g'", "pcomb -o /home/lio/simulation/boston/images/2023_03_30_2249_33_Perspective2_render_illum.hdr | pcompos -x 2 -y 2 - -1614 --93 | pvalue -h -H -df | total -if3 -m | sed -r 's/[\t]+/1/g'", "pcomb -o /home/lio/simulation/boston/images/2023_03_30_2249_33_Perspective2_render_illum.hdr | pcompos -x 2 -y 2 - -1608 --125 | pvalue -h -H -df | total -if3 -m | sed -r 's/[\t]+/1/g'", "pcomb -o /home/lio/simulation/boston/images/2023_03_30_2249_33_Perspective2_render_illum.hdr | pcompos -x 2 -y 2 - -132 -354 | pvalue -h -H -df | total -if3 -m | sed -r 's/[\t]+/1/g'"])  # -> Stdout, Stderr_, Ran
python_14 = GhPythonScript(val=executessh_41.Stdout)  # -> x, y, z, ln
# ---------- python_14: Python ----------
__author__ = "mm1013"
__version__ = "2022.09.28"

import rhinoscriptsyntax as rs

length = int(len(val)/3.0)
x = val[0:length]
y = val[length:2*length]
z = val[2*length:3*length]
ln = length
# ---------- end python_14 ----------
panel_86 = Panel(executessh_41.Stdout)

# ----
# Remote Connect
# export PATH=$PATH:/usr/local/radiance/bin:/usr/local/accelerad/bin;export RAYPATH=.:/usr/local/accelerad/lib:/usr/local/radiance/lib;export DISPLAY=$(ip route list default | awk '{print $3}'):0;export LIBGL_ALWAYS_INDIRECT=1;export LD_LIBRARY_PATH=/usr/local/accelerad/bin:$LD_LIBRARY_PATH
# Be sure to check the above profile files if your EXPORT PATH=radiance stuff is included
panel_87 = Panel(". /etc/profile;. ~/.profile")

connect_2 = ConnectSSHFTP(
    User="lio",
    Ip="10.71.5.181",
    ProjectName="TestFolder",
    Password="_prompt",
    _port="2222",
    Connect=Toggle(True),
    Prefixes=panel_87)  # -> Status, Prefixes, Run

panel_88 = Panel(connect_2.Status)

# ----
# Overview of all running tasks in linux
panel_89 = Panel("ps -aux | grep '<AllRadProgs>'")
logviewer_2 = LogViewer(Number=10)  # -> CurrentTasks, Logs
default = DefaultMSS(data=flatten(panel_89), default_value_flattened=flatten(logviewer_2.CurrentTasks))
panel_90 = Panel(logviewer_2.Logs)

executessh_42 = ExecuteSSH(
    _SSHCommands_=default,
    Run=Toggle(True),
    addPrefix=True,
    fireLogs=False,
    lastRunTime=54.9478,
    suppressWarnings=False,
    results="""root           6  0.0  0.0      0     0 ?        I<   Mar20   0:00 [kworker/0:0H-events_highpri]
root          20  0.0  0.0      0     0 ?        I<   Mar20   0:00 [kworker/1:0H-events_highpri]
root          26  0.0  0.0      0     0 ?        I<   Mar20   0:00 [kworker/2:0H-events_highpri]
root          32  0.0  0.0      0     0 ?        I<   Mar20   0:00 [kworker/3:0H-events_highpri]
root          38  0.0  0.0      0     0 ?        I<   Mar20   0:00 [kworker/4:0H-events_highpri]
root          62  0.0  0.0      0     0 ?        I<   Mar20   0:00 [kworker/8:0H-events_highpri]
root         104  0.0  0.0      0     0 ?        I<   Mar20   0:00 [kworker/15:0H-events_highpri]
root         116  0.0  0.0      0     0 ?        I<   Mar20   0:00 [kworker/17:0H-events_highpri]
root         122  0.0  0.0      0     0 ?        I<   Mar20   0:00 [kworker/18:0H-events_highpri]
root         134  0.0  0.0      0     0 ?        I<   Mar20   0:00 [kworker/20:0H-events_highpri]
root         152  0.0  0.0      0     0 ?        I<   Mar20   0:00 [kworker/23:0H-events_highpri]
root         158  0.0  0.0      0     0 ?        I<   Mar20   0:00 [kworker/24:0H-events_highpri]
root         170  0.0  0.0      0     0 ?        I<   Mar20   0:00 [kworker/26:0H-events_highpri]
root         176  0.0  0.0      0     0 ?        I<   Mar20   0:00 [kworker/27:0H-events_highpri]
root         188  0.0  0.0      0     0 ?        I<   Mar20   0:00 [kworker/29:0H-events_highpri]
root         200  0.0  0.0      0     0 ?        I<   Mar20   0:00 [kworker/31:0H-events_highpri]
root         206  0.0  0.0      0     0 ?        I<   Mar20   0:00 [kworker/32:0H-events_highpri]
root         212  0.0  0.0      0     0 ?        I<   Mar20   0:00 [kworker/33:0H-events_highpri]
root         218  0.0  0.0      0     0 ?        I<   Mar20   0:00 [kworker/34:0H-events_highpri]
root         224  0.0  0.0      0     0 ?        I<   Mar20   0:00 [kworker/35:0H-events_highpri]
root         242  0.0  0.0      0     0 ?        I<   Mar20   0:00 [kworker/38:0H-events_highpri]
root         260  0.0  0.0      0     0 ?        I<   Mar20   0:00 [kworker/41:0H-events_highpri]
root         272  0.0  0.0      0     0 ?        I<   Mar20   0:00 [kworker/43:0H-events_highpri]
root         278  0.0  0.0      0     0 ?        I<   Mar20   0:00 [kworker/44:0H-events_highpri]
root         284  0.0  0.0      0     0 ?        I<   Mar20   0:00 [kworker/45:0H-events_highpri]
root         290  0.0  0.0      0     0 ?        I<   Mar20   0:00 [kworker/46:0H-events_highpri]
root         296  0.0  0.0      0     0 ?        I<   Mar20   0:00 [kworker/47:0H-events_highpri]
root         308  0.0  0.0      0     0 ?        I<   Mar20   0:00 [kworker/49:0H-events_highpri]
root         320  0.0  0.0      0     0 ?        I<   Mar20   0:00 [kworker/51:0H-events_highpri]
root         332  0.0  0.0      0     0 ?        I<   Mar20   0:00 [kworker/53:0H-events_highpri]
root         356  0.0  0.0      0     0 ?        I<   Mar20   0:00 [kworker/57:0H-events_highpri]
root         374  0.0  0.0      0     0 ?        I<   Mar20   0:00 [kworker/60:0H-events_highpri]
root         380  0.0  0.0      0     0 ?        I<   Mar20   0:00 [kworker/61:0H-events_highpri]
root         386  0.0  0.0      0     0 ?        I<   Mar20   0:00 [kworker/62:0H-events_highpri]
root         393  0.0  0.0      0     0 ?        S    Mar20   0:00 [kdevtmpfs]
root         458  0.0  0.0      0     0 ?        I<   Mar20   0:00 [tpm_dev_wq]
root         462  0.0  0.0      0     0 ?        I<   Mar20   0:00 [devfreq_wq]
root         640  0.0  0.0      0     0 ?        I    Mar20   0:00 [kworker/45:1-events]
root         863  0.0  0.0  24604  6924 ?        Ss   Mar20   0:09 /lib/systemd/systemd-udevd
root        1321  0.0  0.0 107920 10988 ?        Ssl  Mar20   0:00 /usr/bin/python3 /usr/share/unattended-upgrades/unattended-upgrade-shutdown --wait-for-signal
root        7947  0.0  0.0      0     0 ?        I    Mar22   0:00 [kworker/13:2-events]
root       18467  0.0  0.0      0     0 ?        I    Mar26   0:00 [kworker/5:2-events]
root       18571  0.0  0.0      0     0 ?        I    Mar27   0:00 [kworker/18:2-events]
root       20601  0.0  0.0      0     0 ?        I    Mar28   0:00 [kworker/34:0-events]
root       20641  0.0  0.0      0     0 ?        I    Mar28   0:05 [kworker/37:0-events]
root       22723  0.0  0.0      0     0 ?        I    Mar29   0:00 [kworker/9:0-events]
root       22726  0.0  0.0      0     0 ?        I    Mar29   0:00 [kworker/58:0-events]
root       36920  0.0  0.0      0     0 ?        I    00:00   0:01 [kworker/49:2-events]
root       37097  0.0  0.0      0     0 ?        I    02:43   0:00 [kworker/52:2-events]
root       37739  0.0  0.0      0     0 ?        I    12:47   0:00 [kworker/54:0-events]
root       38067  0.0  0.0      0     0 ?        I    15:45   0:00 [kworker/56:2-events]
root       38383  0.0  0.0      0     0 ?        I    15:45   0:00 [kworker/7:0-events]
root       38529  0.1  0.0      0     0 ?        I    18:09   0:13 [kworker/0:2-events]
root       39365  0.0  0.0      0     0 ?        I    18:18   0:00 [kworker/8:1-events]
root       39714  0.0  0.0      0     0 ?        I    18:49   0:00 [kworker/20:2-events]
root       45514  0.0  0.0      0     0 ?        I    19:23   0:01 [kworker/u128:1-events_power_efficient]
root       52563  0.0  0.0      0     0 ?        I    20:10   0:00 [kworker/u128:3-events_unbound]
root       53564  0.0  0.0      0     0 ?        I    20:18   0:00 [kworker/25:1-events]
root       54916  0.0  0.0      0     0 ?        I    20:35   0:00 [kworker/u128:2-events_unbound]
lio        56986  0.0  0.0   7024  3504 ?        Ss   20:40   0:00 bash -c . /etc/profile;. ~/.profile;mkdir -p ~/simulation/boston/images/ rtpict -n 62 -w -vf /home/lio/MantaRay/TestFolder/views/Perspective1.vf -x 400 -y 300 -ab 1 -ad 2048 -lw 0.005 -aa 0.1 -ar 512 -as 1024 -af ambfile_2023_03_30_2240_23.af /home/lio/MantaRay/Andrei/octrees/my_test_scene_0800.oct > /dev/null rtpict -n 62 -w -vf /home/lio/MantaRay/TestFolder/views/Perspective1.vf -x 750 -y 500 -ab 1 -ad 2048 -lw 0.005 -aa 0.1 -ar 512 -as 1024 -af ambfile_2023_03_30_2240_23.af /home/lio/MantaRay/Andrei/octrees/my_test_scene_0800.oct | pfilt -x /2 -y /2 > ~/simulation/boston/images/2023_03_30_2143_46_rtpict_rendering_aa0.1_750_sunny_ad4096_ovc.hdr;echo ~/simulation/boston/images/2023_03_30_2143_46_rtpict_rendering_aa0.1_750_sunny_ad4096_ovc.hdr
lio        56991  0.0  0.0  11012  5524 ?        S    20:40   0:00 /usr/bin/perl -w /usr/local/radiance/bin/rtpict -n 62 -w -vf /home/lio/MantaRay/TestFolder/views/Perspective1.vf -x 400 -y 300 -ab 1 -ad 2048 -lw 0.005 -aa 0.1 -ar 512 -as 1024 -af ambfile_2023_03_30_2240_23.af /home/lio/MantaRay/Andrei/octrees/my_test_scene_0800.oct
lio        56997  0.0  0.0   2616   536 ?        S    20:40   0:00 sh -c vwrays -pj .67 -vf /home/lio/MantaRay/TestFolder/views/Perspective1.vf -x 400 -y 300 -ff -i < /tmp/ord56991.txt | rtrace -u- -dt .05 -dc .5 -ds .25 -dr 1 -aa .2 -ar 64 -ad 512 -as 128 -lr 7 -lw 1e-03 -w -ab 1 -ad 2048 -lw 0.005 -aa 0.1 -ar 512 -as 1024 -af ambfile_2023_03_30_2240_23.af -n 62 -ffa -ov '/home/lio/MantaRay/Andrei/octrees/my_test_scene_0800.oct' > /tmp/pix56991.txt
lio        56998  1.0  0.0   3888  1020 ?        S    20:40   0:00 vwrays -pj .67 -vf /home/lio/MantaRay/TestFolder/views/Perspective1.vf -x 400 -y 300 -ff -i
lio        56999 11.6  0.1  32804 29536 ?        R    20:40   0:00 rtrace -u- -dt .05 -dc .5 -ds .25 -dr 1 -aa .2 -ar 64 -ad 512 -as 128 -lr 7 -lw 1e-03 -w -ab 1 -ad 2048 -lw 0.005 -aa 0.1 -ar 512 -as 1024 -af ambfile_2023_03_30_2240_23.af -n 62 -ffa -ov /home/lio/MantaRay/Andrei/octrees/my_test_scene_0800.oct
lio        57001 64.2  0.1  31508 27572 ?        R    20:40   0:03 rtrace -u- -dt .05 -dc .5 -ds .25 -dr 1 -aa .2 -ar 64 -ad 512 -as 128 -lr 7 -lw 1e-03 -w -ab 1 -ad 2048 -lw 0.005 -aa 0.1 -ar 512 -as 1024 -af ambfile_2023_03_30_2240_23.af -n 62 -ffa -ov /home/lio/MantaRay/Andrei/octrees/my_test_scene_0800.oct
lio        57002 51.2  0.1  31668 28288 ?        S    20:40   0:02 rtrace -u- -dt .05 -dc .5 -ds .25 -dr 1 -aa .2 -ar 64 -ad 512 -as 128 -lr 7 -lw 1e-03 -w -ab 1 -ad 2048 -lw 0.005 -aa 0.1 -ar 512 -as 1024 -af ambfile_2023_03_30_2240_23.af -n 62 -ffa -ov /home/lio/MantaRay/Andrei/octrees/my_test_scene_0800.oct
lio        57003 49.0  0.1  32056 28164 ?        S    20:40   0:02 rtrace -u- -dt .05 -dc .5 -ds .25 -dr 1 -aa .2 -ar 64 -ad 512 -as 128 -lr 7 -lw 1e-03 -w -ab 1 -ad 2048 -lw 0.005 -aa 0.1 -ar 512 -as 1024 -af ambfile_2023_03_30_2240_23.af -n 62 -ffa -ov /home/lio/MantaRay/Andrei/octrees/my_test_scene_0800.oct
lio        57004 50.0  0.1  32196 28348 ?        S    20:40   0:02 rtrace -u- -dt .05 -dc .5 -ds .25 -dr 1 -aa .2 -ar 64 -ad 512 -as 128 -lr 7 -lw 1e-03 -w -ab 1 -ad 2048 -lw 0.005 -aa 0.1 -ar 512 -as 1024 -af ambfile_2023_03_30_2240_23.af -n 62 -ffa -ov /home/lio/MantaRay/Andrei/octrees/my_test_scene_0800.oct
lio        57005 52.2  0.1  31844 27964 ?        S    20:40   0:02 rtrace -u- -dt .05 -dc .5 -ds .25 -dr 1 -aa .2 -ar 64 -ad 512 -as 128 -lr 7 -lw 1e-03 -w -ab 1 -ad 2048 -lw 0.005 -aa 0.1 -ar 512 -as 1024 -af ambfile_2023_03_30_2240_23.af -n 62 -ffa -ov /home/lio/MantaRay/Andrei/octrees/my_test_scene_0800.oct
lio        57006 48.2  0.1  32116 28228 ?        S    20:40   0:02 rtrace -u- -dt .05 -dc .5 -ds .25 -dr 1 -aa .2 -ar 64 -ad 512 -as 128 -lr 7 -lw 1e-03 -w -ab 1 -ad 2048 -lw 0.005 -aa 0.1 -ar 512 -as 1024 -af ambfile_2023_03_30_2240_23.af -n 62 -ffa -ov /home/lio/MantaRay/Andrei/octrees/my_test_scene_0800.oct
lio        57007 62.2  0.1  31508 27508 ?        S    20:40   0:03 rtrace -u- -dt .05 -dc .5 -ds .25 -dr 1 -aa .2 -ar 64 -ad 512 -as 128 -lr 7 -lw 1e-03 -w -ab 1 -ad 2048 -lw 0.005 -aa 0.1 -ar 512 -as 1024 -af ambfile_2023_03_30_2240_23.af -n 62 -ffa -ov /home/lio/MantaRay/Andrei/octrees/my_test_scene_0800.oct
lio        57008 54.2  0.1  31672 27820 ?        R    20:40   0:02 rtrace -u- -dt .05 -dc .5 -ds .25 -dr 1 -aa .2 -ar 64 -ad 512 -as 128 -lr 7 -lw 1e-03 -w -ab 1 -ad 2048 -lw 0.005 -aa 0.1 -ar 512 -as 1024 -af ambfile_2023_03_30_2240_23.af -n 62 -ffa -ov /home/lio/MantaRay/Andrei/octrees/my_test_scene_0800.oct
lio        57009 57.4  0.1  31584 28136 ?        R    20:40   0:02 rtrace -u- -dt .05 -dc .5 -ds .25 -dr 1 -aa .2 -ar 64 -ad 512 -as 128 -lr 7 -lw 1e-03 -w -ab 1 -ad 2048 -lw 0.005 -aa 0.1 -ar 512 -as 1024 -af ambfile_2023_03_30_2240_23.af -n 62 -ffa -ov /home/lio/MantaRay/Andrei/octrees/my_test_scene_0800.oct
lio        57010 52.0  0.1  32064 28524 ?        R    20:40   0:02 rtrace -u- -dt .05 -dc .5 -ds .25 -dr 1 -aa .2 -ar 64 -ad 512 -as 128 -lr 7 -lw 1e-03 -w -ab 1 -ad 2048 -lw 0.005 -aa 0.1 -ar 512 -as 1024 -af ambfile_2023_03_30_2240_23.af -n 62 -ffa -ov /home/lio/MantaRay/Andrei/octrees/my_test_scene_0800.oct
lio        57011 49.2  0.1  32064 28088 ?        S    20:40   0:02 rtrace -u- -dt .05 -dc .5 -ds .25 -dr 1 -aa .2 -ar 64 -ad 512 -as 128 -lr 7 -lw 1e-03 -w -ab 1 -ad 2048 -lw 0.005 -aa 0.1 -ar 512 -as 1024 -af ambfile_2023_03_30_2240_23.af -n 62 -ffa -ov /home/lio/MantaRay/Andrei/octrees/my_test_scene_0800.oct
lio        57012 49.4  0.1  32328 28268 ?        R    20:40   0:02 rtrace -u- -dt .05 -dc .5 -ds .25 -dr 1 -aa .2 -ar 64 -ad 512 -as 128 -lr 7 -lw 1e-03 -w -ab 1 -ad 2048 -lw 0.005 -aa 0.1 -ar 512 -as 1024 -af ambfile_2023_03_30_2240_23.af -n 62 -ffa -ov /home/lio/MantaRay/Andrei/octrees/my_test_scene_0800.oct
lio        57013 48.4  0.1  32172 28292 ?        R    20:40   0:02 rtrace -u- -dt .05 -dc .5 -ds .25 -dr 1 -aa .2 -ar 64 -ad 512 -as 128 -lr 7 -lw 1e-03 -w -ab 1 -ad 2048 -lw 0.005 -aa 0.1 -ar 512 -as 1024 -af ambfile_2023_03_30_2240_23.af -n 62 -ffa -ov /home/lio/MantaRay/Andrei/octrees/my_test_scene_0800.oct
lio        57014 52.8  0.1  31796 27816 ?        S    20:40   0:02 rtrace -u- -dt .05 -dc .5 -ds .25 -dr 1 -aa .2 -ar 64 -ad 512 -as 128 -lr 7 -lw 1e-03 -w -ab 1 -ad 2048 -lw 0.005 -aa 0.1 -ar 512 -as 1024 -af ambfile_2023_03_30_2240_23.af -n 62 -ffa -ov /home/lio/MantaRay/Andrei/octrees/my_test_scene_0800.oct
lio        57015 50.8  0.1  31868 28496 ?        S    20:40   0:02 rtrace -u- -dt .05 -dc .5 -ds .25 -dr 1 -aa .2 -ar 64 -ad 512 -as 128 -lr 7 -lw 1e-03 -w -ab 1 -ad 2048 -lw 0.005 -aa 0.1 -ar 512 -as 1024 -af ambfile_2023_03_30_2240_23.af -n 62 -ffa -ov /home/lio/MantaRay/Andrei/octrees/my_test_scene_0800.oct
lio        57016 52.0  0.1  31776 27888 ?        R    20:40   0:02 rtrace -u- -dt .05 -dc .5 -ds .25 -dr 1 -aa .2 -ar 64 -ad 512 -as 128 -lr 7 -lw 1e-03 -w -ab 1 -ad 2048 -lw 0.005 -aa 0.1 -ar 512 -as 1024 -af ambfile_2023_03_30_2240_23.af -n 62 -ffa -ov /home/lio/MantaRay/Andrei/octrees/my_test_scene_0800.oct
lio        57017 55.4  0.1  31576 27684 ?        S    20:40   0:02 rtrace -u- -dt .05 -dc .5 -ds .25 -dr 1 -aa .2 -ar 64 -ad 512 -as 128 -lr 7 -lw 1e-03 -w -ab 1 -ad 2048 -lw 0.005 -aa 0.1 -ar 512 -as 1024 -af ambfile_2023_03_30_2240_23.af -n 62 -ffa -ov /home/lio/MantaRay/Andrei/octrees/my_test_scene_0800.oct
lio        57018 73.8  0.1  31508 27512 ?        R    20:40   0:03 rtrace -u- -dt .05 -dc .5 -ds .25 -dr 1 -aa .2 -ar 64 -ad 512 -as 128 -lr 7 -lw 1e-03 -w -ab 1 -ad 2048 -lw 0.005 -aa 0.1 -ar 512 -as 1024 -af ambfile_2023_03_30_2240_23.af -n 62 -ffa -ov /home/lio/MantaRay/Andrei/octrees/my_test_scene_0800.oct
lio        57019 53.4  0.1  31752 28372 ?        S    20:40   0:02 rtrace -u- -dt .05 -dc .5 -ds .25 -dr 1 -aa .2 -ar 64 -ad 512 -as 128 -lr 7 -lw 1e-03 -w -ab 1 -ad 2048 -lw 0.005 -aa 0.1 -ar 512 -as 1024 -af ambfile_2023_03_30_2240_23.af -n 62 -ffa -ov /home/lio/MantaRay/Andrei/octrees/my_test_scene_0800.oct
lio        57020 56.4  0.1  31664 27784 ?        R    20:40   0:02 rtrace -u- -dt .05 -dc .5 -ds .25 -dr 1 -aa .2 -ar 64 -ad 512 -as 128 -lr 7 -lw 1e-03 -w -ab 1 -ad 2048 -lw 0.005 -aa 0.1 -ar 512 -as 1024 -af ambfile_2023_03_30_2240_23.af -n 62 -ffa -ov /home/lio/MantaRay/Andrei/octrees/my_test_scene_0800.oct
lio        57021 48.8  0.1  32264 28372 ?        S    20:40   0:02 rtrace -u- -dt .05 -dc .5 -ds .25 -dr 1 -aa .2 -ar 64 -ad 512 -as 128 -lr 7 -lw 1e-03 -w -ab 1 -ad 2048 -lw 0.005 -aa 0.1 -ar 512 -as 1024 -af ambfile_2023_03_30_2240_23.af -n 62 -ffa -ov /home/lio/MantaRay/Andrei/octrees/my_test_scene_0800.oct
lio        57022 51.6  0.1  31764 27872 ?        R    20:40   0:02 rtrace -u- -dt .05 -dc .5 -ds .25 -dr 1 -aa .2 -ar 64 -ad 512 -as 128 -lr 7 -lw 1e-03 -w -ab 1 -ad 2048 -lw 0.005 -aa 0.1 -ar 512 -as 1024 -af ambfile_2023_03_30_2240_23.af -n 62 -ffa -ov /home/lio/MantaRay/Andrei/octrees/my_test_scene_0800.oct
lio        57023 51.2  0.1  31916 28532 ?        S    20:40   0:02 rtrace -u- -dt .05 -dc .5 -ds .25 -dr 1 -aa .2 -ar 64 -ad 512 -as 128 -lr 7 -lw 1e-03 -w -ab 1 -ad 2048 -lw 0.005 -aa 0.1 -ar 512 -as 1024 -af ambfile_2023_03_30_2240_23.af -n 62 -ffa -ov /home/lio/MantaRay/Andrei/octrees/my_test_scene_0800.oct
lio        57024 49.4  0.1  31788 28424 ?        R    20:40   0:02 rtrace -u- -dt .05 -dc .5 -ds .25 -dr 1 -aa .2 -ar 64 -ad 512 -as 128 -lr 7 -lw 1e-03 -w -ab 1 -ad 2048 -lw 0.005 -aa 0.1 -ar 512 -as 1024 -af ambfile_2023_03_30_2240_23.af -n 62 -ffa -ov /home/lio/MantaRay/Andrei/octrees/my_test_scene_0800.oct
lio        57025 48.0  0.1  32284 28404 ?        R    20:40   0:02 rtrace -u- -dt .05 -dc .5 -ds .25 -dr 1 -aa .2 -ar 64 -ad 512 -as 128 -lr 7 -lw 1e-03 -w -ab 1 -ad 2048 -lw 0.005 -aa 0.1 -ar 512 -as 1024 -af ambfile_2023_03_30_2240_23.af -n 62 -ffa -ov /home/lio/MantaRay/Andrei/octrees/my_test_scene_0800.oct
lio        57026 48.6  0.1  32056 28092 ?        S    20:40   0:02 rtrace -u- -dt .05 -dc .5 -ds .25 -dr 1 -aa .2 -ar 64 -ad 512 -as 128 -lr 7 -lw 1e-03 -w -ab 1 -ad 2048 -lw 0.005 -aa 0.1 -ar 512 -as 1024 -af ambfile_2023_03_30_2240_23.af -n 62 -ffa -ov /home/lio/MantaRay/Andrei/octrees/my_test_scene_0800.oct
lio        57027 52.2  0.1  31900 28016 ?        R    20:40   0:02 rtrace -u- -dt .05 -dc .5 -ds .25 -dr 1 -aa .2 -ar 64 -ad 512 -as 128 -lr 7 -lw 1e-03 -w -ab 1 -ad 2048 -lw 0.005 -aa 0.1 -ar 512 -as 1024 -af ambfile_2023_03_30_2240_23.af -n 62 -ffa -ov /home/lio/MantaRay/Andrei/octrees/my_test_scene_0800.oct
lio        57028 51.2  0.1  32044 28668 ?        S    20:40   0:02 rtrace -u- -dt .05 -dc .5 -ds .25 -dr 1 -aa .2 -ar 64 -ad 512 -as 128 -lr 7 -lw 1e-03 -w -ab 1 -ad 2048 -lw 0.005 -aa 0.1 -ar 512 -as 1024 -af ambfile_2023_03_30_2240_23.af -n 62 -ffa -ov /home/lio/MantaRay/Andrei/octrees/my_test_scene_0800.oct
lio        57029 53.4  0.1  31740 28360 ?        S    20:40   0:02 rtrace -u- -dt .05 -dc .5 -ds .25 -dr 1 -aa .2 -ar 64 -ad 512 -as 128 -lr 7 -lw 1e-03 -w -ab 1 -ad 2048 -lw 0.005 -aa 0.1 -ar 512 -as 1024 -af ambfile_2023_03_30_2240_23.af -n 62 -ffa -ov /home/lio/MantaRay/Andrei/octrees/my_test_scene_0800.oct
lio        57030 51.6  0.1  31892 28516 ?        R    20:40   0:02 rtrace -u- -dt .05 -dc .5 -ds .25 -dr 1 -aa .2 -ar 64 -ad 512 -as 128 -lr 7 -lw 1e-03 -w -ab 1 -ad 2048 -lw 0.005 -aa 0.1 -ar 512 -as 1024 -af ambfile_2023_03_30_2240_23.af -n 62 -ffa -ov /home/lio/MantaRay/Andrei/octrees/my_test_scene_0800.oct
lio        57031 48.8  0.1  32136 28764 ?        S    20:40   0:02 rtrace -u- -dt .05 -dc .5 -ds .25 -dr 1 -aa .2 -ar 64 -ad 512 -as 128 -lr 7 -lw 1e-03 -w -ab 1 -ad 2048 -lw 0.005 -aa 0.1 -ar 512 -as 1024 -af ambfile_2023_03_30_2240_23.af -n 62 -ffa -ov /home/lio/MantaRay/Andrei/octrees/my_test_scene_0800.oct
lio        57032 53.2  0.1  31804 27828 ?        R    20:40   0:02 rtrace -u- -dt .05 -dc .5 -ds .25 -dr 1 -aa .2 -ar 64 -ad 512 -as 128 -lr 7 -lw 1e-03 -w -ab 1 -ad 2048 -lw 0.005 -aa 0.1 -ar 512 -as 1024 -af ambfile_2023_03_30_2240_23.af -n 62 -ffa -ov /home/lio/MantaRay/Andrei/octrees/my_test_scene_0800.oct
lio        57033 48.4  0.1  32196 28312 ?        R    20:40   0:02 rtrace -u- -dt .05 -dc .5 -ds .25 -dr 1 -aa .2 -ar 64 -ad 512 -as 128 -lr 7 -lw 1e-03 -w -ab 1 -ad 2048 -lw 0.005 -aa 0.1 -ar 512 -as 1024 -af ambfile_2023_03_30_2240_23.af -n 62 -ffa -ov /home/lio/MantaRay/Andrei/octrees/my_test_scene_0800.oct
lio        57034 48.0  0.1  32320 28948 ?        S    20:40   0:02 rtrace -u- -dt .05 -dc .5 -ds .25 -dr 1 -aa .2 -ar 64 -ad 512 -as 128 -lr 7 -lw 1e-03 -w -ab 1 -ad 2048 -lw 0.005 -aa 0.1 -ar 512 -as 1024 -af ambfile_2023_03_30_2240_23.af -n 62 -ffa -ov /home/lio/MantaRay/Andrei/octrees/my_test_scene_0800.oct
lio        57035 52.4  0.1  31880 28508 ?        R    20:40   0:02 rtrace -u- -dt .05 -dc .5 -ds .25 -dr 1 -aa .2 -ar 64 -ad 512 -as 128 -lr 7 -lw 1e-03 -w -ab 1 -ad 2048 -lw 0.005 -aa 0.1 -ar 512 -as 1024 -af ambfile_2023_03_30_2240_23.af -n 62 -ffa -ov /home/lio/MantaRay/Andrei/octrees/my_test_scene_0800.oct
lio        57036 52.2  0.1  31672 27512 ?        S    20:40   0:02 rtrace -u- -dt .05 -dc .5 -ds .25 -dr 1 -aa .2 -ar 64 -ad 512 -as 128 -lr 7 -lw 1e-03 -w -ab 1 -ad 2048 -lw 0.005 -aa 0.1 -ar 512 -as 1024 -af ambfile_2023_03_30_2240_23.af -n 62 -ffa -ov /home/lio/MantaRay/Andrei/octrees/my_test_scene_0800.oct
lio        57037 49.8  0.1  32332 28308 ?        S    20:40   0:02 rtrace -u- -dt .05 -dc .5 -ds .25 -dr 1 -aa .2 -ar 64 -ad 512 -as 128 -lr 7 -lw 1e-03 -w -ab 1 -ad 2048 -lw 0.005 -aa 0.1 -ar 512 -as 1024 -af ambfile_2023_03_30_2240_23.af -n 62 -ffa -ov /home/lio/MantaRay/Andrei/octrees/my_test_scene_0800.oct
lio        57038 48.4  0.1  32200 28308 ?        S    20:40   0:02 rtrace -u- -dt .05 -dc .5 -ds .25 -dr 1 -aa .2 -ar 64 -ad 512 -as 128 -lr 7 -lw 1e-03 -w -ab 1 -ad 2048 -lw 0.005 -aa 0.1 -ar 512 -as 1024 -af ambfile_2023_03_30_2240_23.af -n 62 -ffa -ov /home/lio/MantaRay/Andrei/octrees/my_test_scene_0800.oct
lio        57039 49.2  0.1  32200 28092 ?        R    20:40   0:02 rtrace -u- -dt .05 -dc .5 -ds .25 -dr 1 -aa .2 -ar 64 -ad 512 -as 128 -lr 7 -lw 1e-03 -w -ab 1 -ad 2048 -lw 0.005 -aa 0.1 -ar 512 -as 1024 -af ambfile_2023_03_30_2240_23.af -n 62 -ffa -ov /home/lio/MantaRay/Andrei/octrees/my_test_scene_0800.oct
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""",
    commands="ps -aux | grep 'arch2rad\|bgraph\|bsdf2klems\|bsdf2rad\|bsdf2ttree\|bsdfview\|cnt\|compamb\|cv\|dayfact\|dcglare\|dctimestep\|dgraph\|epw2wea\|ev\|fieldcomb\|findglare\|gcomp\|genBSDF\|genblinds\|genbox\|genclock\|gendaymtx\|genklemsamp\|genprism\|genrev\|gensky\|genskyvec\|gensurf\|genworm\|getbbox\|getinfo\|glare\|glarendx\|glrad\|histo\|icalc\|igraph\|lampcolor\|libmeta.a\|lookamb\|macbethcal\|meta\|meta2bmp\|meta2tga\|metafile\|mgf2meta\|mgf2rad\|mkillum\|mkpmap\|mksource\|neaten\|normpat\|normtiff\|obj2mesh\|obj2rad\|objline\|objview\|oconv\|pabopto2bsdf\|pabopto2xyz\|pcomb\|pcompos\|pcond\|pdfblur\|pexpand\|pextrem\|pfilt\|pflip\|phisto\|pinterp\|pkgBSDF\|plotin\|pmapdump\|pmblur\|pmblur2\|pmdblur\|protate\|psign\|psketch\|psmeta\|psort\|pvalue\|ra_bmp\|ra_gif\|ra_pict\|ra_ppm\|ra_ps\|ra_rgbe\|ra_t16\|ra_t8\|ra_tiff\|ra_xyze\|rad\|rad2mgf\|raddepend\|ran2tiff\|ranimate\|ranimove\|rcalc\|rcode2bmp\|rcode_depth\|rcode_ident\|rcode_norm\|rcollate\|rcontrib\|rcrop\|replmarks\|rfluxmtx\|rhcopy\|rhinfo\|rholo\|rhoptimize\|rhpict\|rlam\|rmtxop\|robjutil\|rpict\|rpiece\|rsensor\|rsplit\|rtpict\|rtrace\|rvu\|tabfunc\|tmesh2rad\|total\|trad\|ttyimage\|vwrays\|vwright\|wrapBSDF\|x11meta\|xform\|xglaresrc\|ximage\|xshowtrace\|falsecolor'")  # -> Stdout, Stderr_, Ran

python_15 = GhPythonScript(x=executessh_42.Stdout)  # -> a
# ---------- python_15: Python ----------
__author__ = "mm1013"
__version__ = "2022.08.30"

import rhinoscriptsyntax as rs

a = [l for l in x.split("\n") if "grep" not in l]
# ---------- end python_15 ----------
panel_91 = Panel(python_15)

panel_92 = Panel("""mkdir -p <proj>/views/
echo "<vf>" > <proj>/views/<target>.vf
echo <proj>/views/<target>.vf""")
concat_5 = Concatenate(FragmentA="Perspective", FragmentB="1")

# ----
# Doubleclick Me To update view
view_3 = CreateView(Viewport="Perspective")  # -> ViewfileContent, ImageRatio

panel_93 = Panel(view_3.ViewfileContent)
vf_3 = Text(view_3.ViewfileContent)
overrides_45 = ApplyOverrides(Input=panel_92, Vf=graft(vf_3), Target=graft(concat_5))  # -> Output, DynamicOutput
executessh_43 = ExecuteSSH(
    _SSHCommands_=overrides_45.DynamicOutput,
    Run=Toggle(True),
    addPrefix=True,
    description="""mkdir -p ~/MantaRay/TestFolder/views/
echo "rvu -vtv -vp 83.9949878671202 13.7941026181952 3.06438760853575 -vd -0.888405294167789 0.447598572622015 0.101938957623567 -vu 0.091037354547255 -0.0458666671823545 0.994790655825948 -vh 63.227 -vv 50.000" > ~/MantaRay/TestFolder/views/Perspective1.vf
echo ~/MantaRay/TestFolder/views/Perspective1.vf""",
    fireLogs=False,
    lastRunTime=83.8739,
    suppressWarnings=False,
    results="/home/lio/MantaRay/TestFolder/views/Perspective1.vf",
    commands="""mkdir -p ~/MantaRay/TestFolder/views/
echo "rvu -vtv -vp 83.9949878671202 13.7941026181952 3.06438760853575 -vd -0.888405294167789 0.447598572622015 0.101938957623567 -vu 0.091037354547255 -0.0458666671823545 0.994790655825948 -vh 63.227 -vv 50.000" > ~/MantaRay/TestFolder/views/Perspective1.vf
echo ~/MantaRay/TestFolder/views/Perspective1.vf""")  # -> Stdout, Stderr_, Ran

# ----
# VIEW
file_exists = Panel("[ -f <out> ] && echo \"1\" || echo \"0\"")
item_3 = ListItem(List=flatten(executessh_43.Stdout), Index=0, Wrap=True)
panel_94 = Panel(executessh_43.Stdout)
overrides_46 = ApplyOverrides(Input=file_exists, Out=graft(item_3))  # -> Output, DynamicOutput
executessh_44 = ExecuteSSH(
    _SSHCommands_=overrides_46.DynamicOutput,
    Run=executessh_21.Ran,
    addPrefix=True,
    description="[ -f /home/lio/MantaRay/TestFolder/views/Perspective1.vf ] && echo \"1\" || echo \"0\"",
    fireLogs=False,
    lastRunTime=95.1177,
    suppressWarnings=False,
    results="1",
    commands="[ -f /home/lio/MantaRay/TestFolder/views/Perspective1.vf ] && echo \"1\" || echo \"0\"")  # -> Stdout, Stderr_, Ran

# ----
# Parallel RTPICT render (luminance)
# without ambient cache
supersampling_2 = Panel("4")
viewfile_3 = Text(executessh_26.Stdout)
octree_3 = Text(octree_overcast)
x_7 = RemoteReceiver(x)
y_5 = RemoteReceiver(y)
panel_95 = Panel("""mkdir -p <proj>/images/
rm -r <proj>/images/<target>
rtpict -n <cpus> -w -ov <proj>/images/<target> -vf <vf> -x <x> -y <y> <radOptions> <oct>;echo <proj>/images/<target>""")
panel_96 = Panel("<time>_rtpict_rendering_aa0_<x>_sunny_ad32_<h>")
multiplication_3 = Multiplication(A=x_7, B=supersampling_2)
multiplication_4 = Multiplication(A=y_5, B=supersampling_2)
run_4 = LBFalseStartToggle(False)
python_16 = GhPythonScript(update=run_4)  # -> time; inputs update: tree
# ---------- python_16: Python ----------
__author__ = "mm1013"
__version__ = "2022.08.30"

import rhinoscriptsyntax as rs

from datetime import datetime
dt = datetime.now()

time = "%02d_%02d_%02d_%02d%02d" % (dt.year, dt.month, dt.day, dt.hour, dt.minute)
# ---------- end python_16 ----------
hours_4 = Number("0")

# ----
# raw render of material colors
panel_97 = Panel("""rpict -vf <vf> -x <x> -y <y> <radOptions> <oct> |
pfilt -x /<ss> -y /<ss> -1 -r 0.7 > <proj>/images/<target>_colors_filt.hdr
echo <proj>/images/<target>_colors_filt.hdr""")
viewfile_4 = Text(executessh_26.Stdout)
octree_4 = Text(octree_overcast)
supersampling_3 = Panel("4")
y_6 = RemoteReceiver(y)
x_8 = RemoteReceiver(x)
multiplication_5 = Multiplication(A=x_8, B=supersampling_3)
multiplication_6 = Multiplication(A=y_6, B=supersampling_3)
overrides_47 = ApplyOverrides(
    Input=panel_97,
    Vf=graft(viewfile_4),
    X=graft(multiplication_5),
    Y=graft(multiplication_6),
    Target=graft(panel_96),
    RadOptions=graft("-ab 0 -ad 1 -aa 1 -w -av 1 1 1"),
    Oct=graft(octree_4),
    Time=graft(python_16),
    H=graft(hours_4),
    Ss=graft(supersampling_3))  # -> Output, DynamicOutput
run_5 = LBFalseStartToggle(False)
panel_98 = Panel(overrides_47.DynamicOutput)
executessh_45 = ExecuteSSH(
    _SSHCommands=overrides_47.DynamicOutput,
    Run=run_5,
    addPrefix=True,
    description="""rpict -vf /home/lio/MantaRay/TestFolder/views/Perspective3.vf -x 3000 -y 1500 -ab 0 -ad 1 -aa 1 -w -av 1 1 1 /home/lio/simulation/boston/octrees/Scene_Overcast10klux.oct |
pfilt -x /4 -y /4 -1 -r 0.7 > ~/simulation/boston/images/2023_03_30_2049_rtpict_rendering_aa0_3000_sunny_ad32_0_colors_filt.hdr
echo ~/simulation/boston/images/2023_03_30_2049_rtpict_rendering_aa0_3000_sunny_ad32_0_colors_filt.hdr""",
    fireLogs=True,
    lastRunTime=80956,
    name="rpict for colors (denoisr test)",
    suppressWarnings=True,
    results="/home/lio/simulation/Boston_Skylights/images/2023_01_09_1607_rtpict_rendering_aa0_20000_sunny_ad32_0_colors_filt.hdr",
    commands="""rpict -vf /home/lio/MantaRay/TestingRemote/views/Perspective1.vf -x 20000 -y 10000 -ab 0 -ad 1 -aa 1 -w -av 1 1 1 /home/lio/simulation/Boston_Skylights/octrees/my_test_scene.oct |
pfilt -x /4 -y /4 -1 -r 0.7 > ~/simulation/Boston_Skylights/images/2023_01_09_1607_rtpict_rendering_aa0_20000_sunny_ad32_0_colors_filt.hdr
echo ~/simulation/Boston_Skylights/images/2023_01_09_1607_rtpict_rendering_aa0_20000_sunny_ad32_0_colors_filt.hdr""")  # -> Stdout, Stderr, Ran
download_12 = Download(SftpPaths=flatten(executessh_45.Stdout), Run=executessh_45.Ran)  # -> FilePaths, Status, Ran
imageviewer_7 = LBImageViewer(ImagePath_=download_12.FilePaths, _scale_=1, DisableClickable=False, SaveImgWithCoords=False, scale=1)  # -> ImagePath, Values, GIF

overrides_48 = ApplyOverrides(Input=panel_96, X=graft(x_7), Time=graft("<time>"), H=graft("<h>"))  # -> Output, DynamicOutput

overrides_49 = ApplyOverrides(
    Input=panel_95,
    Vf=graft(viewfile_3),
    X=graft(multiplication_3),
    Y=graft(multiplication_4),
    Target=graft(overrides_48.Output),
    RadOptions=graft("-ab 3 -ad 8 -aa 0"),
    Oct=graft(octree_3),
    Time=graft(python_16),
    H=graft(hours_4))  # -> Output, DynamicOutput
executessh_46 = ExecuteSSH(
    _SSHCommands=overrides_49.DynamicOutput,
    Run=run_4,
    addPrefix=True,
    description="""mkdir -p ~/simulation/boston/images/
rm -r ~/simulation/boston/images/2023_03_30_2049_rtpict_rendering_aa0_750_sunny_ad32_0
rtpict -n 63 -w -ov ~/simulation/boston/images/2023_03_30_2049_rtpict_rendering_aa0_750_sunny_ad32_0 -vf /home/lio/MantaRay/TestFolder/views/Perspective3.vf -x 3000 -y 1500 -ab 3 -ad 8 -aa 0 /home/lio/simulation/boston/octrees/Scene_Overcast10klux.oct;echo ~/simulation/boston/images/2023_03_30_2049_rtpict_rendering_aa0_750_sunny_ad32_0""",
    fireLogs=True,
    lastRunTime=2090052,
    name="rtpict luminance (denoisr test)",
    suppressWarnings=True,
    results="/home/lio/MantaRay/Andrei/images/2023_03_14_1224_rtpict_rendering_aa0_5000_sunny_ad32_0",
    stderr="rm: cannot remove '/home/lio/MantaRay/Andrei/images/2023_03_14_1224_rtpict_rendering_aa0_5000_sunny_ad32_0': No such file or directory",
    commands="""mkdir -p ~/MantaRay/Andrei/images/
rm -r ~/MantaRay/Andrei/images/2023_03_14_1224_rtpict_rendering_aa0_5000_sunny_ad32_0
rtpict -n 63 -w -ov ~/MantaRay/Andrei/images/2023_03_14_1224_rtpict_rendering_aa0_5000_sunny_ad32_0 -vf /home/lio/MantaRay/Andrei/views/Perspective3.vf -x 20000 -y 10000 -ab 3 -ad 8 -aa 0 /home/lio/MantaRay/Andrei/octrees/Scene_Overcast10klux.oct;echo ~/MantaRay/Andrei/images/2023_03_14_1224_rtpict_rendering_aa0_5000_sunny_ad32_0""")  # -> Stdout, Stderr, Ran
panel_99 = Panel(executessh_46.Stderr)

# ----
# Get path to radiance.hdr
# (rtpict generates a whole folder of other stuff..)
panel_100 = Panel("<proj>/images/<target>")
overrides_50 = ApplyOverrides(Input=panel_100, X=graft(x_7), Target=graft(panel_96), Time=graft(python_16), H=graft(hours_4))  # -> Output, DynamicOutput
overrides_51 = ApplyOverrides(Input="ls <target>", Target=graft(overrides_50.Output))  # -> Output, DynamicOutput
executessh_47 = ExecuteSSH(
    _SSHCommands_=overrides_51.DynamicOutput,
    Run=executessh_46.Ran,
    addPrefix=True,
    description="ls ~/MantaRay/TestFolder/images/2023_03_30_2049_rtpict_rendering_aa0_750_sunny_ad32_0",
    fireLogs=False,
    lastRunTime=14,
    suppressWarnings=False,
    results="radiance.hdr",
    commands="ls ~/MantaRay/Andrei/images/2023_03_14_1224_rtpict_rendering_aa0_5000_sunny_ad32_0")  # -> Stdout, Stderr_, Ran
concat_6 = Concatenate(FragmentA=overrides_50.Output, FragmentB="radiance.hdr", JoinSeparator="/")
split = TextSplit(Text=executessh_47.Stdout)
concat_7 = Concatenate(FragmentA=overrides_50.Output, FragmentB=split, JoinSeparator="/")

# ----
# Using pfilt to downscale image
# radius per Mark Stock:
# http://markjstock.org/radmisc/aa0_test/final.html
panel_101 = Panel("pfilt -x /<ss> -y /<ss> -1 -r 0.7 <file> > <file-.>_filtered.hdr;echo <file-.>_filtered.hdr")
overrides_52 = ApplyOverrides(Input=panel_101, Ss=graft(supersampling_2), File=graft(concat_7))  # -> Output, DynamicOutput
executessh_48 = ExecuteSSH(
    _SSHCommands_=overrides_52.DynamicOutput,
    Run=executessh_46.Ran,
    addPrefix=True,
    description="pfilt -x /4 -y /4 -1 -r 0.7 ~/MantaRay/TestFolder/images/2023_03_30_2049_rtpict_rendering_aa0_750_sunny_ad32_0/radiance.hdr > ~/MantaRay/TestFolder/images/2023_03_30_2049_rtpict_rendering_aa0_750_sunny_ad32_0/radiance_filtered.hdr;echo ~/MantaRay/TestFolder/images/2023_03_30_2049_rtpict_rendering_aa0_750_sunny_ad32_0/radiance_filtered.hdr",
    fireLogs=False,
    lastRunTime=11,
    suppressWarnings=False,
    results="/home/lio/MantaRay/Andrei/images/2023_03_14_1604_rtpict_rendering_aa0_5000_sunny_ad32_0/radiance_filtered.hdr",
    stderr="bash: /home/lio/MantaRay/Andrei/images/2023_03_14_1604_rtpict_rendering_aa0_5000_sunny_ad32_0/radiance_filtered.hdr: No such file or directory",
    commands="pfilt -x /4 -y /4 -1 -r 0.7 ~/MantaRay/Andrei/images/2023_03_14_1604_rtpict_rendering_aa0_5000_sunny_ad32_0/radiance.hdr > ~/MantaRay/Andrei/images/2023_03_14_1604_rtpict_rendering_aa0_5000_sunny_ad32_0/radiance_filtered.hdr;echo ~/MantaRay/Andrei/images/2023_03_14_1604_rtpict_rendering_aa0_5000_sunny_ad32_0/radiance_filtered.hdr")  # -> Stdout, Stderr_, Ran

# ----
# This "was" a test where i combined for the denoiseer..
# -la for titel: pcompos -la -a 3 -s 10 -b 1 1 1 <hdrFiles> > <proj>/images/<target>
# echo <proj>/images/<target>
# pcompos -a 15 -b 1 1 1 -s 5 <proj>/mtxs/skyRenders/skyTregenza*.hdr > <proj>/mtxs/skyRenders/all.hdr
panel_102 = Panel("""ra_tiff <hdrFiles> <proj>/images/<target-.>.tif
convert <proj>/images/<target-.>.tif <proj>/images/<target-.>.png
echo <proj>/images/<target-.>.png""")
panel_103 = Panel("pcond -h <hdr> <hdr-.>_exposed.hdr;echo <hdr-.>_exposed.hdr")
overrides_53 = ApplyOverrides(Input=panel_102, HdrFiles=graft(concat_6), Target=graft("render_original.png"))  # -> Output, DynamicOutput
overrides_54 = ApplyOverrides(Input=panel_103, Hdr=graft(executessh_48.Stdout))  # -> Output, DynamicOutput
panel_104 = Panel("psign -h 15 <h> | pcompos <target> 0 0 - 570 20 > <target-.>_s.hdr;echo <target-.>_s.hdr")
executessh_49 = ExecuteSSH(
    _SSHCommands_=overrides_53.DynamicOutput,
    Run=executessh_48.Ran,
    addPrefix=True,
    description="""ra_tiff ~/MantaRay/TestFolder/images/2023_03_30_2049_rtpict_rendering_aa0_750_sunny_ad32_0/radiance.hdr ~/simulation/boston/images/render_original.tif
convert ~/simulation/boston/images/render_original.tif ~/simulation/boston/images/render_original.png
echo ~/simulation/boston/images/render_original.png""",
    fireLogs=False,
    lastRunTime=4214,
    suppressWarnings=False,
    results="/home/lio/simulation/Boston_Skylights/images/render_original.png",
    commands="""ra_tiff ~/simulation/Boston_Skylights/images/2023_01_09_1607_rtpict_rendering_aa0_5000_sunny_ad32_0/radiance.hdr ~/simulation/Boston_Skylights/images/render_original.tif
convert ~/simulation/Boston_Skylights/images/render_original.tif ~/simulation/Boston_Skylights/images/render_original.png
echo ~/simulation/Boston_Skylights/images/render_original.png""")  # -> Stdout, Stderr_, Ran
panel_105 = Panel(overrides_53.Output)
download_13 = Download(SftpPaths=flatten(executessh_49.Stdout), Run=executessh_48.Ran)  # -> FilePaths, Status, Ran
executessh_50 = ExecuteSSH(
    _SSHCommands_=overrides_54.DynamicOutput,
    Run=executessh_48.Ran,
    addPrefix=True,
    description="pcond -h /home/lio/MantaRay/Andrei/images/2023_03_14_1604_rtpict_rendering_aa0_5000_sunny_ad32_0/radiance_filtered.hdr /home/lio/MantaRay/Andrei/images/2023_03_14_1604_rtpict_rendering_aa0_5000_sunny_ad32_0/radiance_filtered_exposed.hdr;echo /home/lio/MantaRay/Andrei/images/2023_03_14_1604_rtpict_rendering_aa0_5000_sunny_ad32_0/radiance_filtered_exposed.hdr",
    fireLogs=False,
    lastRunTime=537,
    suppressWarnings=False,
    results="/home/lio/simulation/Boston_Skylights/images/2023_01_09_1607_rtpict_rendering_aa0_5000_sunny_ad32_0/radiance_filtered_exposed.hdr",
    commands="pcond -h /home/lio/simulation/Boston_Skylights/images/2023_01_09_1607_rtpict_rendering_aa0_5000_sunny_ad32_0/radiance_filtered.hdr /home/lio/simulation/Boston_Skylights/images/2023_01_09_1607_rtpict_rendering_aa0_5000_sunny_ad32_0/radiance_filtered_exposed.hdr;echo /home/lio/simulation/Boston_Skylights/images/2023_01_09_1607_rtpict_rendering_aa0_5000_sunny_ad32_0/radiance_filtered_exposed.hdr")  # -> Stdout, Stderr_, Ran
item_4 = ListItem(List=download_13.FilePaths, Index=0, Wrap=True)
hours_5 = Number(hours)
overrides_55 = ApplyOverrides(Input=panel_104, H=graft(hours_5), Target=graft(executessh_50.Stdout))  # -> Output, DynamicOutput
lng = ListLength(List=flatten(executessh_50.Stdout))
imageviewer_8 = LBImageViewer(ImagePath_=item_4, _scale_="1", DisableClickable=False, SaveImgWithCoords=False, scale=1)  # -> ImagePath, Values, GIF
python_17 = GhPythonScript(cnt=lng, run=executessh_50.Ran)  # -> out, ran; inputs cnt: Int32, run: Boolean
# ---------- python_17: Python ----------
__author__ = "mm1013"
__version__ = "2022.08.30"

import rhinoscriptsyntax as rs

ran = cnt > 1 and run
# ---------- end python_17 ----------
panel_106 = Panel("""pcompos -a 3 -s 10 -b 0.2 0.2 0.2 <hdrFiles> > <proj>/images/<target>
ra_tiff <proj>/images/<target> <proj>/images/<target-.>.tif
convert <proj>/images/<target-.>.tif <proj>/images/<target-.>.png
echo <proj>/images/<target-.>.png""")
executessh_51 = ExecuteSSH(
    _SSHCommands_=overrides_55.DynamicOutput,
    Run=python_17.ran,
    addPrefix=True,
    description="""psign -h 15 800 | pcompos /home/lio/simulation/Boston_Skylights/images/2023_01_09_1607_rtpict_rendering_aa0_5000_sunny_ad32_0/radiance_filtered_exposed.hdr 0 0 - 570 20 > /home/lio/simulation/Boston_Skylights/images/2023_01_09_1607_rtpict_rendering_aa0_5000_sunny_ad32_0/radiance_filtered_exposed_s.hdr;echo /home/lio/simulation/Boston_Skylights/images/2023_01_09_1607_rtpict_rendering_aa0_5000_sunny_ad32_0/radiance_filtered_exposed_s.hdr


- - -

psign -h 15 900 | pcompos /home/lio/simulation/Boston_Skylights/images/2023_01_09_1607_rtpict_rendering_aa0_5000_sunny_ad32_0/radiance_filtered_exposed.hdr 0 0 - 570 20 > /home/lio/simulation/Boston_Skylights/images/2023_01_09_1607_rtpict_rendering_aa0_5000_sunny_ad32_0/radiance_filtered_exposed_s.hdr;echo /home/lio/simulation/Boston_Skylights/images/2023_01_09_1607_rtpict_rendering_aa0_5000_sunny_ad32_0/radiance_filtered_exposed_s.hdr


- - -

psign -h 15 1000 | pcompos /home/lio/simulation/Boston_Skylights/images/2023_01_09_1607_rtpict_rendering_aa0_5000_sunny_ad32_0/radiance_filtered_exposed.hdr 0 0 - 570 20 > /home/lio/simulation/Boston_Skylights/images/2023_01_09_1607_rtpict_rendering_aa0_5000_sunny_ad32_0/radiance_filtered_exposed_s.hdr;echo /home/lio/simulation/Boston_Skylights/images/2023_01_09_1607_rtpict_rendering_aa0_5000_sunny_ad32_0/radiance_filtered_exposed_s.hdr


- - -

psign -h 15 1100 | pcompos /home/lio/simulation/Boston_Skylights/images/2023_01_09_1607_rtpict_rendering_aa0_5000_sunny_ad32_0/radiance_filtered_exposed.hdr 0 0 - 570 20 > /home/lio/simulation/Boston_Skylights/images/2023_01_09_1607_rtpict_rendering_aa0_5000_sunny_ad32_0/radiance_filtered_exposed_s.hdr;echo /home/lio/simulation/Boston_Skylights/images/2023_01_09_1607_rtpict_rendering_aa0_5000_sunny_ad32_0/radiance_filtered_exposed_s.hdr


- - -

psign -h 15 1200 | pcompos /home/lio/simulation/Boston_Skylights/images/2023_01_09_1607_rtpict_rendering_aa0_5000_sunny_ad32_0/radiance_filtered_exposed.hdr 0 0 - 570 20 > /home/lio/simulation/Boston_Skylights/images/2023_01_09_1607_rtpict_rendering_aa0_5000_sunny_ad32_0/radiance_filtered_exposed_s.hdr;echo /home/lio/simulation/Boston_Skylights/images/2023_01_09_1607_rtpict_rendering_aa0_5000_sunny_ad32_0/radiance_filtered_exposed_s.hdr


- - -

psign -h 15 1300 | pcompos /home/lio/simulation/Boston_Skylights/images/2023_01_09_1607_rtpict_rendering_aa0_5000_sunny_ad32_0/radiance_filtered_exposed.hdr 0 0 - 570 20 > /home/lio/simulation/Boston_Skylights/images/2023_01_09_1607_rtpict_rendering_aa0_5000_sunny_ad32_0/radiance_filtered_exposed_s.hdr;echo /home/lio/simulation/Boston_Skylights/images/2023_01_09_1607_rtpict_rendering_aa0_5000_sunny_ad32_0/radiance_filtered_exposed_s.hdr


- - -

psign -h 15 1400 | pcompos /home/lio/simulation/Boston_Skylights/images/2023_01_09_1607_rtpict_rendering_aa0_5000_sunny_ad32_0/radiance_filtered_exposed.hdr 0 0 - 570 20 > /home/lio/simulation/Boston_Skylights/images/2023_01_09_1607_rtpict_rendering_aa0_5000_sunny_ad32_0/radiance_filtered_exposed_s.hdr;echo /home/lio/simulation/Boston_Skylights/images/2023_01_09_1607_rtpict_rendering_aa0_5000_sunny_ad32_0/radiance_filtered_exposed_s.hdr


- - -

psign -h 15 1500 | pcompos /home/lio/simulation/Boston_Skylights/images/2023_01_09_1607_rtpict_rendering_aa0_5000_sunny_ad32_0/radiance_filtered_exposed.hdr 0 0 - 570 20 > /home/lio/simulation/Boston_Skylights/images/2023_01_09_1607_rtpict_rendering_aa0_5000_sunny_ad32_0/radiance_filtered_exposed_s.hdr;echo /home/lio/simulation/Boston_Skylights/images/2023_01_09_1607_rtpict_rendering_aa0_5000_sunny_ad32_0/radiance_filtered_exposed_s.hdr


- - -

psign -h 15 1600 | pcompos /home/lio/simulation/Boston_Skylights/images/2023_01_09_1607_rtpict_rendering_aa0_5000_sunny_ad32_0/radiance_filtered_exposed.hdr 0 0 - 570 20 > /home/lio/simulation/Boston_Skylights/images/2023_01_09_1607_rtpict_rendering_aa0_5000_sunny_ad32_0/radiance_filtered_exposed_s.hdr;echo /home/lio/simulation/Boston_Skylights/images/2023_01_09_1607_rtpict_rendering_aa0_5000_sunny_ad32_0/radiance_filtered_exposed_s.hdr


- - -

psign -h 15 1700 | pcompos /home/lio/simulation/Boston_Skylights/images/2023_01_09_1607_rtpict_rendering_aa0_5000_sunny_ad32_0/radiance_filtered_exposed.hdr 0 0 - 570 20 > /home/lio/simulation/Boston_Skylights/images/2023_01_09_1607_rtpict_rendering_aa0_5000_sunny_ad32_0/radiance_filtered_exposed_s.hdr;echo /home/lio/simulation/Boston_Skylights/images/2023_01_09_1607_rtpict_rendering_aa0_5000_sunny_ad32_0/radiance_filtered_exposed_s.hdr""",
    fireLogs=False,
    lastRunTime=166,
    suppressWarnings=False,
    results=["/home/lio/MantaRay/TestingRemote/images/2023_01_09_1225_rtpict_rendering_aa0_1500_sunny_ad32_0/radiance_filtered_exposed_s.hdr", "/home/lio/MantaRay/TestingRemote/images/2023_01_09_1225_rtpict_rendering_aa0_1500_sunny_ad32_0/radiance_filtered_exposed_filtered_exposed_s.hdr", "/home/lio/MantaRay/TestingRemote/images/2023_01_09_1225_rtpict_rendering_aa0_1500_sunny_ad32_0/radiance_filtered_exposed_s_filtered_exposed_s.hdr", "/home/lio/MantaRay/TestingRemote/images/2023_01_09_1225_rtpict_rendering_aa0_1500_sunny_ad32_0/radiance_filtered_filtered_exposed_filtered_exposed_s.hdr", "/home/lio/MantaRay/TestingRemote/images/2023_01_09_1225_rtpict_rendering_aa0_1500_sunny_ad32_0/radiance_filtered_filtered_exposed_s_filtered_exposed_s.hdr", "/home/lio/MantaRay/TestingRemote/images/2023_01_09_1225_rtpict_rendering_aa0_1500_sunny_ad32_0/radiance_filtered_filtered_filtered_exposed_s.hdr", "/home/lio/MantaRay/TestingRemote/images/2023_01_09_1225_rtpict_rendering_aa0_1500_sunny_ad32_0/radiance_filtered_filtered_exposed_s.hdr", "/home/lio/MantaRay/TestingRemote/images/2023_01_09_1225_rtpict_rendering_aa0_1500_sunny_ad32_0/radiance_filtered_exposed_s.hdr"],
    stderr=["/home/lio/MantaRay/TestingRemote/images/2023_01_09_1225_rtpict_rendering_aa0_1500_sunny_ad32_0/radiance_filtered_exposed_filtered_exposed.hdr: bad picture size", "/home/lio/MantaRay/TestingRemote/images/2023_01_09_1225_rtpict_rendering_aa0_1500_sunny_ad32_0/radiance_filtered_exposed_s_filtered_exposed.hdr: bad picture size", "/home/lio/MantaRay/TestingRemote/images/2023_01_09_1225_rtpict_rendering_aa0_1500_sunny_ad32_0/radiance_filtered_filtered_exposed_filtered_exposed.hdr: bad picture size", "/home/lio/MantaRay/TestingRemote/images/2023_01_09_1225_rtpict_rendering_aa0_1500_sunny_ad32_0/radiance_filtered_filtered_exposed_s_filtered_exposed.hdr: bad picture size", "/home/lio/MantaRay/TestingRemote/images/2023_01_09_1225_rtpict_rendering_aa0_1500_sunny_ad32_0/radiance_filtered_filtered_filtered_exposed.hdr: bad picture size", "/home/lio/MantaRay/TestingRemote/images/2023_01_09_1225_rtpict_rendering_aa0_1500_sunny_ad32_0/radiance_filtered_filtered_exposed.hdr: bad picture size"],
    commands=["psign -h 15 1000 | pcompos /home/lio/MantaRay/TestingRemote/images/2023_01_09_1225_rtpict_rendering_aa0_1500_sunny_ad32_0/radiance_filtered_exposed_s_filtered_exposed.hdr 0 0 - 570 20 > /home/lio/MantaRay/TestingRemote/images/2023_01_09_1225_rtpict_rendering_aa0_1500_sunny_ad32_0/radiance_filtered_exposed_s_filtered_exposed_s.hdr;echo /home/lio/MantaRay/TestingRemote/images/2023_01_09_1225_rtpict_rendering_aa0_1500_sunny_ad32_0/radiance_filtered_exposed_s_filtered_exposed_s.hdr", "psign -h 15 900 | pcompos /home/lio/MantaRay/TestingRemote/images/2023_01_09_1225_rtpict_rendering_aa0_1500_sunny_ad32_0/radiance_filtered_exposed_filtered_exposed.hdr 0 0 - 570 20 > /home/lio/MantaRay/TestingRemote/images/2023_01_09_1225_rtpict_rendering_aa0_1500_sunny_ad32_0/radiance_filtered_exposed_filtered_exposed_s.hdr;echo /home/lio/MantaRay/TestingRemote/images/2023_01_09_1225_rtpict_rendering_aa0_1500_sunny_ad32_0/radiance_filtered_exposed_filtered_exposed_s.hdr", "psign -h 15 1200 | pcompos /home/lio/MantaRay/TestingRemote/images/2023_01_09_1225_rtpict_rendering_aa0_1500_sunny_ad32_0/radiance_filtered_filtered_exposed_s_filtered_exposed.hdr 0 0 - 570 20 > /home/lio/MantaRay/TestingRemote/images/2023_01_09_1225_rtpict_rendering_aa0_1500_sunny_ad32_0/radiance_filtered_filtered_exposed_s_filtered_exposed_s.hdr;echo /home/lio/MantaRay/TestingRemote/images/2023_01_09_1225_rtpict_rendering_aa0_1500_sunny_ad32_0/radiance_filtered_filtered_exposed_s_filtered_exposed_s.hdr", "psign -h 15 1100 | pcompos /home/lio/MantaRay/TestingRemote/images/2023_01_09_1225_rtpict_rendering_aa0_1500_sunny_ad32_0/radiance_filtered_filtered_exposed_filtered_exposed.hdr 0 0 - 570 20 > /home/lio/MantaRay/TestingRemote/images/2023_01_09_1225_rtpict_rendering_aa0_1500_sunny_ad32_0/radiance_filtered_filtered_exposed_filtered_exposed_s.hdr;echo /home/lio/MantaRay/TestingRemote/images/2023_01_09_1225_rtpict_rendering_aa0_1500_sunny_ad32_0/radiance_filtered_filtered_exposed_filtered_exposed_s.hdr", "psign -h 15 1300 | pcompos /home/lio/MantaRay/TestingRemote/images/2023_01_09_1225_rtpict_rendering_aa0_1500_sunny_ad32_0/radiance_filtered_filtered_filtered_exposed.hdr 0 0 - 570 20 > /home/lio/MantaRay/TestingRemote/images/2023_01_09_1225_rtpict_rendering_aa0_1500_sunny_ad32_0/radiance_filtered_filtered_filtered_exposed_s.hdr;echo /home/lio/MantaRay/TestingRemote/images/2023_01_09_1225_rtpict_rendering_aa0_1500_sunny_ad32_0/radiance_filtered_filtered_filtered_exposed_s.hdr", "psign -h 15 1400 | pcompos /home/lio/MantaRay/TestingRemote/images/2023_01_09_1225_rtpict_rendering_aa0_1500_sunny_ad32_0/radiance_filtered_filtered_exposed.hdr 0 0 - 570 20 > /home/lio/MantaRay/TestingRemote/images/2023_01_09_1225_rtpict_rendering_aa0_1500_sunny_ad32_0/radiance_filtered_filtered_exposed_s.hdr;echo /home/lio/MantaRay/TestingRemote/images/2023_01_09_1225_rtpict_rendering_aa0_1500_sunny_ad32_0/radiance_filtered_filtered_exposed_s.hdr", "psign -h 15 1500 | pcompos /home/lio/MantaRay/TestingRemote/images/2023_01_09_1225_rtpict_rendering_aa0_1500_sunny_ad32_0/radiance_filtered_exposed.hdr 0 0 - 570 20 > /home/lio/MantaRay/TestingRemote/images/2023_01_09_1225_rtpict_rendering_aa0_1500_sunny_ad32_0/radiance_filtered_exposed_s.hdr;echo /home/lio/MantaRay/TestingRemote/images/2023_01_09_1225_rtpict_rendering_aa0_1500_sunny_ad32_0/radiance_filtered_exposed_s.hdr"])  # -> Stdout, Stderr_, Ran
panel_107 = Panel("""pcond -h <hdr> <hdr-.>_exposed.hdr
ra_tiff <hdr-.>_exposed.hdr <hdr-.>_exposed.tif
convert <hdr-.>_exposed.tif <hdr-.>_exposed.png
echo <hdr-.>_exposed.png""")
join_7 = TextJoin(Text=flatten(executessh_51.Stdout), Join=" ")
overrides_56 = ApplyOverrides(Input=panel_106, HdrFiles=graft(join_7), Target=graft("combined.hdr"))  # -> Output, DynamicOutput
executessh_52 = ExecuteSSH(
    _SSHCommands_=overrides_56.Output,
    Run=executessh_51.Ran,
    addPrefix=True,
    fireLogs=False,
    lastRunTime=13,
    suppressWarnings=False,
    results="/home/lio/simulation/Boston_Skylights/images/combined.png",
    stderr="""/home/lio/MantaRay/TestingRemote/images/2023_01_09_1225_rtpict_rendering_aa0_1500_sunny_ad32_0/radiance_filtered_exposed_filtered_exposed_s.hdr: bad picture size
ra_tiff: bad Radiance picture
convert-im6.q16: no images defined `/home/lio/simulation/Boston_Skylights/images/combined.png' @ error/convert.c/ConvertImageCommand/3258.""",
    commands="""pcompos -a 3 -s 10 -b 0.2 0.2 0.2 /home/lio/MantaRay/TestingRemote/images/2023_01_09_1225_rtpict_rendering_aa0_1500_sunny_ad32_0/radiance_filtered_exposed_s.hdr /home/lio/MantaRay/TestingRemote/images/2023_01_09_1225_rtpict_rendering_aa0_1500_sunny_ad32_0/radiance_filtered_exposed_filtered_exposed_s.hdr /home/lio/MantaRay/TestingRemote/images/2023_01_09_1225_rtpict_rendering_aa0_1500_sunny_ad32_0/radiance_filtered_exposed_s_filtered_exposed_s.hdr /home/lio/MantaRay/TestingRemote/images/2023_01_09_1225_rtpict_rendering_aa0_1500_sunny_ad32_0/radiance_filtered_filtered_exposed_filtered_exposed_s.hdr /home/lio/MantaRay/TestingRemote/images/2023_01_09_1225_rtpict_rendering_aa0_1500_sunny_ad32_0/radiance_filtered_filtered_exposed_s_filtered_exposed_s.hdr /home/lio/MantaRay/TestingRemote/images/2023_01_09_1225_rtpict_rendering_aa0_1500_sunny_ad32_0/radiance_filtered_filtered_filtered_exposed_s.hdr /home/lio/MantaRay/TestingRemote/images/2023_01_09_1225_rtpict_rendering_aa0_1500_sunny_ad32_0/radiance_filtered_filtered_exposed_s.hdr /home/lio/MantaRay/TestingRemote/images/2023_01_09_1225_rtpict_rendering_aa0_1500_sunny_ad32_0/radiance_filtered_exposed_s.hdr > ~/simulation/Boston_Skylights/images/combined.hdr
ra_tiff ~/simulation/Boston_Skylights/images/combined.hdr ~/simulation/Boston_Skylights/images/combined.tif
convert ~/simulation/Boston_Skylights/images/combined.tif ~/simulation/Boston_Skylights/images/combined.png
echo ~/simulation/Boston_Skylights/images/combined.png""")  # -> Stdout, Stderr_, Ran
overrides_57 = ApplyOverrides(Input=panel_107, Hdr=graft(executessh_51.Stdout))  # -> Output, DynamicOutput

# ----
# RENDER WITH RAD (rif files)
octree_5 = Data(octree_overcast)
panel_108 = Panel("""rtpict -w -n <cpus> @<options> -x 500 -y 400 -vf <vf> -af <target-.>.amb <oct> > <LinuxHome>/<target-.>_overture.hdr
rtpict -w -n <cpus> @<options> -vf <vf> -af <target-.>.amb <oct> > <LinuxHome>/<target>
echo <LinuxHome>/<target>""")
panel_109 = Panel("""pcond -h <hdr> <hdr-.>_exposed.hdr
ra_tiff <hdr-.>_exposed.hdr <hdr-.>_exposed.tif
convert <hdr-.>_exposed.tif <hdr-.>_exposed.png
echo <hdr-.>_exposed.png""")

# ----
# https://discourse.radiance-online.org/t/rad-program-for-generating-parameters/6026
panel_110 = Panel("scene.rif")
panel_111 = Panel("""rpict= rtpict -n <cpus>
RESOLUTION= 600
QUALITY=H
DETAIL= H
EXPOSURE= +0.1
UP= Z
INDIRECT= 1
VARIABILITY= M
REPORT= 1
<zone>
OCTREE=<oct>
view=<vn> -vf <v>""")
panel_112 = Panel("""echo "<RIF>" > <LinuxHome>/<target>
rad -n -s <LinuxHome>/<target> OPTFILE=<LinuxHome>/render.opt
echo <LinuxHome>/render.opt""")
overrides_58 = ApplyOverrides(
    Input=panel_112,
    RIF=graft(panel_111),
    Target=graft(panel_110),
    Oct=graft(octree_5),
    Zone=graft(zone_2.zone),
    Vn=graft(viewname_2),
    V=graft(executessh_27.Stdout))  # -> Output, DynamicOutput
falsestart_19 = LBFalseStartToggle(True)
executessh_53 = ExecuteSSH(
    _SSHCommands_=overrides_58.Output,
    Run=falsestart_19,
    addPrefix=True,
    fireLogs=False,
    lastRunTime=126.3991,
    suppressWarnings=False,
    results="/home/lio/MantaRay/TestFolder/render.opt",
    commands="""echo "rpict= rtpict -n 63
RESOLUTION= 600
QUALITY=H
DETAIL= H
EXPOSURE= +0.1
UP= Z
INDIRECT= 1
VARIABILITY= M
REPORT= 1
ZONE=E 0.00 14.49 0.00 18.21 0.00 13.53

OCTREE=/home/lio/simulation/boston/octrees/Scene_Overcast10klux.oct
view=Perspective2 -vf /home/lio/MantaRay/TestFolder/views/Perspective2.vf" > ~/MantaRay/TestFolder/scene.rif
rad -n -s ~/MantaRay/TestFolder/scene.rif OPTFILE=~/MantaRay/TestFolder/render.opt
echo ~/MantaRay/TestFolder/render.opt""")  # -> Stdout, Stderr_, Ran
overrides_59 = ApplyOverrides(Input="cat <target>", Target=graft(executessh_53.Stdout))  # -> Output, DynamicOutput
executessh_54 = ExecuteSSH(
    _SSHCommands_=overrides_59.Output,
    Run=executessh_53.Ran,
    addPrefix=True,
    fireLogs=False,
    lastRunTime=57.6992,
    suppressWarnings=False,
    results="""-dp 4096
-ar 400
-ms 0.096
-ds .2
-dt .05
-dc .75
-dr 3
-ss 16
-st .01
-ab 2
-aa .1
-ad 1536
-as 768
-av 0.17 0.17 0.17
-lr 12
-lw 1e-5""",
    commands="cat /home/lio/MantaRay/TestFolder/render.opt")  # -> Stdout, Stderr_, Ran
panel_113 = Panel(executessh_54.Stdout)

overrides_60 = ApplyOverrides(
    Input=panel_108,
    Oct=graft(octree_5),
    Target=graft("myRender.hdr"),
    Options=graft(executessh_53.Stdout),
    Vf=graft(executessh_27.Stdout))  # -> Output, DynamicOutput
executessh_55 = ExecuteSSH(
    _SSHCommands=overrides_60.Output,
    Run=falsestart_17,
    addPrefix=True,
    fireLogs=False,
    lastRunTime=634.1206,
    suppressWarnings=False,
    commands="""rtpict -w -n 63 @/home/lio/MantaRay/TestFolder/render.opt -x 500 -y 400 -vf /home/lio/MantaRay/TestFolder/views/Perspective2.vf -af myRender.amb /home/lio/MantaRay/TestFolder/octrees/Scene_Overcast10klux.oct > ~/MantaRay/TestFolder/myRender_overture.hdr
rtpict -w -n 63 @/home/lio/MantaRay/TestFolder/render.opt -vf /home/lio/MantaRay/TestFolder/views/Perspective2.vf -af myRender.amb /home/lio/MantaRay/TestFolder/octrees/Scene_Overcast10klux.oct > ~/MantaRay/TestFolder/myRender.hdr
echo ~/MantaRay/TestFolder/myRender.hdr""")  # -> Stdout, Stderr_, Ran
overrides_61 = ApplyOverrides(Input=panel_109, Hdr=graft(executessh_55.Stdout))  # -> Output, DynamicOutput
executessh_56 = ExecuteSSH(
    _SSHCommands_=overrides_61.DynamicOutput,
    Run=executessh_55.Ran,
    addPrefix=True,
    description="""pcond -h  _exposed.hdr
ra_tiff _exposed.hdr _exposed.tif
convert _exposed.tif _exposed.png
echo _exposed.png""",
    fireLogs=False,
    lastRunTime=63.1025,
    suppressWarnings=False,
    results="/home/lio/MantaRay/TestFolder/myRender_exposed.png",
    commands="""pcond -h /home/lio/MantaRay/TestFolder/myRender.hdr /home/lio/MantaRay/TestFolder/myRender_exposed.hdr
ra_tiff /home/lio/MantaRay/TestFolder/myRender_exposed.hdr /home/lio/MantaRay/TestFolder/myRender_exposed.tif
convert /home/lio/MantaRay/TestFolder/myRender_exposed.tif /home/lio/MantaRay/TestFolder/myRender_exposed.png
echo /home/lio/MantaRay/TestFolder/myRender_exposed.png""")  # -> Stdout, Stderr_, Ran
download_14 = Download(
    LinuxFilePaths=executessh_56.Stdout,
    Run=executessh_56.Ran,
    stdouts="C:\Users\mm1013\MantaRay\TestFolder\myRender_exposed.png")  # -> FilePaths, Status, Ran
imageviewer_9 = LBImageViewer(ImagePath_=download_14.FilePaths, _scale_="1", DisableClickable=False, SaveImgWithCoords=False, scale=1)  # -> ImagePath, Values, GIF

panel_114 = Panel(overrides_60.Output)

# ----
# Parallel RTPICT render with ambient cache
# overture should now automatically be included in rtpict
viewfile_5 = Text(executessh_43.Stdout)
octree_6 = Text(executessh_23.Stdout)
modifierlist = Text(flatten(cluster_2.name_mod))
octree_overcast_2 = Text(octree_overcast)
entwine_11 = Entwine(Branch00=octree_overcast_2, Branch01=octree_6, FlattenInputs=True)  # -> flatten(Result)
division_2 = Division(A=resolution, B=1.5)
octree_7 = Text(graft(entwine_11))
list_2 = ItemSelector(
    octree_7,
    {"/home/lio/simulation/boston/octrees/Scene_Overcast10klux.oct", "/home/lio/MantaRay/Andrei/octrees/my_test_scene_0800.oct", "/home/lio/MantaRay/Andrei/octrees/my_test_scene_0900.oct", "/home/lio/MantaRay/Andrei/octrees/my_test_scene_1000.oct", "/home/lio/MantaRay/Andrei/octrees/my_test_scene_1100.oct", "/home/lio/MantaRay/Andrei/octrees/my_test_scene_1200.oct", "/home/lio/MantaRay/Andrei/octrees/my_test_scene_1300.oct", "/home/lio/MantaRay/Andrei/octrees/my_test_scene_1400.oct", "/home/lio/MantaRay/Andrei/octrees/my_test_scene_1500.oct", "/home/lio/MantaRay/Andrei/octrees/my_test_scene_1600.oct", "/home/lio/MantaRay/Andrei/octrees/my_test_scene_1700.oct"}, selected="/home/lio/simulation/boston/octrees/Scene_Overcast10klux.oct")
y_7 = Number(division_2)
eval = Evaluate(F="x=y", x=octree_7, y=list_2)
panel_115 = Panel("-ab 1 -ad 2048 -lw 0.005 -aa 0.1 -ar 512 -as 1024")
panel_116 = Panel("""mkdir -p <proj>/images/
rtpict -n <cpus-1> -w -vf <vf> -x 400 -y 300 <radOptions> -af <ambFile> <oct> > /dev/null
rtpict -n <cpus-1> -w -vf <vf> -x <x> -y <y> <radOptions> -af <ambFile> <oct> | pfilt -x /2 -y /2 > <proj>/images/<target>;echo <proj>/images/<target>""")
y_8 = Number(y_7)
x_9 = Number(x_4)
run_6 = LBFalseStartToggle(True)
python_18 = GhPythonScript(update=run_6)  # -> time; inputs update: tree; same code as python_11

# ----
# exclude frames
panel_117 = Panel("frames")
python_19 = GhPythonScript(opaqueModifiers=modifierlist, search=panel_117)  # -> a; inputs opaqueModifiers: list, search: list
# ---------- python_19: Python ----------
__author__ = "mm1013"
__version__ = "2022.09.05"

import rhinoscriptsyntax as rs
#import Grasshopper.DataTree as dt
import ghpythonlib.treehelpers as th


o = []
for l in search:
    o.append([s for s in opaqueModifiers if l.lower() in s.lower()])
    

a = th.list_to_tree(o)
# ---------- end python_19 ----------
overrides_62 = ApplyOverrides(Input="-ae <modifier>", Modifier=graft(python_19))  # -> Output, DynamicOutput
join_8 = TextJoin(Text=flatten(overrides_62.Output), Join=" ")

hours_6 = Text(hours_2)
entwine_12 = Entwine(Branch00="ovc", Branch01=hours_6, FlattenInputs=True)  # -> flatten(Result)
cull_7 = CullPattern(List=graft(entwine_12), CullPattern=eval)  # -> flatten(List)
hours_7 = Text(cull_7)

merge = Merge(Data1=panel_115, Data2=list_2, Data3=join_8, Data4=Button())  # -> flatten(Result)
python_20 = GhPythonScript(update=merge)  # -> time; inputs update: tree; same code as python_11
overrides_63 = ApplyOverrides(Input="ambfile_<time>.af", Time=graft(python_20))  # -> Output, DynamicOutput
overrides_64 = ApplyOverrides(
    Input=panel_116,
    Vf=graft(viewfile_5),
    RadOptions=graft(panel_115),
    AmbFile=graft(overrides_63.Output),
    Oct=graft(list_2),
    X=graft(x_9),
    Y=graft(y_8),
    Target=graft("<time>_rtpict_rendering_aa0.1_<x>_sunny_ad4096_<h>.hdr"),
    Time=graft("<time>"),
    H=graft(hours_7))  # -> Output, DynamicOutput
overrides_65 = ApplyOverrides(Input=overrides_64.Output, Time=graft(python_18))  # -> Output, DynamicOutput
executessh_57 = ExecuteSSH(
    _SSHCommands_=overrides_65.DynamicOutput,
    Run=run_6,
    addPrefix=True,
    description="""mkdir -p ~/simulation/boston/images/
rtpict -n 62 -w -vf /home/lio/MantaRay/TestFolder/views/Perspective1.vf -x 400 -y 300 -ab 1 -ad 2048 -lw 0.005 -aa 0.1 -ar 512 -as 1024 -af ambfile_2023_03_30_2240_36.af /home/lio/simulation/boston/octrees/Scene_Overcast10klux.oct > /dev/null
rtpict -n 62 -w -vf /home/lio/MantaRay/TestFolder/views/Perspective1.vf -x 750 -y 500 -ab 1 -ad 2048 -lw 0.005 -aa 0.1 -ar 512 -as 1024 -af ambfile_2023_03_30_2240_36.af /home/lio/simulation/boston/octrees/Scene_Overcast10klux.oct | pfilt -x /2 -y /2 > ~/simulation/boston/images/2023_03_30_2143_46_rtpict_rendering_aa0.1_750_sunny_ad4096_ovc.hdr;echo ~/simulation/boston/images/2023_03_30_2143_46_rtpict_rendering_aa0.1_750_sunny_ad4096_ovc.hdr""",
    fireLogs=False,
    lastRunTime=626.8868,
    suppressWarnings=False,
    commands="""mkdir -p ~/simulation/boston/images/
rtpict -n 62 -w -vf /home/lio/MantaRay/TestFolder/views/Perspective1.vf -x 400 -y 300 -ab 1 -ad 2048 -lw 0.005 -aa 0.1 -ar 512 -as 1024 -af ambfile_2023_03_30_2240_36.af /home/lio/simulation/boston/octrees/Scene_Overcast10klux.oct > /dev/null
rtpict -n 62 -w -vf /home/lio/MantaRay/TestFolder/views/Perspective1.vf -x 750 -y 500 -ab 1 -ad 2048 -lw 0.005 -aa 0.1 -ar 512 -as 1024 -af ambfile_2023_03_30_2240_36.af /home/lio/simulation/boston/octrees/Scene_Overcast10klux.oct | pfilt -x /2 -y /2 > ~/simulation/boston/images/2023_03_30_2143_46_rtpict_rendering_aa0.1_750_sunny_ad4096_ovc.hdr;echo ~/simulation/boston/images/2023_03_30_2143_46_rtpict_rendering_aa0.1_750_sunny_ad4096_ovc.hdr""")  # -> Stdout, Stderr_, Ran
download_15 = Download(
    LinuxFilePaths=executessh_57.Stdout,
    Run=executessh_57.Ran,
    stdouts="C:\Users\mm1013\MantaRay\TestFolder\2023_03_30_2143_46_rtpict_rendering_aa0.1_750_sunny_ad4096_ovc.hdr")  # -> FilePaths, Status, Ran

# ----
# save pngs exposed and raw
panel_118 = Panel("""pcond -h <hdr> <hdr-.>_exposed.hdr
ra_tiff <hdr-.>_exposed.hdr <hdr-.>_exposed.tif
convert <hdr-.>_exposed.tif <hdr-.>_exposed.png
rm <hdr-.>_exposed.tif
rm <hdr-.>_exposed.hdr
echo <hdr-.>_exposed.png""")
panel_119 = Panel("""ra_tiff <hdr-.>.hdr <hdr-.>.tif
convert <hdr-.>.tif <hdr-.>.png
rm <hdr-.>.tif
echo <hdr-.>.png""")
entwine_13 = Entwine(Branch00=panel_118, Branch01=panel_119, Branch02=set_exposure_manually_e_3, FlattenInputs=True)
overrides_66 = ApplyOverrides(Input=entwine_13, Hdr=graft(executessh_57.Stdout))  # -> Output, DynamicOutput
executessh_58 = ExecuteSSH(
    _SSHCommands_=overrides_66.DynamicOutput,
    Run=download_15.Ran,
    addPrefix=True,
    description="""pcond -h  _exposed.hdr
ra_tiff _exposed.hdr _exposed.tif
convert _exposed.tif _exposed.png
rm _exposed.tif
rm _exposed.hdr
echo _exposed.png


- - -

ra_tiff .hdr .tif
convert .tif .png
rm .tif
echo .png


- - -

pfilt -1 -e -3  > _filt.hdr
ra_tiff _filt.hdr _filt.tif
convert _filt.tif _filt.png
rm _filt.tif
rm _filt.hdr
echo _filt.png""",
    fireLogs=False,
    lastRunTime=99.9272,
    suppressWarnings=False,
    results=["/home/lio/simulation/boston/images/2023_03_30_2143_46_rtpict_rendering_aa0.1_750_sunny_ad4096_ovc_exposed.png", "/home/lio/simulation/boston/images/2023_03_30_2143_46_rtpict_rendering_aa0.1_750_sunny_ad4096_ovc.png", "/home/lio/simulation/boston/images/2023_03_30_2143_46_rtpict_rendering_aa0.1_750_sunny_ad4096_ovc_filt.png"],
    commands=["""pcond -h /home/lio/simulation/boston/images/2023_03_30_2143_46_rtpict_rendering_aa0.1_750_sunny_ad4096_ovc.hdr /home/lio/simulation/boston/images/2023_03_30_2143_46_rtpict_rendering_aa0.1_750_sunny_ad4096_ovc_exposed.hdr
ra_tiff /home/lio/simulation/boston/images/2023_03_30_2143_46_rtpict_rendering_aa0.1_750_sunny_ad4096_ovc_exposed.hdr /home/lio/simulation/boston/images/2023_03_30_2143_46_rtpict_rendering_aa0.1_750_sunny_ad4096_ovc_exposed.tif
convert /home/lio/simulation/boston/images/2023_03_30_2143_46_rtpict_rendering_aa0.1_750_sunny_ad4096_ovc_exposed.tif /home/lio/simulation/boston/images/2023_03_30_2143_46_rtpict_rendering_aa0.1_750_sunny_ad4096_ovc_exposed.png
rm /home/lio/simulation/boston/images/2023_03_30_2143_46_rtpict_rendering_aa0.1_750_sunny_ad4096_ovc_exposed.tif
rm /home/lio/simulation/boston/images/2023_03_30_2143_46_rtpict_rendering_aa0.1_750_sunny_ad4096_ovc_exposed.hdr
echo /home/lio/simulation/boston/images/2023_03_30_2143_46_rtpict_rendering_aa0.1_750_sunny_ad4096_ovc_exposed.png""", """ra_tiff /home/lio/simulation/boston/images/2023_03_30_2143_46_rtpict_rendering_aa0.1_750_sunny_ad4096_ovc.hdr /home/lio/simulation/boston/images/2023_03_30_2143_46_rtpict_rendering_aa0.1_750_sunny_ad4096_ovc.tif
convert /home/lio/simulation/boston/images/2023_03_30_2143_46_rtpict_rendering_aa0.1_750_sunny_ad4096_ovc.tif /home/lio/simulation/boston/images/2023_03_30_2143_46_rtpict_rendering_aa0.1_750_sunny_ad4096_ovc.png
rm /home/lio/simulation/boston/images/2023_03_30_2143_46_rtpict_rendering_aa0.1_750_sunny_ad4096_ovc.tif
echo /home/lio/simulation/boston/images/2023_03_30_2143_46_rtpict_rendering_aa0.1_750_sunny_ad4096_ovc.png""", """pfilt -1 -e -3 /home/lio/simulation/boston/images/2023_03_30_2143_46_rtpict_rendering_aa0.1_750_sunny_ad4096_ovc.hdr > /home/lio/simulation/boston/images/2023_03_30_2143_46_rtpict_rendering_aa0.1_750_sunny_ad4096_ovc_filt.hdr
ra_tiff /home/lio/simulation/boston/images/2023_03_30_2143_46_rtpict_rendering_aa0.1_750_sunny_ad4096_ovc_filt.hdr /home/lio/simulation/boston/images/2023_03_30_2143_46_rtpict_rendering_aa0.1_750_sunny_ad4096_ovc_filt.tif
convert /home/lio/simulation/boston/images/2023_03_30_2143_46_rtpict_rendering_aa0.1_750_sunny_ad4096_ovc_filt.tif /home/lio/simulation/boston/images/2023_03_30_2143_46_rtpict_rendering_aa0.1_750_sunny_ad4096_ovc_filt.png
rm /home/lio/simulation/boston/images/2023_03_30_2143_46_rtpict_rendering_aa0.1_750_sunny_ad4096_ovc_filt.tif
rm /home/lio/simulation/boston/images/2023_03_30_2143_46_rtpict_rendering_aa0.1_750_sunny_ad4096_ovc_filt.hdr
echo /home/lio/simulation/boston/images/2023_03_30_2143_46_rtpict_rendering_aa0.1_750_sunny_ad4096_ovc_filt.png"""])  # -> Stdout, Stderr_, Ran
download_16 = Download(
    LinuxFilePaths=executessh_58.Stdout,
    Run=executessh_58.Ran,
    stdouts="C:\Users\mm1013\MantaRay\TestFolder\2023_03_30_2143_46_rtpict_rendering_aa0.1_750_sunny_ad4096_ovc_filt.png")  # -> flatten(FilePaths), Status, Ran
item_5 = ListItem(List=download_16.FilePaths, Index=0, Wrap=True)  # -> Item, Item1, Item2
imageviewer_10 = LBImageViewer(ImagePath_=item_5.Item, _scale_=2, DisableClickable=False, SaveImgWithCoords=False, scale=2)  # -> ImagePath, Values, GIF
imageviewer_11 = LBImageViewer(ImagePath_=item_5.Item1, _scale_=2, DisableClickable=False, SaveImgWithCoords=False, scale=2)  # -> ImagePath, Values, GIF

imageviewer_12 = LBImageViewer(ImagePath_=item_5.Item2, _scale_=2, DisableClickable=False, SaveImgWithCoords=False, scale=2)  # -> ImagePath, Values, GIF

# ----
# Create a render of facade normals
panel_120 = Panel("xform -m normalshadermaterial <rad> > <rad-.>_black.rad;echo \"<rad-.>_black.rad\"")
scene_rads_3 = Text(entwine_4)
falsestart_20 = LBFalseStartToggle(False)
view_4 = Text(executessh_26.Stdout)
target = Text(panel_96)
overrides_67 = ApplyOverrides(Input=panel_120, Rad=graft(scene_rads_3))  # -> Output, DynamicOutput
python_21 = GhPythonScript(x=flatten(scene_rads_3))  # -> a; inputs x: list; same code as python_7
and_4 = GateAnd(A=python_21, B=falsestart_20)
executessh_59 = ExecuteSSH(
    _SSHCommands=overrides_67.Output,
    Run=and_4,
    addPrefix=True,
    description="""- - -



- - -



- - -



- - -



- - -



- - -



- - -



- - -



- - -



- - -



- - -



- - -



- - -



- - -



- - -



- - -""",
    fireLogs=False,
    lastRunTime=2494,
    suppressWarnings=False,
    results=["~/MantaRay/TestingRemote/radFiles/RevitJintInnerCW_Glass_80_mat_black.rad", "~/MantaRay/TestingRemote/radFiles/RevitJintInnerDoors_80_mat_black.rad", "~/MantaRay/TestingRemote/radFiles/Skylights_65_mat_black.rad", "~/MantaRay/TestingRemote/radFiles/GlassInt_74_mat_black.rad", "~/MantaRay/TestingRemote/radFiles/RevitJfacadeFacadesCWglass_74_mat_black.rad", "~/MantaRay/TestingRemote/radFiles/RevitJfacadeWindowGlass_74_mat_black.rad", "~/MantaRay/TestingRemote/radFiles/Skylights_55_mat_black.rad", "~/MantaRay/TestingRemote/radFiles/RevitJfacadeDoorPanel_70_mat_black.rad", "/home/lio/MantaRay/TestingRemote/radFiles/RevitJintInnerCW_Glass_80_black.rad", "/home/lio/MantaRay/TestingRemote/radFiles/RevitJintInnerDoors_80_black.rad", "/home/lio/MantaRay/TestingRemote/radFiles/Skylights_65_black.rad", "/home/lio/MantaRay/TestingRemote/radFiles/GlassInt_74_black.rad", "/home/lio/MantaRay/TestingRemote/radFiles/RevitJfacadeFacadesCWglass_74_black.rad", "/home/lio/MantaRay/TestingRemote/radFiles/RevitJfacadeWindowGlass_74_black.rad", "/home/lio/MantaRay/TestingRemote/radFiles/Skylights_55_black.rad", "/home/lio/MantaRay/TestingRemote/radFiles/RevitJfacadeDoorPanel_70_black.rad", "~/MantaRay/TestingRemote/radFiles/opaque_materials_black.rad", "/home/lio/MantaRay/TestingRemote/radFiles/RevitJintInnerCWs_50_black.rad", "/home/lio/MantaRay/TestingRemote/radFiles/RANSLUCENT_black.rad", "/home/lio/MantaRay/TestingRemote/radFiles/Ceilings_70_black.rad", "/home/lio/MantaRay/TestingRemote/radFiles/RevitJintInnerDoors_50_black.rad", "/home/lio/MantaRay/TestingRemote/radFiles/RevitJintInnerWalls_50_black.rad", "/home/lio/MantaRay/TestingRemote/radFiles/Roofs_20_black.rad", "/home/lio/MantaRay/TestingRemote/radFiles/RevitJfacadeFacadesCladding_50_black.rad", "/home/lio/MantaRay/TestingRemote/radFiles/RoofMullions_70_black.rad", "/home/lio/MantaRay/TestingRemote/radFiles/Frames_50_black.rad", "/home/lio/MantaRay/TestingRemote/radFiles/SlabWall_50_black.rad", "/home/lio/MantaRay/TestingRemote/radFiles/SlabFloor_30_black.rad", "/home/lio/MantaRay/TestingRemote/radFiles/WallInterior_70_black.rad", "/home/lio/MantaRay/TestingRemote/radFiles/Doors_50_black.rad", "/home/lio/MantaRay/TestingRemote/radFiles/RevitJfacadeFacadesWall_50_black.rad", "/home/lio/MantaRay/TestingRemote/radFiles/Floors_20_black.rad", "/home/lio/MantaRay/TestingRemote/radFiles/ByggD_30_black.rad", "/home/lio/MantaRay/TestingRemote/radFiles/Furniture_black.rad", "/home/lio/MantaRay/TestingRemote/radFiles/Curves_black.rad", "/home/lio/MantaRay/TestingRemote/radFiles/ByggE_30_black.rad", "/home/lio/MantaRay/TestingRemote/radFiles/ContextBright_70_black.rad", "/home/lio/MantaRay/TestingRemote/radFiles/RevitJfacadeDoors_55_black.rad", "/home/lio/MantaRay/TestingRemote/radFiles/RevitJfacadeWindowsFrames_70_black.rad", "/home/lio/MantaRay/TestingRemote/radFiles/RevitJfacadeFacadesFrames_70_black.rad"],
    commands=["xform -m normalshadermaterial ~/MantaRay/TestingRemote/radFiles/RevitJintInnerCW_Glass_80_mat.mat > ~/MantaRay/TestingRemote/radFiles/RevitJintInnerCW_Glass_80_mat_black.rad;echo \"~/MantaRay/TestingRemote/radFiles/RevitJintInnerCW_Glass_80_mat_black.rad\"", "xform -m normalshadermaterial ~/MantaRay/TestingRemote/radFiles/Skylights_65_mat.mat > ~/MantaRay/TestingRemote/radFiles/Skylights_65_mat_black.rad;echo \"~/MantaRay/TestingRemote/radFiles/Skylights_65_mat_black.rad\"", "xform -m normalshadermaterial ~/MantaRay/TestingRemote/radFiles/GlassInt_74_mat.mat > ~/MantaRay/TestingRemote/radFiles/GlassInt_74_mat_black.rad;echo \"~/MantaRay/TestingRemote/radFiles/GlassInt_74_mat_black.rad\"", "xform -m normalshadermaterial ~/MantaRay/TestingRemote/radFiles/RevitJfacadeWindowGlass_74_mat.mat > ~/MantaRay/TestingRemote/radFiles/RevitJfacadeWindowGlass_74_mat_black.rad;echo \"~/MantaRay/TestingRemote/radFiles/RevitJfacadeWindowGlass_74_mat_black.rad\"", "xform -m normalshadermaterial ~/MantaRay/TestingRemote/radFiles/RevitJintInnerDoors_80_mat.mat > ~/MantaRay/TestingRemote/radFiles/RevitJintInnerDoors_80_mat_black.rad;echo \"~/MantaRay/TestingRemote/radFiles/RevitJintInnerDoors_80_mat_black.rad\"", "xform -m normalshadermaterial ~/MantaRay/TestingRemote/radFiles/RevitJfacadeFacadesCWglass_74_mat.mat > ~/MantaRay/TestingRemote/radFiles/RevitJfacadeFacadesCWglass_74_mat_black.rad;echo \"~/MantaRay/TestingRemote/radFiles/RevitJfacadeFacadesCWglass_74_mat_black.rad\""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])  # -> flatten(Stdout), Stderr_, Ran
panel_121 = Panel(executessh_59.Stdout)
panel_122 = Panel("""mkdir -p <proj>/octrees/
oconv -r 2048 -w -f <rads> > <proj>/octrees/<target>
echo <proj>/octrees/<target>""")
python_22 = GhPythonScript(x=flatten(executessh_59.Stdout))  # -> a; inputs x: list; same code as python_7
and_5 = GateAnd(A=python_22, B=executessh_59.Ran)

# ----
# normalshader
panel_123 = Panel("""# Materials
void glow normalglow
0
0
4 1.0 1.0 1.0 -1

normalglow colorfunc normalshadermaterial
4 red green blue normalshader.cal
0
0""")
panel_124 = Panel("echo \"<mat>\" > <LinuxHome>/radFiles/mat_normalglow.mat;echo <LinuxHome>/radFiles/mat_normalglow.mat")
overrides_68 = ApplyOverrides(Input=panel_124, Mat=graft(panel_123))  # -> Output, DynamicOutput
executessh_60 = ExecuteSSH(
    _SSHCommands_=overrides_68.DynamicOutput,
    Run=falsestart_20,
    addPrefix=True,
    description="""echo "# Materials
void glow normalglow
0
0
4 1.0 1.0 1.0 -1

normalglow colorfunc normalshadermaterial
4 red green blue normalshader.cal
0
0" > ~/MantaRay/TestFolder/radFiles/mat_normalglow.mat;echo ~/MantaRay/TestFolder/radFiles/mat_normalglow.mat""",
    fireLogs=False,
    lastRunTime=12,
    suppressWarnings=False,
    results="/home/lio/MantaRay/TestingRemote/radFiles/mat_normalglow.mat",
    commands="""echo "# Materials
void glow normalglow
0
0
4 1.0 1.0 1.0 -1

normalglow colorfunc normalshadermaterial
4 red green blue normalshader.cal
0
0" > ~/MantaRay/TestingRemote/radFiles/mat_normalglow.mat;echo ~/MantaRay/TestingRemote/radFiles/mat_normalglow.mat""")  # -> Stdout, Stderr_, Ran
panel_125 = Panel(overrides_68.Output)
normalshadermat = Text(executessh_60.Stdout)

entwine_14 = Entwine(Branch00=normalshadermat, Branch01=executessh_59.Stdout, FlattenInputs=True)
join_9 = TextJoin(Text=flatten(entwine_14), Join=" ")
overrides_69 = ApplyOverrides(Input=panel_122, Rads=graft(join_9), Target=graft("myNormalsScene.oct"))  # -> Output, DynamicOutput
executessh_61 = ExecuteSSH(
    _SSHCommands=overrides_69.DynamicOutput,
    Run=and_5,
    addPrefix=True,
    description="""mkdir -p ~/simulation/boston/octrees/
oconv -r 2048 -w -f /home/lio/MantaRay/TestingRemote/radFiles/mat_normalglow.mat ~/MantaRay/TestingRemote/radFiles/RevitJintInnerCW_Glass_80_mat_black.rad ~/MantaRay/TestingRemote/radFiles/RevitJintInnerDoors_80_mat_black.rad ~/MantaRay/TestingRemote/radFiles/Skylights_65_mat_black.rad ~/MantaRay/TestingRemote/radFiles/GlassInt_74_mat_black.rad ~/MantaRay/TestingRemote/radFiles/RevitJfacadeFacadesCWglass_74_mat_black.rad ~/MantaRay/TestingRemote/radFiles/RevitJfacadeWindowGlass_74_mat_black.rad ~/MantaRay/TestingRemote/radFiles/Skylights_55_mat_black.rad ~/MantaRay/TestingRemote/radFiles/RevitJfacadeDoorPanel_70_mat_black.rad /home/lio/MantaRay/TestingRemote/radFiles/RevitJintInnerCW_Glass_80_black.rad /home/lio/MantaRay/TestingRemote/radFiles/RevitJintInnerDoors_80_black.rad /home/lio/MantaRay/TestingRemote/radFiles/Skylights_65_black.rad /home/lio/MantaRay/TestingRemote/radFiles/GlassInt_74_black.rad /home/lio/MantaRay/TestingRemote/radFiles/RevitJfacadeFacadesCWglass_74_black.rad /home/lio/MantaRay/TestingRemote/radFiles/RevitJfacadeWindowGlass_74_black.rad /home/lio/MantaRay/TestingRemote/radFiles/Skylights_55_black.rad /home/lio/MantaRay/TestingRemote/radFiles/RevitJfacadeDoorPanel_70_black.rad ~/MantaRay/TestingRemote/radFiles/opaque_materials_black.rad > ~/simulation/boston/octrees/myNormalsScene.oct
echo ~/simulation/boston/octrees/myNormalsScene.oct""",
    fireLogs=False,
    lastRunTime=65176,
    suppressWarnings=False,
    results="/home/lio/simulation/Boston_Skylights/octrees/myNormalsScene.oct",
    commands="""mkdir -p ~/simulation/Boston_Skylights/octrees/
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""")  # -> Stdout, Stderr_, Ran

panel_126 = Panel("""rpict -vf <vf> -x <x> -y <y> <radOptions> <oct> |
pfilt -x /<ss> -y /<ss> -1 -r 0.7 > <proj>/images/<target>_normals_filt.hdr
echo <proj>/images/<target>_normals_filt.hdr""")
supersampling_4 = Panel("4")
y_9 = RemoteReceiver(y)
x_10 = RemoteReceiver(x)
multiplication_7 = Multiplication(A=x_10, B=supersampling_4)
multiplication_8 = Multiplication(A=y_9, B=supersampling_4)
overrides_70 = ApplyOverrides(
    Input=panel_126,
    Vf=graft(view_4),
    X=graft(multiplication_7),
    Y=graft(multiplication_8),
    Target=graft(target),
    RadOptions=graft("-ab 0 -ad 1 -aa 1 -w -av 1 1 1"),
    Oct=graft(executessh_61.Stdout),
    Time=graft("0"),
    H=graft("0"),
    Ss=graft(supersampling_4))  # -> Output, DynamicOutput
panel_127 = Panel(overrides_70.Output)
executessh_62 = ExecuteSSH(
    _SSHCommands=overrides_70.DynamicOutput,
    Run=executessh_61.Ran,
    addPrefix=True,
    description="""rpict -vf /home/lio/MantaRay/TestFolder/views/Perspective3.vf -x 3000 -y 1500 -ab 0 -ad 1 -aa 1 -w -av 1 1 1 /home/lio/simulation/Boston_Skylights/octrees/myNormalsScene.oct |
pfilt -x /4 -y /4 -1 -r 0.7 > ~/simulation/boston/images/0_rtpict_rendering_aa0_3000_sunny_ad32_0_normals_filt.hdr
echo ~/simulation/boston/images/0_rtpict_rendering_aa0_3000_sunny_ad32_0_normals_filt.hdr""",
    fireLogs=False,
    lastRunTime=32065,
    suppressWarnings=True,
    results="/home/lio/simulation/Boston_Skylights/images/2023_01_09_1607_rtpict_rendering_aa0_20000_sunny_ad32_0_normals_filt.hdr",
    commands="""rpict -vf /home/lio/MantaRay/TestingRemote/views/Perspective1.vf -x 20000 -y 10000 -ab 0 -ad 1 -aa 1 -w -av 1 1 1 /home/lio/simulation/Boston_Skylights/octrees/myNormalsScene.oct |
pfilt -x /4 -y /4 -1 -r 0.7 > ~/simulation/Boston_Skylights/images/2023_01_09_1607_rtpict_rendering_aa0_20000_sunny_ad32_0_normals_filt.hdr
echo ~/simulation/Boston_Skylights/images/2023_01_09_1607_rtpict_rendering_aa0_20000_sunny_ad32_0_normals_filt.hdr""")  # -> Stdout, Stderr, Ran
download_17 = Download(SftpPaths=flatten(executessh_62.Stdout), Run=executessh_62.Ran)  # -> FilePaths, Status, Ran
imageviewer_13 = LBImageViewer(ImagePath_=download_17.FilePaths, _scale_=1, DisableClickable=False, SaveImgWithCoords=False, scale=1)  # -> ImagePath, Values, GIF

# ----
# normalshader
# Save the shader. Remember to set your password.
# 
# source = https://discourse.radiance-online.org/t/rendering-of-normal-map/2471/3
panel_128 = Panel("echo <pw> | sudo -S echo \"<shader>\" > /usr/local/radiance/lib/normalshader.cal")
falsestart_21 = LBFalseStartToggle(False)
panel_129 = Panel("""{
  normalshader.cal

  Look in RADIANCE/lib/rayinit.cal for more info on builtin funcs and vars
}

red = (Nx + 1)/2;
green = (Ny + 1)/2;
blue = (Nz + 1)/2;""")

nickname_2 = GH_PromptInput(Prompt="ssh password?", Ask=falsestart_21)

overrides_71 = ApplyOverrides(Input=panel_128, Pw=graft(nickname_2), Shader=graft(panel_129))  # -> Output, DynamicOutput
executessh_63 = ExecuteSSH(
    _SSHCommands_=overrides_71.DynamicOutput,
    Run=falsestart_21,
    addPrefix=True,
    description="""echo  | sudo -S echo "{
  normalshader.cal

  Look in RADIANCE/lib/rayinit.cal for more info on builtin funcs and vars
}

red = (Nx + 1)/2;
green = (Ny + 1)/2;
blue = (Nz + 1)/2;" > /usr/local/radiance/lib/normalshader.cal""",
    fireLogs=False,
    lastRunTime=57,
    suppressWarnings=False,
    stderr="bash: /usr/local/radiance/lib/normalshader.cal: Permission denied",
    commands="""echo YYOURPASSWORD | sudo -S echo "{
  normalshader.cal

  Look in RADIANCE/lib/rayinit.cal for more info on builtin funcs and vars
}

red = (Nx + 1)/2;
green = (Ny + 1)/2;
blue = (Nz + 1)/2;" > /usr/local/radiance/lib/normalshader.cal""")  # -> Stdout, Stderr_, Ran
panel_130 = Panel(overrides_71.Output)
panel_131 = Panel(executessh_63.Stderr_)

# ----
# Parallel RTPICT render (luminance) no cache
viewfile_6 = Text(executessh_26.Stdout)
octree_8 = Text(executessh_23.Stdout)
octree_overcast_3 = Text(octree_overcast)
entwine_15 = Entwine(Branch00=octree_overcast_3, Branch01=octree_8, FlattenInputs=True)  # -> flatten(Result)
panel_132 = Panel("""mkdir -p <proj>/images/
rtpict -n <cpus-1> -w -vf <vf> -x <x> -y <y> <radOptions> <oct> | pfilt -x /<ss> -y /<ss> -r 0.7 > <proj>/images/<target>;echo <proj>/images/<target>""")
octree_9 = Text(graft(entwine_15))
list_3 = ItemSelector(
    octree_9,
    {"/home/lio/simulation/boston/octrees/Scene_Overcast10klux.oct", "/home/lio/MantaRay/Andrei/octrees/my_test_scene_0800.oct", "/home/lio/MantaRay/Andrei/octrees/my_test_scene_0900.oct", "/home/lio/MantaRay/Andrei/octrees/my_test_scene_1000.oct", "/home/lio/MantaRay/Andrei/octrees/my_test_scene_1100.oct", "/home/lio/MantaRay/Andrei/octrees/my_test_scene_1200.oct", "/home/lio/MantaRay/Andrei/octrees/my_test_scene_1300.oct", "/home/lio/MantaRay/Andrei/octrees/my_test_scene_1400.oct", "/home/lio/MantaRay/Andrei/octrees/my_test_scene_1500.oct", "/home/lio/MantaRay/Andrei/octrees/my_test_scene_1600.oct", "/home/lio/MantaRay/Andrei/octrees/my_test_scene_1700.oct"}, selected="/home/lio/MantaRay/Andrei/octrees/my_test_scene_1300.oct")
eval_2 = Evaluate(F="x=y", x=octree_9, y=list_3)
run_7 = LBFalseStartToggle(False)

hours_8 = Text(hours_2)
entwine_16 = Entwine(Branch00="ovc", Branch01=hours_8, FlattenInputs=True)  # -> flatten(Result)
cull_8 = CullPattern(List=graft(entwine_16), CullPattern=eval_2)  # -> flatten(List)
hours_9 = Text(cull_8)

overrides_72 = ApplyOverrides(
    Input=panel_132,
    Vf=graft(viewfile_6),
    X=graft(multiplication),
    Y=graft(multiplication_2),
    RadOptions=graft("-ab 3 -ad 16 -aa 0"),
    Oct=graft(list_3),
    Target=graft("<time>_rtpict_rendering_aa0_<x>_sunny_ad16_<h>.hdr"),
    Time=graft("<time>"),
    H=graft(hours_9),
    Ss=graft(supersampling))  # -> Output, DynamicOutput
python_23 = GhPythonScript(update=flatten(overrides_72.Output))  # -> time; inputs update: tree; same code as python_11

# ----
# Parallel RTPICT render (Illuminance)
# (takes 2.5X longer than above...)
# mkdir -p <proj>/images/
# rtpict -i -w -n 30 -vf <vf> -x <x> -y <y> <radOptions> <oct> | pfilt -x /4 -y /4 -r 0.7 > <proj>/images/<target>;echo <proj>/images/<target>
viewfile_7 = Text(executessh_26.Stdout)
panel_133 = Panel("""mkdir -p <proj>/images/
rtpict -i -w -n <cpus-2> -vf <vf> -x <x> -y <y> <radOptions> <oct> | pfilt -x /<ss> -y /<ss> -r 0.7 > <proj>/images/<target>;echo <proj>/images/<target>""")
run_8 = LBFalseStartToggle(False)
x_11 = RemoteReceiver(x)
y_10 = RemoteReceiver(y)
overrides_73 = ApplyOverrides(
    Input=panel_133,
    Vf=graft(viewfile_7),
    X=graft(x_11),
    Y=graft(y_10),
    RadOptions=graft("-ab 3 -ad 16 -aa 0"),
    Oct=graft(list_3),
    Target=graft("<time>_rtpict_rendering_aa0_<x>_sunny_ad8_<h>_illum.hdr"),
    Time=graft(python_23),
    H=graft(hours_9),
    Ss=graft(supersampling))  # -> Output, DynamicOutput
executessh_64 = ExecuteSSH(
    _SSHCommands_=flatten(overrides_73.DynamicOutput),
    Run=run_8,
    addPrefix=True,
    description="""mkdir -p ~/simulation/boston/images/
rtpict -i -w -n 61 -vf /home/lio/MantaRay/TestFolder/views/Perspective3.vf -x 750 -y 375 -ab 3 -ad 16 -aa 0 /home/lio/MantaRay/Andrei/octrees/my_test_scene_1300.oct | pfilt -x /4 -y /4 -r 0.7 > ~/simulation/boston/images/2023_03_30_2240_36_rtpict_rendering_aa0_750_sunny_ad8_1300_illum.hdr;echo ~/simulation/boston/images/2023_03_30_2240_36_rtpict_rendering_aa0_750_sunny_ad8_1300_illum.hdr""",
    fireLogs=False,
    lastRunTime=0,
    suppressWarnings=False)  # -> Stdout, Stderr_, Ran

overrides_74 = ApplyOverrides(Input=overrides_72.DynamicOutput, Time=graft(python_23))  # -> Output, DynamicOutput
executessh_65 = ExecuteSSH(
    _SSHCommands_=flatten(overrides_74.DynamicOutput),
    Run=run_7,
    addPrefix=True,
    description="""mkdir -p ~/simulation/boston/images/
rtpict -n 62 -w -vf /home/lio/MantaRay/TestFolder/views/Perspective3.vf -x 3000 -y 1500 -ab 3 -ad 16 -aa 0 /home/lio/MantaRay/Andrei/octrees/my_test_scene_1300.oct | pfilt -x /4 -y /4 -r 0.7 > ~/simulation/boston/images/2023_03_30_2240_36_rtpict_rendering_aa0_3000_sunny_ad16_1300.hdr;echo ~/simulation/boston/images/2023_03_30_2240_36_rtpict_rendering_aa0_3000_sunny_ad16_1300.hdr""",
    fireLogs=False,
    lastRunTime=0,
    suppressWarnings=False)  # -> Stdout, Stderr_, Ran

# ----
# orig dimensions
panel_134 = Panel("getinfo <f>")
overrides_75 = ApplyOverrides(Input=panel_134, F=graft(executessh_64.Stdout))  # -> Output, DynamicOutput
executessh_66 = ExecuteSSH(
    _SSHCommands_=overrides_75.DynamicOutput,
    Run=executessh_64.Ran,
    addPrefix=True,
    description="getinfo <f>",
    fireLogs=False,
    lastRunTime=0,
    suppressWarnings=False)  # -> Stdout, Stderr_, Ran
python_24 = GhPythonScript(x=executessh_66.Stdout)  # -> out, org_y
# ---------- python_24: Python ----------
__author__ = "mm1013"
__version__ = "2022.08.31"

import rhinoscriptsyntax as rs

lines = x.replace("\r","").split("\n")

for l in lines:
    line = l.strip()
    if line.startswith("rtrace"):
        print "RTRACE"
        li = line.split("-y")
        
        print li[1].strip().split(" ")[0]
        org_y = int(li[1].strip().split(" ")[0])
    elif line.startswith("pfilt"):
        print "PFIlT"
        li = line.split("-y")
        
        print li[1].strip().split(" ")[0]
        org_y = org_y / float(li[1].strip().split(" ")[0].replace("/",""))
# ---------- end python_24 ----------

panel_135 = Panel("""pcond -h <hdr> <hdr-.>_exposed.hdr
ra_tiff <hdr-.>_exposed.hdr <hdr-.>_exposed.tif
convert <hdr-.>_exposed.tif <hdr-.>_exposed.png
echo <hdr-.>_exposed.png""")
panel_136 = Panel("""ra_tiff <hdr-.>.hdr <hdr-.>.tif
convert <hdr-.>.tif <hdr-.>.png
echo <hdr-.>.png""")
entwine_17 = Entwine(Branch00=panel_135, Branch01=panel_136, FlattenInputs=True)
overrides_76 = ApplyOverrides(Input=entwine_17, Hdr=graft(executessh_65.Stdout))  # -> Output, DynamicOutput
executessh_67 = ExecuteSSH(
    _SSHCommands_=overrides_76.DynamicOutput,
    Run=executessh_65.Ran,
    addPrefix=True,
    description="""pcond -h <hdr> <hdr>_exposed.hdr
ra_tiff <hdr>_exposed.hdr <hdr>_exposed.tif
convert <hdr>_exposed.tif <hdr>_exposed.png
echo <hdr>_exposed.png


- - -

ra_tiff <hdr>.hdr <hdr>.tif
convert <hdr>.tif <hdr>.png
echo <hdr>.png""",
    fireLogs=False,
    lastRunTime=0,
    suppressWarnings=False)  # -> Stdout, Stderr_, Ran
download_18 = Download(LinuxFilePaths=executessh_67.Stdout, Run=executessh_67.Ran)  # -> flatten(FilePaths), Status, Ran
item_6 = ListItem(List=download_18.FilePaths, Index=0, Wrap=True)  # -> Item, Item1
imageviewer_14 = LBImageViewer(ImagePath_=item_6.Item, _scale_=3, DisableClickable=False, SaveImgWithCoords=False, scale=3)  # -> ImagePath, Values, GIF

# ----
# blurring the irrad
panel_137 = Panel("pfilt -x /3 -y /3 -r 1 <file> | pfilt -1 -x <x> -y <y> > <file-.>_filteredBlur.hdr;ra_tiff <file-.>_filteredBlur.hdr <file-.>_filteredBlur.tif;echo <file-.>_filteredBlur.hdr")
overrides_77 = ApplyOverrides(Input=panel_137, File=graft(executessh_64.Stdout), X=graft(x_6), Y=graft(python_24.org_y))  # -> Output, DynamicOutput
executessh_68 = ExecuteSSH(
    _SSHCommands_=overrides_77.DynamicOutput,
    Run=executessh_64.Ran,
    addPrefix=True,
    description="pfilt -x /3 -y /3 -r 1 <file> | pfilt -1 -x 750 -y <y> > <file>_filteredBlur.hdr;ra_tiff <file>_filteredBlur.hdr <file>_filteredBlur.tif;echo <file>_filteredBlur.hdr",
    fireLogs=False,
    lastRunTime=0,
    suppressWarnings=False)  # -> Stdout, Stderr_, Ran

# ----
# overlay illuminance falsecolor on luminance picture
panel_138 = Panel("""pcond -h <rad> | pfilt -x /2 -y /2 -r 0.7 > <rad-.>exposed_sd.hdr
pfilt -x /2 -y /2 -r 0.7 <irrad> > <irrad-.>_sd.hdr
falsecolor -s 2000 -l lux -lw 200 -lh 300 -p <rad-.>exposed_sd.hdr -i <irrad-.>_sd.hdr -cl > <rad-.>_fc.hdr
ra_tiff <rad-.>_fc.hdr <rad-.>_fc.tif
convert <rad-.>_fc.tif <rad-.>_fc.png
echo <rad-.>_fc.hdr""")
panel_139 = Panel("-log 2")
overrides_78 = ApplyOverrides(Input=panel_138, Rad=graft(executessh_65.Stdout), Irrad=graft(executessh_68.Stdout))  # -> Output, DynamicOutput
executessh_69 = ExecuteSSH(
    _SSHCommands_=overrides_78.DynamicOutput,
    Run=[executessh_64.Ran, executessh_65.Ran],
    addPrefix=True,
    description="""pcond -h <rad> | pfilt -x /2 -y /2 -r 0.7 > <rad>exposed_sd.hdr
pfilt -x /2 -y /2 -r 0.7 <irrad> > <irrad>_sd.hdr
falsecolor -s 2000 -l lux -lw 200 -lh 300 -p <rad>exposed_sd.hdr -i <irrad>_sd.hdr -cl > <rad>_fc.hdr
ra_tiff <rad>_fc.hdr <rad>_fc.tif
convert <rad>_fc.tif <rad>_fc.png
echo <rad>_fc.hdr""",
    fireLogs=False,
    lastRunTime=0,
    suppressWarnings=False)  # -> Stdout, Stderr_, Ran
download_19 = Download(LinuxFilePaths=executessh_69.Stdout, Run=executessh_69.Ran)  # -> FilePaths, Status, Ran
imageviewer_15 = LBImageViewer(ImagePath_=download_19.FilePaths, _scale_=2, DisableClickable=False, SaveImgWithCoords=False, scale=2)  # -> ImagePath, Values, GIF

# ----
# FalseColor
panel_140 = Panel("""pfilt -x /2 -y /2 -r 0.7 <irrad> | falsecolor -s 2000 -l lux -lw 200 -lh 300 > <irrad-.>_fc2.hdr
ra_tiff <irrad-.>_fc2.hdr <irrad-.>_fc2.tif
convert <irrad-.>_fc2.tif <irrad-.>_fc2.png
rm <irrad-.>_fc2.hdr
rm <irrad-.>_fc2.tif
echo <irrad-.>_fc2.png""")
overrides_79 = ApplyOverrides(Input=panel_140, Irrad=graft(executessh_64.Stdout))  # -> Output, DynamicOutput
executessh_70 = ExecuteSSH(
    _SSHCommands_=overrides_79.DynamicOutput,
    Run=executessh_64.Ran,
    addPrefix=True,
    description="""pfilt -x /2 -y /2 -r 0.7 <irrad> | falsecolor -s 2000 -l lux -lw 200 -lh 300 > <irrad>_fc2.hdr
ra_tiff <irrad>_fc2.hdr <irrad>_fc2.tif
convert <irrad>_fc2.tif <irrad>_fc2.png
rm <irrad>_fc2.hdr
rm <irrad>_fc2.tif
echo <irrad>_fc2.png""",
    fireLogs=False,
    lastRunTime=0,
    suppressWarnings=False)  # -> Stdout, Stderr_, Ran
download_20 = Download(LinuxFilePaths=executessh_70.Stdout, Run=executessh_70.Ran)  # -> FilePaths, Status, Ran
imageviewer_16 = LBImageViewer(ImagePath_=download_20.FilePaths, _scale_=2, DisableClickable=False, SaveImgWithCoords=False, scale=2)  # -> ImagePath, Values, GIF

# ----
# save pngs exposed and raw
panel_141 = Panel("""ra_tiff <hdr-.>.hdr <hdr-.>.tif
convert <hdr-.>.tif <hdr-.>.png
rm <hdr-.>.tif
echo <hdr-.>.png""")
panel_142 = Panel("""pcond -h <hdr> <hdr-.>_exposed.hdr
ra_tiff <hdr-.>_exposed.hdr <hdr-.>_exposed.tif
convert <hdr-.>_exposed.tif <hdr-.>_exposed.png
rm <hdr-.>_exposed.tif
rm <hdr-.>_exposed.hdr
echo <hdr-.>_exposed.png""")
entwine_18 = Entwine(Branch00=panel_142, Branch01=panel_141, FlattenInputs=True)
overrides_80 = ApplyOverrides(Input=entwine_18, Hdr=graft(executessh_64.Stdout))  # -> Output, DynamicOutput
executessh_71 = ExecuteSSH(
    _SSHCommands_=overrides_80.DynamicOutput,
    Run=executessh_64.Ran,
    addPrefix=True,
    description="""pcond -h <hdr> <hdr>_exposed.hdr
ra_tiff <hdr>_exposed.hdr <hdr>_exposed.tif
convert <hdr>_exposed.tif <hdr>_exposed.png
rm <hdr>_exposed.tif
rm <hdr>_exposed.hdr
echo <hdr>_exposed.png


- - -

ra_tiff <hdr>.hdr <hdr>.tif
convert <hdr>.tif <hdr>.png
rm <hdr>.tif
echo <hdr>.png""",
    fireLogs=False,
    lastRunTime=0,
    suppressWarnings=False)  # -> Stdout, Stderr_, Ran
download_21 = Download(LinuxFilePaths=executessh_71.Stdout, Run=executessh_71.Ran)  # -> flatten(FilePaths), Status, Ran
item_7 = ListItem(List=download_21.FilePaths, Index=0, Wrap=True)  # -> Item, Item1
imageviewer_17 = LBImageViewer(ImagePath_=item_7.Item, _scale_=2, DisableClickable=False, SaveImgWithCoords=False, scale=2)  # -> ImagePath, Values, GIF
imageviewer_18 = LBImageViewer(ImagePath_=item_7.Item1, _scale_=2, DisableClickable=False, SaveImgWithCoords=False, scale=2)  # -> ImagePath, Values, GIF

panel_143 = Panel("""mkdir -p <proj>/views/
echo "<vf>" > <proj>/views/<target>.vf
echo <proj>/views/<target>.vf""")
concat_8 = Concatenate(FragmentA="Perspective", FragmentB="1")

# ----
# Doubleclick Me To update view
view_5 = CreateView(Viewport="Perspective")  # -> ViewfileContent, ImageRatio

panel_144 = Panel(view_5.ViewfileContent)
vf_4 = Text(view_5.ViewfileContent)
overrides_81 = ApplyOverrides(Input=panel_143, Vf=graft(vf_4), Target=graft(concat_8))  # -> Output, DynamicOutput
executessh_72 = ExecuteSSH(
    _SSHCommands_=overrides_81.DynamicOutput,
    Run=Toggle(True),
    addPrefix=True,
    description="""mkdir -p ~/MantaRay/TestFolder/views/
echo "rvu -vtv -vp 76.210958985352 16.4300937305602 1.83584927923156 -vd -0.349680913647465 0.927360836447747 0.133135786524922 -vu 0.0469732080515546 -0.124573895254805 0.991097806649975 -vh 63.227 -vv 50.000" > ~/MantaRay/TestFolder/views/Perspective1.vf
echo ~/MantaRay/TestFolder/views/Perspective1.vf""",
    fireLogs=False,
    lastRunTime=161.5896,
    suppressWarnings=False,
    results="/home/lio/MantaRay/TestFolder/views/Perspective1.vf",
    commands="""mkdir -p ~/MantaRay/TestFolder/views/
echo "rvu -vtv -vp 76.210958985352 16.4300937305602 1.83584927923156 -vd -0.349680913647465 0.927360836447747 0.133135786524922 -vu 0.0469732080515546 -0.124573895254805 0.991097806649975 -vh 63.227 -vv 50.000" > ~/MantaRay/TestFolder/views/Perspective1.vf
echo ~/MantaRay/TestFolder/views/Perspective1.vf""")  # -> Stdout, Stderr_, Ran

# ----
# VIEW
file_exists_2 = Panel("[ -f <out> ] && echo \"1\" || echo \"0\"")
item_8 = ListItem(List=flatten(executessh_72.Stdout), Index=0, Wrap=True)
panel_145 = Panel(executessh_72.Stdout)
overrides_82 = ApplyOverrides(Input=file_exists_2, Out=graft(item_8))  # -> Output, DynamicOutput
executessh_73 = ExecuteSSH(
    _SSHCommands_=overrides_82.DynamicOutput,
    Run=executessh_21.Ran,
    addPrefix=True,
    description="[ -f /home/lio/MantaRay/TestFolder/views/Perspective1.vf ] && echo \"1\" || echo \"0\"",
    fireLogs=False,
    lastRunTime=68.789,
    suppressWarnings=False,
    results="1",
    commands="[ -f /home/lio/MantaRay/TestFolder/views/Perspective1.vf ] && echo \"1\" || echo \"0\"")  # -> Stdout, Stderr_, Ran

# ----
# Parallel ACCELERAD RTRACE render
# echo "rvu -vtv -vp 0.5 4.5 1.6 -vd 0.830824 -1.13002 -0.181063 -vu 0 0 1 -vh 98.2132 -vv 79.2785 -vo 0 -va 0 -vs 0 -vl 0" > <proj>/views/myview.vf;echo <proj>/views/myview.vf
run_9 = LBFalseStartToggle(False)
octree_10 = Text(executessh_21.Stdout)
viewfile_8 = Text(executessh_72.Stdout)
panel_146 = Panel("""mkdir -p <proj>/images/
vwrays -ff -x <x> -y <y> -vf <vf> -pa 1 | accelerad_rtrace <radOptions> -w `vwrays -d -ff -x <x> -y <y> -vf <vf> -pa 1` -ffc <oct> > <proj>/images/<target-.>.hdr
echo <proj>/images/<target-.>.hdr""")
panel_147 = Panel("-ab 3 -ad 2048")
overrides_83 = ApplyOverrides(
    Input=panel_146,
    X=graft("600"),
    Y=graft("300"),
    Vf=graft(viewfile_8),
    RadOptions=graft("-as 0 -ab 3 -aa 0.2 -ad 128"),
    Oct=graft(octree_10),
    Target=graft("accelerad_rtrace_rendering.png"))  # -> Output, DynamicOutput
executessh_74 = ExecuteSSH(
    _SSHCommands_=overrides_83.DynamicOutput,
    Run=run_9,
    addPrefix=True,
    description="""mkdir -p ~/simulation/boston/images/
vwrays -ff -x 600 -y 300 -vf /home/lio/MantaRay/TestFolder/views/Perspective1.vf -pa 1 | accelerad_rtrace -as 0 -ab 3 -aa 0.2 -ad 128 -w `vwrays -d -ff -x 600 -y 300 -vf /home/lio/MantaRay/TestFolder/views/Perspective1.vf -pa 1` -ffc /home/lio/simulation/boston/octrees/Scene_Overcast10klux.oct > ~/simulation/boston/images/accelerad_rtrace_rendering.hdr
echo ~/simulation/boston/images/accelerad_rtrace_rendering.hdr""",
    fireLogs=False,
    lastRunTime=535,
    suppressWarnings=False,
    results="/home/mss/simulation/Boston_Skylights/images/accelerad_rtrace_rendering.hdr",
    stderr="""accelerad_rtrace: internal - A supported NVIDIA GPU could not be found
(/media/nathaniel/DATA/Accelerad/src/rt/optix_radiance.c:255)""",
    commands="""mkdir -p ~/simulation/Boston_Skylights/images/
vwrays -ff -x 600 -y 300 -vf /home/mss/MantaRay/UnnamedProject/views/Perspective1.vf -pa 1 | accelerad_rtrace -as 0 -ab 3 -aa 0.2 -ad 128 -w `vwrays -d -ff -x 600 -y 300 -vf /home/mss/MantaRay/UnnamedProject/views/Perspective1.vf -pa 1` -ffc /home/mss/MantaRay/UnnamedProject/octrees/my_test_scene.oct > ~/simulation/Boston_Skylights/images/accelerad_rtrace_rendering.hdr
echo ~/simulation/Boston_Skylights/images/accelerad_rtrace_rendering.hdr""")  # -> Stdout, Stderr_, Ran
panel_148 = Panel(executessh_74.Stderr_)

# ----
# Using PCOND to set automatic exposure
# and convert to PNG
panel_149 = Panel("""pcond -h <hdr> <hdr-.>_exposed.hdr
ra_tiff <hdr-.>_exposed.hdr <hdr-.>_exposed.tif
convert <hdr-.>_exposed.tif <hdr-.>_exposed.png
echo <hdr-.>_exposed.png""")
overrides_84 = ApplyOverrides(Input=panel_149, Hdr=graft(executessh_74.Stdout))  # -> Output, DynamicOutput
executessh_75 = ExecuteSSH(
    _SSHCommands_=overrides_84.DynamicOutput,
    Run=executessh_74.Ran,
    addPrefix=True,
    description="""pcond -h /home/mss/simulation/Boston_Skylights/images/accelerad_rtrace_rendering.hdr /home/mss/simulation/Boston_Skylights/images/accelerad_rtrace_rendering_exposed.hdr
ra_tiff /home/mss/simulation/Boston_Skylights/images/accelerad_rtrace_rendering_exposed.hdr /home/mss/simulation/Boston_Skylights/images/accelerad_rtrace_rendering_exposed.tif
convert /home/mss/simulation/Boston_Skylights/images/accelerad_rtrace_rendering_exposed.tif /home/mss/simulation/Boston_Skylights/images/accelerad_rtrace_rendering_exposed.png
echo /home/mss/simulation/Boston_Skylights/images/accelerad_rtrace_rendering_exposed.png""",
    fireLogs=False,
    lastRunTime=546,
    suppressWarnings=False,
    results="/home/mss/MantaRay/UnnamedProject/images/rtrace_rendering_exposed.png",
    commands="""pcond -h /home/mss/MantaRay/UnnamedProject/images/rtrace_rendering.hdr /home/mss/MantaRay/UnnamedProject/images/rtrace_rendering_exposed.hdr
ra_tiff /home/mss/MantaRay/UnnamedProject/images/rtrace_rendering_exposed.hdr /home/mss/MantaRay/UnnamedProject/images/rtrace_rendering_exposed.tif
convert /home/mss/MantaRay/UnnamedProject/images/rtrace_rendering_exposed.tif /home/mss/MantaRay/UnnamedProject/images/rtrace_rendering_exposed.png
echo /home/mss/MantaRay/UnnamedProject/images/rtrace_rendering_exposed.png""")  # -> Stdout, Stderr_, Ran
download_22 = Download(LinuxFilePaths=executessh_75.Stdout, Run=executessh_75.Ran)  # -> FilePaths, Status, Ran
imageviewer_19 = LBImageViewer(ImagePath_=download_22.FilePaths, _scale_="1.5", DisableClickable=False, SaveImgWithCoords=False, scale=1.5)  # -> ImagePath, Values, GIF

# ==== cluster DefaultMSS
default_value_flattened = ClusterInput()
data = ClusterInput()
data_2 = Data(data)
merge = Merge(Data1=flatten(data_2), Data2="0")  # -> flatten(Result)
default_value_flattened_2 = Data(flatten(default_value_flattened))
lng = ListLength(List=merge)
equals = Equality(FirstNumber=lng, SecondNumber="1")  # -> Equality, Inequality
cull = CullPattern(List=data_2, CullPattern=invert(equals.Equality))
panel = Panel(equals.Equality)
cull_2 = CullPattern(List=default_value_flattened_2, CullPattern=equals.Equality)
data_3 = Data([cull, cull_2])
data_4 = ClusterOutput(data_3)

# ==== cluster LargestBREP
window_breps = ClusterInput()
window_breps_2 = Brep(window_breps)
debrep = DeconstructBrep(Brep=window_breps_2)  # -> Faces, Edges, Vertices
area = Area(Geometry=debrep.Faces)  # -> Area, Centroid
sort = SortList(Keys=area.Area, ValuesA=debrep.Faces)  # -> Keys, ValuesA
item = ListItem(List=sort.ValuesA, Index=-1, Wrap=True)
group = Group(Objects=flatten(item))
grouped = ClusterOutput(group)

# ==== cluster Cluster
mod = ClusterInput()
panel = Panel(mod)
python = GhPythonScript(mod=mod)  # -> name_geo, name_mod, omod; inputs mod: list
# ---------- python: Python ----------
__author__ = "mm1013"
__version__ = "2023.03.11"

import re

regex = re.compile('[^a-zA-Z0-9_.]')

import rhinoscriptsyntax as rs



name_geo = [regex.sub('_',m.split("\n")[0].split(" ")[2]) + "_geo" for m in mod]
name_mod = [regex.sub('_',m.split("\n")[0].split(" ")[2]) for m in mod]
# ---------- end python ----------
name_mod = ClusterOutput(python.name_mod)
name_geo = ClusterOutput(python.name_geo)
panel_2 = Panel(python.name_geo)
panel_3 = Panel(python.name_mod)

# ==== cluster Cluster_2
L = ClusterInput()
lng = ListLength(List=L)
default = DefaultMSS(data=flatten(lng), default_value_flattened=flatten("0"))
bool = Boolean(default)
bool_2 = ClusterOutput(bool)

# ==== cluster N
mod = ClusterInput()
python = GhPythonScript(mod=mod)  # -> name_geo, name_mod; inputs mod: list
# ---------- python: Python ----------
__author__ = "mm1013"
__version__ = "2023.03.11"

import re

regex = re.compile('[^a-zA-Z0-9_.]')

import rhinoscriptsyntax as rs



name_geo = [regex.sub('_',m.split("\n")[0]) + "_geo" for m in mod]
name_mod = [regex.sub('_',m.split("\n")[0]) for m in mod]
# ---------- end python ----------
name_mod = ClusterOutput(python.name_mod)
name_geo = ClusterOutput(python.name_geo)

# ==== cluster Cluster_3
L = ClusterInput()
lng = ListLength(List=L)
default = DefaultMSS(data=flatten(lng), default_value_flattened=flatten(Toggle(False)))
bool = Boolean(default)
bool_2 = ClusterOutput(bool)
